# Grasshopper definition Area_Calculation.gh (Grasshopper 1.0.7)
# Copyright: Job de Vogel

amount_of_layers = Slider(10, range=0..10)
object = GetGeometry(AtLeast=1, AtMost=1, DeleteInput=False, Filter=1074004029)
amount_of_layers_2 = GetInteger(AtLeast=1, AtMost=1, Maximum=2147483647, Minimum=-2147483648)
layer_1_height = GetInteger(AtLeast=1, AtMost=1, Maximum=2147483647, Minimum=-2147483648)
geometry = Geometry(<brep referenced from the Rhino model>)
cluster = Cluster_2(relay=geometry, z_coordinate=[Slider(10, range=0..100), Slider(12, range=0..100)])  # -> area_3, result
cluster_2 = Cluster(relay=geometry, count=amount_of_layers)  # -> area_2, arithmetic_mean
volume = Volume(Geometry=geometry)  # -> Volume, Centroid
cluster_3 = Cluster_2(relay=object, z_coordinate=layer_1_height)  # -> area_3, result
cluster_4 = Cluster(relay=object, count=amount_of_layers_2)  # -> area_2, arithmetic_mean
volume_2 = Volume(Geometry=object)  # -> Volume, Centroid
areas_by_layer = Panel(cluster_2.area_2)
# Average should be approximatly 6400 m2
average_area = Panel(cluster_2.arithmetic_mean)
# Without extra functions should be 600000 m3
total_volume = Panel(volume.Volume)
one_layer_distribution_area = Panel(cluster.area_3)
two_layer_distribution_area = Panel(cluster.result)

# ---- group: RH_OUT:Areas by layer
number = Number(cluster_4.area_2)

# ---- group: RH_OUT:Average area
number_2 = Number(cluster_4.arithmetic_mean)

# ---- group: RH_OUT:Total volume
number_3 = Number(volume_2.Volume)

# ---- group: RH_OUT:Total One layer distribution area
number_4 = Number(cluster_3.area_3)

# ---- group: RH_OUT:Total two layer distribution area
number_5 = Number(cluster_3.area_3)

# ----
# Should be higher than 25000 m2
larger_than = LargerThan(FirstNumber=total_volume, SecondNumber=600000)  # -> LargerThan, OrEqualTo
larger_than_2 = LargerThan(FirstNumber=one_layer_distribution_area, SecondNumber=25000)  # -> LargerThan, OrEqualTo
larger_than_3 = LargerThan(FirstNumber=number_3, SecondNumber=600000)  # -> LargerThan, OrEqualTo
larger_than_4 = LargerThan(FirstNumber=number_4, SecondNumber=25000)  # -> LargerThan, OrEqualTo
gate_and = GateAnd(A=larger_than.LargerThan, B=larger_than_2.LargerThan)
gate_and_2 = GateAnd(A=larger_than_3.LargerThan, B=larger_than_4.LargerThan)
stream_filter = StreamFilter(Gate=gate_and, Stream0="WARNING, geometry not according to requirements", Stream1="Acceptable Geometry")
stream_filter_2 = StreamFilter(Gate=gate_and_2, Stream0="WARNING, geometry not according to requirements", Stream1="Acceptable Geometry")
check = Panel(stream_filter)

# ---- group: RH_OUT:Check
text = Text(stream_filter_2)

# ==== cluster Cluster
relay = ClusterInput()
deconstruct_brep = DeconstructBrep(Brep=relay)  # -> Faces, Edges, Vertices
deconstruct = Deconstruct(Point=deconstruct_brep.Vertices)  # -> XComponent, YComponent, ZComponent
sort_list = SortList(Keys=deconstruct.ZComponent)  # -> reverse(Keys), ValuesValuesA
xy_plane = XYPlane(Origin=Point(0, 0, 0))
unit_z = UnitZ(Factor=1)
list_item = ListItem(List=sort_list.Keys, Index=0, Wrap=True)
line_sdl = LineSDL(Start=xy_plane, Direction=unit_z, Length=list_item)
count = ClusterInput()
divide_curve = DivideCurve(Curve=line_sdl, Count=count, Kinks=False)  # -> Points, Tangents, Parameters
xy_plane_2 = XYPlane(Origin=divide_curve.Points)
brep_plane = BrepPlane(Brep=relay, Plane=xy_plane_2)  # -> Curves, Points
area = Area(Geometry=brep_plane.Curves)  # -> flatten(Area), Centroid
area_2 = ClusterOutput(area.Area)
average = Average(Input=area.Area)
arithmetic_mean = ClusterOutput(average)

# ==== cluster Cluster_2
relay = ClusterInput()
z_coordinate = ClusterInput()
xy_plane = XYPlane(Origin=Point(0, 0, 0))
construct_point = ConstructPoint(XCoordinate=0, YCoordinate=0, ZCoordinate=z_coordinate)
brep_plane = BrepPlane(Brep=relay, Plane=xy_plane)  # -> Curves, Points
xy_plane_2 = XYPlane(Origin=construct_point)
brep_plane_2 = BrepPlane(Brep=relay, Plane=xy_plane_2)  # -> simplify(Curves), Points
area = Area(Geometry=brep_plane.Curves)  # -> Area, Centroid
area_2 = Area(Geometry=brep_plane_2.Curves)  # -> Area, Centroid
area_3 = ClusterOutput(area.Area)
addition = Addition(A=area_2.Area, B=area.Area)
result = ClusterOutput(addition)
