# Grasshopper definition Building_Model.gh (Grasshopper 1.0.7)
# Copyright: Job de Vogel
# plug-ins: Hops

levels_per_level = Slider(3, range=0..10)
balcony_depth = Slider(1.8, range=0..10)
shell_offset = Slider(1.8, range=0..10)
levels = Slider(11, range=0..30)
level_height = Slider(4.2, range=0..10)
grid_size = Slider(3.6, range=0..10)
core_y_size = Slider(15, range=0..100)
core_x_distance = Slider(10, range=0..100)
core_y_distance = Slider(10, range=0..100)
core_x_size = Slider(15, range=0..100)
levels_per_level_2 = Slider(3, range=0..10)
balcony_depth_2 = Slider(1.8, range=0..10)
shell_offset_2 = Slider(1.8, range=0..10)
levels_2 = Slider(10, range=0..30)
level_height_2 = Slider(4.2, range=0..10)
grid_size_2 = Slider(3.6, range=0..10)
core_y_size_2 = Slider(15, range=0..100)
core_x_distance_2 = Slider(10, range=0..100)
core_y_distance_2 = Slider(10, range=0..100)
core_x_size_2 = Slider(15, range=0..100)
curve = Curve(<curve referenced from the Rhino model>)
boolean_toggle = BooleanToggle(False)
curve_2 = Curve(<curve referenced from the Rhino model>)

curve_3 = Curve(<curve referenced from the Rhino model>)
north_border = Slider(0.865, range=0..1)
south_border = Slider(0.064, range=0..1)
shatter = Shatter(Curve=reparameterize(curve_3), Parameters=[south_border, north_border])
water_offset = Slider(100, range=0..150)
dike_offset = Slider(50, range=0..100)
xy_plane = XYPlane(Origin=Point(0, 0, 0))
list_item = ListItem(List=shatter, Index=1, Wrap=True)
negative = Negative(Value=water_offset)
offset_curve = OffsetCurve(Curve=list_item, Distance=dike_offset, Plane=xy_plane, Corners=1)
offset_curve_2 = OffsetCurve(Curve=list_item, Distance=negative, Plane=xy_plane, Corners=1)
end_points = EndPoints(Curve=offset_curve)  # -> Start, End
end_points_2 = EndPoints(Curve=offset_curve_2)  # -> Start, End
line = Line(StartPoint=end_points_2.Start, EndPoint=end_points.Start)
line_2 = Line(StartPoint=end_points_2.End, EndPoint=end_points.End)
join_curves = JoinCurves(Curves=[line, line_2, offset_curve_2, offset_curve], Preserve=False)

hops = Hops(
    BalconiesBool=boolean_toggle,
    GroundFloorRectangle=curve,
    BalconyDepth=balcony_depth,
    ShellOffset=shell_offset,
    LevelsPerLevel=levels_per_level,
    Levels=levels,
    LevelHeight=level_height,
    GridSize=grid_size,
    CoreXDistance=core_x_distance,
    CoreYDistance=core_y_distance,
    CoreXSize=core_x_size,
    CoreYSize=core_y_size,
    UseCoreBooleanToggle=Toggle(False),
    CacheResultsInMemory=True,
    CacheSolveResults=True,
    RemoteDefinitionLocation="C:\Users\Job de Vogel\OneDrive\Documenten\TU Delft\Building Technology\MEGA\Grasshopper Files\Towers.gh",
    RemoteSolveVersion=(0, 1, 0),
    ShowInput_Enabled=False,
    ShowInput_Path=False,
    SynchronousSolve=False)  # -> OUT, Balconies, OuterShell, Columns, Points, FloorSurfaces, Core, Height, Area
hops_2 = Hops(
    BalconiesBool=boolean_toggle,
    GroundFloorRectangle=curve_2,
    BalconyDepth=balcony_depth_2,
    ShellOffset=shell_offset_2,
    LevelsPerLevel=levels_per_level_2,
    Levels=levels_2,
    LevelHeight=level_height_2,
    GridSize=grid_size_2,
    CoreXDistance=core_x_distance_2,
    CoreYDistance=core_y_distance_2,
    CoreXSize=core_x_size_2,
    CoreYSize=core_y_size_2,
    UseCoreBooleanToggle=Toggle(False),
    CacheResultsInMemory=True,
    CacheSolveResults=True,
    RemoteDefinitionLocation="C:\Users\Job de Vogel\OneDrive\Documenten\TU Delft\Building Technology\MEGA\Grasshopper Files\Towers.gh",
    RemoteSolveVersion=(0, 1, 0),
    ShowInput_Enabled=False,
    ShowInput_Path=False,
    SynchronousSolve=False)  # -> OUT, Balconies, OuterShell, Columns, Points, FloorSurfaces, Core, Height, Area
area = Area(Geometry=curve_2)  # -> Area, Centroid
area_2 = Area(Geometry=curve)  # -> Area, Centroid
mass_addition = MassAddition(Input=[area_2.Area, area.Area])  # -> Result, PartialResults
grid_size_3 = Slider(24, range=0..24)

curve_center_grid = Slider(0.57, range=0..1)
evaluate_curve = EvaluateCurve(Curve=reparameterize(list_item), Parameter=curve_center_grid)  # -> Point, Tangent, Angle
plane_normal = PlaneNormal(Origin=evaluate_curve.Point, ZAxis=evaluate_curve.Tangent)
deconstruct_plane = DeconstructPlane(Plane=plane_normal)  # -> Origin, XAxis, YAxis, ZAxis
construct_plane = ConstructPlane(Origin=deconstruct_plane.Origin, XAxis=deconstruct_plane.XAxis, YAxis=deconstruct_plane.ZAxis)
flip_plane = FlipPlane(Plane=construct_plane, ReverseX=True, ReverseY=True, SwapAxes=False)
plane = Plane(flip_plane)
deconstruct_plane_2 = DeconstructPlane(Plane=flip_plane)  # -> Origin, XAxis, YAxis, ZAxis
grid_size_4 = Slider(12, range=0..12)
x_size_grid = Slider(150, range=0..150)
y_size_grid = Slider(300, range=0..300)
dike_cut_size = Slider(50, range=-50..75)
negative_2 = Negative(Value=deconstruct_plane_2.XAxis)
negative_3 = Negative(Value=deconstruct_plane_2.YAxis)
amplitude = Amplitude(Vector=negative_3, Amplitude=expr("x/2", y_size_grid))
amplitude_2 = Amplitude(Vector=negative_2, Amplitude=dike_cut_size)
addition = Addition(A=amplitude_2, B=amplitude)
division = Division(A=x_size_grid, B=grid_size_4)
division_2 = Division(A=y_size_grid, B=grid_size_3)
move = Move(Geometry=plane, Motion=addition)  # -> Geometry, Transform
rectangular = Rectangular(Plane=move.Geometry, SizeX=grid_size_4, SizeY=grid_size_3, ExtentX=division, ExtentY=division_2)  # -> Cells, Points

multiplication = Multiplication(A=x_size_grid, B=y_size_grid)
subtraction = Subtraction(A=multiplication, B=mass_addition.Result)
area_3 = Panel(subtraction)
xy_plane_2 = XYPlane(Origin=Point(0, 0, 0))
curve_4 = Curve(offset_curve_2)
curve_5 = Curve(list_item)

# ---- group: Dikes
water_offset_2 = Slider(212, range=0..220)
negative_4 = Negative(Value=water_offset_2)
unit_z = UnitZ(Factor=Slider(29, range=0..100))
unit_z_2 = UnitZ(Factor=Slider(22, range=0..100))
offset_curve_3 = OffsetCurve(Curve=curve_5, Distance=Slider(66, range=0..100), Plane=xy_plane_2, Corners=1)
offset_curve_4 = OffsetCurve(Curve=curve_5, Distance=negative_4, Plane=xy_plane_2, Corners=1)
negative_5 = Negative(Value=unit_z)
move_2 = Move(Geometry=offset_curve_4, Motion=negative_5)  # -> Geometry, Transform
move_3 = Move(Geometry=offset_curve_3, Motion=unit_z_2)  # -> Geometry, Transform
ruled_surface = RuledSurface(CurveA=curve_5, CurveB=move_3.Geometry)
ruled_surface_2 = RuledSurface(CurveA=curve_4, CurveB=curve_5)
ruled_surface_3 = RuledSurface(CurveA=curve_4, CurveB=move_2.Geometry)
custom_preview = CustomPreview(Geometry=[ruled_surface_2, ruled_surface_3, ruled_surface], Material=ColourSwatch(SwatchColor=RGBA(255, 255, 255, 60)))

# ----
point = Point(rectangular.Points)
point_in_curve = PointInCurve(Point=point, Curve=join_curves)  # -> Relationship, Point

# ---- group: Dimensions
curve_middle = CurveMiddle(Curve=curve_5)
curve_closest_point = CurveClosestPoint(Point=curve_middle, Curve=curve_4)  # -> Point, Parameter, Distance
curve_closest_point_2 = CurveClosestPoint(Point=curve_closest_point.Point, Curve=offset_curve_4)  # -> Point, Parameter, Distance
curve_closest_point_3 = CurveClosestPoint(Point=curve_middle, Curve=offset_curve_3)  # -> Point, Parameter, Distance
line_3 = Line(StartPoint=curve_closest_point.Point, EndPoint=curve_closest_point_2.Point)
line_4 = Line(StartPoint=curve_middle, EndPoint=curve_closest_point.Point)
line_5 = Line(StartPoint=curve_middle, EndPoint=curve_closest_point_3.Point)
linear_dimension = LinearDimension(Line=line_3, PointA=curve_closest_point.Point, PointB=curve_closest_point_2.Point, Text="{0:0.00}", Size=5)
linear_dimension_2 = LinearDimension(Line=line_4, PointA=curve_middle, PointB=curve_closest_point.Point, Text="{0:0.00}", Size=5)
linear_dimension_3 = LinearDimension(Line=line_5, PointA=curve_closest_point_3.Point, PointB=curve_middle, Text="{0:0.00}", Size=5)

# ----
mass_addition_2 = MassAddition(Input=point_in_curve.Relationship)  # -> Result, PartialResults
dispatch = Dispatch(List=point, DispatchPattern=point_in_curve.Relationship)  # -> ListA, ListB
equality = Equality(FirstNumber=mass_addition_2.Result, SecondNumber=8)  # -> Equality, Inequality
curve_6 = Curve(offset_curve)
curve_7 = Curve(offset_curve_2)
plane_normal_2 = PlaneNormal(Origin=dispatch.ListB, ZAxis=deconstruct_plane.ZAxis)
curve_plane = CurvePlane(Curve=curve_7, Plane=plane_normal_2)  # -> Points, ParamsC, ParamsP
curve_plane_2 = CurvePlane(Curve=curve_6, Plane=plane_normal_2)  # -> Points, ParamsC, ParamsP
cull_duplicates = CullDuplicates(Points=curve_plane.Points, Tolerance=0.1, CullMode=3)  # -> Points, Indices, Valence
cull_duplicates_2 = CullDuplicates(Points=curve_plane_2.Points, Tolerance=0.1, CullMode=3)  # -> Points, Indices, Valence

# ---- group: Central Grid Points
point_2 = Point(simplify(dispatch.ListA))

# ----
stream_filter = StreamFilter(Gate=Toggle(True), Stream1=cull_duplicates.Points)
stream_filter_2 = StreamFilter(Gate=Toggle(True), Stream1=cull_duplicates_2.Points)
merge = Merge(Data1=stream_filter, Data2=stream_filter_2)

# ---- group: Boundary Points
point_3 = Point(simplify(graft(merge)))

# ----
clean_tree = CleanTree(RemoveNulls=True, RemoveInvalid=True, RemoveEmpty=True, Tree=point_3)
z_grid_size = Slider(6, range=0..10)
distribution_height = Slider(12, range=0..100)
division_3 = Division(A=distribution_height, B=z_grid_size)
series = Series(Start=z_grid_size, Step=z_grid_size, Count=division_3)
graft_tree = GraftTree(Tree=point_2, IncludeEmptyLists=True, IncludeNullItems=True)
unit_z_3 = UnitZ(Factor=series)
move_4 = Move(Geometry=graft_tree, Motion=unit_z_3)  # -> Geometry, Transform
move_5 = Move(Geometry=clean_tree, Motion=unit_z_3)  # -> Geometry, Transform
merge_2 = Merge(Data1=graft_tree, Data2=move_4.Geometry)
# NEXT STEPS: -Be able to remove points for facade or exceptions
# - Add thickness to surfaces
merge_3 = Merge(Data1=move_5.Geometry, Data2=clean_tree)
list_item_2 = ListItem(List=merge_2, Index=2, Wrap=True)
polyline = PolyLine(Vertices=merge_3, Closed=False)
trim_tree = TrimTree(Tree=list_item_2, Depth=1)
