# Grasshopper definition Config_Generator_Wallacei.gh (Grasshopper 1.0.7)
# Copyright: Job de Vogel
# plug-ins: Anemone, Wallacei

tower_2_y = Slider(17, range=10..50)
tower_position = Slider(10, range=4..10)
tower_1_x = Slider(-17, range=-42..-15)
tower_distance = Slider(20, range=20..50)
tower_1_y = Slider(40, range=20..42)
tower_2_x = Slider(-37, range=-50..-20)
tower_2_pos = Slider(0.1, range=0.1..0.4)
tower_1_pos = Slider(0.5, range=0..0.5)
multiplication = Multiplication(A=36, B=tower_position)
circle = Circle(Plane=PlaneXY(0, 0, 0), Radius=tower_distance)
rotate = Rotate(Geometry=circle, Angle=degrees(multiplication), Plane=PlaneXY(0, 0, 0))  # -> Geometry, Transform
curve = Curve(circle)
# 1. Postioning Towers
negative = Negative(Value=tower_1_x)
negative_2 = Negative(Value=tower_2_y)
evaluate_curve = EvaluateCurve(Curve=reparameterize(rotate.Geometry), Parameter=tower_1_pos)  # -> Point, Tangent, Angle
evaluate_curve_2 = EvaluateCurve(Curve=reparameterize(rotate.Geometry), Parameter=tower_2_pos)  # -> Point, Tangent, Angle
construct_domain = ConstructDomain(DomainStart=negative, DomainEnd=tower_1_x)
construct_domain_2 = ConstructDomain(DomainStart=negative_2, DomainEnd=tower_2_y)

rectangle = Rectangle(Plane=evaluate_curve_2.Point, XSize=construct_domain_2, YSize=tower_2_x, Radius=0)  # -> Rectangle, Length
rectangle_2 = Rectangle(Plane=evaluate_curve.Point, XSize=construct_domain, YSize=tower_1_y, Radius=0)  # -> Rectangle, Length

discontinuity = Discontinuity(Curve=rectangle.Rectangle, Level=1)  # -> Points, Parameters
area = Area(Geometry=rectangle_2.Rectangle)  # -> Area, Centroid
area_2 = Area(Geometry=rectangle.Rectangle)  # -> Area, Centroid
point_in_curve = PointInCurve(Point=discontinuity.Points, Curve=rectangle_2.Rectangle)  # -> Relationship, Point
mass_addition = MassAddition(Input=point_in_curve.Relationship)  # -> Result, PartialResults
larger_than = LargerThan(FirstNumber=mass_addition.Result, SecondNumber=0)  # -> LargerThan, OrEqualTo
line = Line(StartPoint=area.Centroid, EndPoint=area_2.Centroid)
length = Length(Curve=line)
one_over_x = OneOverX(Value=length)
stream_filter = StreamFilter(Gate=larger_than.LargerThan, Stream0=0, Stream1=999999)
penalty_for_closeness = Panel(one_over_x)
intersection_pentalty = Panel(stream_filter)
multiplication_2 = Multiplication(A=tower_2_y, B=2)
multiplication_3 = Multiplication(A=tower_1_x, B=2)
penalty_diagonality = Number(intersection_pentalty)
penalty_closeness = Number(penalty_for_closeness)
width_factor_middle_rectangle = Slider(1, range=0.9..1)
top_width = Slider(0.85, range=0.8..1)
top_length = Slider(0.85, range=0.8..1)
upper_top_width = Slider(0.64, range=0.6..0.8)
upper_top_length = Slider(0.64, range=0.6..0.8)
length_factor_middle_rectangle = Slider(1, range=0.9..1)
tower_swap = Slider(0, range=0..1)
length_factor_top_rectangle = Slider(1.2, range=1..1.2)
width_factor_top_rectangle = Slider(1.2, range=1..1.2)
height_tower_1 = Slider(119, range=90..120)
width_factor_middle_rectangle_2 = Slider(0.85, range=0.85..1)
width_factor_middle_rectangle_3 = Slider(0.85, range=0.85..1)
merge = Merge(Data1=rectangle_2.Rectangle, Data2=rectangle.Rectangle)
multiplication_4 = Multiplication(A=height_tower_1, B=Slider(1.2, range=1.1..1.25))
list_item = ListItem(List=merge, Index=tower_swap, Wrap=True)  # -> Item, Item1
multiplication_5 = Multiplication(A=width_factor_middle_rectangle, B=upper_top_width)
multiplication_6 = Multiplication(A=length_factor_middle_rectangle, B=upper_top_length)
multiplication_7 = Multiplication(A=width_factor_top_rectangle, B=width_factor_middle_rectangle_3)
multiplication_8 = Multiplication(A=length_factor_top_rectangle, B=width_factor_middle_rectangle_2)
multiplication_9 = Multiplication(A=tower_2_x, B=width_factor_middle_rectangle)
multiplication_10 = Multiplication(A=multiplication_2, B=length_factor_middle_rectangle)
division = Division(A=multiplication_4, B=2)
multiplication_11 = Multiplication(A=tower_2_x, B=multiplication_5)
multiplication_12 = Multiplication(A=multiplication_2, B=multiplication_6)
multiplication_13 = Multiplication(A=tower_2_x, B=top_width)
multiplication_14 = Multiplication(A=multiplication_2, B=top_length)
curve_2 = Curve(list_item.Item1)
curve_3 = Curve(list_item.Item)
multiplication_15 = Multiplication(A=multiplication_3, B=width_factor_top_rectangle)
multiplication_16 = Multiplication(A=tower_1_y, B=length_factor_top_rectangle)
division_2 = Division(A=height_tower_1, B=2)
multiplication_17 = Multiplication(A=multiplication_3, B=multiplication_7)
multiplication_18 = Multiplication(A=tower_1_y, B=multiplication_8)

# ----
# Constructing tower 1
discontinuity_2 = Discontinuity(Curve=curve_3, Level=1)  # -> Points, Parameters
rectangle_3 = Rectangle(curve_3)
list_item_2 = ListItem(List=discontinuity_2.Points, Index=1, Wrap=True)
unit_z = UnitZ(Factor=division_2)
unit_z_2 = UnitZ(Factor=height_tower_1)
move = Move(Geometry=list_item_2, Motion=unit_z)  # -> Geometry, Transform
move_2 = Move(Geometry=list_item_2, Motion=unit_z_2)  # -> Geometry, Transform
# 2. Build tower based on required volume
rectangle_4 = Rectangle(Plane=move_2.Geometry, XSize=multiplication_15, YSize=multiplication_16, Radius=0)  # -> Rectangle, Length
rectangle_5 = Rectangle(Plane=move.Geometry, XSize=multiplication_17, YSize=multiplication_18, Radius=0)  # -> Rectangle, Length
discontinuity_3 = Discontinuity(Curve=rectangle_5.Rectangle, Level=1)  # -> simplify(graft(Points)), Parameters
discontinuity_4 = Discontinuity(Curve=rectangle_4.Rectangle, Level=1)  # -> simplify(graft(Points)), Parameters
discontinuity_5 = Discontinuity(Curve=rectangle_3, Level=1)  # -> simplify(graft(Points)), Parameters
unit_z_3 = UnitZ(Factor=1)
interpolate_t = InterpolateT(
    Vertices=[discontinuity_5.Points, discontinuity_3.Points, discontinuity_4.Points],
    TangentStart=unit_z_3,
    TangentEnd=Vector(0, 0, 0),
    KnotStyle=1)  # -> flatten(Curve), Length, Domain
graft_tree = GraftTree(Tree=interpolate_t.Curve, IncludeEmptyLists=True, IncludeNullItems=True)
shift_list = ShiftList(List=interpolate_t.Curve, Shift=1, Wrap=True)  # -> graft(List)
area_3 = Area(Geometry=curve_3)  # -> Area, Centroid
shift_paths = ShiftPaths(Data=shift_list, Offset=1)
orientation_tower_1 = Slider(3, range=0..3)
loft = Loft(
    Curves=[graft_tree, shift_paths],
    Options={Adjust=False, Closed=False, LoftEnds=0, LoftSimp=0, LoftType=0, Rebuild=10, Refit=0.01})  # -> flatten(Loft)
unit_z_4 = UnitZ(Factor=1)
brep_join = BrepJoin(Breps=loft)  # -> Breps, Closed
line_sdl = LineSDL(Start=area_3.Centroid, Direction=unit_z_4, Length=1)
cap_holes = CapHoles(Brep=brep_join.Breps)
multiplication_19 = Multiplication(A=orientation_tower_1, B=90)
rotate_axis = RotateAxis(Geometry=cap_holes, Angle=degrees(multiplication_19), Axis=line_sdl)  # -> Geometry, Transform

number_slider = Slider(0.6, range=0..1)
number_slider_2 = Slider(0.8, range=0..1)
unit_z_5 = UnitZ(Factor=12)
rotate_axis_2 = RotateAxis(Geometry=curve_3, Angle=degrees(multiplication_19), Axis=line_sdl)  # -> Geometry, Transform
negative_3 = Negative(Value=unit_z_5)
extrude = Extrude(Base=rotate_axis_2.Geometry, Direction=negative_3)
cap_holes_2 = CapHoles(Brep=extrude)
merge_2 = Merge(Data1=rotate_axis.Geometry, Data2=cap_holes_2)
volume = Volume(Geometry=rotate_axis.Geometry)  # -> Volume, Centroid
geometry = Geometry(simplify(merge_2))
use_new_model = BooleanToggle(False)

# ---- group: Height circles
wlc = GenePool(Decimals=1, Maximum=0.6, Minimum=-0.6, Value=[-0.1, 0.2, -0.2, -0.3, 0.1, -0.4, -0.6])

# ----
max_radius_factor = Slider(2, range=0..10)

# ---- group: Radius circles
wlc_1 = GenePool(Decimals=2, Maximum=1, Minimum=0, Value=[0.51, 0.42, 0.21, 0.06, 0.67, 0.6, 0.14])

# ---- group: Parameter circles
wlc_3 = GenePool(Decimals=2, Maximum=1, Minimum=0, Value=[0.96, 0.14, 0.73, 0.95, 0.99, 0.04, 0.93])

# ----
requirements = Panel("""140722.5
68853
62509
53995.68
54418.5
23838
5000""")
construction = Slider(90000, range=0..100000)

# ---- group: Volume adjustment
wlc_4 = GenePool(Decimals=2, Maximum=1, Minimum=-1, Value=[0.53, 0.27, -0.31, -0.52, 0.36, 0.36, 0.97])

# ----
# 3. Configure functions in setup
entwine = Entwine(Branch00=wlc, Branch01=wlc_1, Branch02=wlc_3, Branch03=wlc_4, FlattenInputs=True)  # -> simplify(Result)
absolute = Absolute(Value=wlc_4)
panel = Panel("Lower is better")

epw_url = Panel("https://energyplus-weather.s3.amazonaws.com/europe_wmo_region_6/NLD/NLD_Amsterdam.062400_IWEC/NLD_Amsterdam.062400_IWEC.zip")
# Retrieve the EPW data
# Double-click on False
go_to_epw_website = BooleanToggle(False)
epwmap = LBEPWmap(epw_map=go_to_epw_website)  # -> Output; plug-in component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
downloadepw = LBDownloadWeather(weather_URL=epw_url)  # -> epw_file, stat_file, ddy_file; plug-in component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

panel_2 = Panel("""Fab Lab Algen
Data Center
Hotel & Restaurant
Residences
Offices
General Services
Extra""")
list_length = ListLength(List=panel_2)
# Extract the EPW data
importepw = LBImportEPW(epw_file=downloadepw.epw_file)  # -> location, dry_bulb_temperature, dew_point_temperature, relative_humidity, wind_speed, wind_direction, direct_normal_rad, diffuse_horizontal_rad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; plug-in component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
month = Slider(7, range=0..10)
day = Slider(21, range=0..100)
hour = Slider(8, range=0..100)
month_2 = Slider(7, range=0..10)
day_2 = Slider(21, range=0..100)
hour_2 = Slider(21, range=0..100)

# ----
# Set the analysis period
month_3 = Slider(7, range=0..10)
day_3 = Slider(21, range=0..100)
hour_3 = Slider(15, range=0..23)
analysisperiod = LBAnalysisPeriod(start_month=month, start_day=day, start_hour=hour, end_month=month_2, end_day=day_2, end_hour=hour_2)  # -> period, hoys, dates; plug-in component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
hoy = LBCalculateHOY(month=month_3, day=day_3, hour=hour_3)  # -> flatten(hoy), flatten(doy), flatten(date); plug-in component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

# ----
# Change legend settings
# HERE -->
construct_domain_3 = ConstructDomain(DomainStart=0, DomainEnd=1)
legend_steps = Slider(10, range=0..10)
range = Range(Domain=construct_domain_3, Steps=legend_steps)
# Set the legend color
gradient = Gradient(LowerLimit=0, UpperLimit=1, Parameter=range, stops=[0: RGB(0, 0, 0), 1: RGB(255, 255, 255)])
legend_size = Slider(30, range=0..10000)
location_legend = BooleanToggle(True)
legendpar = LBLegendParameters(colors=gradient, vert_or_horiz=location_legend, seg_height=legend_size)  # -> leg_par; plug-in component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

# ----
# Create the sunpath
sun_position = Slider(-55, range=-55..-35)
panel_3 = Panel("Higher is better")
scale = Panel("1.5")

sunpath_type = ValueList({"Orthographic", "Stereographic", "3D": None}, selected="3D")
sunpath = LBSunPath(north=sun_position, location=importepw.location, hoys=analysisperiod.hoys, scale=scale, projection=sunpath_type)  # -> out, vectors, altitudes, azimuths, hoys, sun_pts, analemma, daily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; plug-in component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

sphere = Sphere(Base=sunpath.sun_pts, Radius=1)
data = Data([sunpath.sun_pts, sunpath.altitudes, sunpath.azimuths, sunpath.analemma, sunpath.vectors, sunpath.out, sunpath.hoys, sunpath.daily, sunpath.compass])
squareness = Panel("MINIMIZE NON-CUBENESS")
# Fab Lab Algen
# Data Center
# Hotel & Restaurant
# Residences
# Offices
# General Services
# Extra
factor = Slider(1000, range=0..1000)

# ----
# Constructing tower 2
discontinuity_6 = Discontinuity(Curve=curve_2, Level=1)  # -> Points, Parameters
rectangle_6 = Rectangle(curve_2)
unit_z_6 = UnitZ(Factor=height_tower_1)
move_3 = Move(Geometry=curve_2, Motion=unit_z_6)  # -> Geometry, Transform
unit_z_7 = UnitZ(Factor=division_2)
unit_z_8 = UnitZ(Factor=multiplication_4)
move_4 = Move(Geometry=curve_2, Motion=unit_z_7)  # -> Geometry, Transform
move_5 = Move(Geometry=curve_2, Motion=unit_z_8)  # -> Geometry, Transform
unit_z_9 = UnitZ(Factor=12)
negative_4 = Negative(Value=unit_z_9)
unit_z_10 = UnitZ(Factor=1)
area_4 = Area(Geometry=curve_2)  # -> Area, Centroid
orientation_tower_2 = Slider(0, range=0..3)
unit_z_11 = UnitZ(Factor=1)
line_sdl_2 = LineSDL(Start=area_4.Centroid, Direction=unit_z_11, Length=1)
multiplication_20 = Multiplication(A=orientation_tower_2, B=90)
rotate_axis_3 = RotateAxis(Geometry=curve_2, Angle=degrees(multiplication_20), Axis=line_sdl_2)  # -> Geometry, Transform
extrude_2 = Extrude(Base=rotate_axis_3.Geometry, Direction=negative_4)
cap_holes_3 = CapHoles(Brep=extrude_2)

list_item_3 = ListItem(List=discontinuity_6.Points, Index=0, Wrap=True)
xy_plane = XYPlane(Origin=list_item_3)
discontinuity_7 = Discontinuity(Curve=move_3.Geometry, Level=1)  # -> Points, Parameters
list_item_4 = ListItem(List=discontinuity_7.Points, Index=0, Wrap=True)
xy_plane_2 = XYPlane(Origin=list_item_4)

scale_nu = ScaleNU(Geometry=move_4.Geometry, Plane=xy_plane, ScaleX=1, ScaleY=1, ScaleZ=1)  # -> Geometry, Transform
scale_nu_2 = ScaleNU(Geometry=move_3.Geometry, Plane=xy_plane, ScaleX=number_slider_2, ScaleY=number_slider_2, ScaleZ=1)  # -> Geometry, Transform
scale_nu_3 = ScaleNU(Geometry=move_5.Geometry, Plane=xy_plane, ScaleX=number_slider, ScaleY=number_slider, ScaleZ=1)  # -> Geometry, Transform
discontinuity_8 = Discontinuity(Curve=scale_nu.Geometry, Level=1)  # -> simplify(graft(Points)), Parameters
discontinuity_9 = Discontinuity(Curve=scale_nu_2.Geometry, Level=1)  # -> simplify(graft(Points)), Parameters
discontinuity_10 = Discontinuity(Curve=scale_nu_3.Geometry, Level=1)  # -> simplify(graft(Points)), Parameters
merge_3 = Merge(
    Data1=simplify(graft(discontinuity_6.Points)),
    Data2=discontinuity_8.Points,
    Data3=discontinuity_9.Points,
    Data4=discontinuity_10.Points)
interpolate_t_2 = InterpolateT(Vertices=merge_3, TangentStart=unit_z_10, TangentEnd=Vector(0, 0, 0), KnotStyle=1)  # -> flatten(Curve), Length, Domain
shift_list_2 = ShiftList(List=interpolate_t_2.Curve, Shift=1, Wrap=True)  # -> graft(List)
graft_tree_2 = GraftTree(Tree=interpolate_t_2.Curve, IncludeEmptyLists=True, IncludeNullItems=True)
shift_paths_2 = ShiftPaths(Data=shift_list_2, Offset=1)
loft_2 = Loft(
    Curves=[graft_tree_2, shift_paths_2],
    Options={Adjust=False, Closed=False, LoftEnds=0, LoftSimp=0, LoftType=0, Rebuild=10, Refit=0.01})  # -> flatten(Loft)
brep_join_2 = BrepJoin(Breps=loft_2)  # -> Breps, Closed
cap_holes_4 = CapHoles(Brep=brep_join_2.Breps)
rotate_axis_4 = RotateAxis(Geometry=cap_holes_4, Angle=degrees(multiplication_20), Axis=line_sdl_2)  # -> Geometry, Transform
merge_4 = Merge(Data1=rotate_axis_4.Geometry, Data2=cap_holes_3)
geometry_2 = Geometry(simplify(merge_4))
volume_2 = Volume(Geometry=rotate_axis_4.Geometry)  # -> Volume, Centroid

entwine_2 = Entwine(Branch00=geometry, Branch01=geometry_2, FlattenInputs=True)  # -> simplify(Result)
mass_addition_2 = MassAddition(Input=[volume_2.Volume, volume.Volume])  # -> Result, PartialResults

# ---- group: Extract facades
deconstruct_brep = DeconstructBrep(Brep=entwine_2)  # -> Faces, Edges, Vertices
area_5 = Area(Geometry=deconstruct_brep.Faces)  # -> Area, Centroid
deconstruct = Deconstruct(Point=area_5.Centroid)  # -> XComponent, YComponent, ZComponent
sort_list = SortList(Keys=deconstruct.ZComponent, ValuesValuesA=deconstruct_brep.Faces)  # -> Keys, ValuesValuesA
cull_index = CullIndex(List=sort_list.ValuesValuesA, Indices=[0, -1], Wrap=True)  # -> simplify(List)
shift_paths_3 = ShiftPaths(Data=cull_index, Offset=-1)

# ----
merge_5 = Merge(Data1=rotate_axis.Geometry, Data2=rotate_axis_4.Geometry)
panel_6 = Panel(mass_addition_2.Result)
stream_filter_2 = StreamFilter(Gate=use_new_model, Stream0=merge_5)
geometry_3 = Geometry(stream_filter_2)

# ---- group: Extract facades / Facades to analyze
geometry_4 = Geometry(shift_paths_3)

# ----
# Surface to calculate
# Context geometry
surface = Surface(geometry_4)
geometry_5 = Geometry(surface)

multicore_processing = BooleanToggle(False)
run_the_calculation = BooleanToggle(True)
offset_height = Slider(1, range=0..1000)
grid_size = Panel("5")
# Calculate sun hours
directsunhours = LBDirectSunHours(
    vectors=flatten(sunpath.vectors),
    geometry=flatten(surface),
    context=flatten(geometry_5),
    grid_size=grid_size,
    offset_dist=offset_height,
    legend_par=legendpar,
    parallel=multicore_processing,
    run=run_the_calculation)  # -> out, points, results, mesh, legend, title, int_mtx; plug-in component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

suirify = Suirify(directsunhours.mesh)
mesh = Mesh(directsunhours.mesh)
mass_addition_3 = MassAddition(Input=directsunhours.results)  # -> Result, PartialResults
overall_sunlight = Number(mass_addition_3.Result)
point = Point(directsunhours.points)

# ---- group: Voxel Grid generator
bounding_box = BoundingBox(Content=geometry_3, Plane=PlaneXY(0, 0, 0), UnionBox=True)  # -> Box, Box_2
deconstruct_brep_2 = DeconstructBrep(Brep=bounding_box.Box_2)  # -> Faces, Edges, Vertices
deconstruct_box = DeconstructBox(Box=bounding_box.Box_2)  # -> Plane, X, Y, Z
list_item_5 = ListItem(List=deconstruct_brep_2.Vertices, Index=0, Wrap=True)
deconstruct_domain = DeconstructDomain(Domain=deconstruct_box.Y)  # -> Start, End
deconstruct_domain_2 = DeconstructDomain(Domain=deconstruct_box.X)  # -> Start, End
deconstruct_domain_3 = DeconstructDomain(Domain=deconstruct_box.Z)  # -> Start, End
number_slider_3 = Slider(15, range=0..40)
number_slider_4 = Slider(15, range=0..45)
subtraction = Subtraction(A=deconstruct_domain.End, B=deconstruct_domain.Start)
subtraction_2 = Subtraction(A=deconstruct_domain_2.End, B=deconstruct_domain_2.Start)
subtraction_3 = Subtraction(A=deconstruct_domain_3.End, B=deconstruct_domain_3.Start)
division_3 = Division(A=subtraction_2, B=number_slider_3)
division_4 = Division(A=subtraction_3, B=number_slider_4)
division_5 = Division(A=subtraction, B=number_slider_3)
domain_box = DomainBox(Base=PlaneXY(0, 0, 0), X=division_3, Y=division_5, Z=division_4)
orient = Orient(Geometry=domain_box, Source=PlaneXY(0, 0, 0), Target=list_item_5)  # -> Geometry, Transform
box_array = BoxArray(Geometry=orient.Geometry, Cell=orient.Geometry, XCount=number_slider_3, YCount=number_slider_3, ZCount=number_slider_4)  # -> Geometry, Transform
volume_3 = Volume(Geometry=box_array.Geometry)  # -> Volume, Centroid
sort_list_2 = SortList(Keys=[division_3, division_5, division_4])  # -> reverse(Keys), ValuesValuesA
list_item_6 = ListItem(List=sort_list_2.Keys, Index=0, Wrap=True)
list_item_7 = ListItem(List=volume_3.Volume, Index=0, Wrap=True)

# ----
maximum = Maximum(A=subtraction_2, B=subtraction)
multiplication_21 = Multiplication(A=maximum, B=max_radius_factor)
point_in_breps = PointInBreps(Brep=geometry_3, Point=volume_3.Centroid, Strict=False)  # -> Inside, Index
multiplication_22 = Multiplication(A=wlc_1, B=multiplication_21)

# ---- group: Attractor
multiplication_23 = Multiplication(A=wlc, B=subtraction_3)
volume_4 = Volume(Geometry=bounding_box.Box_2)  # -> Volume, Centroid
unit_z_12 = UnitZ(Factor=multiplication_23)
move_6 = Move(Geometry=volume_4.Centroid, Motion=unit_z_12)  # -> Geometry, Transform
circle_2 = Circle(Plane=move_6.Geometry, Radius=multiplication_22)
evaluate_curve_3 = EvaluateCurve(Curve=reparameterize(circle_2), Parameter=wlc_3)  # -> Point, Tangent, Angle

# ---- group: Voxel Grid generator (continued)
cull_pattern = CullPattern(List=box_array.Geometry, CullPattern=point_in_breps.Inside)
cull_pattern_2 = CullPattern(List=volume_3.Centroid, CullPattern=point_in_breps.Inside)

# ----
voxels = Geometry(cull_pattern)
highest_nb_distance = Number(list_item_6)
block_volume = Number(list_item_7)
point_2 = Point(cull_pattern_2)
# Fab Lab Algen
# Data Center
# Hotel & Restaurant
# Residences
# Offices
# General Services
# Extra
points = Point(evaluate_curve_3.Point)
list_length_2 = ListLength(List=points)

grid_volume = Number(block_volume)
division_6 = Division(A=requirements, B=grid_volume)
round = Round(Number=division_6)  # -> Nearest, Floor, Ceiling
number_slider_5 = Slider(0.1, range=0..1)
multiplication_24 = Multiplication(A=wlc_4, B=number_slider_5)
multiplication_25 = Multiplication(A=round.Ceiling, B=multiplication_24)
integer = Integer(multiplication_25)
mass_addition_4 = MassAddition(Input=absolute)  # -> Result, PartialResults
addition = Addition(A=round.Ceiling, B=integer)
minimize_deviation_volume = Panel(mass_addition_4.Result)

# ---- group: Main Assignment Loop
fast_loop_start = FastLoopStart(Iterations=list_length_2, Data=point_2)  # -> port, Counter, Data, Assigned
list_item_8 = ListItem(List=points, Index=fast_loop_start.Counter, Wrap=True)
list_item_9 = ListItem(List=addition, Index=fast_loop_start.Counter, Wrap=True)
clean_tree = CleanTree(RemoveNulls=True, RemoveInvalid=True, RemoveEmpty=False, Tree=fast_loop_start.Data)
closest_points = ClosestPoints(Point=list_item_8, Cloud=fast_loop_start.Data, Count=list_item_9)  # -> ClosestPoint, CPIndex, Distance
list_length_3 = ListLength(List=clean_tree)
merge_6 = Merge(Data1=fast_loop_start.Assigned, Data2=closest_points.CPIndex)  # -> flatten(Result)
smaller_than = SmallerThan(FirstNumber=list_length_3, SecondNumber=list_item_9)  # -> SmallerThan, OrEqualTo
replace_items = ReplaceItems(List=fast_loop_start.Data, Indices=closest_points.CPIndex, Wrap=False)
fast_loop_end = FastLoopEnd(
    port=fast_loop_start.port,
    Exit=smaller_than.SmallerThan,
    Data=replace_items,
    Assigned=simplify(merge_6),
    RecordData=False,
    TimeOutVal=0)  # -> Data, Assigned

# ---- group: Partition assigned boxes
mass_addition_5 = MassAddition(Input=addition)  # -> Result, PartialResults
cull_index_2 = CullIndex(List=fast_loop_end.Assigned, Indices=0, Wrap=True)
construct_domain_4 = ConstructDomain(DomainStart=0, DomainEnd=expr("x-1", mass_addition_5.Result))
sub_list = SubList(List=cull_index_2, Domain=construct_domain_4, Wrap=True)  # -> List, Index
partition_list = PartitionList(List=sub_list.List, Size=addition)  # -> simplify(Chunks)
index_clusters = Integer(partition_list)

# ---- group: Accepted volume
at_least = Slider(0.9, range=0..1)
multiplication_26 = Multiplication(A=round.Ceiling, B=at_least)
list_length_4 = ListLength(List=partition_list)  # -> simplify(Length)
graft_tree_3 = GraftTree(Tree=multiplication_26, IncludeEmptyLists=True, IncludeNullItems=True)  # -> simplify(Tree)
list_length_5 = ListLength(List=round.Ceiling)
amount_of_clusters = Integer(list_length_5)
larger_than_2 = LargerThan(FirstNumber=list_length_4, SecondNumber=graft_tree_3)  # -> flatten(LargerThan), OrEqualTo
acceptable_volume = Panel(larger_than_2.LargerThan)

# ----
mass_addition_6 = MassAddition(Input=larger_than_2.LargerThan)  # -> Result, PartialResults

merge_7 = Merge(
    Data1=ColourSwatch(SwatchColor=RGB(125, 121, 121)),
    Data2=ColourSwatch(SwatchColor=RGB(235, 231, 230)),
    Data3=ColourSwatch(SwatchColor=RGB(232, 125, 125)),
    Data4=ColourSwatch(SwatchColor=RGB(176, 143, 77)),
    Data5=ColourSwatch(SwatchColor=RGB(176, 77, 77)),
    Data6=ColourSwatch(SwatchColor=RGB(232, 115, 26)),
    Data7=ColourSwatch(SwatchColor=RGB(110, 20, 20)))  # -> graft(Result)
list_item_10 = ListItem(List=cull_pattern, Index=index_clusters, Wrap=True)
volume_5 = Volume(Geometry=list_item_10)  # -> Volume, Centroid
mass_addition_7 = MassAddition(Input=volume_5.Volume)  # -> Result, PartialResults

equality = Equality(FirstNumber=mass_addition_6.Result, SecondNumber=list_length)  # -> Equality, Inequality

# ---- group: Average Squareness Calculation
list_item_11 = ListItem(List=point_2, Index=index_clusters, Wrap=True)
tree_statistics = TreeStatistics(Tree=list_item_11)  # -> Paths, Length, Count
tree_branch = TreeBranch(Tree=list_item_11, Path=tree_statistics.Paths, MaintainPaths=True)
proximity_3d = Proximity3D(Points=tree_branch, Group=6, MinRadius=0, MaxRadius=expr("x+0.01", highest_nb_distance))  # -> Links, Topology

# ----
volume_check = Number(equality.Equality)

# ---- group: Labelling
list_item_12 = ListItem(List=point_2, Index=index_clusters, Wrap=True)
average = Average(Input=list_item_12)
panel_7 = Panel("""Fab Lab Algen
Data Center
Hotel & Restaurant
Residences
Offices
General Services
Extra""")
text_tag = TextTag(Location=average, Text=graft(panel_7), Colour=RGB(0, 0, 0))

# ----
list_item_13 = ListItem(List=point_2, Index=index_clusters, Wrap=True)
custom_preview = CustomPreview(Geometry=graft(evaluate_curve_3.Point), Material=merge_7)
mesh_colours = MeshColours(Mesh=list_item_10, Colours=simplify(merge_7))
mesh_join = MeshJoin(Meshes=flatten(mesh_colours))
function_volumes = Panel(mass_addition_7.Result)

proximity_3d_2 = Proximity3D(Points=flatten(tree_branch), Group=6, MinRadius=0, MaxRadius=expr("x+0.01", highest_nb_distance))  # -> Links, Topology
list_length_6 = ListLength(List=proximity_3d_2.Links)  # -> flatten(Length)
average_2 = Average(Input=list_length_6)
# 4. Calculate Sunlight in with random position
# sun between -10 degrees north and 10 degrees
#  north.
squareness_2 = Panel("MAXIMIZE OVERALL CONNECTIONS")

list_length_7 = ListLength(List=proximity_3d.Links)
subtraction_4 = Subtraction(A=list_length_7, B=6)
squareness_penalty = Slider(3, range=0..10)
power = Power(A=subtraction_4, B=squareness_penalty)
absolute_2 = Absolute(Value=power)
shift_paths_4 = ShiftPaths(Data=absolute_2, Offset=-1)
mass_addition_8 = MassAddition(Input=shift_paths_4)  # -> Result, PartialResults
division_7 = Division(A=mass_addition_8.Result, B=graft(addition))  # -> flatten(Result)
average_3 = Average(Input=division_7)

one_over_x_2 = OneOverX(Value=average_2)

# ---- group: Overall Connectivity
wlc_overall_connectivity = Data(one_over_x_2)

# ---- group: Cubeness
wlc_cubeness = Data(average_3)

# ----
# ASSIGNED POINTS IN CLUSTERING ALGORITHM
point_3 = Point(list_item_13)
closest_point = ClosestPoint(Point=point_3, Cloud=point)  # -> ClosestPoint, CPIndex, Distance
list_item_14 = ListItem(List=directsunhours.results, Index=closest_point.CPIndex, Wrap=True)
mass_addition_9 = MassAddition(Input=list_item_14)  # -> simplify(Result), PartialResults
explode_tree = ExplodeTree(Data=mass_addition_9.Result)  # -> Branch0, Branch1, Branch2, Branch3, Branch4, Branch5, Branch6
all_functions_that_require_shadow_averag = Panel(mass_addition_9.Result)  # "All functions that require shadow, averaged"
division_8 = Division(A=explode_tree.Branch0, B=factor)
division_9 = Division(A=explode_tree.Branch3, B=factor)
division_10 = Division(A=explode_tree.Branch2, B=factor)
one_over_x_3 = OneOverX(Value=division_8)
one_over_x_4 = OneOverX(Value=division_9)
one_over_x_5 = OneOverX(Value=division_10)
average_4 = Average(Input=flatten([one_over_x_3, one_over_x_5, one_over_x_4]))

# ---- group: Sun Hours
wlc_shadow = Number(average_4)

# ---- group: Volume
mass_addition_10 = MassAddition(Input=requirements)  # -> Result, PartialResults

# ----
addition_2 = Addition(A=mass_addition_10.Result, B=construction)

# ---- group: Volume (continued)
subtraction_5 = Subtraction(A=mass_addition_2.Result, B=addition_2)

# ----
volume_difference = Absolute(Value=subtraction_5)

# ---- group: Volume Difference
wlc_volume_difference = Number(volume_difference)

# ---- group: Volume (continued)
volume_difference_2 = Panel(wlc_volume_difference)

# ----
wallacei_x = WallaceiX(
    Genes=[tower_swap, orientation_tower_1, orientation_tower_2, sun_position, tower_distance, tower_position, wlc, wlc_1, wlc_3, wlc_4, height_tower_1],
    Objectives=[wlc_overall_connectivity, wlc_cubeness, wlc_shadow, wlc_volume_difference, overall_sunlight],
    Data=[sun_position, volume_check],
    Phenotype=suirify,
    allFitness="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",
    allFrontIdx="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",
    allGenomes="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",
    curFrontIdx="99|0;99|1;99|2;99|3;99|4;99|5;99|6;99|7;99|8;99|9;99|10;99|11;99|12;99|13;99|14;99|15;99|16;99|17;99|18;99|19;99|20;99|21;99|22;99|23;99|24;99|25;99|26;99|27;99|28;99|29;99|30;99|31;99|32;99|33;99|34;99|35;99|36;99|37;99|38;99|39;99|40;99|41;99|42;99|43;99|44;99|45;99|46;99|47;99|48;99|49",
    curFrontIdxSave="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",
    popGen="50,100",
    total="9718141",
    wlcDone=True)  # -> WallaceiGenomes, FitnessValues, Data, Phenotypes

# ---- group: Generate Phenotype Grid
tree_statistics_2 = TreeStatistics(Tree=wallacei_x.Phenotypes)  # -> Paths, Length, Count
fitness_to_sort = Slider(1, range=0..2)
tree_branch_2 = TreeBranch(Tree=wallacei_x.FitnessValues, Path=tree_statistics_2.Paths, MaintainPaths=True)
list_item_15 = ListItem(List=tree_branch_2, Index=fitness_to_sort, Wrap=True)  # -> Item, Item1, Item2, Item3, Item4
merge_8 = Merge(
    Data1=list_item_15.Item,
    Data2=list_item_15.Item1,
    Data3=list_item_15.Item2,
    Data4=list_item_15.Item3,
    Data5=list_item_15.Item4)
x_size = Slider(218, range=0..1000)
y_size = Slider(260, range=0..1000)
distribute_to_grid = DistributeToGrid(
    FitnessValues=merge_8,
    WallaceiPhenotypes=wallacei_x.Phenotypes,
    SizeOfTheGridInTheXDirection=x_size,
    SizeOfTheGridInTheYDirection=y_size,
    SizeOfTheTexts=10,
    OutputOptions=0)  # -> DistributedFitnessValues, DistributedData, DistributedGeometries, DistributedMeshes, DistributedNumbers, GridLocations

# ----
# 5. Wallacei optimization
panel_8 = Panel(wallacei_x.Phenotypes)
panel_9 = Panel(list_item_15.Item)
geometry_6 = Geometry(distribute_to_grid.DistributedMeshes)
# 6. Grid varying solutions
data_2 = Data(distribute_to_grid.DistributedFitnessValues)
