# Grasshopper definition Connectivity.gh (Grasshopper 1.0.7)
# Copyright: Job de Vogel
# plug-ins: LunchBox

# ---- group: Inner Doors
curve = Curve([<curve referenced from the Rhino model> x1278])

# ----
length = Length(Curve=curve)

# ---- group: Boundary Curves
curve_2 = Curve([<curve referenced from the Rhino model> x34])

# ----
larger_than = LargerThan(FirstNumber=length, SecondNumber=Slider(1, range=0..1))  # -> LargerThan, OrEqualTo
discontinuity = Discontinuity(Curve=curve_2, Level=1)  # -> Points, Parameters

# ---- group: Inner Walls
curve_3 = Curve([<curve referenced from the Rhino model> x2067])

# ----
average = Average(Input=discontinuity.Points)
cull_pattern = CullPattern(List=curve, CullPattern=larger_than.LargerThan)
number_slider = Slider(20, range=0..100)

# ---- group: Bottom Rectangle
curve_4 = Curve(<curve referenced from the Rhino model>)

# ----
merge = Merge(Data1=curve_3, Data2=cull_pattern)  # -> flatten(Result)
grid_structure = GridStructure(Surface=curve_4, UDivisions=number_slider, VDivisions=number_slider)  # -> StructureLines, StructureNodes
deconstruct = Deconstruct(Point=flatten(average))  # -> XComponent, YComponent, ZComponent
join_curves = JoinCurves(Curves=merge, Preserve=False)
curve_5 = Curve(join_curves)
sort_list = SortList(Keys=deconstruct.ZComponent, ValuesValuesA=flatten(average), ValuesA=curve_2)  # -> Keys, ValuesValuesA, ValuesA
curve_middle = CurveMiddle(Curve=curve_5)
xy_plane = XYPlane(Origin=sort_list.ValuesValuesA)
project = Project(Geometry=grid_structure.StructureNodes, Plane=graft(xy_plane))  # -> Geometry, Transform
deconstruct_2 = Deconstruct(Point=curve_middle)  # -> XComponent, YComponent, ZComponent
format = Format(Format="{0:0.0}", Culture=127, Data0=deconstruct_2.ZComponent)
round = Round(Number=deconstruct_2.ZComponent)  # -> Nearest, Floor, Ceiling
create_set = CreateSet(List=format)  # -> Set, Map
point_in_curve = PointInCurve(Point=project.Geometry, Curve=graft(sort_list.ValuesA))  # -> Relationship, Point
sort_list_2 = SortList(Keys=create_set.Set)  # -> Keys, ValuesA
shift_list = ShiftList(List=sort_list_2.Keys, Shift=1, Wrap=False)
sort_list_3 = SortList(Keys=round.Nearest, ValuesValuesA=curve_5)  # -> Keys, ValuesValuesA
larger_than_2 = LargerThan(FirstNumber=point_in_curve.Relationship, SecondNumber=0)  # -> LargerThan, OrEqualTo
subtraction = Subtraction(A=shift_list, B=sort_list_2.Keys)
create_set_2 = CreateSet(List=sort_list_3.Keys)  # -> Set, Map
cull_index = CullIndex(List=subtraction, Indices=-1, Wrap=True)
cull_pattern_2 = CullPattern(List=project.Geometry, CullPattern=larger_than_2.LargerThan)
merge_2 = Merge(Data1=flatten(cull_index), Data2=flatten(Slider(3.8, range=0..10)))  # -> graft(Result)
member_index = MemberIndex(Set=sort_list_3.Keys, Member=create_set_2.Set)  # -> Index, simplify(Count)
series = Series(Start=Slider(0, range=0..100), Step=1, Count=Slider(34, range=0..34))
panel = Panel(subtraction)
unit_z = UnitZ(Factor=merge_2)  # -> simplify(UnitVector)
point = Point(simplify(cull_pattern_2))
partition_list = PartitionList(List=sort_list_3.ValuesValuesA, Size=member_index.Count)  # -> simplify(Chunks)
curve_6 = Curve(partition_list)
tree_branch = TreeBranch(Tree=partition_list, Path=series, MaintainPaths=True)
tree_branch_2 = TreeBranch(Tree=point, Path=series, MaintainPaths=True)
graft_tree = GraftTree(Tree=sort_list.ValuesA, IncludeEmptyLists=True, IncludeNullItems=True)  # -> simplify(Tree)
extrude = Extrude(Base=curve_6, Direction=unit_z)
extrude_2 = Extrude(Base=graft_tree, Direction=unit_z)
cap_holes = CapHoles(Brep=extrude_2)
custom_preview = CustomPreview(Geometry=[extrude, cap_holes], Material=ColourSwatch(SwatchColor=RGBA(255, 255, 255, 5)))
curve_7 = Curve(tree_branch)
point_2 = Point(tree_branch_2)
panel_2 = Panel("C:\Users\Job de Vogel\OneDrive\Bureaublad\excel_test.xlsx")  # disabled
boolean_toggle = BooleanToggle(False)  # disabled
list_length = ListLength(List=point_2)
curve_8 = Curve(<curve referenced from the Rhino model>)
excel_reader = ExcelReader(ReadExcelData=boolean_toggle, WorkbookPath=panel_2, WorksheetName="Sheet1")  # -> Exceptions, ExcelData; disabled
list_length_2 = ListLength(List=curve_7)
graft_tree_2 = GraftTree(Tree=point_2, IncludeEmptyLists=True, IncludeNullItems=True)  # -> simplify(Tree)
duplicate_data = DuplicateData(Data=curve_7, Number=list_length, Order=True)
divide_length = DivideLength(Curve=curve_8, Length=Slider(3.8, range=0..10))  # -> Points, Tangents, Parameters
partition_list_2 = PartitionList(List=duplicate_data, Size=list_length_2)  # -> simplify(Chunks)
construct_domain = ConstructDomain(DomainStart=1, DomainEnd=49)  # disabled
data_recorder = DataRecorder(excel_reader.ExcelData, DataLimit=-10, RecordData=True)  # disabled
curve_closest_point = CurveClosestPoint(Point=graft_tree_2, Curve=partition_list_2)  # -> Point, Parameter, Distance
smaller_than = SmallerThan(FirstNumber=curve_closest_point.Distance, SecondNumber=0.1)  # -> SmallerThan, OrEqualTo
sub_list = SubList(List=data_recorder, Domain=construct_domain, Wrap=True)  # -> List, Index; disabled
explode_tree = ExplodeTree(Data=sub_list.List)  # -> Branch0, Branch1, Branch2, Branch3, Branch4, Branch5, Branch6; disabled
mass_addition = MassAddition(Input=smaller_than.SmallerThan)  # -> Result, PartialResults
text_split = TextSplit(Text=explode_tree.Branch1, Separators=",")  # disabled
text_split_2 = TextSplit(Text=explode_tree.Branch2, Separators=",")  # disabled
text_split_3 = TextSplit(Text=explode_tree.Branch3, Separators=",")  # disabled
multiplication = Multiplication(A=explode_tree.Branch0, B=24)  # disabled
text_split_4 = TextSplit(Text=explode_tree.Branch4, Separators=",")  # disabled
text_split_5 = TextSplit(Text=explode_tree.Branch5, Separators=";")  # disabled
boolean = Boolean(mass_addition.Result)
list_item = ListItem(List=point_2, Index=0, Wrap=True)  # -> Item, Item1
trim_tree = TrimTree(Tree=boolean, Depth=1)
distance = Distance(PointA=list_item.Item, PointB=list_item.Item1)
text_split_6 = TextSplit(Text=text_split_5, Separators=",")  # disabled
cull_pattern_3 = CullPattern(List=point_2, CullPattern=invert(trim_tree))  # -> simplify(List)
list_item_2 = ListItem(List=flatten(distance), Index=0, Wrap=True)
number = Number(distance)
number_2 = Number(distance)
square = Square(Value=list_item_2)
square_2 = Square(Value=number)
square_3 = Square(Value=number_2)
xy_plane_2 = XYPlane(Origin=Point(0, 0, 0))
addition = Addition(A=square_2, B=square_3)
panel_3 = Panel(square)
square_root = SquareRoot(Value=addition)
proximity_2d = Proximity2D(Points=cull_pattern_3, Plane=xy_plane_2, Group=Slider(8, range=0..10), MaxRadius=expr("x+0.001", square_root))  # -> simplify(Links), Topology
trim_tree_2 = TrimTree(Tree=proximity_2d.Links, Depth=1)
list_length_3 = ListLength(List=trim_tree_2)
list_length_4 = ListLength(List=proximity_2d.Links)
duplicate_data_2 = DuplicateData(Data=curve_7, Number=list_length_3, Order=True)
list_length_5 = ListLength(List=curve_7)
shift_paths = ShiftPaths(Data=list_length_4, Offset=-1)
graft_tree_3 = GraftTree(Tree=trim_tree_2, IncludeEmptyLists=True, IncludeNullItems=True)
partition_list_3 = PartitionList(List=duplicate_data_2, Size=list_length_5)  # -> simplify(Chunks)
curve_curve = CurveCurve(CurveA=graft_tree_3, CurveB=partition_list_3, UseTasks=False)  # -> Points, ParamsA, ParamsB
list_length_6 = ListLength(List=curve_curve.Points)
trim_tree_3 = TrimTree(Tree=list_length_6, Depth=1)
mass_addition_2 = MassAddition(Input=trim_tree_3)  # -> simplify(Result), PartialResults
larger_than_3 = LargerThan(FirstNumber=mass_addition_2.Result, SecondNumber=0)  # -> LargerThan, OrEqualTo
trim_tree_4 = TrimTree(Tree=larger_than_3.LargerThan, Depth=1)  # -> simplify(Tree)
partition_list_4 = PartitionList(List=trim_tree_4, Size=shift_paths)  # -> simplify(Chunks)
cull_pattern_4 = CullPattern(List=proximity_2d.Links, CullPattern=invert(partition_list_4))  # -> simplify(List)
cull_pattern_5 = CullPattern(List=proximity_2d.Topology, CullPattern=invert(partition_list_4))  # -> simplify(List)
point_3 = Point(cull_pattern_3)
length_2 = Length(Curve=cull_pattern_4)
custom_preview_2 = CustomPreview(Geometry=cull_pattern_4, Material=ColourSwatch(SwatchColor=RGBA(255, 255, 255, 0)))

# ---- group: Vertical Connections
point_4 = Point(point_3)
curve_9 = Curve(graft([<curve referenced from the Rhino model> x3]))
tree_statistics = TreeStatistics(Tree=curve_9)  # -> Paths, Length, Count
curve_closest_point_2 = CurveClosestPoint(Point=flatten(point_4), Curve=simplify(curve_9))  # -> Point, Parameter, Distance
list_length_7 = ListLength(List=point_4)  # -> flatten(Length)
duplicate_data_3 = DuplicateData(Data=flatten(point_4), Number=tree_statistics.Count, Order=True)
tree_statistics_2 = TreeStatistics(Tree=point_4)  # -> Paths, Length, Count
mass_addition_3 = MassAddition(Input=tree_statistics_2.Length)  # -> Result, PartialResults
partition_list_5 = PartitionList(List=curve_closest_point_2.Distance, Size=list_length_7)
panel_4 = Panel("""Per curve
per level""")
partition_list_6 = PartitionList(List=duplicate_data_3, Size=mass_addition_3.Result)  # -> simplify(Chunks)
list_length_8 = ListLength(List=partition_list_5)
series_2 = Series(Start=0, Step=1, Count=list_length_8)  # -> simplify(Series)
partition_list_7 = PartitionList(List=partition_list_6, Size=tree_statistics_2.Length)  # -> simplify(Chunks)
sort_list_4 = SortList(Keys=partition_list_5, ValuesValuesA=series_2)  # -> Keys, ValuesValuesA
list_item_3 = ListItem(List=sort_list_4.Keys, Index=0, Wrap=True)
smaller_than_2 = SmallerThan(FirstNumber=list_item_3, SecondNumber=number)  # -> SmallerThan, OrEqualTo
list_item_4 = ListItem(List=sort_list_4.ValuesValuesA, Index=0, Wrap=True)
cull_pattern_6 = CullPattern(List=list_item_4, CullPattern=smaller_than_2.SmallerThan)
list_item_5 = ListItem(List=partition_list_7, Index=cull_pattern_6, Wrap=True)
trim_tree_5 = TrimTree(Tree=list_item_5, Depth=1)
panel_5 = Panel("Points")
panel_6 = Panel("Indices per level!")
trim_tree_6 = TrimTree(Tree=cull_pattern_6, Depth=1)
point_5 = Point(trim_tree_5)
integer = Integer(trim_tree_6)
polyline = PolyLine(Vertices=point_5, Closed=False)

# ----
integer_2 = Integer(cull_pattern_5)
number_3 = Number(length_2)

# ---- group: Neighbour Relations
ghpython_script = GhPythonScript(Indices=integer_2, Distances=number_3)  # -> simplify(parent_idxs), neighbour_dict; inputs Indices: tree, Distances: tree
# ---------- ghpython_script: Python ----------
"""Provides a scripting component.
    Inputs:
        Indices: Initial indices of the neighbours per point per floor
        Distances: Euclidian distances to neighbours
    Output:
        parent_idxs: Remapped indices of parent points
        neighbour_dict: Dictionary with all neighbour relations per parent"""

__author__ = "Job de Vogel"
__version__ = "2022.05.30"

from ghpythonlib import treehelpers
from Rhino.Geometry import Line
import random

indices = treehelpers.tree_to_list(Indices, False)
distances = treehelpers.tree_to_list(Distances, False)

parent_idxs = []
nb = {}

index_shift = 0
for f, (floor_idxs, floor_dis) in enumerate(zip(indices, distances)):
    parent_idxs.append([])
    nb[f] = {}
    for i, (neighbours, distance) in enumerate(zip(floor_idxs, floor_dis)):
        neighbours = [neighbor + index_shift for neighbor in neighbours]
        
        parent_idxs[f].append(i + index_shift)

        nb[f][i + index_shift] = dict(zip(neighbours, distance))
    
    index_shift += len(indices[f])

parent_idxs = treehelpers.list_to_tree(parent_idxs)
neighbour_dict = list(nb.values())
print(neighbour_dict[0])
# ---------- end ghpython_script ----------

# ----
flatten_tree = FlattenTree(Tree=point_3, Path="{0}")
suirify = Suirify(ghpython_script.neighbour_dict)
point_6 = Point(graft([<point referenced from the Rhino model> x602]))
point_7 = Point([<point referenced from the Rhino model> x3])
integer_3 = Integer(flatten(ghpython_script.parent_idxs))
duplicate_data_4 = DuplicateData(Data=flatten(integer_3), Number=tree_statistics.Count, Order=True)
closest_point = ClosestPoint(Point=point_7, Cloud=flatten_tree)  # -> ClosestPoint, CPIndex, Distance
closest_point_2 = ClosestPoint(Point=point_6, Cloud=flatten_tree)  # -> ClosestPoint, CPIndex, Distance
partition_list_8 = PartitionList(List=duplicate_data_4, Size=mass_addition_3.Result)  # -> simplify(Chunks)
longest_list = LongestList(ListListA=closest_point_2.CPIndex, ListListB=closest_point.CPIndex, PaddingMode=2)  # -> flatten(ListListA), flatten(ListListB)
partition_list_9 = PartitionList(List=partition_list_8, Size=tree_statistics_2.Length)  # -> simplify(Chunks)
manhattandistance = BooleanToggle(False)
list_length_9 = ListLength(List=flatten_tree)
parallel = BooleanToggle(True)
list_item_6 = ListItem(List=partition_list_9, Index=cull_pattern_6, Wrap=True)
trim_tree_7 = TrimTree(Tree=list_item_6, Depth=1)
panel_7 = Panel("""Real indices!
Per curve""")
integer_4 = Integer(trim_tree_7)
# Elevator cost not implemented yet. May be interesting for stairs.
ghpython_script_2 = GhPythonScript(neighbour_dict=suirify, vertical_connections=integer_4)  # -> building_neighbours; inputs neighbour_dict: list, vertical_connections: tree
# ---------- ghpython_script_2: Python ----------
__author__ = "Job de Vogel"
__version__ = "2022.05.31"
        
from ghpythonlib import treehelpers as th
import itertools
        
#print(neighbour_dict[0][47])
        
building_dict = {}
        
for dict in neighbour_dict:
    building_dict.update(dict)
        
#print(building_dict[47])
#  {36: 7.8567420131838537, 37: 5.55555555555555, 38: 7.8567420131838581, 46: 5.55555555555555, 48: 5.5555555555555571}
""" """
        
vertical_connections = th.tree_to_list(vertical_connections, False)
        
for vertical in vertical_connections:
    for i in vertical:
        temp_neighbours = vertical[:]
        temp_neighbours.remove(i)
        
        temp_dict = {}
        for neigh in temp_neighbours:
            temp_dict[neigh] = 0
        
        building_dict[i] = {k:v for d in (building_dict[i],temp_dict) for k,v in d.items()}

# Convert Building Dict to Grasshopper output
temp = {}
temp[0] = building_dict

building_neighbours = list(temp.values())
# ---------- end ghpython_script_2 ----------
astar_algorithm_fast = GhPythonScript(
    StartIndex=longest_list.ListListA,
    GoalIndex=longest_list.ListListB,
    points=flatten_tree,
    parent_idxs=flatten(ghpython_script.parent_idxs),
    neighbour_dict=ghpython_script_2,
    cloud_size=list_length_9,
    manhattanDistance=manhattandistance,
    Parallel=parallel)  # -> result; inputs StartIndex: list of Int32, GoalIndex: list of Int32, points: list of Point3d, parent_idxs: list, cloud_size: Int32, Cull_Data: list of Int32, manhattanDistance: Boolean, Parallel: Boolean
# ---------- astar_algorithm_fast: Python ----------
__author__copy = "Job de Vogel"
__version__ = "2020.11.06"
# Updated on 2022.05.31

from math import sqrt
import array as array
import random

def manhattan(index_1, index_2):
    point_1_coord = points[index_1]
    point_2_coord = points[index_2]
    
    return sum(abs(val1-val2) for val1, val2 in zip(point_1_coord, point_2_coord))

def euclidean(index_1, index_2):
    point_1_coord = points[index_1]
    point_2_coord = points[index_2]
    
    squares = [(p-q) ** 2 for p, q in zip(point_1_coord, point_2_coord)]
    return sum(squares) ** .5

def astar(Start, Goal, manhattanDistance = True):
    ###variables:
    open_set = []
    open_set.append((0, Start))
    came_from = {}
    path = array.array('i', [])

    g_score = {index: float("inf") for index in range(cloud_size)}
    g_score[Start] = 0

    f_score = {index: float("inf") for index in range(cloud_size)}
    
    
    if manhattanDistance:
        f_score[Start] = manhattan(Start, Goal)
    else:
        f_score[Start] = euclidean(Start, Goal)

    closed_set = {Start}

    iterations = 1

    #Algorithm function:
    while open_set:
        current = open_set[0][1]
        closed_set.remove(current)

        if current == Goal:
            #rebuild the path:
            while current != Start:
                    try:
                        path.insert(0, current)
                        current = came_from[current]
                    except KeyError:
                        path = False
                        break
            path.insert(0, Start)
            break

        #f_score_temp stores the f_scores of the neighbors of this node, so that it can be shuffled before it is added to the open_set
        f_score_temp = []

        Neighbors = neighbour_dict[current]

        #Calculate f_score for all neighbors
        for neighbor in Neighbors:
            temp_g_score = g_score[current] + Neighbors[neighbor]
            if temp_g_score < g_score[neighbor]:
                came_from[neighbor] = current
                g_score[neighbor] = temp_g_score
                
                if manhattanDistance:
                    f_score[neighbor] = temp_g_score + manhattan(neighbor, Goal)
                else:
                    f_score[neighbor] = temp_g_score + euclidean(neighbor, Goal) 

                if neighbor not in closed_set:
                    f_score_temp.append((f_score[neighbor], neighbor))
                    closed_set.add(neighbor)

        #shuffle the neighors and their f_scores (this will give alternative paths)
        if not Parallel:
            random.seed(random.random())
        random.shuffle(f_score_temp)
       
        open_set = open_set + f_score_temp
        
        #sort open_set based on f_score
        open_set.pop(0)
        open_set = sorted(open_set, key = lambda f: f[0])
        iterations += 1
    return path

def main(i):
    #Check if there are multiple starts/goals, if not use a single value
    if len(StartIndex) > 1:
        Start = StartIndex[i]
    else:
        Start = StartIndex[0]

    if len(GoalIndex) > 1:
        Goal = GoalIndex[i]
    else:
        Goal = GoalIndex[0]
    
    #In fast version of Astar, Start automatically gets added withoud checking Cull_Data, therefore do it manually here
    if Start in Cull_Data:
        Start = None

    #If goal isn't checked in Cull_Data, it is calculated, while a path is not possible
    if Goal in Cull_Data:
        Goal = None

    #Try to find a path, if not possible, return empty list
    try:
        path = astar(Start, Goal, manhattanDistance)
    except:
        path = None
    return path

##Find the number of paths to find
number_of_paths = [j for j in range(max(len(StartIndex), len(GoalIndex)))]

import ghpythonlib.parallel as parallel
import ghpythonlib.treehelpers as th

##ADD A NON-PARALLEL OPTION HERE
if Parallel == True:
    result = th.list_to_tree(parallel.run(main, number_of_paths, False))
else:
    result = []
    for i in number_of_paths:
        result.append(main(i))
    result = th.list_to_tree(result)
# ---------- end astar_algorithm_fast ----------
list_item_7 = ListItem(List=flatten(point_3), Index=astar_algorithm_fast, Wrap=True)  # -> simplify(Item)
polyline_2 = PolyLine(Vertices=list_item_7, Closed=False)
tree_statistics_3 = TreeStatistics(Tree=list_item_7)  # -> Paths, Length, Count
partition_list_10 = PartitionList(List=flatten(polyline_2), Size=Slider(3, range=0..10))
clean_tree = CleanTree(RemoveNulls=True, RemoveInvalid=True, RemoveEmpty=False, Tree=partition_list_10)
random = Random(Range=Domain(0, 255), Number=tree_statistics_3.Count, Seed=Slider(1, range=0..3))
length_3 = Length(Curve=partition_list_10)
partition_list_11 = PartitionList(List=random, Size=3)
list_length_10 = ListLength(List=clean_tree)  # -> flatten(Length)
sort_list_5 = SortList(Keys=length_3, ValuesValuesA=partition_list_10)  # -> Keys, ValuesValuesA
list_item_8 = ListItem(List=partition_list_11, Index=0, Wrap=True)  # -> Item, Item1, Item2
equality = Equality(FirstNumber=list_length_10, SecondNumber=0)  # -> Equality, Inequality
colour_rgb = ColourRGB(Alpha=255, Red=list_item_8.Item, Green=0, Blue=list_item_8.Item2)  # -> simplify(Colour)
list_item_9 = ListItem(List=sort_list_5.ValuesValuesA, Index=0, Wrap=True)
cull_pattern_7 = CullPattern(List=flatten(point_6), CullPattern=equality.Equality)
end_points = EndPoints(Curve=list_item_9)  # -> simplify(Start), simplify(End)
stream_filter = StreamFilter(Gate=Toggle(False), Stream0=list_item_9, Stream1=partition_list_10)
point_8 = Point(cull_pattern_7)
pipe = Pipe(Curve=stream_filter, Radius=0.2, Caps=1)  # -> simplify(Pipe); disabled

# ---- group: All Route Lengths
number_4 = Number(flatten(length_3))

# ---- group: Shortest Routes
custom_preview_3 = CustomPreview(Geometry=stream_filter, Material=colour_rgb)

# ----
flatten_tree_2 = FlattenTree(Tree=stream_filter, Path="{0}")  # disabled

# ---- group: All Routes
curve_10 = Curve(simplify(partition_list_10))

# ----
curve_11 = Curve(<curve referenced from the Rhino model>)  # disabled
sort_list_6 = SortList(Keys=number_4)  # -> reverse(Keys), ValuesValuesA
number_slider_2 = Slider(159, range=0..300)  # disabled
time = ControlKnob(Decimals=0, Limit=True, Maximum=300, Minimum=0, Range=300, Value=0)  # disabled
flip_curve = FlipCurve(Curve=flatten_tree_2, Guide=curve_11)  # -> Curve, Flag; disabled
list_item_10 = ListItem(List=sort_list_6.Keys, Index=0, Wrap=True)
longest_route_distance = Panel(list_item_10)
length_4 = Length(Curve=flip_curve.Curve)  # disabled
remap_numbers = RemapNumbers(Value=number_slider_2, Source=length_4, Target=Domain(0, 1))  # -> Mapped, Clipped; disabled
evaluate_curve = EvaluateCurve(Curve=reparameterize(flip_curve.Curve), Parameter=remap_numbers.Mapped)  # -> Point, Tangent, Angle; disabled
closest_point_3 = ClosestPoint(Point=evaluate_curve.Point, Cloud=flatten(point_3))  # -> ClosestPoint, CPIndex, Distance; disabled
list_length_11 = ListLength(List=closest_point_3.CPIndex)  # disabled
member_index_2 = MemberIndex(Set=closest_point_3.CPIndex, Member=closest_point_3.CPIndex)  # -> Index, Count; disabled
series_3 = Series(Start=0, Step=1, Count=list_length_11)  # disabled
sort_list_7 = SortList(Keys=member_index_2.Count, ValuesA=series_3)  # -> reverse(Keys), reverse(ValuesA); disabled
list_item_11 = ListItem(List=sort_list_7.ValuesA, Index=0, Wrap=True)  # disabled
list_item_12 = ListItem(List=sort_list_7.Keys, Index=0, Wrap=True)  # disabled
mesh_sphere = MeshSphere(Base=evaluate_curve.Point, Radius=0.5, UCount=10, VCount=20)  # disabled
list_item_13 = ListItem(List=evaluate_curve.Point, Index=list_item_11, Wrap=True)  # disabled
gradient = Gradient(
    LowerLimit=0,
    UpperLimit=list_item_12,
    Parameter=member_index_2.Count,
    stops=[0: RGB(0, 128, 0), 0.5: RGB(255, 255, 0), 1: RGB(255, 0, 0)])  # disabled
point_9 = Point(list_item_13)  # disabled
custom_preview_4 = CustomPreview(Geometry=mesh_sphere, Material=gradient)  # disabled
division = Division(A=list_item_12, B=square)  # disabled
panel_8 = Panel(gradient)  # disabled
amount_of_people_per_square_meter = Panel(division)  # disabled
