# Grasshopper definition Core_Structure.gh (Grasshopper 1.0.7)
# Copyright: Job de Vogel

# ---- group: SMALL TOWER
balcony_depth = Slider(1.8, range=0..10)
# DESIGN PARAMETERS
shell_offset = Slider(1.8, range=0..10)

levels = Slider(10, range=0..30)
levels_per_level = Slider(3, range=0..10)
level_height = Slider(3.8, range=0..10)
grid_size = Slider(7.2, range=0..10)
core_x_distance = Slider(10, range=0..100)
# OUTER CORE POSITION ->
core_y_distance = Slider(10, range=0..100)
core_x_size = Slider(15, range=0..100)
core_y_size = Slider(15, range=0..100)

# ----
# STRUCTURAL PARAMETERS
core_corner = Slider(0, range=0..3)
x_size_small_core = Slider(9, range=0..15)
y_size_small_core = Slider(10, range=0..15)
core_split_level = Slider(14, range=0..30)
truss_x_grid_distance = Slider(7.2, range=0..10)
truss_1_height = Slider(22, range=0..30)
truss_2_height = Slider(16, range=0..30)
truss_height = Slider(4.2, range=0..8.4)
truss_count_center = Slider(3, range=0..10)
# README: For the facade truss extensions, paramaters can be found in script, depending on control level choose grafted list or just in X and Y direction.
truss_count_endings = Slider(2, range=0..10)

# ---- group: LARGE TOWER
balcony_depth_2 = Slider(1.8, range=0..10)
# DESIGN PARAMETERS
shell_offset_2 = Slider(1.8, range=0..10)

levels_2 = Slider(13, range=0..30)
levels_per_level_2 = Slider(3, range=0..10)
level_height_2 = Slider(3.8, range=0..10)
grid_size_2 = Slider(7.2, range=0..10)
core_x_distance_2 = Slider(10, range=0..100)
# OUTER CORE POSITION ->
core_y_distance_2 = Slider(10, range=0..100)
core_x_size_2 = Slider(15, range=0..100)
core_y_size_2 = Slider(15, range=0..100)

# ----
balcony_type = BooleanToggle(False)
# STRUCTURAL PARAMETERS
core_corner_2 = Slider(0, range=0..3)
x_size_small_core_2 = Slider(9, range=0..15)
y_size_small_core_2 = Slider(10, range=0..15)
core_split_level_2 = Slider(14, range=0..30)
truss_x_grid_distance_2 = Slider(7.2, range=0..10)
truss_1_height_2 = Slider(22, range=0..30)
truss_2_height_2 = Slider(16, range=0..30)
truss_height_2 = Slider(4.2, range=0..8.4)
truss_count_center_2 = Slider(3, range=0..10)
# README: For the facade truss extensions, paramaters can be found in script, depending on control level choose grafted list or just in X and Y direction.
truss_count_endings_2 = Slider(2, range=0..10)
balcony_type_2 = BooleanToggle(False)
# SMALL TOWER
curve = Curve(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)
# BIG TOWER
curve_2 = Curve(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)
ground_floor_rectangle = GetGeometry(curve, AtLeast=1, AtMost=1, DeleteInput=False, Filter=1073741828)
ground_floor_rectangle_2 = GetGeometry(curve_2, AtLeast=1, AtMost=1, DeleteInput=False, Filter=1073741828)

# ---- group: Move tower to origin
discontinuity = Discontinuity(Curve=ground_floor_rectangle, Level=1)  # -> Points, Parameters
list_item = ListItem(List=discontinuity.Points, Index=0, Wrap=True)  # -> Item, Item1
xy_plane = XYPlane(Origin=Point(0, 0, 0))
vector_2pt = Vector2Pt(PointA=xy_plane, PointB=list_item.Item, Unitize=False)  # -> Vector, Length
negative = Negative(Value=vector_2pt.Vector)
move = Move(Geometry=ground_floor_rectangle, Motion=negative)  # -> Geometry, Transform
discontinuity_2 = Discontinuity(Curve=move.Geometry, Level=1)  # -> Points, Parameters
list_item_2 = ListItem(List=discontinuity_2.Points, Index=0, Wrap=True)  # -> Item, Item1
vector_2pt_2 = Vector2Pt(PointA=list_item_2.Item, PointB=list_item_2.Item1, Unitize=False)  # -> Vector, Length
unit_x = UnitX(Factor=1)
unit_y = UnitY(Factor=1)
rotate_direction = RotateDirection(Geometry=move.Geometry, Center=Point(0, 0, 0), From=vector_2pt_2.Vector, To=unit_x)  # -> Geometry, Transform
discontinuity_3 = Discontinuity(Curve=rotate_direction.Geometry, Level=1)  # -> Points, Parameters
list_item_3 = ListItem(List=discontinuity_3.Points, Index=0, Wrap=True)
point = Point(list_item_3)
geometry = Geometry(rotate_direction.Geometry)

discontinuity_4 = Discontinuity(Curve=ground_floor_rectangle_2, Level=1)  # -> Points, Parameters
list_item_4 = ListItem(List=discontinuity_4.Points, Index=0, Wrap=True)  # -> Item, Item1
xy_plane_2 = XYPlane(Origin=Point(0, 0, 0))
vector_2pt_3 = Vector2Pt(PointA=xy_plane_2, PointB=list_item_4.Item, Unitize=False)  # -> Vector, Length
negative_2 = Negative(Value=vector_2pt_3.Vector)
move_2 = Move(Geometry=ground_floor_rectangle_2, Motion=negative_2)  # -> Geometry, Transform
discontinuity_5 = Discontinuity(Curve=move_2.Geometry, Level=1)  # -> Points, Parameters
list_item_5 = ListItem(List=discontinuity_5.Points, Index=0, Wrap=True)  # -> Item, Item1
vector_2pt_4 = Vector2Pt(PointA=list_item_5.Item, PointB=list_item_5.Item1, Unitize=False)  # -> Vector, Length
unit_x_2 = UnitX(Factor=1)
unit_y_2 = UnitY(Factor=1)
rotate_direction_2 = RotateDirection(Geometry=move_2.Geometry, Center=Point(0, 0, 0), From=vector_2pt_4.Vector, To=unit_x_2)  # -> Geometry, Transform
discontinuity_6 = Discontinuity(Curve=rotate_direction_2.Geometry, Level=1)  # -> Points, Parameters
list_item_6 = ListItem(List=discontinuity_6.Points, Index=0, Wrap=True)
point_2 = Point(list_item_6)
geometry_2 = Geometry(rotate_direction_2.Geometry)

# ---- group: Core Rectangle
number = Number(core_y_distance)
number_2 = Number(core_x_distance)
core_x_distance_3 = GetNumber(number_2, AtLeast=1, AtMost=1, Maximum=1.797693135e+308, Minimum=-1.797693135e+308)
core_y_distance_3 = GetNumber(number, AtLeast=1, AtMost=1, Maximum=1.797693135e+308, Minimum=-1.797693135e+308)
number_3 = Number(core_x_size)
number_4 = Number(core_y_size)
core_x_size_3 = GetNumber(number_3, AtLeast=1, AtMost=1, Maximum=1.797693135e+308, Minimum=-1.797693135e+308)
core_y_size_3 = GetNumber(number_4, AtLeast=1, AtMost=1, Maximum=1.797693135e+308, Minimum=-1.797693135e+308)
unit_y_3 = UnitY(Factor=core_y_distance_3)
unit_x_3 = UnitX(Factor=core_x_distance_3)
rectangle = Rectangle(Plane=PlaneXY(0, 0, 0), XSize=core_x_size_3, YSize=core_y_size_3, Radius=0)  # -> Rectangle, Length
addition = Addition(A=unit_x_3, B=unit_y_3)
use_core_boolean_toggle = BooleanToggle(True)
move_3 = Move(Geometry=rectangle.Rectangle, Motion=addition)  # -> Geometry, Transform
use_core_boolean_toggle_2 = GetBoolean(use_core_boolean_toggle, AtLeast=1, AtMost=1, FalseValue="False", TrueValue="True")
stream_filter = StreamFilter(Gate=use_core_boolean_toggle_2, Stream1=move_3.Geometry)

number_5 = Number(core_y_distance_2)
number_6 = Number(core_x_distance_2)
core_x_distance_4 = GetNumber(number_6, AtLeast=1, AtMost=1, Maximum=1.797693135e+308, Minimum=-1.797693135e+308)
core_y_distance_4 = GetNumber(number_5, AtLeast=1, AtMost=1, Maximum=1.797693135e+308, Minimum=-1.797693135e+308)
number_7 = Number(core_x_size_2)
number_8 = Number(core_y_size_2)
core_x_size_4 = GetNumber(number_7, AtLeast=1, AtMost=1, Maximum=1.797693135e+308, Minimum=-1.797693135e+308)
core_y_size_4 = GetNumber(number_8, AtLeast=1, AtMost=1, Maximum=1.797693135e+308, Minimum=-1.797693135e+308)
unit_y_4 = UnitY(Factor=core_y_distance_4)
unit_x_4 = UnitX(Factor=core_x_distance_4)
rectangle_2 = Rectangle(Plane=PlaneXY(0, 0, 0), XSize=core_x_size_4, YSize=core_y_size_4, Radius=0)  # -> Rectangle, Length
addition_2 = Addition(A=unit_x_4, B=unit_y_4)
use_core_boolean_toggle_3 = BooleanToggle(True)
move_4 = Move(Geometry=rectangle_2.Rectangle, Motion=addition_2)  # -> Geometry, Transform
use_core_boolean_toggle_4 = GetBoolean(use_core_boolean_toggle_3, AtLeast=1, AtMost=1, FalseValue="False", TrueValue="True")
stream_filter_2 = StreamFilter(Gate=use_core_boolean_toggle_4, Stream1=move_4.Geometry)

# ----
number_9 = Number(level_height)
number_10 = Number(level_height_2)
level_height_3 = GetNumber(number_9, AtLeast=1, AtMost=1, Maximum=1.797693135e+308, Minimum=-1.797693135e+308)

# ---- group: Rectangles
deconstuct_rectangle = DeconstuctRectangle(Rectangle=geometry)  # -> BasePlane, XInterval, YInterval
integer = Integer(levels)
number_11 = Number(balcony_depth)
integer_2 = Integer(levels_per_level)
balcony_depth_3 = GetNumber(number_11, AtLeast=1, AtMost=1, Maximum=1.797693135e+308, Minimum=-1.797693135e+308)
levels_per_level_3 = GetNumber(integer_2, AtLeast=1, AtMost=1, Maximum=1.797693135e+308, Minimum=-1.797693135e+308)
levels_3 = GetNumber(integer, AtLeast=1, AtMost=1, Maximum=1.797693135e+308, Minimum=-1.797693135e+308)
deconstruct_domain = DeconstructDomain(Domain=deconstuct_rectangle.XInterval)  # -> Start, End
deconstruct_domain_2 = DeconstructDomain(Domain=deconstuct_rectangle.YInterval)  # -> Start, End
series = Series(Start=0, Step=balcony_depth_3, Count=levels_3)
panel = Panel("3")
repeat_data = RepeatData(Data=levels_per_level_3, Length=levels_3)
absolute = Absolute(Value=deconstruct_domain.Start)
absolute_2 = Absolute(Value=deconstruct_domain_2.Start)
replace_items = ReplaceItems(List=repeat_data, Item=panel, Indices="0", Wrap=False)
addition_3 = Addition(A=absolute, B=deconstruct_domain.End)
addition_4 = Addition(A=absolute_2, B=deconstruct_domain_2.End)
stack_data = StackData(Data=series, Stack=replace_items)
xy_plane_3 = XYPlane(Origin=point)
subtraction = Subtraction(A=addition_3, B=stack_data)
subtraction_2 = Subtraction(A=addition_4, B=stack_data)
rectangle_3 = Rectangle(Plane=xy_plane_3, XSize=subtraction, YSize=subtraction_2, Radius=0)  # -> Rectangle, Length
list_length = ListLength(List=rectangle_3.Rectangle)
series_2 = Series(Start=level_height_3, Step=level_height_3, Count=list_length)
unit_z = UnitZ(Factor=series_2)
move_5 = Move(Geometry=xy_plane_3, Motion=unit_z)  # -> Geometry, Transform
move_6 = Move(Geometry=rectangle_3.Rectangle, Motion=unit_z)  # -> Geometry, Transform
plane = Plane(move_5.Geometry)
curve_3 = Curve(move_6.Geometry)

# ---- group: Floor Plan Check
number_12 = Number(grid_size)
grid_size_3 = GetNumber(number_12, AtLeast=1, AtMost=1, Maximum=1.797693135e+308, Minimum=-1.797693135e+308)
text = Text(addition_3)
text_2 = Text(addition_4)
number_13 = Number(text)
number_14 = Number(text_2)
modulus = Modulus(A=number_13, B=grid_size_3)
modulus_2 = Modulus(A=number_14, B=grid_size_3)
mass_addition = MassAddition(Input=[modulus_2, modulus])  # -> Result, PartialResults
larger_than = LargerThan(FirstNumber=mass_addition.Result, SecondNumber=0)  # -> LargerThan, OrEqualTo
stream_filter_3 = StreamFilter(
    Gate=larger_than.LargerThan,
    Stream0="Everything Okay",
    Stream1="WARNING: Ground Floor rectangle domain does not fit in grid size.")

# ----
level_height_4 = GetNumber(number_10, AtLeast=1, AtMost=1, Maximum=1.797693135e+308, Minimum=-1.797693135e+308)

# ---- group: Rectangles
deconstuct_rectangle_2 = DeconstuctRectangle(Rectangle=geometry_2)  # -> BasePlane, XInterval, YInterval
integer_3 = Integer(levels_2)
number_15 = Number(balcony_depth_2)
integer_4 = Integer(levels_per_level_2)
balcony_depth_4 = GetNumber(number_15, AtLeast=1, AtMost=1, Maximum=1.797693135e+308, Minimum=-1.797693135e+308)
levels_per_level_4 = GetNumber(integer_4, AtLeast=1, AtMost=1, Maximum=1.797693135e+308, Minimum=-1.797693135e+308)
levels_4 = GetNumber(integer_3, AtLeast=1, AtMost=1, Maximum=1.797693135e+308, Minimum=-1.797693135e+308)
deconstruct_domain_3 = DeconstructDomain(Domain=deconstuct_rectangle_2.XInterval)  # -> Start, End
deconstruct_domain_4 = DeconstructDomain(Domain=deconstuct_rectangle_2.YInterval)  # -> Start, End
series_3 = Series(Start=0, Step=balcony_depth_4, Count=levels_4)
panel_2 = Panel("3")
repeat_data_2 = RepeatData(Data=levels_per_level_4, Length=levels_4)
absolute_3 = Absolute(Value=deconstruct_domain_3.Start)
absolute_4 = Absolute(Value=deconstruct_domain_4.Start)
replace_items_2 = ReplaceItems(List=repeat_data_2, Item=panel_2, Indices="0", Wrap=False)
addition_5 = Addition(A=absolute_3, B=deconstruct_domain_3.End)
addition_6 = Addition(A=absolute_4, B=deconstruct_domain_4.End)
stack_data_2 = StackData(Data=series_3, Stack=replace_items_2)
xy_plane_4 = XYPlane(Origin=point_2)
subtraction_3 = Subtraction(A=addition_5, B=stack_data_2)
subtraction_4 = Subtraction(A=addition_6, B=stack_data_2)
rectangle_4 = Rectangle(Plane=xy_plane_4, XSize=subtraction_3, YSize=subtraction_4, Radius=0)  # -> Rectangle, Length
list_length_2 = ListLength(List=rectangle_4.Rectangle)
series_4 = Series(Start=level_height_4, Step=level_height_4, Count=list_length_2)
unit_z_2 = UnitZ(Factor=series_4)
move_7 = Move(Geometry=xy_plane_4, Motion=unit_z_2)  # -> Geometry, Transform
move_8 = Move(Geometry=rectangle_4.Rectangle, Motion=unit_z_2)  # -> Geometry, Transform
plane_2 = Plane(move_7.Geometry)
curve_4 = Curve(move_8.Geometry)

# ---- group: Floor Plan Check
number_16 = Number(grid_size_2)
grid_size_4 = GetNumber(number_16, AtLeast=1, AtMost=1, Maximum=1.797693135e+308, Minimum=-1.797693135e+308)
text_3 = Text(addition_5)
text_4 = Text(addition_6)
number_17 = Number(text_3)
number_18 = Number(text_4)
modulus_3 = Modulus(A=number_17, B=grid_size_4)
modulus_4 = Modulus(A=number_18, B=grid_size_4)
mass_addition_2 = MassAddition(Input=[modulus_4, modulus_3])  # -> Result, PartialResults
larger_than_2 = LargerThan(FirstNumber=mass_addition_2.Result, SecondNumber=0)  # -> LargerThan, OrEqualTo
stream_filter_4 = StreamFilter(
    Gate=larger_than_2.LargerThan,
    Stream0="Everything Okay",
    Stream1="WARNING: Ground Floor rectangle domain does not fit in grid size.")

# ---- group: RH_OUT:OUT
out = Panel(stream_filter_3)

out_2 = Panel(stream_filter_4)

# ---- group: General Information
area = Area(Geometry=curve_3)  # -> Area, Centroid
mass_addition_3 = MassAddition(Input=area.Area)  # -> Result, PartialResults

area_2 = Area(Geometry=curve_4)  # -> Area, Centroid
mass_addition_4 = MassAddition(Input=area_2.Area)  # -> Result, PartialResults

# ----
merge = Merge(Data1=simplify(flatten(geometry)), Data2=flatten(move_6.Geometry))  # -> simplify(graft(Result))
merge_2 = Merge(Data1=simplify(flatten(geometry_2)), Data2=flatten(move_8.Geometry))  # -> simplify(graft(Result))

# ---- group: General Information / RH_OUT:Area
area_3 = Panel(mass_addition_3.Result)

area_4 = Panel(mass_addition_4.Result)

# ---- group: Point Grid
deconstuct_rectangle_3 = DeconstuctRectangle(Rectangle=curve_3)  # -> BasePlane, XInterval, YInterval
deconstruct_domain_5 = DeconstructDomain(Domain=deconstuct_rectangle_3.XInterval)  # -> Start, End
deconstruct_domain_6 = DeconstructDomain(Domain=deconstuct_rectangle_3.YInterval)  # -> Start, End
absolute_5 = Absolute(Value=deconstruct_domain_5.Start)
absolute_6 = Absolute(Value=deconstruct_domain_6.Start)
addition_7 = Addition(A=absolute_5, B=deconstruct_domain_5.End)
addition_8 = Addition(A=absolute_6, B=deconstruct_domain_6.End)
text_5 = Text(addition_7)
text_6 = Text(addition_8)
grid_size_5 = Number(grid_size_3)
number_19 = Number(text_5)
number_20 = Number(text_6)
division = Division(A=number_19, B=grid_size_5)
division_2 = Division(A=number_20, B=grid_size_5)
round = Round(Number=division)  # -> Nearest, graft(Floor), Ceiling
round_2 = Round(Number=division_2)  # -> Nearest, graft(Floor), Ceiling
series_5 = Series(Start=0, Step=grid_size_5, Count=expr("x+1", round.Floor))
series_6 = Series(Start=0, Step=grid_size_5, Count=expr("x+1", round_2.Floor))
cross_reference = CrossReference(ListListA=series_5, ListListB=series_6, CrossMode=1)  # -> ListListA, ListListB
construct_point = ConstructPoint(XCoordinate=cross_reference.ListListA, YCoordinate=cross_reference.ListListB, ZCoordinate=0)  # -> simplify(Point)
move_9 = Move(Geometry=construct_point, Motion=graft(unit_z))  # -> simplify(Geometry), Transform

deconstuct_rectangle_4 = DeconstuctRectangle(Rectangle=curve_4)  # -> BasePlane, XInterval, YInterval
deconstruct_domain_7 = DeconstructDomain(Domain=deconstuct_rectangle_4.XInterval)  # -> Start, End
deconstruct_domain_8 = DeconstructDomain(Domain=deconstuct_rectangle_4.YInterval)  # -> Start, End
absolute_7 = Absolute(Value=deconstruct_domain_7.Start)
absolute_8 = Absolute(Value=deconstruct_domain_8.Start)
addition_9 = Addition(A=absolute_7, B=deconstruct_domain_7.End)
addition_10 = Addition(A=absolute_8, B=deconstruct_domain_8.End)
text_7 = Text(addition_9)
text_8 = Text(addition_10)
grid_size_6 = Number(grid_size_4)
number_21 = Number(text_7)
number_22 = Number(text_8)
division_3 = Division(A=number_21, B=grid_size_6)
division_4 = Division(A=number_22, B=grid_size_6)
round_3 = Round(Number=division_3)  # -> Nearest, graft(Floor), Ceiling
round_4 = Round(Number=division_4)  # -> Nearest, graft(Floor), Ceiling
series_7 = Series(Start=0, Step=grid_size_6, Count=expr("x+1", round_3.Floor))
series_8 = Series(Start=0, Step=grid_size_6, Count=expr("x+1", round_4.Floor))
cross_reference_2 = CrossReference(ListListA=series_7, ListListB=series_8, CrossMode=1)  # -> ListListA, ListListB
construct_point_2 = ConstructPoint(XCoordinate=cross_reference_2.ListListA, YCoordinate=cross_reference_2.ListListB, ZCoordinate=0)  # -> simplify(Point)
move_10 = Move(Geometry=construct_point_2, Motion=graft(unit_z_2))  # -> simplify(Geometry), Transform

# ----
level_height_5 = Number(level_height_3)
level_height_6 = Number(level_height_4)

# ---- group: Cores / Core Corner
integer_5 = Integer(core_corner)

integer_6 = Integer(core_corner_2)

# ---- group: Cores / X Size Small Core
number_23 = Number(x_size_small_core)

# ---- group: Cores / Y Size Small Core
number_24 = Number(y_size_small_core)

# ---- group: Cores / X Size Small Core
number_25 = Number(x_size_small_core_2)

# ---- group: Cores / Y Size Small Core
number_26 = Number(y_size_small_core_2)

# ---- group: Core Split Level
integer_7 = Integer(core_split_level)

integer_8 = Integer(core_split_level_2)

# ----
panel_3 = Panel("1 item: mesh core")

# ---- group: Truss Height
number_27 = Number(truss_height)

number_28 = Number(truss_height_2)

# ----
truss_1_height_3 = Number(truss_1_height)

# ---- group: Truss X Grid Distance
number_29 = Number(truss_x_grid_distance)

# ----
truss_1_height_4 = Number(truss_1_height_2)

# ---- group: Truss X Grid Distance
number_30 = Number(truss_x_grid_distance_2)

# ---- group: Truss 2 Height
number_31 = Number(truss_2_height)

number_32 = Number(truss_2_height_2)

# ----
facade_truss_y_width = Slider(8.1, range=0..10)
# TRUSS EXTENSION PARAMETERS
# README: If you need more control over the length of the facade trusses, just add some number sliders to the Data input. e.g. adding two sliders will give control over all sides individually.
facade_truss_x_width = Slider(6.9, range=0..10)
facade_truss_y_width_2 = Slider(8.1, range=0..10)
# TRUSS EXTENSION PARAMETERS
# README: If you need more control over the length of the facade trusses, just add some number sliders to the Data input. e.g. adding two sliders will give control over all sides individually.
facade_truss_x_width_2 = Slider(6.9, range=0..10)

width_1 = Slider(6.9, range=0..10)
width_2 = Slider(6.9, range=0..10)
width_3 = Slider(6.9, range=0..10)
width_4 = Slider(6.9, range=0..10)
width_5 = Slider(6.9, range=0..10)
width_6 = Slider(6.9, range=0..10)
width_7 = Slider(6.9, range=0..10)
width_8 = Slider(6.9, range=0..10)

width_1_2 = Slider(6.9, range=0..10)
width_2_2 = Slider(6.9, range=0..10)
width_3_2 = Slider(6.9, range=0..10)
width_4_2 = Slider(6.9, range=0..10)
width_5_2 = Slider(6.9, range=0..10)
width_6_2 = Slider(6.9, range=0..10)
width_7_2 = Slider(6.9, range=0..10)
width_8_2 = Slider(6.9, range=0..10)

merge_3 = Merge(Data1=width_1, Data2=width_2, Data3=width_3, Data4=width_4)
merge_4 = Merge(Data1=width_5, Data2=width_6, Data3=width_7, Data4=width_8)
merge_5 = Merge(Data1=width_1_2, Data2=width_2_2, Data3=width_3_2, Data4=width_4_2)
merge_6 = Merge(Data1=width_5_2, Data2=width_6_2, Data3=width_7_2, Data4=width_8_2)

# ---- group: Truss Count Center
integer_9 = Integer(truss_count_center)

integer_10 = Integer(truss_count_center_2)

# ----
entwine = Entwine(Branch00=merge_3, Branch01=merge_4, FlattenInputs=True)  # -> simplify(Result)
entwine_2 = Entwine(Branch00=merge_5, Branch01=merge_6, FlattenInputs=True)  # -> simplify(Result)
number_33 = Number(entwine)
number_34 = Number(entwine_2)

# ---- group: Truss Count Endings
integer_11 = Integer(truss_count_endings)

integer_12 = Integer(truss_count_endings_2)

# ----
multiplication = Multiplication(A=list_length, B=level_height_3)
curve_5 = Curve(stream_filter)
unit_z_3 = UnitZ(Factor=multiplication)
extrude = Extrude(Base=curve_5, Direction=unit_z_3)
brep_plane = BrepPlane(Brep=extrude, Plane=plane, UseTasks=False)  # -> Curves, Points
cap_holes = CapHoles(Brep=extrude)
surface = Surface(curve_3)
cluster = Cluster(geometry=extrude, transform=rotate_direction.Transform, transform_3=move.Transform)

merge_7 = Merge(Data1=move_3.Geometry, Data2=flatten(brep_plane.Curves))  # -> graft(Result)

# ---- group: General Information / RH_OUT:Height
height = Panel(multiplication)

# ---- group: Point Grid Core Extraction
point_in_brep = PointInBrep(Brep=cap_holes, Point=move_9.Geometry, Strict=False)
cull_pattern = CullPattern(List=move_9.Geometry, CullPattern=invert(point_in_brep))
cluster_2 = Cluster(geometry=cull_pattern, transform=rotate_direction.Transform, transform_3=move.Transform)

# ---- group: Columns
unit_z_4 = UnitZ(Factor=1)
negative_3 = Negative(Value=unit_z_4)
line_sdl = LineSDL(Start=cull_pattern, Direction=negative_3, Length=level_height_5)  # -> flatten(Line)
join_curves = JoinCurves(Curves=line_sdl, Preserve=False)
cluster_3 = Cluster(geometry=join_curves, transform=rotate_direction.Transform, transform_3=move.Transform)

# ---- group: Point Grid Core Extraction / RH_OUT:Points
point_3 = Point(cluster_2)

# ----
cluster_4 = Cluster(geometry=join_curves, transform=rotate_direction.Transform, transform_3=move.Transform)

# ---- group: Columns / RH_OUT:Columns
curve_6 = Curve(cluster_3)

# ----
curve_7 = Curve(merge_7)
discontinuity_7 = Discontinuity(Curve=curve_7, Level=1)  # -> Points, Parameters
list_item_7 = ListItem(List=flatten(curve_7), Index=0, Wrap=True)

# ---- group: RH_OUT:Core
geometry_3 = Geometry(cluster)

# ----
sort_along_curve = SortAlongCurve(Points=discontinuity_7.Points, Curve=list_item_7)  # -> Points, Indices
polyline = PolyLine(Vertices=sort_along_curve.Points, Closed=True)

multiplication_2 = Multiplication(A=list_length_2, B=level_height_4)
curve_8 = Curve(stream_filter_2)
unit_z_5 = UnitZ(Factor=multiplication_2)
extrude_2 = Extrude(Base=curve_8, Direction=unit_z_5)
brep_plane_2 = BrepPlane(Brep=extrude_2, Plane=plane_2, UseTasks=False)  # -> Curves, Points
cap_holes_2 = CapHoles(Brep=extrude_2)
surface_2 = Surface(curve_4)
cluster_5 = Cluster(geometry=extrude_2, transform=rotate_direction_2.Transform, transform_3=move_2.Transform)

merge_8 = Merge(Data1=move_4.Geometry, Data2=flatten(brep_plane_2.Curves))  # -> graft(Result)

# ---- group: General Information / RH_OUT:Height
height_2 = Panel(multiplication_2)

# ---- group: Point Grid Core Extraction
point_in_brep_2 = PointInBrep(Brep=cap_holes_2, Point=move_10.Geometry, Strict=False)
cull_pattern_2 = CullPattern(List=move_10.Geometry, CullPattern=invert(point_in_brep_2))
cluster_6 = Cluster(geometry=cull_pattern_2, transform=rotate_direction_2.Transform, transform_3=move_2.Transform)

# ---- group: Columns
unit_z_6 = UnitZ(Factor=1)
negative_4 = Negative(Value=unit_z_6)
line_sdl_2 = LineSDL(Start=cull_pattern_2, Direction=negative_4, Length=level_height_6)  # -> flatten(Line)
join_curves_2 = JoinCurves(Curves=line_sdl_2, Preserve=False)
cluster_7 = Cluster(geometry=join_curves_2, transform=rotate_direction_2.Transform, transform_3=move_2.Transform)

# ---- group: Point Grid Core Extraction / RH_OUT:Points
point_4 = Point(cluster_6)

# ----
cluster_8 = Cluster(geometry=join_curves_2, transform=rotate_direction_2.Transform, transform_3=move_2.Transform)

# ---- group: Columns / RH_OUT:Columns
curve_9 = Curve(cluster_7)

# ----
curve_10 = Curve(merge_8)
discontinuity_8 = Discontinuity(Curve=curve_10, Level=1)  # -> Points, Parameters
list_item_8 = ListItem(List=flatten(curve_10), Index=0, Wrap=True)

# ---- group: RH_OUT:Core
geometry_4 = Geometry(cluster_5)

# ----
sort_along_curve_2 = SortAlongCurve(Points=discontinuity_8.Points, Curve=list_item_8)  # -> Points, Indices
polyline_2 = PolyLine(Vertices=sort_along_curve_2.Points, Closed=True)

# ---- group: Shell
partition_list = PartitionList(List=curve_3, Size=replace_items)
number_35 = Number(shell_offset)
shell_offset_3 = GetNumber(number_35, AtLeast=1, AtMost=1, Maximum=1.797693135e+308, Minimum=-1.797693135e+308)
list_item_9 = ListItem(List=partition_list, Index=-1, Wrap=True)  # -> simplify(Item)
offset_curve = OffsetCurve(Curve=list_item_9, Distance=shell_offset_3, Corners=1)  # -> flatten(Curve)
loft = Loft(Curves=offset_curve, Options={Adjust=False, Closed=False, LoftEnds=0, LoftSimp=0, LoftType=0, Rebuild=10, Refit=0.01})
cluster_9 = Cluster(geometry=loft, transform=rotate_direction.Transform, transform_3=move.Transform)

# ---- group: Shell / RH_OUT:Outer Shell
geometry_5 = Geometry(cluster_9)

# ---- group: Balconies
cluster_10 = Cluster(geometry=curve_3, transform=rotate_direction.Transform, transform_3=move.Transform)
mesh_brep = MeshBrep(
    Brep=geometry_5,
    Settings={GridMaxCount=0, GridMinCount=16, JaggedSeams=False, MaxEdgeLength=0, MinEdgeLength=0.0001, MinTolerance=0, Refine=True, RefineAngle=0, RelativeTolerance=0.65, SimplePlanes=True, Tolerance=0})
number_36 = Number(balcony_depth)
mesh_plane = MeshPlane(Mesh=mesh_brep, Plane=cluster_10, UseTasks=False)  # -> simplify(Curves)
offset_curve_2 = OffsetCurve(Curve=cluster_10, Distance=flatten(number_36), Corners=1)
discontinuity_9 = Discontinuity(Curve=cluster_10, Level=1)  # -> simplify(Points), Parameters
discontinuity_10 = Discontinuity(Curve=mesh_plane, Level=1)  # -> simplify(Points), Parameters
merge_9 = Merge(Data1=graft(cluster_10), Data2=offset_curve_2)
closest_point = ClosestPoint(Point=discontinuity_9.Points, Cloud=discontinuity_10.Points)  # -> ClosestPoint, CPIndex, Distance
loft_2 = Loft(Curves=merge_9, Options={Adjust=False, Closed=False, LoftEnds=0, LoftSimp=0, LoftType=0, Rebuild=10, Refit=0.01})
clean_tree = CleanTree(RemoveNulls=True, RemoveInvalid=True, RemoveEmpty=False, Tree=closest_point.ClosestPoint)
tree_statistics = TreeStatistics(Tree=clean_tree)  # -> Paths, Length, Count
larger_than_3 = LargerThan(FirstNumber=tree_statistics.Length, SecondNumber=0)  # -> LargerThan, OrEqualTo
cull_pattern_3 = CullPattern(List=tree_statistics.Paths, CullPattern=larger_than_3.LargerThan)
tree_branch = TreeBranch(Tree=discontinuity_9.Points, Path=cull_pattern_3, MaintainPaths=True)
tree_branch_2 = TreeBranch(Tree=closest_point.ClosestPoint, Path=cull_pattern_3, MaintainPaths=True)
tree_branch_3 = TreeBranch(Tree=simplify(loft_2), Path=cull_pattern_3, MaintainPaths=True)  # -> flatten(Branch)
polyline_3 = PolyLine(Vertices=tree_branch_2, Closed=True)
polyline_4 = PolyLine(Vertices=tree_branch, Closed=True)
loft_3 = Loft(
    Curves=[polyline_3, polyline_4],
    Options={Adjust=False, Closed=False, LoftEnds=0, LoftSimp=0, LoftType=0, Rebuild=10, Refit=0.01})
boolean = Boolean(balcony_type)
balconies_bool = GetBoolean(boolean, AtLeast=1, AtMost=1, FalseValue="False", TrueValue="True")
stream_filter_5 = StreamFilter(Gate=balconies_bool, Stream0=flatten(loft_3), Stream1=tree_branch_3)

# ---- group: Shell (continued)
custom_preview = CustomPreview(Geometry=geometry_5, Material=ColourSwatch(SwatchColor=RGBA(255, 255, 255, 153)))

# ---- group: Anyoing part of the script that should have been avoided...
curve_11 = Curve(merge)
integer_13 = Integer(panel)
xy_plane_5 = XYPlane(Origin=Point(0, 0, 0))
merge_10 = Merge(Data1=xy_plane_5, Data2=plane)  # -> flatten(Result)
split_list = SplitList(List=flatten(curve_11), Index=integer_13)  # -> flatten(ListA), ListB
split_list_2 = SplitList(List=merge_10, Index=integer_13)  # -> ListA, ListB
brep_plane_3 = BrepPlane(Brep=loft, Plane=split_list_2.ListB, UseTasks=False)  # -> simplify(Curves), Points
merge_11 = Merge(Data1=split_list.ListA, Data2=flatten(brep_plane_3.Curves))  # -> graft(Result)

# ---- group: RH_OUT:Balconies
geometry_6 = Geometry(stream_filter_5)

# ---- group: Shell
partition_list_2 = PartitionList(List=curve_4, Size=replace_items_2)
number_37 = Number(shell_offset_2)
shell_offset_4 = GetNumber(number_37, AtLeast=1, AtMost=1, Maximum=1.797693135e+308, Minimum=-1.797693135e+308)
list_item_10 = ListItem(List=partition_list_2, Index=-1, Wrap=True)  # -> simplify(Item)
offset_curve_3 = OffsetCurve(Curve=list_item_10, Distance=shell_offset_4, Corners=1)  # -> flatten(Curve)
loft_4 = Loft(Curves=offset_curve_3, Options={Adjust=False, Closed=False, LoftEnds=0, LoftSimp=0, LoftType=0, Rebuild=10, Refit=0.01})
cluster_11 = Cluster(geometry=loft_4, transform=rotate_direction_2.Transform, transform_3=move_2.Transform)

# ---- group: Shell / RH_OUT:Outer Shell
geometry_7 = Geometry(cluster_11)

# ---- group: Balconies
cluster_12 = Cluster(geometry=curve_4, transform=rotate_direction_2.Transform, transform_3=move_2.Transform)
mesh_brep_2 = MeshBrep(
    Brep=geometry_7,
    Settings={GridMaxCount=0, GridMinCount=16, JaggedSeams=False, MaxEdgeLength=0, MinEdgeLength=0.0001, MinTolerance=0, Refine=True, RefineAngle=0, RelativeTolerance=0.65, SimplePlanes=True, Tolerance=0})
number_38 = Number(balcony_depth_2)
mesh_plane_2 = MeshPlane(Mesh=mesh_brep_2, Plane=cluster_12, UseTasks=False)  # -> simplify(Curves)
offset_curve_4 = OffsetCurve(Curve=cluster_12, Distance=flatten(number_38), Corners=1)
discontinuity_11 = Discontinuity(Curve=cluster_12, Level=1)  # -> simplify(Points), Parameters
discontinuity_12 = Discontinuity(Curve=mesh_plane_2, Level=1)  # -> simplify(Points), Parameters
merge_12 = Merge(Data1=graft(cluster_12), Data2=offset_curve_4)
closest_point_2 = ClosestPoint(Point=discontinuity_11.Points, Cloud=discontinuity_12.Points)  # -> ClosestPoint, CPIndex, Distance
loft_5 = Loft(Curves=merge_12, Options={Adjust=False, Closed=False, LoftEnds=0, LoftSimp=0, LoftType=0, Rebuild=10, Refit=0.01})
clean_tree_2 = CleanTree(RemoveNulls=True, RemoveInvalid=True, RemoveEmpty=False, Tree=closest_point_2.ClosestPoint)
tree_statistics_2 = TreeStatistics(Tree=clean_tree_2)  # -> Paths, Length, Count
larger_than_4 = LargerThan(FirstNumber=tree_statistics_2.Length, SecondNumber=0)  # -> LargerThan, OrEqualTo
cull_pattern_4 = CullPattern(List=tree_statistics_2.Paths, CullPattern=larger_than_4.LargerThan)
tree_branch_4 = TreeBranch(Tree=discontinuity_11.Points, Path=cull_pattern_4, MaintainPaths=True)
tree_branch_5 = TreeBranch(Tree=closest_point_2.ClosestPoint, Path=cull_pattern_4, MaintainPaths=True)
tree_branch_6 = TreeBranch(Tree=simplify(loft_5), Path=cull_pattern_4, MaintainPaths=True)  # -> flatten(Branch)
polyline_5 = PolyLine(Vertices=tree_branch_5, Closed=True)
polyline_6 = PolyLine(Vertices=tree_branch_4, Closed=True)
loft_6 = Loft(
    Curves=[polyline_5, polyline_6],
    Options={Adjust=False, Closed=False, LoftEnds=0, LoftSimp=0, LoftType=0, Rebuild=10, Refit=0.01})
boolean_2 = Boolean(balcony_type_2)
balconies_bool_2 = GetBoolean(boolean_2, AtLeast=1, AtMost=1, FalseValue="False", TrueValue="True")
stream_filter_6 = StreamFilter(Gate=balconies_bool_2, Stream0=flatten(loft_6), Stream1=tree_branch_6)

# ---- group: Shell (continued)
custom_preview_2 = CustomPreview(Geometry=geometry_7, Material=ColourSwatch(SwatchColor=RGBA(255, 255, 255, 153)))

# ---- group: Anyoing part of the script that should have been avoided...
curve_12 = Curve(merge_2)
integer_14 = Integer(panel_2)
xy_plane_6 = XYPlane(Origin=Point(0, 0, 0))
merge_13 = Merge(Data1=xy_plane_6, Data2=plane_2)  # -> flatten(Result)
split_list_3 = SplitList(List=flatten(curve_12), Index=integer_14)  # -> flatten(ListA), ListB
split_list_4 = SplitList(List=merge_13, Index=integer_14)  # -> ListA, ListB
brep_plane_4 = BrepPlane(Brep=loft_4, Plane=split_list_4.ListB, UseTasks=False)  # -> simplify(Curves), Points
merge_14 = Merge(Data1=split_list_3.ListA, Data2=flatten(brep_plane_4.Curves))  # -> graft(Result)

# ---- group: RH_OUT:Balconies
geometry_8 = Geometry(stream_filter_6)

# ----
custom_preview_3 = CustomPreview(Geometry=geometry_3, Material=ColourSwatch(SwatchColor=RGB(255, 255, 255)))

custom_preview_4 = CustomPreview(Geometry=geometry_4, Material=ColourSwatch(SwatchColor=RGB(255, 255, 255)))

# ---- group: Cores
list_item_11 = ListItem(List=sort_along_curve.Points, Index=integer_5, Wrap=True)  # -> Item1, Item, Item1_2, Item2
vector_2pt_5 = Vector2Pt(PointA=list_item_11.Item, PointB=list_item_11.Item1, Unitize=False)  # -> Vector, Length
vector_2pt_6 = Vector2Pt(PointA=list_item_11.Item, PointB=list_item_11.Item1_2, Unitize=False)  # -> Vector, Length
xy_plane_7 = XYPlane(Origin=list_item_11.Item)
amplitude = Amplitude(Vector=vector_2pt_5.Vector, Amplitude=number_23)  # -> simplify(Vector)
amplitude_2 = Amplitude(Vector=vector_2pt_6.Vector, Amplitude=number_24)  # -> simplify(Vector)
move_11 = Move(Geometry=list_item_11.Item, Motion=amplitude_2)  # -> Geometry, Transform
move_12 = Move(Geometry=list_item_11.Item, Motion=amplitude)  # -> Geometry, Transform
rectangle_2pt = Rectangle2Pt(Plane=xy_plane_7, PointA=move_12.Geometry, PointB=move_11.Geometry, Radius=0)  # -> flatten(Rectangle), Length
merge_15 = Merge(
    Data1=move_12.Geometry,
    Data2=list_item_11.Item1,
    Data3=list_item_11.Item2,
    Data4=list_item_11.Item1_2,
    Data5=move_11.Geometry)
polyline_7 = PolyLine(Vertices=merge_15, Closed=False)  # -> flatten(Polyline)
split_list_5 = SplitList(List=rectangle_2pt.Rectangle, Index=integer_7)  # -> ListA, ListB
split_list_6 = SplitList(List=polyline_7, Index=integer_7)  # -> ListA, ListB
curve_13 = Curve(rectangle_2pt.Rectangle)
curve_14 = Curve(split_list_6.ListA)
loft_7 = Loft(Curves=curve_13, Options={Adjust=False, Closed=False, LoftEnds=0, LoftSimp=0, LoftType=0, Rebuild=10, Refit=0.01})
loft_8 = Loft(Curves=curve_14, Options={Adjust=False, Closed=False, LoftEnds=0, LoftSimp=0, LoftType=0, Rebuild=10, Refit=0.01})

# ---- group: Core Corners
split_list_7 = SplitList(List=flatten(polyline), Index=integer_7)  # -> ListA, ListB
merge_16 = Merge(Data1=split_list_7.ListA, Data2=split_list_5.ListB)
deconstruct_brep = DeconstructBrep(Brep=merge_16)  # -> Faces, Edges, Vertices
shift_list = ShiftList(List=deconstruct_brep.Edges, Shift=1, Wrap=True)
end_points = EndPoints(Curve=deconstruct_brep.Edges)  # -> Start, End
plane_normal = PlaneNormal(Origin=end_points.Start, ZAxis=shift_list)  # -> simplify(Plane)
curve_plane = CurvePlane(Curve=merge_11, Plane=plane_normal)  # -> Points, ParamsC, ParamsP
discontinuity_13 = Discontinuity(Curve=merge_16, Level=1)  # -> simplify(Points), Parameters
trim_tree = TrimTree(Tree=curve_plane.Points, Depth=1)
closest_point_3 = ClosestPoint(Point=trim_tree, Cloud=discontinuity_13.Points)  # -> ClosestPoint, CPIndex, Distance

# ---- group: Cores / Small Core
geometry_9 = Geometry(loft_7)

# ---- group: Cores / Large Core
geometry_10 = Geometry(loft_8)

# ---- group: Cores (continued)
mesh_brep_3 = MeshBrep(
    Brep=geometry_9,
    Settings={GridMaxCount=0, GridMinCount=16, JaggedSeams=False, MaxEdgeLength=0, MinEdgeLength=0.0001, MinTolerance=0, Refine=True, RefineAngle=0, RelativeTolerance=0.65, SimplePlanes=True, Tolerance=0})
mesh_brep_4 = MeshBrep(
    Brep=geometry_10,
    Settings={GridMaxCount=0, GridMinCount=16, JaggedSeams=False, MaxEdgeLength=0, MinEdgeLength=0.0001, MinTolerance=0, Refine=True, RefineAngle=0, RelativeTolerance=0.65, SimplePlanes=True, Tolerance=0})
mesh_join = MeshJoin(Meshes=flatten([mesh_brep_3, mesh_brep_4]))

# ---- group: Combined Core
mesh = Mesh(mesh_join)

# ---- group: Core Rectangles
# 1 list: all rectangle sections of core
curve_15 = Curve(merge_16)

# ---- group: Outriggers
line = Line(StartPoint=closest_point_3.ClosestPoint, EndPoint=trim_tree)  # -> simplify(Line)
unit_z_7 = UnitZ(Factor=number_27)
tree_branch_7 = TreeBranch(Tree=line, Path=[truss_1_height_3, number_31], MaintainPaths=False)
negative_5 = Negative(Value=unit_z_7)
move_13 = Move(Geometry=tree_branch_7, Motion=negative_5)  # -> Geometry, Transform
end_points_2 = EndPoints(Curve=graft(tree_branch_7))  # -> Start, End
end_points_3 = EndPoints(Curve=graft(move_13.Geometry))  # -> Start, End
divide_distance = DivideDistance(Curve=tree_branch_7, Distance=number_29)  # -> Points, Tangents, Parameters
divide_distance_2 = DivideDistance(Curve=move_13.Geometry, Distance=number_29)  # -> Points, Tangents, Parameters
vector_2pt_7 = Vector2Pt(PointA=end_points_3.Start, PointB=end_points_3.End, Unitize=False)  # -> Vector, Length
mesh_brep_5 = MeshBrep(
    Brep=loft,
    Settings={GridMaxCount=0, GridMinCount=16, JaggedSeams=False, MaxEdgeLength=0, MinEdgeLength=0.0001, MinTolerance=0, Refine=True, RefineAngle=0, RelativeTolerance=0.65, SimplePlanes=True, Tolerance=0})
merge_17 = Merge(Data1=divide_distance.Points, Data2=end_points_2.End)
mesh_ray = MeshRay(Mesh=mesh_brep_5, Point=end_points_3.Start, Direction=vector_2pt_7.Vector)  # -> Point, Hit
merge_18 = Merge(Data1=divide_distance_2.Points, Data2=mesh_ray.Point)
shift_list_2 = ShiftList(List=merge_17, Shift=1, Wrap=False)  # -> simplify(List)
shift_list_3 = ShiftList(List=merge_18, Shift=1, Wrap=False)  # -> simplify(List)
line_2 = Line(StartPoint=end_points_3.Start, EndPoint=mesh_ray.Point)
shortest_list = ShortestList(ListListA=merge_17, ListListB=shift_list_3, TrimMode=2)  # -> ListListA, ListListB
shortest_list_2 = ShortestList(ListListA=shift_list_2, ListListB=merge_18, TrimMode=2)  # -> ListListA, ListListB
line_3 = Line(StartPoint=shortest_list_2.ListListA, EndPoint=shortest_list_2.ListListB)
line_4 = Line(StartPoint=shortest_list.ListListA, EndPoint=shortest_list.ListListB)
line_5 = Line(StartPoint=merge_17, EndPoint=merge_18)

# ---- group: Horizontal Top
curve_16 = Curve(graft(tree_branch_7))

# ---- group: Diagonal 2
curve_17 = Curve(line_4)

# ---- group: Horizontal Bottom
curve_18 = Curve(line_2)

# ---- group: Diagonal 1
# {1;*} indicating outrigger level
# 
# Subbranch indicating truss
# 
# Item indicating element
curve_19 = Curve(line_3)

# ---- group: Vertical
curve_20 = Curve(line_5)

# ----
surface_split = SurfaceSplit(Surface=graft(surface), Curves=graft(merge_16))  # -> simplify(Fragments)
list_item_12 = ListItem(List=surface_split, Index=0, Wrap=True)
cluster_13 = Cluster(geometry=list_item_12, transform=rotate_direction.Transform, transform_3=move.Transform)

# ---- group: RH_OUT:Floor Surfaces
surface_3 = Surface(cluster_13)

# ----
custom_preview_5 = CustomPreview(Geometry=surface_3, Material=ColourSwatch(SwatchColor=RGB(255, 255, 255)))

# ---- group: Cores
list_item_13 = ListItem(List=sort_along_curve_2.Points, Index=integer_6, Wrap=True)  # -> Item1, Item, Item1_2, Item2
vector_2pt_8 = Vector2Pt(PointA=list_item_13.Item, PointB=list_item_13.Item1, Unitize=False)  # -> Vector, Length
vector_2pt_9 = Vector2Pt(PointA=list_item_13.Item, PointB=list_item_13.Item1_2, Unitize=False)  # -> Vector, Length
xy_plane_8 = XYPlane(Origin=list_item_13.Item)
amplitude_3 = Amplitude(Vector=vector_2pt_8.Vector, Amplitude=number_25)  # -> simplify(Vector)
amplitude_4 = Amplitude(Vector=vector_2pt_9.Vector, Amplitude=number_26)  # -> simplify(Vector)
move_14 = Move(Geometry=list_item_13.Item, Motion=amplitude_4)  # -> Geometry, Transform
move_15 = Move(Geometry=list_item_13.Item, Motion=amplitude_3)  # -> Geometry, Transform
rectangle_2pt_2 = Rectangle2Pt(Plane=xy_plane_8, PointA=move_15.Geometry, PointB=move_14.Geometry, Radius=0)  # -> flatten(Rectangle), Length
merge_19 = Merge(
    Data1=move_15.Geometry,
    Data2=list_item_13.Item1,
    Data3=list_item_13.Item2,
    Data4=list_item_13.Item1_2,
    Data5=move_14.Geometry)
polyline_8 = PolyLine(Vertices=merge_19, Closed=False)  # -> flatten(Polyline)
split_list_8 = SplitList(List=rectangle_2pt_2.Rectangle, Index=integer_8)  # -> ListA, ListB
split_list_9 = SplitList(List=polyline_8, Index=integer_8)  # -> ListA, ListB
curve_21 = Curve(rectangle_2pt_2.Rectangle)
curve_22 = Curve(split_list_9.ListA)
loft_9 = Loft(Curves=curve_21, Options={Adjust=False, Closed=False, LoftEnds=0, LoftSimp=0, LoftType=0, Rebuild=10, Refit=0.01})
loft_10 = Loft(Curves=curve_22, Options={Adjust=False, Closed=False, LoftEnds=0, LoftSimp=0, LoftType=0, Rebuild=10, Refit=0.01})

# ---- group: Core Corners
split_list_10 = SplitList(List=flatten(polyline_2), Index=integer_8)  # -> ListA, ListB
merge_20 = Merge(Data1=split_list_10.ListA, Data2=split_list_8.ListB)
deconstruct_brep_2 = DeconstructBrep(Brep=merge_20)  # -> Faces, Edges, Vertices
shift_list_4 = ShiftList(List=deconstruct_brep_2.Edges, Shift=1, Wrap=True)
end_points_4 = EndPoints(Curve=deconstruct_brep_2.Edges)  # -> Start, End
plane_normal_2 = PlaneNormal(Origin=end_points_4.Start, ZAxis=shift_list_4)  # -> simplify(Plane)
curve_plane_2 = CurvePlane(Curve=merge_14, Plane=plane_normal_2)  # -> Points, ParamsC, ParamsP
discontinuity_14 = Discontinuity(Curve=merge_20, Level=1)  # -> simplify(Points), Parameters
trim_tree_2 = TrimTree(Tree=curve_plane_2.Points, Depth=1)
closest_point_4 = ClosestPoint(Point=trim_tree_2, Cloud=discontinuity_14.Points)  # -> ClosestPoint, CPIndex, Distance

# ---- group: Cores / Small Core
geometry_11 = Geometry(loft_9)

# ---- group: Cores / Large Core
geometry_12 = Geometry(loft_10)

# ---- group: Cores (continued)
mesh_brep_6 = MeshBrep(
    Brep=geometry_11,
    Settings={GridMaxCount=0, GridMinCount=16, JaggedSeams=False, MaxEdgeLength=0, MinEdgeLength=0.0001, MinTolerance=0, Refine=True, RefineAngle=0, RelativeTolerance=0.65, SimplePlanes=True, Tolerance=0})
mesh_brep_7 = MeshBrep(
    Brep=geometry_12,
    Settings={GridMaxCount=0, GridMinCount=16, JaggedSeams=False, MaxEdgeLength=0, MinEdgeLength=0.0001, MinTolerance=0, Refine=True, RefineAngle=0, RelativeTolerance=0.65, SimplePlanes=True, Tolerance=0})
mesh_join_2 = MeshJoin(Meshes=flatten([mesh_brep_6, mesh_brep_7]))

# ---- group: Combined Core
mesh_2 = Mesh(mesh_join_2)

# ---- group: Core Rectangles
# 1 list: all rectangle sections of core
curve_23 = Curve(merge_20)

# ---- group: Outriggers
line_6 = Line(StartPoint=closest_point_4.ClosestPoint, EndPoint=trim_tree_2)  # -> simplify(Line)
unit_z_8 = UnitZ(Factor=number_28)
tree_branch_8 = TreeBranch(Tree=line_6, Path=[truss_1_height_4, number_32], MaintainPaths=False)
negative_6 = Negative(Value=unit_z_8)
move_16 = Move(Geometry=tree_branch_8, Motion=negative_6)  # -> Geometry, Transform
end_points_5 = EndPoints(Curve=graft(tree_branch_8))  # -> Start, End
end_points_6 = EndPoints(Curve=graft(move_16.Geometry))  # -> Start, End
divide_distance_3 = DivideDistance(Curve=tree_branch_8, Distance=number_30)  # -> Points, Tangents, Parameters
divide_distance_4 = DivideDistance(Curve=move_16.Geometry, Distance=number_30)  # -> Points, Tangents, Parameters
vector_2pt_10 = Vector2Pt(PointA=end_points_6.Start, PointB=end_points_6.End, Unitize=False)  # -> Vector, Length
mesh_brep_8 = MeshBrep(
    Brep=loft_4,
    Settings={GridMaxCount=0, GridMinCount=16, JaggedSeams=False, MaxEdgeLength=0, MinEdgeLength=0.0001, MinTolerance=0, Refine=True, RefineAngle=0, RelativeTolerance=0.65, SimplePlanes=True, Tolerance=0})
merge_21 = Merge(Data1=divide_distance_3.Points, Data2=end_points_5.End)
mesh_ray_2 = MeshRay(Mesh=mesh_brep_8, Point=end_points_6.Start, Direction=vector_2pt_10.Vector)  # -> Point, Hit
merge_22 = Merge(Data1=divide_distance_4.Points, Data2=mesh_ray_2.Point)
shift_list_5 = ShiftList(List=merge_21, Shift=1, Wrap=False)  # -> simplify(List)
shift_list_6 = ShiftList(List=merge_22, Shift=1, Wrap=False)  # -> simplify(List)
line_7 = Line(StartPoint=end_points_6.Start, EndPoint=mesh_ray_2.Point)
shortest_list_3 = ShortestList(ListListA=merge_21, ListListB=shift_list_6, TrimMode=2)  # -> ListListA, ListListB
shortest_list_4 = ShortestList(ListListA=shift_list_5, ListListB=merge_22, TrimMode=2)  # -> ListListA, ListListB
line_8 = Line(StartPoint=shortest_list_4.ListListA, EndPoint=shortest_list_4.ListListB)
line_9 = Line(StartPoint=shortest_list_3.ListListA, EndPoint=shortest_list_3.ListListB)
line_10 = Line(StartPoint=merge_21, EndPoint=merge_22)

# ---- group: Horizontal Top
curve_24 = Curve(graft(tree_branch_8))

# ---- group: Diagonal 2
curve_25 = Curve(line_9)

# ---- group: Horizontal Bottom
curve_26 = Curve(line_7)

# ---- group: Diagonal 1
# {1;*} indicating outrigger level
# 
# Subbranch indicating truss
# 
# Item indicating element
curve_27 = Curve(line_8)

# ---- group: Vertical
curve_28 = Curve(line_10)

# ----
surface_split_2 = SurfaceSplit(Surface=graft(surface_2), Curves=graft(merge_20))  # -> simplify(Fragments)
list_item_14 = ListItem(List=surface_split_2, Index=0, Wrap=True)
cluster_14 = Cluster(geometry=list_item_14, transform=rotate_direction_2.Transform, transform_3=move_2.Transform)

# ---- group: RH_OUT:Floor Surfaces
surface_4 = Surface(cluster_14)

# ----
custom_preview_6 = CustomPreview(Geometry=surface_4, Material=ColourSwatch(SwatchColor=RGB(255, 255, 255)))

tree_branch_9 = TreeBranch(Tree=simplify(merge_11), Path=[truss_1_height_3, number_31], MaintainPaths=False)
trim_tree_3 = TrimTree(Tree=end_points_2.End, Depth=1)
curve_closest_point = CurveClosestPoint(Point=trim_tree_3, Curve=tree_branch_9)  # -> Point, Parameter, Distance
sort_list = SortList(Keys=curve_closest_point.Parameter, ValuesValuesA=curve_closest_point.Point)  # -> Keys, ValuesValuesA
dispatch = Dispatch(List=sort_list.ValuesValuesA, DispatchPattern=[True, False])  # -> ListA, ListB
line_11 = Line(StartPoint=dispatch.ListA, EndPoint=dispatch.ListB)
vector_2pt_11 = Vector2Pt(PointA=dispatch.ListA, PointB=dispatch.ListB, Unitize=False)  # -> Vector, Length
repeat_data_3 = RepeatData(Data=[facade_truss_x_width, facade_truss_y_width], Length=8)
negative_7 = Negative(Value=vector_2pt_11.Vector)
partition_list_3 = PartitionList(List=repeat_data_3, Size=4)
divide_curve = DivideCurve(Curve=line_11, Count=integer_9, Kinks=False)  # -> Points, Tangents, Parameters
shift_list_7 = ShiftList(List=divide_curve.Points, Shift=1, Wrap=False)  # -> simplify(List)

number_39 = Number(partition_list_3)

# ---- group: Facade Horizontal Bottom
curve_closest_point_2 = CurveClosestPoint(Point=trim_tree_3, Curve=tree_branch_9)  # -> Point, Parameter, Distance
trim_tree_4 = TrimTree(Tree=mesh_ray.Point, Depth=1)
sort_list_2 = SortList(Keys=curve_closest_point_2.Parameter, ValuesValuesA=trim_tree_4)  # -> Keys, ValuesValuesA
partition_list_4 = PartitionList(List=sort_list_2.ValuesValuesA, Size=2)
polyline_9 = PolyLine(Vertices=partition_list_4, Closed=False)
end_points_7 = EndPoints(Curve=polyline_9)  # -> Start, End
vector_2pt_12 = Vector2Pt(PointA=end_points_7.Start, PointB=end_points_7.End, Unitize=False)  # -> Vector, Length
negative_8 = Negative(Value=vector_2pt_12.Vector)
amplitude_5 = Amplitude(Vector=negative_8, Amplitude=graft(number_39))  # -> simplify(Vector)
amplitude_6 = Amplitude(Vector=vector_2pt_12.Vector, Amplitude=graft(number_39))  # -> simplify(Vector)
move_17 = Move(Geometry=end_points_7.Start, Motion=amplitude_5)  # -> Geometry, Transform
move_18 = Move(Geometry=end_points_7.End, Motion=amplitude_6)  # -> Geometry, Transform
line_12 = Line(StartPoint=end_points_7.Start, EndPoint=move_17.Geometry)
line_13 = Line(StartPoint=end_points_7.End, EndPoint=move_18.Geometry)
join_curves_3 = JoinCurves(Curves=[polyline_9, line_12, line_13], Preserve=False)
merge_23 = Merge(Data1=graft(line_12), Data2=graft(line_13))

# ----
amplitude_7 = Amplitude(Vector=vector_2pt_11.Vector, Amplitude=number_39)
amplitude_8 = Amplitude(Vector=negative_7, Amplitude=number_39)
move_19 = Move(Geometry=dispatch.ListA, Motion=amplitude_8)  # -> Geometry, Transform
move_20 = Move(Geometry=dispatch.ListB, Motion=amplitude_7)  # -> Geometry, Transform
divide_curve_2 = DivideCurve(Curve=polyline_9, Count=integer_9, Kinks=False)  # -> Points, Tangents, Parameters
line_14 = Line(StartPoint=dispatch.ListA, EndPoint=move_19.Geometry)
line_15 = Line(StartPoint=dispatch.ListB, EndPoint=move_20.Geometry)
line_16 = Line(StartPoint=divide_curve.Points, EndPoint=divide_curve_2.Points)
shift_list_8 = ShiftList(List=divide_curve_2.Points, Shift=1, Wrap=False)  # -> simplify(List)
trim_tree_5 = TrimTree(Tree=line_16, Depth=1)
shortest_list_5 = ShortestList(ListListA=divide_curve.Points, ListListB=shift_list_8, TrimMode=2)  # -> ListListA, ListListB
shortest_list_6 = ShortestList(ListListA=shift_list_7, ListListB=divide_curve_2.Points, TrimMode=2)  # -> ListListA, ListListB
merge_24 = Merge(Data1=graft(line_14), Data2=graft(line_15))
merge_25 = Merge(Data1=graft(line_11), Data2=simplify(merge_24))
move_21 = Move(Geometry=merge_24, Motion=negative_5)  # -> Geometry, Transform
join_curves_4 = JoinCurves(Curves=merge_25, Preserve=False)
divide_curve_3 = DivideCurve(Curve=merge_24, Count=integer_11, Kinks=False)  # -> Points, Tangents, Parameters
divide_curve_4 = DivideCurve(Curve=merge_23, Count=integer_11, Kinks=False)  # -> Points, Tangents, Parameters
shift_list_9 = ShiftList(List=divide_curve_3.Points, Shift=1, Wrap=False)  # -> simplify(List)
shift_list_10 = ShiftList(List=divide_curve_4.Points, Shift=1, Wrap=False)  # -> simplify(List)
line_17 = Line(StartPoint=shortest_list_6.ListListA, EndPoint=shortest_list_6.ListListB)  # -> simplify(Line)
shortest_list_7 = ShortestList(ListListA=divide_curve_3.Points, ListListB=shift_list_10, TrimMode=2)  # -> ListListA, ListListB
line_18 = Line(StartPoint=shortest_list_5.ListListA, EndPoint=shortest_list_5.ListListB)
shortest_list_8 = ShortestList(ListListA=shift_list_9, ListListB=divide_curve_4.Points, TrimMode=2)  # -> ListListA, ListListB
line_19 = Line(StartPoint=shortest_list_8.ListListA, EndPoint=shortest_list_8.ListListB)
line_20 = Line(StartPoint=shortest_list_7.ListListA, EndPoint=shortest_list_7.ListListB)
line_21 = Line(StartPoint=divide_curve_3.Points, EndPoint=divide_curve_4.Points)  # -> simplify(Line)
trim_tree_6 = TrimTree(Tree=line_19, Depth=1)  # -> simplify(Tree)
trim_tree_7 = TrimTree(Tree=line_20, Depth=1)  # -> simplify(Tree)
trim_tree_8 = TrimTree(Tree=line_21, Depth=1)

# ---- group: Facade Horizontal Bottom
curve_29 = Curve(join_curves_3)

# ---- group: Facade Horizontal Top
# {1;*} indicating outrigger level
# 
# Subbranch indicating truss
# 
# Item indicating element
curve_30 = Curve(join_curves_4)

# ---- group: Facade Vertical
curve_31 = Curve([trim_tree_8, trim_tree_5])

# ---- group: Facade Diagonals
curve_32 = Curve([trim_tree_6, trim_tree_7, line_17, line_18])

# ---- group: Facade Columns
split_tree = SplitTree(Data=simplify(curve_30), Masks=flatten("{0;*}"))  # -> Positive, Negative
split_tree_2 = SplitTree(Data=curve_31, Masks=flatten("{0;*}"))  # -> Positive, Negative
end_points_8 = EndPoints(Curve=split_tree_2.Positive)  # -> Start, End
end_points_9 = EndPoints(Curve=split_tree_2.Negative)  # -> Start, End
curve_closest_point_3 = CurveClosestPoint(Point=end_points_8.End, Curve=split_tree.Negative)  # -> Point, Parameter, Distance
vector_2pt_13 = Vector2Pt(PointA=end_points_9.Start, PointB=end_points_9.End, Unitize=False)  # -> Vector, Length
xy_plane_9 = XYPlane(Origin=Point(0, 0, 0))
line_22 = Line(StartPoint=end_points_8.End, EndPoint=curve_closest_point_3.Point)
project_point = ProjectPoint(Point=end_points_9.End, Direction=vector_2pt_13.Vector, Geometry=xy_plane_9)  # -> Point, Index
line_23 = Line(StartPoint=end_points_9.End, EndPoint=project_point.Point)

# ----
# Top columns organized by truss
curve_33 = Curve(line_22)
# Bottom columns organized by truss
curve_34 = Curve(line_23)
cluster_15 = Cluster(
    geometry=[curve_33, curve_34, curve_30, curve_31, curve_32, curve_29, curve_19, curve_17, curve_20, curve_16, curve_18, mesh],
    transform=rotate_direction.Transform,
    transform_3=move.Transform)

tree_branch_10 = TreeBranch(Tree=simplify(merge_14), Path=[truss_1_height_4, number_32], MaintainPaths=False)
trim_tree_9 = TrimTree(Tree=end_points_5.End, Depth=1)
curve_closest_point_4 = CurveClosestPoint(Point=trim_tree_9, Curve=tree_branch_10)  # -> Point, Parameter, Distance
sort_list_3 = SortList(Keys=curve_closest_point_4.Parameter, ValuesValuesA=curve_closest_point_4.Point)  # -> Keys, ValuesValuesA
dispatch_2 = Dispatch(List=sort_list_3.ValuesValuesA, DispatchPattern=[True, False])  # -> ListA, ListB
line_24 = Line(StartPoint=dispatch_2.ListA, EndPoint=dispatch_2.ListB)
vector_2pt_14 = Vector2Pt(PointA=dispatch_2.ListA, PointB=dispatch_2.ListB, Unitize=False)  # -> Vector, Length
repeat_data_4 = RepeatData(Data=[facade_truss_x_width_2, facade_truss_y_width_2], Length=8)
negative_9 = Negative(Value=vector_2pt_14.Vector)
partition_list_5 = PartitionList(List=repeat_data_4, Size=4)
divide_curve_5 = DivideCurve(Curve=line_24, Count=integer_10, Kinks=False)  # -> Points, Tangents, Parameters
shift_list_11 = ShiftList(List=divide_curve_5.Points, Shift=1, Wrap=False)  # -> simplify(List)

number_40 = Number(partition_list_5)

# ---- group: Facade Horizontal Bottom
curve_closest_point_5 = CurveClosestPoint(Point=trim_tree_9, Curve=tree_branch_10)  # -> Point, Parameter, Distance
trim_tree_10 = TrimTree(Tree=mesh_ray_2.Point, Depth=1)
sort_list_4 = SortList(Keys=curve_closest_point_5.Parameter, ValuesValuesA=trim_tree_10)  # -> Keys, ValuesValuesA
partition_list_6 = PartitionList(List=sort_list_4.ValuesValuesA, Size=2)
polyline_10 = PolyLine(Vertices=partition_list_6, Closed=False)
end_points_10 = EndPoints(Curve=polyline_10)  # -> Start, End
vector_2pt_15 = Vector2Pt(PointA=end_points_10.Start, PointB=end_points_10.End, Unitize=False)  # -> Vector, Length
negative_10 = Negative(Value=vector_2pt_15.Vector)
amplitude_9 = Amplitude(Vector=negative_10, Amplitude=graft(number_40))  # -> simplify(Vector)
amplitude_10 = Amplitude(Vector=vector_2pt_15.Vector, Amplitude=graft(number_40))  # -> simplify(Vector)
move_22 = Move(Geometry=end_points_10.Start, Motion=amplitude_9)  # -> Geometry, Transform
move_23 = Move(Geometry=end_points_10.End, Motion=amplitude_10)  # -> Geometry, Transform
line_25 = Line(StartPoint=end_points_10.Start, EndPoint=move_22.Geometry)
line_26 = Line(StartPoint=end_points_10.End, EndPoint=move_23.Geometry)
join_curves_5 = JoinCurves(Curves=[polyline_10, line_25, line_26], Preserve=False)
merge_26 = Merge(Data1=graft(line_25), Data2=graft(line_26))

# ----
amplitude_11 = Amplitude(Vector=vector_2pt_14.Vector, Amplitude=number_40)
amplitude_12 = Amplitude(Vector=negative_9, Amplitude=number_40)
move_24 = Move(Geometry=dispatch_2.ListA, Motion=amplitude_12)  # -> Geometry, Transform
move_25 = Move(Geometry=dispatch_2.ListB, Motion=amplitude_11)  # -> Geometry, Transform
divide_curve_6 = DivideCurve(Curve=polyline_10, Count=integer_10, Kinks=False)  # -> Points, Tangents, Parameters
line_27 = Line(StartPoint=dispatch_2.ListA, EndPoint=move_24.Geometry)
line_28 = Line(StartPoint=dispatch_2.ListB, EndPoint=move_25.Geometry)
line_29 = Line(StartPoint=divide_curve_5.Points, EndPoint=divide_curve_6.Points)
shift_list_12 = ShiftList(List=divide_curve_6.Points, Shift=1, Wrap=False)  # -> simplify(List)
trim_tree_11 = TrimTree(Tree=line_29, Depth=1)
shortest_list_9 = ShortestList(ListListA=divide_curve_5.Points, ListListB=shift_list_12, TrimMode=2)  # -> ListListA, ListListB
shortest_list_10 = ShortestList(ListListA=shift_list_11, ListListB=divide_curve_6.Points, TrimMode=2)  # -> ListListA, ListListB
merge_27 = Merge(Data1=graft(line_27), Data2=graft(line_28))
merge_28 = Merge(Data1=graft(line_24), Data2=simplify(merge_27))
move_26 = Move(Geometry=merge_27, Motion=negative_6)  # -> Geometry, Transform
join_curves_6 = JoinCurves(Curves=merge_28, Preserve=False)
divide_curve_7 = DivideCurve(Curve=merge_27, Count=integer_12, Kinks=False)  # -> Points, Tangents, Parameters
divide_curve_8 = DivideCurve(Curve=merge_26, Count=integer_12, Kinks=False)  # -> Points, Tangents, Parameters
shift_list_13 = ShiftList(List=divide_curve_7.Points, Shift=1, Wrap=False)  # -> simplify(List)
shift_list_14 = ShiftList(List=divide_curve_8.Points, Shift=1, Wrap=False)  # -> simplify(List)
line_30 = Line(StartPoint=shortest_list_10.ListListA, EndPoint=shortest_list_10.ListListB)  # -> simplify(Line)
shortest_list_11 = ShortestList(ListListA=divide_curve_7.Points, ListListB=shift_list_14, TrimMode=2)  # -> ListListA, ListListB
line_31 = Line(StartPoint=shortest_list_9.ListListA, EndPoint=shortest_list_9.ListListB)
shortest_list_12 = ShortestList(ListListA=shift_list_13, ListListB=divide_curve_8.Points, TrimMode=2)  # -> ListListA, ListListB
line_32 = Line(StartPoint=shortest_list_12.ListListA, EndPoint=shortest_list_12.ListListB)
line_33 = Line(StartPoint=shortest_list_11.ListListA, EndPoint=shortest_list_11.ListListB)
line_34 = Line(StartPoint=divide_curve_7.Points, EndPoint=divide_curve_8.Points)  # -> simplify(Line)
trim_tree_12 = TrimTree(Tree=line_32, Depth=1)  # -> simplify(Tree)
trim_tree_13 = TrimTree(Tree=line_33, Depth=1)  # -> simplify(Tree)
trim_tree_14 = TrimTree(Tree=line_34, Depth=1)

# ---- group: Facade Horizontal Bottom
curve_35 = Curve(join_curves_5)

# ---- group: Facade Horizontal Top
# {1;*} indicating outrigger level
# 
# Subbranch indicating truss
# 
# Item indicating element
curve_36 = Curve(join_curves_6)

# ---- group: Facade Vertical
curve_37 = Curve([trim_tree_14, trim_tree_11])

# ---- group: Facade Diagonals
curve_38 = Curve([trim_tree_12, trim_tree_13, line_30, line_31])

# ---- group: Facade Columns
split_tree_3 = SplitTree(Data=simplify(curve_36), Masks=flatten("{0;*}"))  # -> Positive, Negative
split_tree_4 = SplitTree(Data=curve_37, Masks=flatten("{0;*}"))  # -> Positive, Negative
end_points_11 = EndPoints(Curve=split_tree_4.Positive)  # -> Start, End
end_points_12 = EndPoints(Curve=split_tree_4.Negative)  # -> Start, End
curve_closest_point_6 = CurveClosestPoint(Point=end_points_11.End, Curve=split_tree_3.Negative)  # -> Point, Parameter, Distance
vector_2pt_16 = Vector2Pt(PointA=end_points_12.Start, PointB=end_points_12.End, Unitize=False)  # -> Vector, Length
xy_plane_10 = XYPlane(Origin=Point(0, 0, 0))
line_35 = Line(StartPoint=end_points_11.End, EndPoint=curve_closest_point_6.Point)
project_point_2 = ProjectPoint(Point=end_points_12.End, Direction=vector_2pt_16.Vector, Geometry=xy_plane_10)  # -> Point, Index
line_36 = Line(StartPoint=end_points_12.End, EndPoint=project_point_2.Point)

# ----
# Top columns organized by truss
curve_39 = Curve(line_35)
# Bottom columns organized by truss
curve_40 = Curve(line_36)
cluster_16 = Cluster(
    geometry=[curve_39, curve_40, curve_36, curve_37, curve_38, curve_35, curve_27, curve_25, curve_28, curve_24, curve_26, mesh_2],
    transform=rotate_direction_2.Transform,
    transform_3=move_2.Transform)

# ==== cluster Cluster
transform = ClusterInput()
inverse_transform = InverseTransform(Transform=transform)
geometry = ClusterInput()
transform_2 = Transform(Geometry=geometry, Transform=inverse_transform)
transform_3 = ClusterInput()
inverse_transform_2 = InverseTransform(Transform=transform_3)
transform_4 = Transform(Geometry=transform_2, Transform=inverse_transform_2)
geometry_2 = ClusterOutput(transform_4)
