# Grasshopper definition Crowd Simulation.gh (Grasshopper 1.0.7)
# Copyright: Job de Vogel
# plug-ins: LunchBox, Human

# ---- group: Preprocessing / Inner Doors
curve = Curve([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])

# ---- group: Preprocessing / Boundary Curves
curve_2 = Curve(reverse([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]))

# ---- group: Preprocessing / Bottom Rectangle
curve_3 = Curve(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)

# ---- group: Preprocessing / Inner Walls
curve_4 = Curve([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])

# ---- group: Preprocessing
number_slider = Slider(1, range=0..1)  # disabled
length = Length(Curve=curve)
discontinuity = Discontinuity(Curve=curve_2, Level=1)  # -> Points, Parameters
larger_than = LargerThan(FirstNumber=length, SecondNumber=number_slider)  # -> LargerThan, OrEqualTo
average = Average(Input=discontinuity.Points)
cull_pattern = CullPattern(List=curve, CullPattern=larger_than.LargerThan)
number_slider_2 = Slider(20, range=0..100)
deconstruct = Deconstruct(Point=flatten(average))  # -> XComponent, YComponent, ZComponent
merge = Merge(Data1=curve_4, Data2=cull_pattern)  # -> flatten(Result)
grid_structure = GridStructure(Surface=curve_3, UDivisions=number_slider_2, VDivisions=number_slider_2)  # -> StructureLines, StructureNodes
sort_list = SortList(Keys=deconstruct.ZComponent, ValuesValuesA=flatten(average), ValuesA=curve_2)  # -> Keys, ValuesValuesA, ValuesA
join_curves = JoinCurves(Curves=merge, Preserve=False)
xy_plane = XYPlane(Origin=sort_list.ValuesValuesA)
curve_5 = Curve(join_curves)
curve_middle = CurveMiddle(Curve=curve_5)
project = Project(Geometry=grid_structure.StructureNodes, Plane=graft(xy_plane))  # -> Geometry, Transform
deconstruct_2 = Deconstruct(Point=curve_middle)  # -> XComponent, YComponent, ZComponent
format = Format(Format="{0:0.0}", Culture=127, Data0=deconstruct_2.ZComponent)
round = Round(Number=deconstruct_2.ZComponent)  # -> Nearest, Floor, Ceiling
create_set = CreateSet(List=format)  # -> Set, Map
point_in_curve = PointInCurve(Point=project.Geometry, Curve=graft(sort_list.ValuesA))  # -> Relationship, Point
sort_list_2 = SortList(Keys=create_set.Set)  # -> Keys, ValuesValuesA
sort_list_3 = SortList(Keys=round.Nearest, ValuesValuesA=curve_5)  # -> Keys, ValuesValuesA
larger_than_2 = LargerThan(FirstNumber=point_in_curve.Relationship, SecondNumber=0)  # -> LargerThan, OrEqualTo
shift_list = ShiftList(List=sort_list_2.Keys, Shift=1, Wrap=False)
create_set_2 = CreateSet(List=sort_list_3.Keys)  # -> Set, Map
cull_pattern_2 = CullPattern(List=project.Geometry, CullPattern=larger_than_2.LargerThan)
member_index = MemberIndex(Set=sort_list_3.Keys, Member=create_set_2.Set)  # -> Index, simplify(Count)
subtraction = Subtraction(A=shift_list, B=sort_list_2.Keys)
series = Series(Start=Slider(0, range=0..100), Step=1, Count=Slider(34, range=0..34))
cull_index = CullIndex(List=subtraction, Indices=-1, Wrap=True)
point = Point(simplify(cull_pattern_2))
partition_list = PartitionList(List=sort_list_3.ValuesValuesA, Size=member_index.Count)  # -> simplify(Chunks)
merge_2 = Merge(Data1=flatten(cull_index), Data2=flatten(Slider(3.8, range=0..10)))  # -> graft(Result)
tree_branch = TreeBranch(Tree=partition_list, Path=series, MaintainPaths=True)
tree_branch_2 = TreeBranch(Tree=point, Path=series, MaintainPaths=True)
graft_tree = GraftTree(Tree=sort_list.ValuesA, IncludeEmptyLists=True, IncludeNullItems=True)  # -> simplify(Tree)
unit_z = UnitZ(Factor=merge_2)  # -> simplify(UnitVector)
extrude = Extrude(Base=graft_tree, Direction=unit_z)
curve_6 = Curve(partition_list)
cap_holes = CapHoles(Brep=extrude)
extrude_2 = Extrude(Base=curve_6, Direction=unit_z)

# ----
size = Slider(0.4, range=0..1)
custom_preview = CustomPreview(Geometry=tree_branch, Material=ColourSwatch(SwatchColor=RGBA(51, 51, 51, 6)))
custom_preview_2 = CustomPreview(Geometry=[extrude_2, cap_holes], Material=ColourSwatch(SwatchColor=RGBA(110, 110, 110, 0)))
dot_display = DotDisplay(Point=tree_branch_2, Colour=RGB(0, 0, 0), Size=size)

# ---- group: Network calculation
point_2 = Point(tree_branch_2)
curve_7 = Curve(tree_branch)
list_length = ListLength(List=point_2)
list_length_2 = ListLength(List=curve_7)
graft_tree_2 = GraftTree(Tree=point_2, IncludeEmptyLists=True, IncludeNullItems=True)  # -> simplify(Tree)
duplicate_data = DuplicateData(Data=curve_7, Number=list_length, Order=True)
partition_list_2 = PartitionList(List=duplicate_data, Size=list_length_2)  # -> simplify(Chunks)
curve_closest_point = CurveClosestPoint(Point=graft_tree_2, Curve=partition_list_2)  # -> Point, Parameter, Distance
smaller_than = SmallerThan(FirstNumber=curve_closest_point.Distance, SecondNumber=0.1)  # -> SmallerThan, OrEqualTo
mass_addition = MassAddition(Input=smaller_than.SmallerThan)  # -> Result, PartialResults
boolean = Boolean(mass_addition.Result)
list_item = ListItem(List=point_2, Index=0, Wrap=True)  # -> Item, Item1
trim_tree = TrimTree(Tree=boolean, Depth=1)
distance = Distance(PointA=list_item.Item, PointB=list_item.Item1)
cull_pattern_3 = CullPattern(List=point_2, CullPattern=invert(trim_tree))  # -> simplify(List)
list_item_2 = ListItem(List=flatten(distance), Index=0, Wrap=True)
number = Number(distance)
number_2 = Number(distance)
square = Square(Value=list_item_2)
square_2 = Square(Value=number)
square_3 = Square(Value=number_2)
addition = Addition(A=square_2, B=square_3)
xy_plane_2 = XYPlane(Origin=Point(0, 0, 0))
panel = Panel(square)
square_root = SquareRoot(Value=addition)
proximity_2d = Proximity2D(Points=cull_pattern_3, Plane=xy_plane_2, Group=Slider(8, range=0..10), MaxRadius=expr("x+0.001", square_root))  # -> simplify(Links), Topology
trim_tree_2 = TrimTree(Tree=proximity_2d.Links, Depth=1)
list_length_3 = ListLength(List=trim_tree_2)
list_length_4 = ListLength(List=proximity_2d.Links)
duplicate_data_2 = DuplicateData(Data=curve_7, Number=list_length_3, Order=True)
list_length_5 = ListLength(List=curve_7)
shift_paths = ShiftPaths(Data=list_length_4, Offset=-1)
graft_tree_3 = GraftTree(Tree=trim_tree_2, IncludeEmptyLists=True, IncludeNullItems=True)
partition_list_3 = PartitionList(List=duplicate_data_2, Size=list_length_5)  # -> simplify(Chunks)
curve_curve = CurveCurve(CurveA=graft_tree_3, CurveB=partition_list_3, UseTasks=False)  # -> Points, ParamsA, ParamsB
list_length_6 = ListLength(List=curve_curve.Points)
trim_tree_3 = TrimTree(Tree=list_length_6, Depth=1)
mass_addition_2 = MassAddition(Input=trim_tree_3)  # -> simplify(Result), PartialResults
larger_than_3 = LargerThan(FirstNumber=mass_addition_2.Result, SecondNumber=0)  # -> LargerThan, OrEqualTo
trim_tree_4 = TrimTree(Tree=larger_than_3.LargerThan, Depth=1)  # -> simplify(Tree)
partition_list_4 = PartitionList(List=trim_tree_4, Size=shift_paths)  # -> simplify(Chunks)
cull_pattern_4 = CullPattern(List=proximity_2d.Links, CullPattern=invert(partition_list_4))  # -> simplify(List)
cull_pattern_5 = CullPattern(List=proximity_2d.Topology, CullPattern=invert(partition_list_4))  # -> simplify(List)
length_2 = Length(Curve=cull_pattern_4)
point_3 = Point(cull_pattern_3)
custom_preview_3 = CustomPreview(Geometry=cull_pattern_4, Material=ColourSwatch(SwatchColor=RGBA(255, 255, 255, 0)))
integer = Integer(cull_pattern_5)
number_3 = Number(length_2)

# ---- group: Insert Vertical Connections to Network
point_4 = Point(point_3)
curve_8 = Curve(graft([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]))
tree_statistics = TreeStatistics(Tree=curve_8)  # -> Paths, Length, Count
curve_closest_point_2 = CurveClosestPoint(Point=flatten(point_4), Curve=simplify(curve_8))  # -> Point, Parameter, Distance
list_length_7 = ListLength(List=point_4)  # -> flatten(Length)
duplicate_data_3 = DuplicateData(Data=flatten(point_4), Number=tree_statistics.Count, Order=True)
tree_statistics_2 = TreeStatistics(Tree=point_4)  # -> Paths, Length, Count
mass_addition_3 = MassAddition(Input=tree_statistics_2.Length)  # -> Result, PartialResults
partition_list_5 = PartitionList(List=curve_closest_point_2.Distance, Size=list_length_7)
partition_list_6 = PartitionList(List=duplicate_data_3, Size=mass_addition_3.Result)  # -> simplify(Chunks)
panel_2 = Panel("""Per curve
per level""")
list_length_8 = ListLength(List=partition_list_5)
series_2 = Series(Start=0, Step=1, Count=list_length_8)  # -> simplify(Series)
partition_list_7 = PartitionList(List=partition_list_6, Size=tree_statistics_2.Length)  # -> simplify(Chunks)
sort_list_4 = SortList(Keys=partition_list_5, ValuesValuesA=series_2)  # -> Keys, ValuesValuesA
list_item_3 = ListItem(List=sort_list_4.Keys, Index=0, Wrap=True)
smaller_than_2 = SmallerThan(FirstNumber=list_item_3, SecondNumber=number)  # -> SmallerThan, OrEqualTo
list_item_4 = ListItem(List=sort_list_4.ValuesValuesA, Index=0, Wrap=True)
cull_pattern_6 = CullPattern(List=list_item_4, CullPattern=smaller_than_2.SmallerThan)
list_item_5 = ListItem(List=partition_list_7, Index=cull_pattern_6, Wrap=True)
trim_tree_5 = TrimTree(Tree=list_item_5, Depth=1)
panel_3 = Panel("Points")
panel_4 = Panel("Indices per level!")
trim_tree_6 = TrimTree(Tree=cull_pattern_6, Depth=1)
point_5 = Point(trim_tree_5)
integer_2 = Integer(trim_tree_6)
polyline = PolyLine(Vertices=point_5, Closed=False)

# ---- group: Neighbour Relations
ghpython_script = GhPythonScript(Indices=integer, Distances=number_3)  # -> simplify(parent_idxs), neighbour_dict; inputs Indices: tree, Distances: tree
# ---------- ghpython_script: Python ----------
"""Provides a scripting component.
    Inputs:
        Indices: Initial indices of the neighbours per point per floor
        Distances: Euclidian distances to neighbours
    Output:
        parent_idxs: Remapped indices of parent points
        neighbour_dict: Dictionary with all neighbour relations per parent"""

__author__ = "Job de Vogel"
__version__ = "2022.05.30"

from ghpythonlib import treehelpers
from Rhino.Geometry import Line
import random

indices = treehelpers.tree_to_list(Indices, False)
distances = treehelpers.tree_to_list(Distances, False)

parent_idxs = []
nb = {}

index_shift = 0
for f, (floor_idxs, floor_dis) in enumerate(zip(indices, distances)):
    parent_idxs.append([])
    nb[f] = {}
    for i, (neighbours, distance) in enumerate(zip(floor_idxs, floor_dis)):
        neighbours = [neighbor + index_shift for neighbor in neighbours]
        
        parent_idxs[f].append(i + index_shift)

        nb[f][i + index_shift] = dict(zip(neighbours, distance))
    
    index_shift += len(indices[f])

parent_idxs = treehelpers.list_to_tree(parent_idxs)
neighbour_dict = list(nb.values())
print(neighbour_dict[0])
# ---------- end ghpython_script ----------

# ----
suirify = Suirify(ghpython_script.neighbour_dict)

# ---- group: Path Searching
integer_3 = Integer(flatten(ghpython_script.parent_idxs))
duplicate_data_4 = DuplicateData(Data=flatten(integer_3), Number=tree_statistics.Count, Order=True)
partition_list_8 = PartitionList(List=duplicate_data_4, Size=mass_addition_3.Result)  # -> simplify(Chunks)
partition_list_9 = PartitionList(List=partition_list_8, Size=tree_statistics_2.Length)  # -> simplify(Chunks)
flatten_tree = FlattenTree(Tree=point_3, Path="{0}")
list_item_6 = ListItem(List=partition_list_9, Index=cull_pattern_6, Wrap=True)
point_6 = Point([<point referenced from the Rhino model> x3])
point_7 = Point(graft([<point referenced from the Rhino model> x602]))
trim_tree_7 = TrimTree(Tree=list_item_6, Depth=1)
closest_point = ClosestPoint(Point=point_6, Cloud=flatten_tree)  # -> ClosestPoint, CPIndex, Distance
closest_point_2 = ClosestPoint(Point=point_7, Cloud=flatten_tree)  # -> ClosestPoint, CPIndex, Distance
integer_4 = Integer(trim_tree_7)
panel_5 = Panel("""Real indices!
Per curve""")
ghpython_script_2 = GhPythonScript(neighbour_dict=suirify, vertical_connections=integer_4)  # -> building_neighbours; inputs neighbour_dict: list, vertical_connections: tree
# ---------- ghpython_script_2: Python ----------
__author__ = "Job de Vogel"
__version__ = "2022.05.31"
        
from ghpythonlib import treehelpers as th
import itertools
        
#print(neighbour_dict[0][47])
        
building_dict = {}
        
for dict in neighbour_dict:
    building_dict.update(dict)
        
#print(building_dict[47])
#  {36: 7.8567420131838537, 37: 5.55555555555555, 38: 7.8567420131838581, 46: 5.55555555555555, 48: 5.5555555555555571}
""" """
        
vertical_connections = th.tree_to_list(vertical_connections, False)
        
for vertical in vertical_connections:
    for i in vertical:
        temp_neighbours = vertical[:]
        temp_neighbours.remove(i)
        
        temp_dict = {}
        for neigh in temp_neighbours:
            temp_dict[neigh] = 0
        
        building_dict[i] = {k:v for d in (building_dict[i],temp_dict) for k,v in d.items()}

# Convert Building Dict to Grasshopper output
temp = {}
temp[0] = building_dict

building_neighbours = list(temp.values())
# ---------- end ghpython_script_2 ----------
manhattandistance = BooleanToggle(False)
longest_list = LongestList(ListListA=closest_point_2.CPIndex, ListListB=closest_point.CPIndex, PaddingMode=2)  # -> flatten(ListListA), flatten(ListListB)
parallel = BooleanToggle(True)
list_length_9 = ListLength(List=flatten_tree)
astar_algorithm_fast = GhPythonScript(
    StartIndex=longest_list.ListListA,
    GoalIndex=longest_list.ListListB,
    points=flatten_tree,
    parent_idxs=flatten(ghpython_script.parent_idxs),
    neighbour_dict=ghpython_script_2,
    cloud_size=list_length_9,
    manhattanDistance=manhattandistance,
    Parallel=parallel)  # -> result; inputs StartIndex: list of Int32, GoalIndex: list of Int32, points: list of Point3d, parent_idxs: list, cloud_size: Int32, Cull_Data: list of Int32, manhattanDistance: Boolean, Parallel: Boolean
# ---------- astar_algorithm_fast: Python ----------
__author__copy = "Job de Vogel"
__version__ = "2020.11.06"
# Updated on 2022.05.31

from math import sqrt
import array as array
import random

def manhattan(index_1, index_2):
    point_1_coord = points[index_1]
    point_2_coord = points[index_2]
    
    return sum(abs(val1-val2) for val1, val2 in zip(point_1_coord, point_2_coord))

def euclidean(index_1, index_2):
    point_1_coord = points[index_1]
    point_2_coord = points[index_2]
    
    squares = [(p-q) ** 2 for p, q in zip(point_1_coord, point_2_coord)]
    return sum(squares) ** .5

def astar(Start, Goal, manhattanDistance = True):
    ###variables:
    open_set = []
    open_set.append((0, Start))
    came_from = {}
    path = array.array('i', [])

    g_score = {index: float("inf") for index in range(cloud_size)}
    g_score[Start] = 0

    f_score = {index: float("inf") for index in range(cloud_size)}
    
    
    if manhattanDistance:
        f_score[Start] = manhattan(Start, Goal)
    else:
        f_score[Start] = euclidean(Start, Goal)

    closed_set = {Start}

    iterations = 1

    #Algorithm function:
    while open_set:
        current = open_set[0][1]
        closed_set.remove(current)

        if current == Goal:
            #rebuild the path:
            while current != Start:
                    try:
                        path.insert(0, current)
                        current = came_from[current]
                    except KeyError:
                        path = False
                        break
            path.insert(0, Start)
            break

        #f_score_temp stores the f_scores of the neighbors of this node, so that it can be shuffled before it is added to the open_set
        f_score_temp = []

        Neighbors = neighbour_dict[current]

        #Calculate f_score for all neighbors
        for neighbor in Neighbors:
            temp_g_score = g_score[current] + Neighbors[neighbor]
            if temp_g_score < g_score[neighbor]:
                came_from[neighbor] = current
                g_score[neighbor] = temp_g_score
                
                if manhattanDistance:
                    f_score[neighbor] = temp_g_score + manhattan(neighbor, Goal)
                else:
                    f_score[neighbor] = temp_g_score + euclidean(neighbor, Goal) 

                if neighbor not in closed_set:
                    f_score_temp.append((f_score[neighbor], neighbor))
                    closed_set.add(neighbor)

        #shuffle the neighors and their f_scores (this will give alternative paths)
        if not Parallel:
            random.seed(random.random())
        random.shuffle(f_score_temp)
       
        open_set = open_set + f_score_temp
        
        #sort open_set based on f_score
        open_set.pop(0)
        open_set = sorted(open_set, key = lambda f: f[0])
        iterations += 1
    return path

def main(i):
    #Check if there are multiple starts/goals, if not use a single value
    if len(StartIndex) > 1:
        Start = StartIndex[i]
    else:
        Start = StartIndex[0]

    if len(GoalIndex) > 1:
        Goal = GoalIndex[i]
    else:
        Goal = GoalIndex[0]
    
    #In fast version of Astar, Start automatically gets added withoud checking Cull_Data, therefore do it manually here
    if Start in Cull_Data:
        Start = None

    #If goal isn't checked in Cull_Data, it is calculated, while a path is not possible
    if Goal in Cull_Data:
        Goal = None

    #Try to find a path, if not possible, return empty list
    try:
        path = astar(Start, Goal, manhattanDistance)
    except:
        path = None
    return path

##Find the number of paths to find
number_of_paths = [j for j in range(max(len(StartIndex), len(GoalIndex)))]

import ghpythonlib.parallel as parallel
import ghpythonlib.treehelpers as th

##ADD A NON-PARALLEL OPTION HERE
if Parallel == True:
    result = th.list_to_tree(parallel.run(main, number_of_paths, False))
else:
    result = []
    for i in number_of_paths:
        result.append(main(i))
    result = th.list_to_tree(result)
# ---------- end astar_algorithm_fast ----------

# ----
custom_preview_4 = CustomPreview(Geometry=polyline, Material=ColourSwatch(SwatchColor=RGBA(255, 66, 66, 44)))

# ---- group: Time Step
time_step_s = Slider(40, range=0..1178)

# ---- group: Information Extraction
# Smoke with visibility > 3m: 1.35 m/s
# 
# Visibility levels ≤ 3 meter: Peoples’ walking speed is represented by a relative reduction of 0,34
# m/s per meter visibility down to the minimum speed of 0,2 m/s
list_item_7 = ListItem(List=flatten(point_3), Index=astar_algorithm_fast, Wrap=True)  # -> simplify(Item)
polyline_2 = PolyLine(Vertices=list_item_7, Closed=False)
tree_statistics_3 = TreeStatistics(Tree=list_item_7)  # -> Paths, Length, Count
partition_list_10 = PartitionList(List=flatten(polyline_2), Size=3)
clean_tree = CleanTree(RemoveNulls=True, RemoveInvalid=True, RemoveEmpty=False, Tree=partition_list_10)
random = Random(Range=Domain(0, 255), Number=tree_statistics_3.Count, Seed=Slider(1, range=0..3))
length_3 = Length(Curve=partition_list_10)
partition_list_11 = PartitionList(List=random, Size=3)
list_length_10 = ListLength(List=clean_tree)  # -> flatten(Length)
sort_list_5 = SortList(Keys=length_3, ValuesValuesA=partition_list_10)  # -> Keys, ValuesValuesA
list_item_8 = ListItem(List=partition_list_11, Index=0, Wrap=True)  # -> Item, Item1, Item2
equality = Equality(FirstNumber=list_length_10, SecondNumber=0)  # -> Equality, Inequality
clean_tree_2 = CleanTree(RemoveNulls=True, RemoveInvalid=True, RemoveEmpty=False, Tree=sort_list_5.ValuesValuesA)
colour_rgb = ColourRGB(Alpha=255, Red=list_item_8.Item, Green=0, Blue=list_item_8.Item2)  # -> simplify(Colour)
cull_pattern_7 = CullPattern(List=flatten(point_7), CullPattern=equality.Equality)
list_item_9 = ListItem(List=clean_tree_2, Index=1, Wrap=True)
length_4 = Length(Curve=list_item_9)
point_8 = Point(cull_pattern_7)
sort_list_6 = SortList(Keys=flatten(length_4))  # -> reverse(Keys), ValuesValuesA
list_item_10 = ListItem(List=sort_list_6.Keys, Index=0, Wrap=True)
average_2 = Average(Input=flatten(length_4))
m_s_horizontal = Slider(1.4, range=0..10)
m_s_vertical = Slider(0.1, range=0..10)
stream_filter = StreamFilter(Gate=Toggle(True), Stream0=list_item_9, Stream1=partition_list_10)
curve_9 = Curve(flatten(stream_filter))
curve_10 = Curve(curve_9)
route = Route(relay=curve_10, relay_2=m_s_horizontal, relay_3=m_s_vertical)  # -> points, result
list_length_11 = ListLength(List=flatten(curve_10))
list_length_12 = ListLength(List=flatten(curve_10))
random_2 = Random(Range=Domain(-0.4, 0.4), Number=list_length_11, Seed=2)
random_3 = Random(Range=Domain(-0.02, 0.02), Number=list_length_12, Seed=2)
tree_statistics_4 = TreeStatistics(Tree=route.points)  # -> Paths, Length, Count
random_4 = Random(Range=Domain(1, 20), Number=tree_statistics_4.Count, Seed=2)
list_item_11 = ListItem(List=route.points, Index=0, Wrap=True)
repeat_data = RepeatData(Data=simplify(list_item_11), Length=graft(random_4))  # -> simplify(Data)
time = Number(route.result)
point_9 = Point(route.points)
number_slider_3 = Slider(122, range=0..602)
merge_3 = Merge(Data1=repeat_data, Data2=simplify(point_9))
list_length_13 = ListLength(List=merge_3)
sort_list_7 = SortList(Keys=flatten(list_length_13))  # -> reverse(Keys), ValuesValuesA
average_3 = Average(Input=flatten(list_length_13))
tree_branch_3 = TreeBranch(Tree=simplify(stream_filter), Path=number_slider_3, MaintainPaths=True)
integer_5 = Integer(time_step_s)
list_item_12 = ListItem(List=sort_list_7.Keys, Index=0, Wrap=True)
list_item_13 = ListItem(List=merge_3, Index=integer_5, Wrap=False)
point_10 = Point(flatten(point_3))
simplify_tree = SimplifyTree(Tree=stream_filter, Front=False)
pipe = Pipe(Curve=tree_branch_3, Radius=0.2, Caps=2)
point_11 = Point(simplify(point_7))
clean_tree_3 = CleanTree(RemoveNulls=True, RemoveInvalid=True, RemoveEmpty=False, Tree=list_item_13)
tree_branch_4 = TreeBranch(Tree=point_11, Path=number_slider_3, MaintainPaths=True)
proximity_3d = Proximity3D(Points=flatten(clean_tree_3), Group=100, MaxRadius=list_item_2)  # -> Links, Topology
custom_preview_5 = CustomPreview(Geometry=[tree_branch_4, pipe, point_6], Material=ColourSwatch(SwatchColor=RGB(255, 255, 255)))
list_length_14 = ListLength(List=flatten(clean_tree_3))
pi = Pi(Factor=1)
square_4 = Square(Value=list_item_2)
list_length_15 = ListLength(List=proximity_3d.Links)  # -> expr("x+1", simplify(Length))
series_3 = Series(Start=0, Step=1, Count=list_length_14)
multiplication = Multiplication(A=square_4, B=pi)
sort_list_8 = SortList(Count=flatten(list_length_15), ValuesIndex=series_3, ValuesPoint=flatten(clean_tree_3))  # -> Count, ValuesIndex, ValuesPoint
division = Division(A=sort_list_8.Count, B=multiplication)

# ---- group: Information Extraction / All Route Lengths
number_4 = Number(flatten(length_3))

# ---- group: Information Extraction / All Routes
curve_11 = Curve(simplify(partition_list_10))

# ---- group: Information Extraction (continued)
sort_list_9 = SortList(Keys=number_4)  # -> reverse(Keys), ValuesValuesA
list_item_14 = ListItem(List=sort_list_9.Keys, Index=0, Wrap=True)
longest_route_distance = Panel(list_item_14)

# ---- group: Information Extraction / Shortest Routes
custom_preview_6 = CustomPreview(Geometry=simplify_tree, Material=colour_rgb)

# ---- group: Visualization
max_allowed_per_m2 = Slider(1.5, range=0..10)
multiplication_2 = Multiplication(A=max_allowed_per_m2, B=square)
list_item_15 = ListItem(List=sort_list_8.Count, Index=-1, Wrap=True)
gradient = Gradient(
    LowerLimit=0,
    UpperLimit=max_allowed_per_m2,
    Parameter=division,
    stops=[0: RGB(0, 128, 0), 0.5: RGB(255, 255, 0), 1: RGB(255, 0, 0)])
max_amount_of_people_per_point = Panel(list_item_15)
custom_preview_7 = CustomPreview(Geometry=sort_list_8.ValuesPoint, Material=gradient)
division_2 = Division(A=max_amount_of_people_per_point, B=multiplication)
max_amount_of_people_per_square_meter = Panel(division_2)
data_recorder = DataRecorder(max_amount_of_people_per_square_meter, DataLimit=1200, RecordData=True)

# ---- group: Data Visualization
sort_list_10 = SortList(Keys=flatten(data_recorder))  # -> reverse(Keys), ValuesValuesA
list_item_16 = ListItem(List=sort_list_10.Keys, Index=0, Wrap=True)
division_3 = Division(A=list_item_12, B=60)
division_4 = Division(A=average_3, B=60)
text = Text(time_step_s)
format_2 = Format(Format="{0:0.0}", Culture=127, Data0=division_3)
format_3 = Format(Format="{0:0.0}", Culture=127, Data0=division_4)
text_2 = Text(max_allowed_per_m2)
text_3 = Text(m_s_vertical)
text_4 = Text(m_s_horizontal)
format_4 = Format(Format="{0:0.0}", Culture=127, Data0=list_item_10)
format_5 = Format(Format="{0:0.0}", Culture=127, Data0=average_2)
format_6 = Format(Format="{0:0.0}", Culture=127, Data0=list_item_16)
concatenate = Concatenate(Fragment_A="Max allowed people: ", Fragment_B=text_2, A="/m2")
format_7 = Format(Format="{0:0.0}", Culture=127, Data0=division_2)
concatenate_2 = Concatenate(Fragment_A="Average travel time: ", Fragment_B=format_3, A="m")
concatenate_3 = Concatenate(Fragment_A="Average vertical speed: ", Fragment_B=text_3, A="m/s")
concatenate_4 = Concatenate(Fragment_A="Max travel time: ", Fragment_B=format_2, A="m")
concatenate_5 = Concatenate(Fragment_A="Average horizontal speed: ", Fragment_B=text_4, A="m/s")
concatenate_6 = Concatenate(Fragment_A="Time step: ", Fragment_B=text, A="s")
concatenate_7 = Concatenate(Fragment_A="Max travel distance: ", Fragment_B=format_4, A="m")
concatenate_8 = Concatenate(Fragment_A="Average travel distance: ", Fragment_B=format_5, A="m")
concatenate_9 = Concatenate(Fragment_A="App. max amount of people: ", Fragment_B=format_7, A="/m2")
concatenate_10 = Concatenate(Fragment_A="Overall app. max amount of people: ", Fragment_B=format_6, A="/m2")
suirify_2 = Suirify(concatenate_9)
merge_4 = Merge(
    Data1=simplify("INFORMATION"),
    Data2=simplify(concatenate_6),
    Data3=simplify(suirify_2),
    Data4=simplify(concatenate_10),
    Data5=simplify(concatenate_8),
    Data6=simplify(concatenate_2),
    Data7=simplify(concatenate_7),
    Data8=simplify(concatenate_4),
    Data9=simplify(concatenate_5),
    Data10=simplify(concatenate_3),
    Data11=concatenate)
list_length_16 = ListLength(List=merge_4)
series_4 = Series(Start=0, Step=1, Count=list_length_16)
font_table = FontTable()
merge_5 = Merge(
    Data1=ColourSwatch(SwatchColor=RGB(255, 255, 255)),
    Data2=ColourSwatch(SwatchColor=RGB(255, 255, 255)),
    Data3=ColourSwatch(SwatchColor=RGB(255, 255, 255)),
    Data4=ColourSwatch(SwatchColor=RGB(255, 69, 69)),
    Data5=ColourSwatch(SwatchColor=RGB(255, 255, 255)),
    Data6=ColourSwatch(SwatchColor=RGB(255, 255, 255)),
    Data7=ColourSwatch(SwatchColor=RGB(255, 255, 255)),
    Data8=ColourSwatch(SwatchColor=RGB(255, 255, 255)),
    Data9=ColourSwatch(SwatchColor=RGB(255, 255, 255)),
    Data10=ColourSwatch(SwatchColor=RGB(255, 255, 255)))
multiplication_3 = Multiplication(A=series_4, B=Slider(17, range=0..100))
list_item_17 = ListItem(List=font_table, Index=Slider(6, range=0..10), Wrap=True)
addition_2 = Addition(A=multiplication_3, B=Slider(908, range=0..2000))
construct_point = ConstructPoint(XCoordinate=Slider(22, range=0..10000), YCoordinate=addition_2, ZCoordinate=0)
render_text_to_screen = RenderTextToScreen(Text=merge_4, Location=construct_point, Size=12, Color=merge_5, Font=list_item_17, m_scWithvp=False)

# ==== cluster Route
relay = ClusterInput()
discontinuity = Discontinuity(Curve=relay, Level=1)  # -> Points, Parameters
shatter = Shatter(Curve=graft(relay), Parameters=discontinuity.Parameters)
end_points = EndPoints(Curve=shatter)  # -> Start, End
deconstruct = Deconstruct(Point=end_points.Start)  # -> XComponent, YComponent, ZComponent
deconstruct_2 = Deconstruct(Point=end_points.End)  # -> XComponent, YComponent, ZComponent
subtraction = Subtraction(A=deconstruct_2.ZComponent, B=deconstruct.ZComponent)
absolute = Absolute(Value=subtraction)
larger_than = LargerThan(FirstNumber=absolute, SecondNumber=0)  # -> LargerThan, OrEqualTo
dispatch = Dispatch(List=shatter, DispatchPattern=larger_than.LargerThan)  # -> ListA, ListB
length = Length(Curve=dispatch.ListB)
length_2 = Length(Curve=dispatch.ListA)
relay_2 = ClusterInput()
relay_3 = ClusterInput()
division = Division(A=length, B=relay_2)
division_2 = Division(A=length_2, B=relay_3)
round = Round(Number=division)  # -> Nearest, Floor, Ceiling
round_2 = Round(Number=division_2)  # -> Nearest, Floor, Ceiling
divide_curve = DivideCurve(Curve=dispatch.ListB, Count=round.Nearest, Kinks=False)  # -> Points, Tangents, Parameters
divide_curve_2 = DivideCurve(Curve=dispatch.ListA, Count=round_2.Nearest, Kinks=False)  # -> Points, Tangents, Parameters
trim_tree = TrimTree(Tree=divide_curve_2.Points, Depth=1)
trim_tree_2 = TrimTree(Tree=divide_curve.Points, Depth=1)
list_length = ListLength(List=trim_tree_2)  # -> expr("x-1", Length)
list_length_2 = ListLength(List=trim_tree)
merge = Merge(Data1=trim_tree, Data2=trim_tree_2)
cull_duplicates = CullDuplicates(Points=merge, Tolerance=0.1, CullMode=3)  # -> Points, Indices, Valence
addition = Addition(A=list_length_2, B=list_length)  # -> simplify(Result)
sort_along_curve = SortAlongCurve(Points=cull_duplicates.Points, Curve=graft(relay))  # -> Points, Indices
result = ClusterOutput(addition)
points = ClusterOutput(sort_along_curve.Points)
