# Grasshopper definition Distribution centre.gh (Grasshopper 1.0.7)

# ----
# Distribution centre
# Start of distribution centre
# End of distribution centre
height_distribution_centre = Slider(15, range=0..100)
curve = Curve(<curve referenced from the Rhino model>)
curve_2 = Curve(<curve referenced from the Rhino model>)
point_on_curve = PointOnCurve(curve, parameter=0)
point_on_curve_2 = PointOnCurve(curve, parameter=1)
point_on_curve_3 = PointOnCurve(curve_2, parameter=1)
point_on_curve_4 = PointOnCurve(curve_2, parameter=0)
line = Line(StartPoint=point_on_curve, EndPoint=point_on_curve_4)
line_2 = Line(StartPoint=point_on_curve_2, EndPoint=point_on_curve_3)
unit_z = UnitZ(Factor=height_distribution_centre)
edge_surface = EdgeSurface(CurveA=line, CurveB=curve, CurveC=line_2, CurveD=curve_2)
extrude = Extrude(Base=edge_surface, Direction=unit_z)

# ----
# Parameters for tower 1
# If all are true -> tower 1 fully within the distribution centre
move_x_dir_tower_1 = Slider(-5, range=-100..100)
move_y_dir_tower_1 = Slider(58, range=0..200)
width_bottom_tower_1 = Slider(42, range=0..100)
height_tower_1 = Slider(148, range=0..150)

length_top = Slider(55, range=0..60)
height_halfway = Slider(60, range=0..100)
length_halfway = Slider(44, range=0..50)
length_bottom_tower_1 = Slider(42, range=0..100)
width_halfway = Slider(34, range=0..50)
width_top = Slider(57, range=0..60)

# ----
# Parameters for tower 2
# If all are true -> tower 1 fully within the distribution centre
height_tower_2 = Slider(150, range=0..150)
move_x_dir_tower_1_2 = Slider(-90, range=-100..100)
move_y_dir_tower_1_2 = Slider(256, range=0..350)
length_top_tower_1 = Slider(38, range=0..60)
height_halfway_2 = Slider(79, range=0..100)
width_halfway_2 = Slider(31, range=0..50)
width_top_tower_1 = Slider(38, range=0..60)
length_halfway_2 = Slider(50, range=0..50)
length_bottom_tower_1_2 = Slider(49, range=0..100)
width_bottom_tower_1_2 = Slider(47, range=0..100)
height_tower_1_2 = Slider(120, range=0..150)

md_slider = MDSlider(
    SliderMode=0,
    slider_value=Point(1, 0.9968346982, 0.5),
    x_domain=Domain(0, 0.5),
    y_domain=Domain(0, 1),
    z_domain=Domain(0, 1))
move = Move(Geometry=edge_surface, Motion=unit_z)  # -> Geometry, Transform
evaluate_surface = EvaluateSurface(Surface=reparameterize(move.Geometry), Point=md_slider)  # -> Point, Normal, UDirection, VDirection, Frame

# ----
# Finding a point on the top of the distribution centre
curve_middle = CurveMiddle(Curve=line)
deconstruct = Deconstruct(Point=curve_middle)  # -> XComponent, YComponent, ZComponent
addition = Addition(A=deconstruct.ZComponent, B=height_distribution_centre)
construct_point = ConstructPoint(XCoordinate=deconstruct.XComponent, YCoordinate=deconstruct.YComponent, ZCoordinate=expr("x-1", addition))

# ----
# Tower 2
negative = Negative(Value=length_bottom_tower_1_2)
vector_xyz = VectorXYZ(XComponent=move_x_dir_tower_1_2, YComponent=move_y_dir_tower_1_2, ZComponent=0)  # -> Vector, Length
rectangle = Rectangle(Plane=construct_point, XSize=width_bottom_tower_1_2, YSize=negative, Radius=0)  # -> Rectangle, Length
move_2 = Move(Geometry=rectangle.Rectangle, Motion=vector_xyz.Vector)  # -> Geometry, Transform
discontinuity = Discontinuity(Curve=move_2.Geometry, Level=1)  # -> Points, Parameters
list_item = ListItem(List=discontinuity.Points, Index=1, Wrap=True)
unit_z_2 = UnitZ(Factor=height_tower_1_2)
unit_z_3 = UnitZ(Factor=height_halfway_2)
unit_z_4 = UnitZ(Factor=height_tower_2)
move_3 = Move(Geometry=list_item, Motion=unit_z_3)  # -> Geometry, Transform
move_4 = Move(Geometry=list_item, Motion=unit_z_2)  # -> Geometry, Transform
negative_2 = Negative(Value=length_top_tower_1)
move_5 = Move(Geometry=list_item, Motion=unit_z_4)  # -> Geometry, Transform
negative_3 = Negative(Value=Slider(35, range=0..100))
negative_4 = Negative(Value=length_halfway_2)
rectangle_2 = Rectangle(Plane=move_4.Geometry, XSize=negative_2, YSize=width_top_tower_1, Radius=0)  # -> Rectangle, Length
rectangle_3 = Rectangle(Plane=move_5.Geometry, XSize=negative_3, YSize=Slider(35, range=0..100), Radius=0)  # -> Rectangle, Length
rectangle_4 = Rectangle(Plane=move_3.Geometry, XSize=negative_4, YSize=width_halfway_2, Radius=0)  # -> Rectangle, Length
rectangle_5 = Rectangle(move_2.Geometry)
discontinuity_2 = Discontinuity(Curve=rectangle_2.Rectangle, Level=1)  # -> simplify(graft(Points)), Parameters
discontinuity_3 = Discontinuity(Curve=rectangle_4.Rectangle, Level=1)  # -> simplify(graft(Points)), Parameters
discontinuity_4 = Discontinuity(Curve=rectangle_5, Level=1)  # -> simplify(graft(Points)), Parameters
discontinuity_5 = Discontinuity(Curve=rectangle_3.Rectangle, Level=1)  # -> simplify(graft(Points)), Parameters
unit_z_5 = UnitZ(Factor=1)
interpolate_t = InterpolateT(
    Vertices=[discontinuity_4.Points, discontinuity_3.Points, discontinuity_2.Points, discontinuity_5.Points],
    TangentStart=unit_z_5,
    TangentEnd=Vector(0, 0, 0),
    KnotStyle=1)  # -> flatten(Curve), Length, Domain
graft_tree = GraftTree(Tree=interpolate_t.Curve, IncludeEmptyLists=True, IncludeNullItems=True)
shift_list = ShiftList(List=interpolate_t.Curve, Shift=1, Wrap=True)  # -> graft(List)
shift_paths = ShiftPaths(Data=shift_list, Offset=1)
loft = Loft(
    Curves=[graft_tree, shift_paths],
    Options={Adjust=False, Closed=False, LoftEnds=0, LoftSimp=0, LoftType=0, Rebuild=10, Refit=0.01})  # -> flatten(Loft)
brep_join = BrepJoin(Breps=loft)  # -> Breps, Closed
cap_holes = CapHoles(Brep=brep_join.Breps)
rotate = Rotate(Geometry=cap_holes, Angle=3.141592654, Plane=move_4.Geometry)  # -> Geometry, Transform

# ----
# Tower 1
negative_5 = Negative(Value=length_bottom_tower_1)
vector_xyz_2 = VectorXYZ(XComponent=move_x_dir_tower_1, YComponent=move_y_dir_tower_1, ZComponent=0)  # -> Vector, Length
rectangle_6 = Rectangle(Plane=construct_point, XSize=negative_5, YSize=width_bottom_tower_1, Radius=0)  # -> Rectangle, Length
move_6 = Move(Geometry=rectangle_6.Rectangle, Motion=vector_xyz_2.Vector)  # -> Geometry, Transform
discontinuity_6 = Discontinuity(Curve=move_6.Geometry, Level=1)  # -> Points, Parameters
list_item_2 = ListItem(List=discontinuity_6.Points, Index=1, Wrap=True)
unit_z_6 = UnitZ(Factor=height_halfway)
unit_z_7 = UnitZ(Factor=height_tower_1)
move_7 = Move(Geometry=list_item_2, Motion=unit_z_7)  # -> Geometry, Transform
move_8 = Move(Geometry=list_item_2, Motion=unit_z_6)  # -> Geometry, Transform
negative_6 = Negative(Value=length_top)
negative_7 = Negative(Value=length_halfway)
rectangle_7 = Rectangle(Plane=move_8.Geometry, XSize=negative_7, YSize=width_halfway, Radius=0)  # -> Rectangle, Length
rectangle_8 = Rectangle(Plane=move_7.Geometry, XSize=negative_6, YSize=width_top, Radius=0)  # -> Rectangle, Length
rectangle_9 = Rectangle(move_6.Geometry)
discontinuity_7 = Discontinuity(Curve=rectangle_8.Rectangle, Level=1)  # -> simplify(graft(Points)), Parameters
discontinuity_8 = Discontinuity(Curve=rectangle_7.Rectangle, Level=1)  # -> simplify(graft(Points)), Parameters
discontinuity_9 = Discontinuity(Curve=rectangle_9, Level=1)  # -> simplify(graft(Points)), Parameters
unit_z_8 = UnitZ(Factor=1)
interpolate_t_2 = InterpolateT(
    Vertices=[discontinuity_9.Points, discontinuity_8.Points, discontinuity_7.Points],
    TangentStart=unit_z_8,
    TangentEnd=Vector(0, 0, 0),
    KnotStyle=1)  # -> flatten(Curve), Length, Domain
graft_tree_2 = GraftTree(Tree=interpolate_t_2.Curve, IncludeEmptyLists=True, IncludeNullItems=True)
shift_list_2 = ShiftList(List=interpolate_t_2.Curve, Shift=1, Wrap=True)  # -> graft(List)
shift_paths_2 = ShiftPaths(Data=shift_list_2, Offset=1)
loft_2 = Loft(
    Curves=[graft_tree_2, shift_paths_2],
    Options={Adjust=False, Closed=False, LoftEnds=0, LoftSimp=0, LoftType=0, Rebuild=10, Refit=0.01})  # -> flatten(Loft)
brep_join_2 = BrepJoin(Breps=loft_2)  # -> Breps, Closed
cap_holes_2 = CapHoles(Brep=brep_join_2.Breps)
