# Grasshopper definition Facade.gh (Grasshopper 1.0.7)
# Copyright: Job de Vogel

v_panel_height = Slider(3.8, range=0..10)
u_panel_width = Slider(1.2, range=0..10)

# ---- group: Facade surface boundary curves
# If facade is not as expected, flip the boundary curves of the facade. Other solution: move the curve to another quadrant of the Rhino World view.
curve = Curve(graft([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]))

# ---- group: WORK IN PROGRESS / Facade Surfaces
surface = Surface(<surface referenced from the Rhino model>)

# ---- group: WORK IN PROGRESS
# Check if normals of facade surface point outwards!
deconstruct_brep = DeconstructBrep(Brep=surface)  # -> Faces, Edges, Vertices
join_curves = JoinCurves(Curves=deconstruct_brep.Edges, Preserve=False)  # -> simplify(Curves)
evaluate_surface = EvaluateSurface(Surface=reparameterize(surface), Point="0.5,0.5")  # -> Point, graft(Normal), UDirection, VDirection, Frame
vector_display = VectorDisplay(Anchor=graft(evaluate_surface.Point), Vector=evaluate_surface.Normal)

# ----
cluster = Cluster(grafted_facades=curve, u_panel_width=u_panel_width, v_panel_height=v_panel_height)  # -> cut_panel_axis, panel_axis, cut_panel_boundary_curve, panel_boundary_curve, cut_panel_plane, panel_plane, out
angle = Slider(3, range=0..90)
# If angle of windows is not as expected, make values negative
bottom_distance = Slider(0.4, range=0..2)
negative = Negative(Value=angle)
deconstruct_plane = DeconstructPlane(Plane=cluster.panel_plane)  # -> Origin, XAxis, YAxis, ZAxis
deconstruct_plane_2 = DeconstructPlane(Plane=cluster.cut_panel_plane)  # -> Origin, XAxis, YAxis, ZAxis

# ---- group: WORK IN PROGRESS / Extract Facade Surface Border
geometry = Geometry(join_curves)
discontinuity = Discontinuity(Curve=geometry, Level=1)  # -> Points, Parameters
evaluate_curve = EvaluateCurve(Curve=geometry, Parameter=discontinuity.Parameters)  # -> Point, Tangent, Angle
degrees = Degrees(Radians=evaluate_curve.Angle)
sort_list = SortList(Keys=degrees, ValuesA=discontinuity.Points)  # -> Keys, reverse(ValuesA)
sort_along_curve = SortAlongCurve(Points=sort_list.ValuesA, Curve=geometry)  # -> Points, Indices
polyline = PolyLine(Vertices=sort_along_curve.Points, Closed=True)  # -> simplify(Polyline)
curve_2 = Curve(flatten(polyline))

# ----
amplitude = Amplitude(Vector=deconstruct_plane.ZAxis, Amplitude=bottom_distance)
amplitude_2 = Amplitude(Vector=deconstruct_plane_2.ZAxis, Amplitude=bottom_distance)
rotate_axis = RotateAxis(Geometry=cluster.cut_panel_plane, Angle=degrees(negative), Axis=cluster.cut_panel_axis)  # -> Geometry, Transform
rotate_axis_2 = RotateAxis(Geometry=cluster.panel_plane, Angle=degrees(negative), Axis=cluster.panel_axis)  # -> Geometry, Transform
curve_3 = Curve(cluster.cut_panel_boundary_curve)
move = Move(Geometry=rotate_axis.Geometry, Motion=amplitude_2)  # -> Geometry, Transform
curve_4 = Curve(cluster.panel_boundary_curve)
move_2 = Move(Geometry=rotate_axis_2.Geometry, Motion=amplitude)  # -> Geometry, Transform
graft_tree = GraftTree(Tree=curve_4, IncludeEmptyLists=True, IncludeNullItems=True)
project_along = ProjectAlong(Geometry=curve_3, Plane=move.Geometry, Direction=deconstruct_plane_2.ZAxis)  # -> Geometry, Transform
project_along_2 = ProjectAlong(Geometry=curve_4, Plane=move_2.Geometry, Direction=deconstruct_plane.ZAxis)  # -> Geometry, Transform
frame_thickness = Slider(0.1, range=0..1)
graft_tree_2 = GraftTree(Tree=curve_3, IncludeEmptyLists=True, IncludeNullItems=True)
negative_2 = Negative(Value=frame_thickness)
graft_tree_3 = GraftTree(Tree=project_along_2.Geometry, IncludeEmptyLists=True, IncludeNullItems=True)
offset_curve = OffsetCurve(Curve=project_along.Geometry, Distance=negative_2, Plane=move.Geometry, Corners=1)  # -> simplify(graft(Curve))
graft_tree_4 = GraftTree(Tree=project_along.Geometry, IncludeEmptyLists=True, IncludeNullItems=True)
offset_curve_2 = OffsetCurve(Curve=project_along_2.Geometry, Distance=negative_2, Plane=rotate_axis_2.Geometry, Corners=1)  # -> simplify(graft(Curve))
ruled_surface = RuledSurface(CurveA=graft_tree, CurveB=graft_tree_3)
ruled_surface_2 = RuledSurface(CurveA=graft_tree_4, CurveB=offset_curve)
ruled_surface_3 = RuledSurface(CurveA=graft_tree_3, CurveB=offset_curve_2)
ruled_surface_4 = RuledSurface(CurveA=graft_tree_2, CurveB=graft_tree_4)
# IGNORE WARNING, small windows at corners give issues I will fix later
surface_2 = Surface(offset_curve)
surface_3 = Surface(offset_curve_2)
# Next step: make inner window frames smaller at bottom and top
custom_preview = CustomPreview(
    Geometry=[ruled_surface, ruled_surface_3, ruled_surface_4, ruled_surface_2],
    Material=ColourSwatch(SwatchColor=RGB(105, 105, 105)))  # disabled
custom_preview_2 = CustomPreview(Geometry=[surface_2, surface_3], Material=ColourSwatch(SwatchColor=RGBA(255, 255, 255, 233)))  # disabled

# ==== cluster Cluster
grafted_facades = ClusterInput()
deconstruct_brep = DeconstructBrep(Brep=grafted_facades)  # -> Faces, Edges, Vertices
area = Area(Geometry=grafted_facades)  # -> Area, Centroid
curve_middle = CurveMiddle(Curve=deconstruct_brep.Edges)
surface_closest_point = SurfaceClosestPoint(Point=area.Centroid, Surface=grafted_facades)  # -> Point, UVPoint, Distance
deconstruct = Deconstruct(Point=curve_middle)  # -> XComponent, YComponent, ZComponent
sort_list = SortList(Keys=deconstruct.ZComponent, ValuesValuesA=deconstruct_brep.Edges)  # -> Keys, ValuesValuesA
evaluate_surface = EvaluateSurface(Surface=grafted_facades, Point=surface_closest_point.UVPoint)  # -> Point, Normal, UDirection, VDirection, Frame
list_item = ListItem(List=sort_list.ValuesValuesA, Index=0, Wrap=True)  # -> Item, Item1, Item2, Item3
end_points = EndPoints(Curve=list_item.Item3)  # -> Start, End
end_points_2 = EndPoints(Curve=list_item.Item)  # -> Start, End
flip_curve = FlipCurve(Curve=list_item.Item1)  # -> Curve, Flag
v_panel_height = ClusterInput()
u_panel_width = ClusterInput()
length = Length(Curve=list_item.Item2)
length_2 = Length(Curve=list_item.Item)
construct_plane = ConstructPlane(Origin=end_points_2.Start, XAxis=list_item.Item, YAxis=flip_curve.Curve)
end_points_3 = EndPoints(Curve=list_item.Item2)  # -> Start, End
rectangle_2pt = Rectangle2Pt(Plane=construct_plane, PointA=end_points_2.End, PointB=end_points.End, Radius=0)  # -> Rectangle, Length
curve = Curve(list_item.Item2)
curve_2 = Curve(list_item.Item1)
division = Division(A=length, B=v_panel_height)
division_2 = Division(A=length_2, B=u_panel_width)
line = Line(StartPoint=end_points_3.Start, EndPoint=end_points_3.End)
divide_curve = DivideCurve(Curve=curve_2, Count=division, Kinks=False)  # -> Points, Tangents, Parameters
quad_panels = QuadPanels(Surface=rectangle_2pt.Rectangle, UDivisions=division_2, VDivisions=division)
round = Round(Number=division_2)  # -> Nearest, Floor, Ceiling
round_2 = Round(Number=division)  # -> Nearest, Floor, Ceiling
area_2 = Area(Geometry=quad_panels)  # -> Area, Centroid
plane_normal = PlaneNormal(Origin=divide_curve.Points, ZAxis=curve_2)  # -> simplify(Plane)
modulus = Modulus(A=division_2, B=round.Floor)
modulus_2 = Modulus(A=division_2, B=round_2.Floor)
curve_closest_point = CurveClosestPoint(Point=area_2.Centroid, Curve=line)  # -> Point, Parameter, Distance
deconstruct_brep_2 = DeconstructBrep(Brep=quad_panels)  # -> Faces, Edges, Vertices
curve_plane = CurvePlane(Curve=curve, Plane=plane_normal, UseTasks=False)  # -> simplify(Points), ParamsC, ParamsP
mass_addition = MassAddition(Input=flatten(modulus))  # -> Result, PartialResults
mass_addition_2 = MassAddition(Input=flatten(modulus_2))  # -> Result, PartialResults
trim_tree = TrimTree(Tree=curve_plane.Points, Depth=1)
smaller_than = SmallerThan(FirstNumber=curve_closest_point.Distance, SecondNumber=u_panel_width)  # -> SmallerThan, OrEqualTo
larger_than = LargerThan(FirstNumber=mass_addition.Result, SecondNumber=0)  # -> LargerThan, OrEqualTo
larger_than_2 = LargerThan(FirstNumber=mass_addition_2.Result, SecondNumber=0)  # -> LargerThan, OrEqualTo
line_2 = Line(StartPoint=plane_normal, EndPoint=trim_tree)
dispatch = Dispatch(List=area_2.Centroid, DispatchPattern=smaller_than.SmallerThan)  # -> ListA, ListB
dispatch_2 = Dispatch(List=quad_panels, DispatchPattern=smaller_than.SmallerThan)  # -> ListA, ListB
gate_or = GateOr(A=larger_than.LargerThan, B=larger_than_2.LargerThan)
cull_index = CullIndex(List=line_2, Indices=-1, Wrap=True)
point_in_curve = PointInCurve(Point=simplify(dispatch.ListB), Curve=simplify(grafted_facades))  # -> Relationship, Point
surface_split = SurfaceSplit(Surface=dispatch_2.ListA, Curves=line)  # -> simplify(Fragments)
stream_filter = StreamFilter(Gate=gate_or, Stream0="Everything is fine!", Stream1="WARNING: One of the facades grids does not follow the panel sizes")
equality = Equality(FirstNumber=point_in_curve.Relationship, SecondNumber=2)  # -> Equality, Inequality
cull_pattern = CullPattern(List=dispatch_2.ListB, CullPattern=equality.Equality)  # -> simplify(List)
area_3 = Area(Geometry=surface_split, UseTasks=True)  # -> Area, Centroid
text = Text(stream_filter)
trim_tree_2 = TrimTree(Tree=area_3.Centroid, Depth=1)
list_length = ListLength(List=area_3.Centroid)
point_in_curve_2 = PointInCurve(Point=trim_tree_2, Curve=simplify(grafted_facades))  # -> Relationship, Point
trim_tree_3 = TrimTree(Tree=list_length, Depth=1)
partition_list = PartitionList(List=point_in_curve_2.Relationship, Size=trim_tree_3)
equality_2 = Equality(FirstNumber=partition_list, SecondNumber=2)  # -> Equality, Inequality
deconstruct_brep_3 = DeconstructBrep(Brep=cull_pattern)  # -> Faces, Edges, Vertices
curve_middle_2 = CurveMiddle(Curve=deconstruct_brep_3.Edges)
cull_pattern_2 = CullPattern(List=surface_split, CullPattern=equality_2.Equality)
deconstruct_2 = Deconstruct(Point=curve_middle_2)  # -> XComponent, YComponent, ZComponent
trim_tree_4 = TrimTree(Tree=cull_pattern_2, Depth=1)
deconstruct_brep_4 = DeconstructBrep(Brep=trim_tree_4)  # -> Faces, Edges, Vertices
evaluate_surface_2 = EvaluateSurface(Surface=reparameterize(trim_tree_4), Point="0.5,0.5")  # -> Point, Normal, UDirection, VDirection, Frame
evaluate_surface_3 = EvaluateSurface(Surface=reparameterize(cull_pattern), Point="0.5,0.5")  # -> Point, Normal, UDirection, VDirection, Frame
sort_list_2 = SortList(Keys=deconstruct_2.ZComponent, ValuesValuesA=deconstruct_brep_3.Edges)  # -> Keys, ValuesValuesA
join_curves = JoinCurves(Curves=deconstruct_brep_3.Edges, Preserve=False)
join_curves_2 = JoinCurves(Curves=deconstruct_brep_4.Edges, Preserve=False)
curve_middle_3 = CurveMiddle(Curve=deconstruct_brep_4.Edges)
list_item_2 = ListItem(List=sort_list_2.ValuesValuesA, Index=0, Wrap=True)
trim_tree_5 = TrimTree(Tree=join_curves, Depth=2)
trim_tree_6 = TrimTree(Tree=join_curves_2, Depth=2)
deconstruct_3 = Deconstruct(Point=curve_middle_3)  # -> XComponent, YComponent, ZComponent
trim_tree_7 = TrimTree(Tree=list_item_2, Depth=1)
cut_panel_boundary_curve = ClusterOutput(trim_tree_6)
cut_panel_plane = ClusterOutput(evaluate_surface_2.Frame)
panel_boundary_curve = ClusterOutput(trim_tree_5)
panel_plane = ClusterOutput(evaluate_surface_3.Frame)
out = ClusterOutput(text)
sort_list_3 = SortList(Keys=deconstruct_3.ZComponent, ValuesValuesA=deconstruct_brep_4.Edges)  # -> Keys, ValuesValuesA
panel_axis = ClusterOutput(trim_tree_7)
list_item_3 = ListItem(List=sort_list_3.ValuesValuesA, Index=0, Wrap=True)
trim_tree_8 = TrimTree(Tree=list_item_3, Depth=1)
cut_panel_axis = ClusterOutput(trim_tree_8)
