# Grasshopper definition Honeybee balconies.gh (Grasshopper 1.0.7)

# Import rectangle :
height_building = Slider(100, range=0..100)
number_of_stories = Slider(10, range=0..10)

# ----
# Create rectangles
curve = Curve(<curve referenced from the Rhino model>)
box_rectangle = BoxRectangle(Rectangle=curve, Height=height_building)
division = Division(A=height_building, B=number_of_stories)
series = Series(Start=number_of_stories, Step=division, Count=number_of_stories)
construct_point = ConstructPoint(XCoordinate=0, YCoordinate=0, ZCoordinate=series)
xy_plane = XYPlane(Origin=construct_point)
brep_plane = BrepPlane(Brep=box_rectangle, Plane=xy_plane)  # -> simplify(Curves), Points

# ----
# Create different elements for honeybee analysis
# Select floorlevel to analyse
depth_balcony = Slider(10, range=0..20)
offset_curve = OffsetCurve(Curve=brep_plane.Curves, Distance=depth_balcony, Corners=1)  # -> simplify(Curve)
loft = Loft(
    Curves=[brep_plane.Curves, offset_curve],
    Options={Adjust=False, Closed=False, LoftEnds=0, LoftSimp=0, LoftType=0, Rebuild=10, Refit=0.01})  # -> flatten(Loft)
shift_list = ShiftList(List=flatten(offset_curve), Shift=1, Wrap=True)  # -> graft(List)
graft_tree = GraftTree(Tree=flatten(offset_curve), IncludeEmptyLists=True, IncludeNullItems=True)
shift_paths = ShiftPaths(Data=shift_list, Offset=1)
list_item = ListItem(List=flatten(brep_plane.Curves), Index="5", Wrap=True)  # -> Item, Item1
list_item_2 = ListItem(List=loft, Index="5", Wrap=True)  # -> Item, Item1
loft_2 = Loft(
    Curves=[graft_tree, shift_paths],
    Options={Adjust=False, Closed=False, LoftEnds=0, LoftSimp=0, LoftType=0, Rebuild=10, Refit=0.01})
loft_3 = Loft(
    Curves=[list_item.Item, list_item.Item1],
    Options={Adjust=False, Closed=False, LoftEnds=0, LoftSimp=0, LoftType=0, Rebuild=10, Refit=0.01})
list_item_3 = ListItem(List=flatten(loft_2), Index="5", Wrap=True)
deconstruct_brep = DeconstructBrep(Brep=list_item_3)  # -> Faces, Edges, Vertices
area = Area(Geometry=deconstruct_brep.Faces)  # -> Area, Centroid
scale = Scale(Geometry=deconstruct_brep.Faces, Center=area.Centroid, Factor="0.99")  # -> Geometry, Transform

# ----
# Create honeybee elements
floor = Geometry(list_item_2.Item)
roof = Geometry(list_item_2.Item1)
wall_inside = Geometry(loft_3)
wall_outside = Geometry(list_item_3)
window = Geometry(scale.Geometry)
aperture = HBAperture(geo=window, operable="True")  # -> out, apertures; plug-in component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
face = HBFace(geo=floor, type="Floor", bc="Ground")  # -> out, faces; plug-in component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
face_2 = HBFace(geo=roof, type="RoofCeiling", bc="Outdoors")  # -> out, faces; plug-in component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
face_3 = HBFace(geo=wall_outside, type="Wall", bc="Outdoors")  # -> out, faces; plug-in component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
face_4 = HBFace(geo=wall_inside, type="Wall", bc="Adiabatic")  # -> out, faces; plug-in component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

# ----
# Extract epw data
epw_url = Panel("https://energyplus-weather.s3.amazonaws.com/europe_wmo_region_6/NLD/NLD_Amsterdam.062400_IWEC/NLD_Amsterdam.062400_IWEC.zip")
go_to_epw_website = BooleanToggle(False)
epwmap = LBEPWmap(epw_map=go_to_epw_website)  # -> Output; plug-in component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
downloadepw = LBDownloadWeather(weather_URL=epw_url)  # -> epw_file, stat_file, ddy_file; plug-in component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
importepw = LBImportEPW(epw_file=downloadepw.epw_file)  # -> location, dry_bulb_temperature, dew_point_temperature, relative_humidity, wind_speed, wind_direction, direct_normal_rad, diffuse_horizontal_rad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; plug-in component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

# ----
# Create honeybee model
number_slider = Slider(0.1, range=0..1)
addshade = HBAddShade(hb_obj=aperture.apertures)  # -> hb_obj; plug-in component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
addsubface = HBAddSubface(hb_obj=flatten(face_3.faces), sub_faces=flatten(addshade))  # -> hb_obj; plug-in component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
bordershades = HBExtrudedBorderShades(hb_objs=flatten(aperture.apertures), depth=number_slider, indoor="True")  # -> out, hb_objs; plug-in component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
room = HBRoom(faces=flatten([face.faces, face_2.faces, face_4.faces, addsubface]), name="Room", conditioned=True)  # -> out, room; plug-in component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
model = HBModel(rooms=flatten(room.room), apertures=flatten(bordershades.hb_objs))  # -> out, model; plug-in component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

# ----
# Create grid size
height_to_analyse = Slider(0, range=0..1)
gridsize = Slider(1, range=0..15)
gridrooms = HBSensorGridFromRooms(rooms=model.model, grid_size=gridsize, dist_floor=height_to_analyse)  # -> grid, points, mesh; plug-in component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
assigngridsviews = HBAssignGridsAndViews(model=model.model, grids=flatten(gridrooms.grid))  # -> model; plug-in component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

# ----
# Annual sunlight analysis
# Run analysis!
wea = HBWeaFromEPW(epw_file=downloadepw.epw_file)  # -> wea; plug-in component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
unit_y = UnitY(Factor=1)
directsunhours = HBDirectSunHours(model=assigngridsviews, wea=wea, north=unit_y, run=Toggle(False))  # -> out, results, hours; plug-in component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
heatmap = LBSpatialHeatmap(values=directsunhours.hours, mesh=gridrooms.mesh)  # -> mesh, legend, title, colors, legend_par; plug-in component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

# ----
# Point in time analysis
# Run analysis!
month = Slider(3, range=0..12)
hour = Slider(13, range=0..24)
day = Slider(12, range=0..31)
unit_y_2 = UnitY(Factor=1)
ciesky = HBCIEStandardSky(north=unit_y_2, location=importepw.location, month=month, day=day, hour=hour, type=Slider(0, range=0..100))  # -> sky; plug-in component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
radpar = HBRadianceParameter(recipe_type=Slider(2, range=0..2), detail_level=Slider(1, range=0..10))  # -> rad_par; plug-in component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
pitgrid = HBPointInTimeGridBased(model=assigngridsviews, sky=ciesky, metric=Slider(1, range=0..1), radiance_par=radpar, run=Toggle(False))  # -> out, results; plug-in component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
# Extract the EPW data
# Retrieve the EPW data
# Double-click on False
heatmap_2 = LBSpatialHeatmap(values=pitgrid.results, mesh=gridrooms.mesh)  # -> mesh, legend, title, colors, legend_par; plug-in component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
