# Grasshopper definition Ladybug analysis facade hops.gh (Grasshopper 1.0.7)
# plug-ins: Hops

# ----
# Insert tower shell
frame_width_outer = Slider(0.1, range=0..1)
angle = Slider(10, range=0..100)
frame_width_inner = Slider(0.1, range=0..1)
u_panel_width = Slider(1.8, range=0..10)
straight_offset = Slider(0, range=0..1)
angled_offset = Slider(0.1, range=0..1)
v_panel_height = Slider(3.8, range=0..10)
tolerance_2 = Slider(0.001, range=0..0.001)
geometry = Geometry(<brep referenced from the Rhino model>)

# ----
# Starting moment for analysis
hour = Slider(0, range=0..23)
month = Slider(1, range=0..10)
day = Slider(0, range=0..100)

# ----
# Ending moment for analysis
month_2 = Slider(12, range=0..12)
day_2 = Slider(31, range=0..31)
hour_2 = Slider(23, range=0..23)

# ----
# Position of the north
# Gridsize
# Start analysis:
run_the_calculation = BooleanToggle(False)
sun_position = Slider(0, range=0..180)
grid_size = Panel("5")

# ----
# Building to analyse
# Turn preview off after analysis to get a better view
brep = Brep(<brep referenced from the Rhino model>)
surface = Surface(<surface referenced from the Rhino model>)
brep_2 = Brep(<brep referenced from the Rhino model>)

# ----
# Surroundings to consider
# Also add these to the merge
brep_3 = Brep()
brep_4 = Brep(<brep referenced from the Rhino model>)
brep_5 = Brep(<brep referenced from the Rhino model>)
brep_6 = Brep()

cap_holes = CapHoles(Brep=brep)
cap_holes_2 = CapHoles(Brep=brep_2)

# ----
# Extract facade elements with hops:
# Use main_facade
hops = Hops(
    ShellBrep=geometry,
    VPanelHeight=v_panel_height,
    UPanelWidth=u_panel_width,
    AngleDegrees=angle,
    NormalOffset=straight_offset,
    AngledOffset=angled_offset,
    FrameWidthInner=frame_width_inner,
    FrameWidthOuter=frame_width_outer,
    Tolerance=tolerance_2,
    CacheResultsInMemory=True,
    CacheSolveResults=True,
    RemoteDefinitionLocation="https://github.com/JobdeVogel/MEGA/raw/main/main_facade.gh",
    RemoteSolveVersion=(0, 1, 0),
    ShowInput_Enabled=False,
    ShowInput_Path=False,
    SynchronousSolve=True)  # -> OuterFrameInside, InnerFrameInside, InnerFrameOutside, StraightOffsetOuterFrame, AngledOffsetOuterFrame
curve = Curve(flatten(hops.OuterFrameInside))

# ----
# Add surroundings to this merge component
merge = Merge(Data1=cap_holes_2, Data2=cap_holes, Data3=surface)

epw_url = Panel("https://energyplus-weather.s3.amazonaws.com/europe_wmo_region_6/NLD/NLD_Amsterdam.062400_IWEC/NLD_Amsterdam.062400_IWEC.zip")
go_to_epw_website = BooleanToggle(False)
epwmap = LBEPWmap(epw_map=go_to_epw_website)  # -> Output; plug-in component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
downloadepw = LBDownloadWeather(weather_URL=epw_url)  # -> epw_file, stat_file, ddy_file; plug-in component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

# ----
# Find center of breps
merge_2 = Merge(Data1=cap_holes)
area = Area(Geometry=merge_2)  # -> Area, flatten(Centroid)
list_length = ListLength(List=merge_2)
deconstruct = Deconstruct(Point=area.Centroid)  # -> XComponent, YComponent, ZComponent
mass_addition = MassAddition(Input=deconstruct.XComponent)  # -> Result, PartialResults
mass_addition_2 = MassAddition(Input=deconstruct.YComponent)  # -> Result, PartialResults
division = Division(A=mass_addition.Result, B=list_length)
division_2 = Division(A=mass_addition_2.Result, B=list_length)
construct_point = ConstructPoint(XCoordinate=division, YCoordinate=division_2, ZCoordinate="0")

importepw = LBImportEPW(epw_file=downloadepw.epw_file)  # -> location, dry_bulb_temperature, dew_point_temperature, relative_humidity, wind_speed, wind_direction, direct_normal_rad, diffuse_horizontal_rad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; plug-in component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

# ----
# Change legend settings
# HERE -->
construct_domain = ConstructDomain(DomainStart=0, DomainEnd=1)
legend_steps = Slider(20, range=0..20)
range = Range(Domain=construct_domain, Steps=legend_steps)
gradient = Gradient(LowerLimit=0, UpperLimit=1, Parameter=range, stops=[0: RGB(0, 0, 0), 1: RGB(255, 255, 255)])
legend_size = Slider(30, range=0..10000)
location_legend = BooleanToggle(True)
legendpar = LBLegendParameters(colors=gradient, vert_or_horiz=location_legend, seg_height=legend_size)  # -> leg_par; plug-in component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

# ----
# Radiation analysis
analysisperiod = LBAnalysisPeriod(start_month=month, start_day=day, start_hour=hour, end_month=month_2, end_day=day_2, end_hour=hour_2)  # -> period, hoys, dates; plug-in component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
sunpath = LBSunPath(north=sun_position, location=importepw.location, hoys=analysisperiod.hoys, center_pt=construct_point, scale="4")  # -> out, vectors, altitudes, azimuths, hoys, sun_pts, analemma, daily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; plug-in component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
skymatrix = LBCumulativeSkyMatrix(
    north=sun_position,
    location=importepw.location,
    direct_rad=importepw.direct_normal_rad,
    diffuse_rad=importepw.diffuse_horizontal_rad,
    hoys=analysisperiod.hoys,
    high_density=Toggle(True))  # -> out, sky_mtx; plug-in component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
offset_height = Slider(0.1, range=0..1)
multicore_processing = BooleanToggle(False)
incidentradiation = LBIncidentRadiation(
    sky_mtx=skymatrix.sky_mtx,
    geometry=flatten(merge_2),
    context=flatten(merge),
    grid_size=grid_size,
    offset_dist=offset_height,
    cpu_count=multicore_processing,
    run=run_the_calculation)  # -> out, points, results, total, mesh, legend, title, int_mtx; plug-in component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

# ----
# Remove top and bottom of the data points
point = Point(incidentradiation.points)
data = Data(incidentradiation.results)
deconstruct_2 = Deconstruct(Point=point)  # -> XComponent, YComponent, ZComponent
sort_list = SortList(Keys=deconstruct_2.ZComponent, ValuesValuesA=point)  # -> Keys, ValuesValuesA
sort_list_2 = SortList(Keys=deconstruct_2.ZComponent, ValuesValuesA=data)  # -> Keys, ValuesValuesA
integer = Integer(sort_list.Keys)
list_item = ListItem(List=integer, Index=0, Wrap=True)  # -> Item1, Item
equality = Equality(FirstNumber=integer, SecondNumber=list_item.Item)  # -> Equality, Inequality
dispatch = Dispatch(List=integer, DispatchPattern=equality.Equality)  # -> ListA, ListB
dispatch_2 = Dispatch(List=sort_list.ValuesValuesA, DispatchPattern=equality.Equality)  # -> ListA, ListB
dispatch_3 = Dispatch(List=sort_list_2.ValuesValuesA, DispatchPattern=equality.Equality)  # -> ListA, ListB
equality_2 = Equality(FirstNumber=list_item.Item1, SecondNumber=dispatch.ListB)  # -> Equality, Inequality
dispatch_4 = Dispatch(List=dispatch_3.ListB, DispatchPattern=equality_2.Inequality)  # -> ListA, ListB
dispatch_5 = Dispatch(List=dispatch_2.ListB, DispatchPattern=equality_2.Inequality)  # -> ListA, ListB
point_2 = Point(dispatch_5.ListA)
data_2 = Data(dispatch_4.ListA)

# ----
# Create surface from facade frames
discontinuity = Discontinuity(Curve=curve, Level=1)  # -> Points, Parameters
list_item_2 = ListItem(List=discontinuity.Points, Index=0, Wrap=True)  # -> Item, Item1, Item2, Item3
_4point_surface = _4PointSurface(CornerA=list_item_2.Item, CornerB=list_item_2.Item1, CornerC=list_item_2.Item2, CornerD=list_item_2.Item3)  # -> flatten(Surface)
average = Average(Input=discontinuity.Points)  # -> flatten(ArithmeticMean)

# ----
# Percentage glass:
# Avarage of slider 1 and 2 is roughly the percentage glass
slider_1 = Slider(8, range=0..50)
slider_2 = Slider(69, range=50..100)

# ----
# Remove pattern
closest_point = ClosestPoint(Point=average, Cloud=point_2)  # -> ClosestPoint, CPIndex, Distance
list_item_3 = ListItem(List=data_2, Index=closest_point.CPIndex, Wrap=True)
construct_domain_2 = ConstructDomain(DomainStart=slider_1, DomainEnd=slider_2)
bounds = Bounds(Numbers=list_item_3)
remap_numbers = RemapNumbers(Value=list_item_3, Source=bounds, Target=construct_domain_2)  # -> Mapped, Clipped
subtraction = Subtraction(A=100, B=remap_numbers.Mapped)
list_length_2 = ListLength(List=remap_numbers.Mapped)
series = Series(Start=0, Step=1, Count=100)
integer_2 = Integer(subtraction)
random = Random(Range=Domain(0, 99), Number=list_length_2, Seed=4, Integers=True)  # -> simplify(Random)
random_reduce = RandomReduce(List=series, Reduction=integer_2, Seed=Slider(6, range=0..10))  # -> simplify(List)
list_item_4 = ListItem(List=series, Index=random, Wrap=True)  # -> simplify(graft(Item))
member_index = MemberIndex(Set=random_reduce, Member=list_item_4)  # -> Index, flatten(Count)
boolean = Boolean(member_index.Count)

remap_numbers_2 = RemapNumbers(Value=list_item_3, Source=bounds, Target=Domain(0, 1))  # -> Mapped, Clipped
gradient_2 = Gradient(
    LowerLimit=0,
    UpperLimit=1,
    Parameter=remap_numbers_2.Mapped,
    stops=[0: RGB(0, 128, 0), 0.5: RGB(255, 165, 0), 1: RGB(255, 0, 0)])
list_length_3 = ListLength(List=_4point_surface)
dispatch_6 = Dispatch(List=_4point_surface, DispatchPattern=boolean)  # -> ListA, ListB
cull_pattern = CullPattern(List=gradient_2, CullPattern=boolean)
list_length_4 = ListLength(List=dispatch_6.ListA)
division_3 = Division(A=list_length_4, B=list_length_3)

panel = Panel(division_3)

# ----
# Different legend opaque panels
custom_preview = CustomPreview(Geometry=simplify(graft(dispatch_6.ListA)), Material=simplify(graft(cull_pattern)))

# ----
# Glass
colour_swatch = ColourSwatch(SwatchColor=RGBA(255, 255, 255, 111))
custom_preview_2 = CustomPreview(Geometry=dispatch_6.ListB, Material=colour_swatch)

# ----
# Opaque
colour_swatch_2 = ColourSwatch(SwatchColor=RGBA(0, 0, 0, 133))
# Create the sunpath
# Calculate sun hours
# Extract the EPW data
# Set the analysis period
# Set the legend color
custom_preview_3 = CustomPreview(Geometry=dispatch_6.ListA, Material=colour_swatch_2)
