# Grasshopper definition Ladybug analysis hops.gh (Grasshopper 1.0.7)

brep = Brep(<brep referenced from the Rhino model>)
brep_2 = Brep(<brep referenced from the Rhino model>)

epw_url = Panel("https://energyplus-weather.s3.amazonaws.com/europe_wmo_region_6/NLD/NLD_Amsterdam.062400_IWEC/NLD_Amsterdam.062400_IWEC.zip")
go_to_epw_website = BooleanToggle(False)
epwmap = LBEPWmap(epw_map=go_to_epw_website)  # -> Output; plug-in component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
downloadepw = LBDownloadWeather(weather_URL=epw_url)  # -> epw_file, stat_file, ddy_file; plug-in component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

input_geometry = GetGeometry([brep, brep_2], AtLeast=1, AtMost=1, DeleteInput=False, Filter=1073741880)
cap_holes = CapHoles(Brep=input_geometry)
importepw = LBImportEPW(epw_file=downloadepw.epw_file)  # -> location, dry_bulb_temperature, dew_point_temperature, relative_humidity, wind_speed, wind_direction, direct_normal_rad, diffuse_horizontal_rad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; plug-in component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
day = Slider(21, range=0..100)
month = Slider(7, range=0..10)
hour = Slider(8, range=0..100)
month_2 = Slider(7, range=0..10)
day_2 = Slider(21, range=0..100)
hour_2 = Slider(8, range=0..100)

# ----
# Change legend settings
# HERE -->
construct_domain = ConstructDomain(DomainStart=0, DomainEnd=1)
legend_steps = Slider(10, range=0..10)
range = Range(Domain=construct_domain, Steps=legend_steps)
gradient = Gradient(LowerLimit=0, UpperLimit=1, Parameter=range, stops=[0: RGB(0, 0, 0), 1: RGB(255, 255, 255)])
legend_size = Slider(30, range=0..10000)
location_legend = BooleanToggle(True)
legendpar = LBLegendParameters(colors=gradient, vert_or_horiz=location_legend, seg_height=legend_size)  # -> leg_par; plug-in component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

start_month = GetNumber(month, AtLeast=1, AtMost=12, Maximum=12, Minimum=1)
start_hour = GetNumber(hour, AtLeast=1, AtMost=24, Maximum=1.797693135e+308, Minimum=-1.797693135e+308)
start_day = GetNumber(day, AtLeast=1, AtMost=31, Maximum=1.797693135e+308, Minimum=-1.797693135e+308)
end_day = GetNumber(day_2, AtLeast=1, AtMost=31, Maximum=1.797693135e+308, Minimum=-1.797693135e+308)
end_hour = GetNumber(hour_2, AtLeast=1, AtMost=24, Maximum=1.797693135e+308, Minimum=-1.797693135e+308)
end_month = GetNumber(month_2, AtLeast=1, AtMost=12, Maximum=1.797693135e+308, Minimum=-1.797693135e+308)

hour_3 = Slider(16, range=0..23)
month_3 = Slider(6, range=0..10)
day_3 = Slider(22, range=0..100)
hoy = LBCalculateHOY(month=month_3, day=day_3, hour=hour_3)  # -> flatten(hoy), flatten(doy), flatten(date); plug-in component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
analysisperiod = LBAnalysisPeriod(
    start_month=start_month,
    start_day=start_day,
    start_hour=start_hour,
    end_month=end_month,
    end_day=end_day,
    end_hour=end_hour)  # -> period, hoys, dates; plug-in component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

sun_position = Slider(20, range=0..20)
north = GetNumber(sun_position, AtLeast=1, AtMost=360, Maximum=1.797693135e+308, Minimum=-1.797693135e+308)
scale = Panel("3")

sunpath_type = ValueList({"Orthographic", "Stereographic", "3D": None}, selected="3D")
sunpath = LBSunPath(north=north, location=importepw.location, hoys=analysisperiod.hoys, scale=scale, projection=sunpath_type)  # -> out, vectors, altitudes, azimuths, hoys, sun_pts, analemma, daily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; plug-in component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

# ----
# Surface to calculate
# Context geometry
brep_3 = Brep()

brep_4 = Brep(cap_holes)
sphere = Sphere(Base=sunpath.sun_pts, Radius=1)
list_length = ListLength(List=brep_4)
duplicate_data = DuplicateData(Data=brep_4, Number=list_length, Order=True)
series = Series(Start=0, Step=1, Count=list_length)  # -> simplify(graft(Series))
partition_list = PartitionList(List=duplicate_data, Size=list_length)  # -> simplify(Chunks)
cull_index = CullIndex(List=partition_list, Indices=series, Wrap=True)  # -> simplify(List)
list_item = ListItem(List=partition_list, Index=series, Wrap=True)  # -> simplify(Item)

run_the_calculation = BooleanToggle(True)
grid_size = Panel("5")
multicore_processing = BooleanToggle(False)
offset_height = Slider(1, range=0..1000)

grid_size_2 = GetNumber(grid_size, AtLeast=1, AtMost=1, Maximum=1.797693135e+308, Minimum=-1.797693135e+308)
run = GetBoolean(run_the_calculation, AtLeast=1, AtMost=1, FalseValue="False", TrueValue="True")

directsunhours = LBDirectSunHours(
    vectors=flatten(sunpath.vectors),
    geometry=list_item,
    context=cull_index,
    grid_size=grid_size_2,
    offset_dist=offset_height,
    parallel=multicore_processing,
    run=run)  # -> out, points, results, mesh, legend, title, int_mtx; plug-in component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

# ---- group: RH_OUT: mesh
mesh = Mesh(directsunhours.mesh)

# ---- group: RH_OUT: Legend
# Create the sunpath
# Calculate sun hours
# Extract the EPW data
# Set the analysis period
# Set the legend color
text = Text(directsunhours.legend)

# ---- group: RH_OUT: result
rh_out_results = Number(directsunhours.results)
