# Grasshopper definition Ladybug analysis sunhours hops.gh (Grasshopper 1.0.7)

# ----
# Ending moment for analysis
month = Slider(12, range=0..12)
day = Slider(31, range=0..31)
hour = Slider(23, range=0..23)

# ----
# Building to analyse
# Turn preview off after analysis to get a better view
brep = Brep(<brep referenced from the Rhino model>)
brep_2 = Brep(<brep referenced from the Rhino model>)
surface = Surface(<surface referenced from the Rhino model>)

# ----
# Starting moment for analysis
hour_2 = Slider(0, range=0..23)
month_2 = Slider(1, range=0..10)
day_2 = Slider(0, range=0..100)

# ----
# Position of the north
# Gridsize
# Start analysis:
run_the_calculation = BooleanToggle(True)
sun_position = Slider(0, range=0..180)
grid_size = Panel("10")

# ----
# Surroundings to consider
brep_3 = Brep()
brep_4 = Brep(<brep referenced from the Rhino model>)
brep_5 = Brep(<brep referenced from the Rhino model>)
brep_6 = Brep()

cap_holes = CapHoles(Brep=brep)
cap_holes_2 = CapHoles(Brep=brep_2)
merge = Merge(Data1=cap_holes)
merge_2 = Merge(Data1=cap_holes_2, Data2=cap_holes, Data3=surface)

epw_url = Panel("https://energyplus-weather.s3.amazonaws.com/europe_wmo_region_6/NLD/NLD_Amsterdam.062400_IWEC/NLD_Amsterdam.062400_IWEC.zip")
go_to_epw_website = BooleanToggle(False)
epwmap = LBEPWmap(epw_map=go_to_epw_website)  # -> Output; plug-in component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
downloadepw = LBDownloadWeather(weather_URL=epw_url)  # -> epw_file, stat_file, ddy_file; plug-in component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

area = Area(Geometry=merge)  # -> Area, flatten(Centroid)
list_length = ListLength(List=merge)
deconstruct = Deconstruct(Point=area.Centroid)  # -> XComponent, YComponent, ZComponent
importepw = LBImportEPW(epw_file=downloadepw.epw_file)  # -> location, dry_bulb_temperature, dew_point_temperature, relative_humidity, wind_speed, wind_direction, direct_normal_rad, diffuse_horizontal_rad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; plug-in component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
mass_addition = MassAddition(Input=deconstruct.XComponent)  # -> Result, PartialResults
mass_addition_2 = MassAddition(Input=deconstruct.YComponent)  # -> Result, PartialResults

hour_3 = Slider(16, range=0..23)
month_3 = Slider(6, range=0..10)
day_3 = Slider(22, range=0..100)
analysisperiod = LBAnalysisPeriod(start_month=month_2, start_day=day_2, start_hour=hour_2, end_month=month, end_day=day, end_hour=hour)  # -> period, hoys, dates; plug-in component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
hoy = LBCalculateHOY(month=month_3, day=day_3, hour=hour_3)  # -> flatten(hoy), flatten(doy), flatten(date); plug-in component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

division = Division(A=mass_addition.Result, B=list_length)
division_2 = Division(A=mass_addition_2.Result, B=list_length)
construct_domain = ConstructDomain(DomainStart=0, DomainEnd=1)
# Change legend settings
# HERE -->
legend_steps = Slider(20, range=0..20)
construct_point = ConstructPoint(XCoordinate=division, YCoordinate=division_2, ZCoordinate="0")
range = Range(Domain=construct_domain, Steps=legend_steps)
gradient = Gradient(LowerLimit=0, UpperLimit=1, Parameter=range, stops=[0: RGB(0, 0, 0), 1: RGB(255, 255, 255)])
scale = Panel("4")

sunpath_type = ValueList({"Orthographic", "Stereographic", "3D": None}, selected="3D")
sunpath = LBSunPath(
    north=sun_position,
    location=importepw.location,
    hoys=analysisperiod.hoys,
    center_pt=construct_point,
    scale=scale,
    projection=sunpath_type)  # -> out, vectors, altitudes, azimuths, hoys, sun_pts, analemma, daily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; plug-in component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

legend_size = Slider(30, range=0..10000)
location_legend = BooleanToggle(True)
legendpar = LBLegendParameters(colors=gradient, vert_or_horiz=location_legend, seg_height=legend_size)  # -> leg_par; plug-in component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
multicore_processing = BooleanToggle(False)
offset_height = Slider(0.1, range=0..1)
incidentradiation = LBIncidentRadiation()  # -> out, points, results, total, mesh, legend, title, int_mtx; plug-in component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
directsunhours = LBDirectSunHours(
    vectors=flatten(sunpath.vectors),
    geometry=merge,
    context=merge_2,
    grid_size=grid_size,
    offset_dist=offset_height,
    parallel=multicore_processing,
    run=run_the_calculation)  # -> out, points, results, mesh, legend, title, int_mtx; plug-in component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
