# Grasshopper definition Pointgrid_Generator.gh (Grasshopper 1.0.7)
# Copyright: Job de Vogel

geometry = Geometry([<brep referenced from the Rhino model> x2])
building_brep = GetGeometry(AtLeast=1, AtMost=1, DeleteInput=False, Filter=1074004029)
geometry_2 = Geometry(building_brep)
z_count = GetInteger(AtLeast=1, AtMost=1, Maximum=2147483647, Minimum=-2147483648)
xy_count = GetInteger(AtLeast=1, AtMost=1, Maximum=2147483647, Minimum=-2147483648)

# ---- group: Voxel Grid generator
bounding_box = BoundingBox(Content=geometry_2, Plane=PlaneXY(0, 0, 0), UnionBox=True)  # -> Box, Box_2
deconstruct_brep = DeconstructBrep(Brep=bounding_box.Box_2)  # -> Faces, Edges, Vertices
number_slider = Slider(24, range=0..40)
number_slider_2 = Slider(20, range=0..40)
deconstruct_box = DeconstructBox(Box=bounding_box.Box_2)  # -> Plane, X, Y, Z
list_item = ListItem(List=deconstruct_brep.Vertices, Index=0, Wrap=True)
deconstruct_domain = DeconstructDomain(Domain=deconstruct_box.Y)  # -> Start, End
deconstruct_domain_2 = DeconstructDomain(Domain=deconstruct_box.X)  # -> Start, End
deconstruct_domain_3 = DeconstructDomain(Domain=deconstruct_box.Z)  # -> Start, End
subtraction = Subtraction(A=deconstruct_domain.End, B=deconstruct_domain.Start)
subtraction_2 = Subtraction(A=deconstruct_domain_2.End, B=deconstruct_domain_2.Start)
subtraction_3 = Subtraction(A=deconstruct_domain_3.End, B=deconstruct_domain_3.Start)
division = Division(A=subtraction_2, B=xy_count)
division_2 = Division(A=subtraction_3, B=z_count)
division_3 = Division(A=subtraction, B=xy_count)
domain_box = DomainBox(Base=PlaneXY(0, 0, 0), X=division, Y=division_3, Z=division_2)
sort_list = SortList(Keys=[division, division_3, division_2])  # -> reverse(Keys), ValuesValuesA
list_item_2 = ListItem(List=sort_list.Keys, Index=0, Wrap=True)

# ---- group: RH_OUT:Z-height
number = Number(subtraction_3)

# ----
mesh = Mesh(domain_box)
brep = Brep(bounding_box.Box_2)

# ---- group: RH_OUT:Highest NB Distance
highest_nb_distance = Number(list_item_2)

# ---- group: RH_OUT:Box
geometry_3 = Geometry(brep)

# ---- group: Voxel Grid generator (continued)
orient = Orient(Geometry=mesh, Source=PlaneXY(0, 0, 0), Target=list_item)  # -> Geometry, Transform
box_array = BoxArray(Geometry=orient.Geometry, Cell=orient.Geometry, XCount=xy_count, YCount=xy_count, ZCount=z_count)  # -> Geometry, Transform
volume = Volume(Geometry=box_array.Geometry)  # -> Volume, Centroid
list_item_3 = ListItem(List=volume.Volume, Index=0, Wrap=True)

# ----
point_in_breps = PointInBreps(Brep=geometry_2, Point=volume.Centroid, Strict=False)  # -> Inside, Index

# ---- group: Voxel Grid generator (continued)
cull_pattern = CullPattern(List=box_array.Geometry, CullPattern=point_in_breps.Inside)
cull_pattern_2 = CullPattern(List=volume.Centroid, CullPattern=point_in_breps.Inside)

# ---- group: RH_OUT:Pointcloud
point = Point(cull_pattern_2)

# ---- group: RH_OUT:Voxel volume
block_volume = Number(list_item_3)

# ---- group: RH_OUT:Voxels
geometry_4 = Geometry(cull_pattern)
