# Grasshopper definition Read_CSV.gh (Grasshopper 1.0.7)
# Copyright: Job de Vogel
# plug-ins: LunchBox

# Hops variant
path = GetFilePath(AtLeast=1, AtMost=1)
# README: This script converts excel requirements to Grasshopper numerical data.
path_2 = Panel("C:/Users/Job de Vogel/OneDrive/Bureaublad/csv_data1.csv")
read_file = ReadFile(File=path, PerLineParse=True)
read_csv = ReadCSV(CSVString=read_file, Delimiter=",")  # -> Headers, Values
to_extract = GetString(AtLeast=1, AtMost=1)
read_file_2 = ReadFile(File=path_2, PerLineParse=True)
read_csv_2 = ReadCSV(CSVString=read_file_2, Delimiter=",")  # -> Headers, Values
# Select headers here!
to_extract_2 = Panel("""min_height
min_length
min_width""")
flip_matrix = FlipMatrix(Data=read_csv.Values)
ghpython_script = GhPythonScript(headers=read_csv.Headers, to_find=to_extract)  # -> out, indices; inputs headers: list, to_find: list
# ---------- ghpython_script: Python ----------
__author__ = "Job de Vogel"
__version__ = "2022.04.22"

indices = []

for find in to_find:
    for i, header in enumerate(headers):
        if header ==  find:
            indices.append(i)
            break
# ---------- end ghpython_script ----------
flip_matrix_2 = FlipMatrix(Data=read_csv_2.Values)
headers = Panel(read_csv_2.Headers)
ghpython_script_2 = GhPythonScript(headers=read_csv_2.Headers, to_find=to_extract_2)  # -> out, indices; inputs headers: list, to_find: list; same code as ghpython_script
list_item = ListItem(List=flip_matrix, Index=ghpython_script.indices, Wrap=True)  # -> simplify(Item)
list_item_2 = ListItem(List=flip_matrix_2, Index=ghpython_script_2.indices, Wrap=True)  # -> simplify(Item)
flip_matrix_3 = FlipMatrix(Data=list_item)
flip_matrix_4 = FlipMatrix(Data=list_item_2)

# ---- group: RH_OUT:Headers
number = Number(read_csv.Headers)

# ---- group: RH_OUT:Header values by function
number_2 = Number(list_item)

# ---- group: RH_OUT:Values by header
number_3 = Number(flip_matrix_3)

# ----
header_values_by_program_function = Panel(list_item_2)
values_by_header = Panel(flip_matrix_4)
