# Grasshopper definition Speckle_template.gh (Grasshopper 1.0.7)
# Copyright: Job de Vogel
# plug-ins: Speckle 2

accounts = Accounts(
    {"No account selected": , "Account (j.devogel@student.tudelft.nl | https://speckle.xyz)": "f35b9d4886"}, selected="Account (j.devogel@student.tudelft.nl | https://speckle.xyz)",
    selectedId="f35b9d4886",
    selectedServer="https://speckle.xyz")
stream_list = StreamList(Account=accounts, Limit=10)
send = Send(
    Stream=stream_list,
    Message="Add message for send here",
    AutoSend=False,
    BaseId="cbf0f997d9f73c591a42a890f21f4f45",
    CurrentComponentState="up_to_date",
    KitName="Objects",
    OutputWrappers="https://speckle.xyz\t5269b7bee5\td5e28d5708",
    UseDefaultCache=True,
    selectedKitName="Objects")
stream_details = StreamDetails(Stream=stream_list)  # -> StreamID, Name, Description, CreatedAt, UpdatedAt, Public, Collaborators, Branches
receive = Receive(
    Stream=stream_list,
    AutoReceive=False,
    CurrentComponentState="expired",
    ExpandOutput=True,
    LastInfoMessage="Job de Vogel @ 2022-04-25T10:44:43.152Z: Add message for send here (id:d5e28d5708)",
    ReceiveOnOpen=False,
    ReceivedCommitId="d5e28d5708",
    StreamWrapper="https://speckle.xyz/streams/5269b7bee5?u=f35b9d4886",
    selectedKitName="Objects")  # -> Info, Data
expand_speckle_object = ExpandSpeckleObject(SpeckleObject=receive.Data, selectedKitName="Objects")
