# Grasshopper definition Tower_Positioning.gh (Grasshopper 1.0.7)
# Copyright: Job de Vogel

tower_distance = Slider(26, range=0..50)
tower_1_x = Slider(-28, range=-30..30)
tower_1_y = Slider(30, range=0..100)
tower_1_pos = Slider(0.38, range=0..1)
tower_2_pos = Slider(0.89, range=0..1)
tower_2_x = Slider(-24, range=-30..30)
tower_2_y = Slider(30, range=0..100)
circle = Circle(Plane=PlaneXY(0, 0, 0), Radius=tower_distance)
evaluate_curve = EvaluateCurve(Curve=reparameterize(circle), Parameter=tower_1_pos)  # -> Point, Tangent, Angle
evaluate_curve_2 = EvaluateCurve(Curve=reparameterize(circle), Parameter=tower_2_pos)  # -> Point, Tangent, Angle
negative = Negative(Value=tower_2_x)
negative_2 = Negative(Value=tower_2_y)
rectangle = Rectangle(Plane=evaluate_curve.Point, XSize=tower_1_x, YSize=tower_1_y, Radius=0)  # -> Rectangle, Length
rectangle_2 = Rectangle(Plane=evaluate_curve_2.Point, XSize=negative, YSize=negative_2, Radius=0)  # -> Rectangle, Length
area = Area(Geometry=rectangle_2.Rectangle)  # -> Area, Centroid
discontinuity = Discontinuity(Curve=rectangle_2.Rectangle, Level=1)  # -> Points, Parameters
area_2 = Area(Geometry=rectangle.Rectangle)  # -> Area, Centroid
unit_y = UnitY(Factor=1)
point_in_curve = PointInCurve(Point=discontinuity.Points, Curve=rectangle.Rectangle)  # -> Relationship, Point
vector_2pt = Vector2Pt(PointA=area_2.Centroid, PointB=area.Centroid, Unitize=False)  # -> Vector, Length
mass_addition = MassAddition(Input=point_in_curve.Relationship)  # -> Result, PartialResults
reverse = Reverse(Vector=vector_2pt.Vector)
angle = Angle(VectorA=unit_y, VectorB=vector_2pt.Vector)  # -> Angle, Reflex
angle_2 = Angle(VectorA=unit_y, VectorB=reverse)  # -> Angle, Reflex
larger_than = LargerThan(FirstNumber=mass_addition.Result, SecondNumber=0)  # -> LargerThan, OrEqualTo
line = Line(StartPoint=area_2.Centroid, EndPoint=area.Centroid)
degrees = Degrees(Radians=angle.Angle)
degrees_2 = Degrees(Radians=angle_2.Angle)
length = Length(Curve=line)
subtraction = Subtraction(A=degrees, B=45)
subtraction_2 = Subtraction(A=degrees_2, B=45)
one_over_x = OneOverX(Value=length)
absolute = Absolute(Value=subtraction)
absolute_2 = Absolute(Value=subtraction_2)
penalty_for_closeness = Panel(one_over_x)
minimum = Minimum(A=absolute, B=absolute_2)
stream_filter = StreamFilter(Gate=larger_than.LargerThan, Stream0=minimum, Stream1=inf)
penalty_for_anti_diagonality_and_interse = Panel(stream_filter)  # "Penalty for anti-diagonality and intersection"
