# Grasshopper definition Towers Honeybee.gh (Grasshopper 1.0.7)
# Copyright: Job de Vogel

level_height = Slider(4.2, range=0..10)  # disabled
levels_per_level = Slider(3, range=0..10)  # disabled
balcony_depth = Slider(1.8, range=0..10)  # disabled
core_y_size = Slider(15, range=0..100)  # disabled
shell_offset = Slider(1.8, range=0..10)  # disabled
levels = Slider(11, range=0..30)  # disabled
grid_size = Slider(3.6, range=0..10)  # disabled
core_x_distance = Slider(10, range=0..100)  # disabled
core_y_distance = Slider(10, range=0..100)  # disabled
core_x_size = Slider(15, range=0..100)  # disabled
balcony_type = BooleanToggle(False)  # disabled
balcony_depth_2 = Slider(1.8, range=0..10)  # disabled
shell_offset_2 = Slider(1.8, range=0..10)  # disabled
levels_2 = Slider(11, range=0..30)  # disabled
levels_per_level_2 = Slider(3, range=0..10)  # disabled
level_height_2 = Slider(4.2, range=0..10)  # disabled
grid_size_2 = Slider(3.6, range=0..10)  # disabled
core_x_distance_2 = Slider(10, range=0..100)  # disabled
core_y_distance_2 = Slider(10, range=0..100)  # disabled
core_x_size_2 = Slider(15, range=0..100)  # disabled
core_y_size_2 = Slider(15, range=0..100)  # disabled
balcony_type_2 = BooleanToggle(False)  # disabled
curve = Curve(<curve referenced from the Rhino model>)  # disabled
level_height_3 = Slider(4.2, range=0..10)
levels_per_level_3 = Slider(3, range=0..10)
balcony_depth_3 = Slider(1.8, range=0..10)
core_y_size_3 = Slider(15, range=0..100)
shell_offset_3 = Slider(1.8, range=0..10)
levels_3 = Slider(11, range=0..30)
grid_size_3 = Slider(3.6, range=0..10)
core_x_distance_3 = Slider(10, range=0..100)
core_y_distance_3 = Slider(10, range=0..100)
core_x_size_3 = Slider(15, range=0..100)
ground_floor_rectangle = GetGeometry(curve, AtLeast=1, AtMost=1, DeleteInput=False, Filter=1073741828)  # disabled
balcony_type_3 = BooleanToggle(True)
curve_2 = Curve(<curve referenced from the Rhino model>)  # disabled
levels_per_level_4 = Slider(3, range=0..10)
grid_size_4 = Slider(3.6, range=0..10)
core_y_size_4 = Slider(15, range=0..100)
levels_4 = Slider(11, range=0..30)
level_height_4 = Slider(4.2, range=0..10)
core_x_distance_4 = Slider(10, range=0..100)
core_y_distance_4 = Slider(10, range=0..100)
core_x_size_4 = Slider(15, range=0..100)
balcony_depth_4 = Slider(1.8, range=0..10)
shell_offset_4 = Slider(1.8, range=0..10)
ground_floor_rectangle_2 = GetGeometry(curve_2, AtLeast=1, AtMost=1, DeleteInput=False, Filter=1073741828)  # disabled
balcony_type_4 = BooleanToggle(True)
curve_3 = Curve(<curve referenced from the Rhino model>)
ground_floor_rectangle_3 = GetGeometry(curve_3, AtLeast=1, AtMost=1, DeleteInput=False, Filter=1073741828)

# ---- group: Move tower to origin
discontinuity = Discontinuity(Curve=ground_floor_rectangle, Level=1)  # -> Points, Parameters; disabled
list_item = ListItem(List=discontinuity.Points, Index=0, Wrap=True)  # -> Item, Item1; disabled
xy_plane = XYPlane(Origin=Point(0, 0, 0))  # disabled
vector_2pt = Vector2Pt(PointA=xy_plane, PointB=list_item.Item, Unitize=False)  # -> Vector, Length; disabled
negative = Negative(Value=vector_2pt.Vector)  # disabled
move = Move(Geometry=ground_floor_rectangle, Motion=negative)  # -> Geometry, Transform; disabled
discontinuity_2 = Discontinuity(Curve=move.Geometry, Level=1)  # -> Points, Parameters; disabled
list_item_2 = ListItem(List=discontinuity_2.Points, Index=0, Wrap=True)  # -> Item, Item1; disabled
vector_2pt_2 = Vector2Pt(PointA=list_item_2.Item, PointB=list_item_2.Item1, Unitize=False)  # -> Vector, Length; disabled
unit_x = UnitX(Factor=1)  # disabled
unit_y = UnitY(Factor=1)  # disabled
rotate_direction = RotateDirection(Geometry=move.Geometry, Center=Point(0, 0, 0), From=vector_2pt_2.Vector, To=unit_x)  # -> Geometry, Transform; disabled
discontinuity_3 = Discontinuity(Curve=rotate_direction.Geometry, Level=1)  # -> Points, Parameters; disabled
list_item_3 = ListItem(List=discontinuity_3.Points, Index=0, Wrap=True)  # disabled
point = Point(list_item_3)  # disabled
geometry = Geometry(rotate_direction.Geometry)  # disabled

# ----
curve_4 = Curve(<curve referenced from the Rhino model>)
ground_floor_rectangle_4 = GetGeometry(curve_4, AtLeast=1, AtMost=1, DeleteInput=False, Filter=1073741828)

# ---- group: Move tower to origin
discontinuity_4 = Discontinuity(Curve=ground_floor_rectangle_2, Level=1)  # -> Points, Parameters; disabled
list_item_4 = ListItem(List=discontinuity_4.Points, Index=0, Wrap=True)  # -> Item, Item1; disabled
xy_plane_2 = XYPlane(Origin=Point(0, 0, 0))  # disabled
vector_2pt_3 = Vector2Pt(PointA=xy_plane_2, PointB=list_item_4.Item, Unitize=False)  # -> Vector, Length; disabled
negative_2 = Negative(Value=vector_2pt_3.Vector)  # disabled
move_2 = Move(Geometry=ground_floor_rectangle_2, Motion=negative_2)  # -> Geometry, Transform; disabled
discontinuity_5 = Discontinuity(Curve=move_2.Geometry, Level=1)  # -> Points, Parameters; disabled
list_item_5 = ListItem(List=discontinuity_5.Points, Index=0, Wrap=True)  # -> Item, Item1; disabled
vector_2pt_4 = Vector2Pt(PointA=list_item_5.Item, PointB=list_item_5.Item1, Unitize=False)  # -> Vector, Length; disabled
unit_x_2 = UnitX(Factor=1)  # disabled
unit_y_2 = UnitY(Factor=1)  # disabled
rotate_direction_2 = RotateDirection(Geometry=move_2.Geometry, Center=Point(0, 0, 0), From=vector_2pt_4.Vector, To=unit_x_2)  # -> Geometry, Transform; disabled
discontinuity_6 = Discontinuity(Curve=rotate_direction_2.Geometry, Level=1)  # -> Points, Parameters; disabled
list_item_6 = ListItem(List=discontinuity_6.Points, Index=0, Wrap=True)  # disabled
point_2 = Point(list_item_6)  # disabled
geometry_2 = Geometry(rotate_direction_2.Geometry)  # disabled

discontinuity_7 = Discontinuity(Curve=ground_floor_rectangle_3, Level=1)  # -> Points, Parameters
list_item_7 = ListItem(List=discontinuity_7.Points, Index=0, Wrap=True)  # -> Item, Item1
xy_plane_3 = XYPlane(Origin=Point(0, 0, 0))
vector_2pt_5 = Vector2Pt(PointA=xy_plane_3, PointB=list_item_7.Item, Unitize=False)  # -> Vector, Length
negative_3 = Negative(Value=vector_2pt_5.Vector)
move_3 = Move(Geometry=ground_floor_rectangle_3, Motion=negative_3)  # -> Geometry, Transform
discontinuity_8 = Discontinuity(Curve=move_3.Geometry, Level=1)  # -> Points, Parameters
list_item_8 = ListItem(List=discontinuity_8.Points, Index=0, Wrap=True)  # -> Item, Item1
vector_2pt_6 = Vector2Pt(PointA=list_item_8.Item, PointB=list_item_8.Item1, Unitize=False)  # -> Vector, Length
unit_x_3 = UnitX(Factor=1)
unit_y_3 = UnitY(Factor=1)
rotate_direction_3 = RotateDirection(Geometry=move_3.Geometry, Center=Point(0, 0, 0), From=vector_2pt_6.Vector, To=unit_x_3)  # -> Geometry, Transform
discontinuity_9 = Discontinuity(Curve=rotate_direction_3.Geometry, Level=1)  # -> Points, Parameters
list_item_9 = ListItem(List=discontinuity_9.Points, Index=0, Wrap=True)
point_3 = Point(list_item_9)
geometry_3 = Geometry(rotate_direction_3.Geometry)

discontinuity_10 = Discontinuity(Curve=ground_floor_rectangle_4, Level=1)  # -> Points, Parameters
list_item_10 = ListItem(List=discontinuity_10.Points, Index=0, Wrap=True)  # -> Item, Item1
xy_plane_4 = XYPlane(Origin=Point(0, 0, 0))
vector_2pt_7 = Vector2Pt(PointA=xy_plane_4, PointB=list_item_10.Item, Unitize=False)  # -> Vector, Length
negative_4 = Negative(Value=vector_2pt_7.Vector)
move_4 = Move(Geometry=ground_floor_rectangle_4, Motion=negative_4)  # -> Geometry, Transform
discontinuity_11 = Discontinuity(Curve=move_4.Geometry, Level=1)  # -> Points, Parameters
list_item_11 = ListItem(List=discontinuity_11.Points, Index=0, Wrap=True)  # -> Item, Item1
vector_2pt_8 = Vector2Pt(PointA=list_item_11.Item, PointB=list_item_11.Item1, Unitize=False)  # -> Vector, Length
unit_x_4 = UnitX(Factor=1)
unit_y_4 = UnitY(Factor=1)
rotate_direction_4 = RotateDirection(Geometry=move_4.Geometry, Center=Point(0, 0, 0), From=vector_2pt_8.Vector, To=unit_x_4)  # -> Geometry, Transform
discontinuity_12 = Discontinuity(Curve=rotate_direction_4.Geometry, Level=1)  # -> Points, Parameters
list_item_12 = ListItem(List=discontinuity_12.Points, Index=0, Wrap=True)
point_4 = Point(list_item_12)
geometry_4 = Geometry(rotate_direction_4.Geometry)

# ---- group: Core Rectangle
number = Number(core_y_distance)  # disabled
number_2 = Number(core_x_distance)  # disabled
core_x_distance_5 = GetNumber(number_2, AtLeast=1, AtMost=1, Maximum=1.797693135e+308, Minimum=-1.797693135e+308)  # disabled
core_y_distance_5 = GetNumber(number, AtLeast=1, AtMost=1, Maximum=1.797693135e+308, Minimum=-1.797693135e+308)  # disabled
number_3 = Number(core_x_size)  # disabled
number_4 = Number(core_y_size)  # disabled
core_x_size_5 = GetNumber(number_3, AtLeast=1, AtMost=1, Maximum=1.797693135e+308, Minimum=-1.797693135e+308)  # disabled
core_y_size_5 = GetNumber(number_4, AtLeast=1, AtMost=1, Maximum=1.797693135e+308, Minimum=-1.797693135e+308)  # disabled
unit_y_5 = UnitY(Factor=core_y_distance_5)  # disabled
unit_x_5 = UnitX(Factor=core_x_distance_5)  # disabled
rectangle = Rectangle(Plane=PlaneXY(0, 0, 0), XSize=core_x_size_5, YSize=core_y_size_5, Radius=0)  # -> Rectangle, Length; disabled
addition = Addition(A=unit_x_5, B=unit_y_5)  # disabled
use_core_boolean_toggle = BooleanToggle(True)  # disabled
move_5 = Move(Geometry=rectangle.Rectangle, Motion=addition)  # -> Geometry, Transform; disabled
use_core_boolean_toggle_2 = GetBoolean(use_core_boolean_toggle, AtLeast=1, AtMost=1, FalseValue="False", TrueValue="True")  # disabled
stream_filter = StreamFilter(Gate=use_core_boolean_toggle_2, Stream1=move_5.Geometry)  # disabled

number_5 = Number(core_y_distance_2)  # disabled
number_6 = Number(core_x_distance_2)  # disabled
core_x_distance_6 = GetNumber(number_6, AtLeast=1, AtMost=1, Maximum=1.797693135e+308, Minimum=-1.797693135e+308)  # disabled
core_y_distance_6 = GetNumber(number_5, AtLeast=1, AtMost=1, Maximum=1.797693135e+308, Minimum=-1.797693135e+308)  # disabled
number_7 = Number(core_x_size_2)  # disabled
number_8 = Number(core_y_size_2)  # disabled
core_x_size_6 = GetNumber(number_7, AtLeast=1, AtMost=1, Maximum=1.797693135e+308, Minimum=-1.797693135e+308)  # disabled
core_y_size_6 = GetNumber(number_8, AtLeast=1, AtMost=1, Maximum=1.797693135e+308, Minimum=-1.797693135e+308)  # disabled
unit_y_6 = UnitY(Factor=core_y_distance_6)  # disabled
unit_x_6 = UnitX(Factor=core_x_distance_6)  # disabled
rectangle_2 = Rectangle(Plane=PlaneXY(0, 0, 0), XSize=core_x_size_6, YSize=core_y_size_6, Radius=0)  # -> Rectangle, Length; disabled
addition_2 = Addition(A=unit_x_6, B=unit_y_6)  # disabled
use_core_boolean_toggle_3 = BooleanToggle(True)  # disabled
move_6 = Move(Geometry=rectangle_2.Rectangle, Motion=addition_2)  # -> Geometry, Transform; disabled
use_core_boolean_toggle_4 = GetBoolean(use_core_boolean_toggle_3, AtLeast=1, AtMost=1, FalseValue="False", TrueValue="True")  # disabled
stream_filter_2 = StreamFilter(Gate=use_core_boolean_toggle_4, Stream1=move_6.Geometry)  # disabled

number_9 = Number(core_y_distance_3)
number_10 = Number(core_x_distance_3)
core_x_distance_7 = GetNumber(number_10, AtLeast=1, AtMost=1, Maximum=1.797693135e+308, Minimum=-1.797693135e+308)
core_y_distance_7 = GetNumber(number_9, AtLeast=1, AtMost=1, Maximum=1.797693135e+308, Minimum=-1.797693135e+308)
number_11 = Number(core_x_size_3)
number_12 = Number(core_y_size_3)
core_x_size_7 = GetNumber(number_11, AtLeast=1, AtMost=1, Maximum=1.797693135e+308, Minimum=-1.797693135e+308)
core_y_size_7 = GetNumber(number_12, AtLeast=1, AtMost=1, Maximum=1.797693135e+308, Minimum=-1.797693135e+308)
unit_y_7 = UnitY(Factor=core_y_distance_7)
unit_x_7 = UnitX(Factor=core_x_distance_7)
rectangle_3 = Rectangle(Plane=PlaneXY(0, 0, 0), XSize=core_x_size_7, YSize=core_y_size_7, Radius=0)  # -> Rectangle, Length
addition_3 = Addition(A=unit_x_7, B=unit_y_7)
use_core_boolean_toggle_5 = BooleanToggle(True)
move_7 = Move(Geometry=rectangle_3.Rectangle, Motion=addition_3)  # -> Geometry, Transform
use_core_boolean_toggle_6 = GetBoolean(use_core_boolean_toggle_5, AtLeast=1, AtMost=1, FalseValue="False", TrueValue="True")
stream_filter_3 = StreamFilter(Gate=use_core_boolean_toggle_6, Stream1=move_7.Geometry)

# ----
offset_curve = OffsetCurve(Distance=1, Corners=1)  # disabled

# ---- group: Core Rectangle
number_13 = Number(core_y_distance_4)
number_14 = Number(core_x_distance_4)
core_x_distance_8 = GetNumber(number_14, AtLeast=1, AtMost=1, Maximum=1.797693135e+308, Minimum=-1.797693135e+308)
core_y_distance_8 = GetNumber(number_13, AtLeast=1, AtMost=1, Maximum=1.797693135e+308, Minimum=-1.797693135e+308)
number_15 = Number(core_x_size_4)
number_16 = Number(core_y_size_4)
core_x_size_8 = GetNumber(number_15, AtLeast=1, AtMost=1, Maximum=1.797693135e+308, Minimum=-1.797693135e+308)
core_y_size_8 = GetNumber(number_16, AtLeast=1, AtMost=1, Maximum=1.797693135e+308, Minimum=-1.797693135e+308)
unit_y_8 = UnitY(Factor=core_y_distance_8)
unit_x_8 = UnitX(Factor=core_x_distance_8)
rectangle_4 = Rectangle(Plane=PlaneXY(0, 0, 0), XSize=core_x_size_8, YSize=core_y_size_8, Radius=0)  # -> Rectangle, Length
addition_4 = Addition(A=unit_x_8, B=unit_y_8)
use_core_boolean_toggle_7 = BooleanToggle(True)
move_8 = Move(Geometry=rectangle_4.Rectangle, Motion=addition_4)  # -> Geometry, Transform
use_core_boolean_toggle_8 = GetBoolean(use_core_boolean_toggle_7, AtLeast=1, AtMost=1, FalseValue="False", TrueValue="True")
stream_filter_4 = StreamFilter(Gate=use_core_boolean_toggle_8, Stream1=move_8.Geometry)

# ----
offset_curve_2 = OffsetCurve(Distance=1, Corners=1)  # disabled
number_17 = Number(level_height)  # disabled
level_height_5 = GetNumber(number_17, AtLeast=1, AtMost=1, Maximum=1.797693135e+308, Minimum=-1.797693135e+308)  # disabled

# ---- group: Rectangles
deconstuct_rectangle = DeconstuctRectangle(Rectangle=geometry)  # -> BasePlane, XInterval, YInterval; disabled
number_18 = Number(balcony_depth)  # disabled
integer = Integer(levels_per_level)  # disabled
integer_2 = Integer(levels)  # disabled
balcony_depth_5 = GetNumber(number_18, AtLeast=1, AtMost=1, Maximum=1.797693135e+308, Minimum=-1.797693135e+308)  # disabled
levels_per_level_5 = GetNumber(integer, AtLeast=1, AtMost=1, Maximum=1.797693135e+308, Minimum=-1.797693135e+308)  # disabled
levels_5 = GetNumber(integer_2, AtLeast=1, AtMost=1, Maximum=1.797693135e+308, Minimum=-1.797693135e+308)  # disabled
deconstruct_domain = DeconstructDomain(Domain=deconstuct_rectangle.XInterval)  # -> Start, End; disabled
deconstruct_domain_2 = DeconstructDomain(Domain=deconstuct_rectangle.YInterval)  # -> Start, End; disabled
series = Series(Start=0, Step=balcony_depth_5, Count=levels_5)  # disabled
panel = Panel("2")  # disabled
panel_2 = Panel("0")  # disabled
repeat_data = RepeatData(Data=levels_per_level_5, Length=levels_5)  # disabled
absolute = Absolute(Value=deconstruct_domain.Start)  # disabled
absolute_2 = Absolute(Value=deconstruct_domain_2.Start)  # disabled
replace_items = ReplaceItems(List=repeat_data, Item=panel, Indices=panel_2, Wrap=False)  # disabled
addition_5 = Addition(A=absolute, B=deconstruct_domain.End)  # disabled
addition_6 = Addition(A=absolute_2, B=deconstruct_domain_2.End)  # disabled
stack_data = StackData(Data=series, Stack=replace_items)  # disabled
xy_plane_5 = XYPlane(Origin=point)  # disabled
subtraction = Subtraction(A=addition_5, B=stack_data)  # disabled
subtraction_2 = Subtraction(A=addition_6, B=stack_data)  # disabled
rectangle_5 = Rectangle(Plane=xy_plane_5, XSize=subtraction, YSize=subtraction_2, Radius=0)  # -> Rectangle, Length; disabled
list_length = ListLength(List=rectangle_5.Rectangle)  # disabled
series_2 = Series(Start=level_height_5, Step=level_height_5, Count=list_length)  # disabled
unit_z = UnitZ(Factor=series_2)  # disabled
move_9 = Move(Geometry=xy_plane_5, Motion=unit_z)  # -> Geometry, Transform; disabled
move_10 = Move(Geometry=rectangle_5.Rectangle, Motion=unit_z)  # -> Geometry, Transform; disabled
plane = Plane(move_9.Geometry)  # disabled
curve_5 = Curve(move_10.Geometry)  # disabled

# ---- group: Floor Plan Check
number_19 = Number(grid_size)  # disabled
grid_size_5 = GetNumber(number_19, AtLeast=1, AtMost=1, Maximum=1.797693135e+308, Minimum=-1.797693135e+308)  # disabled
text = Text(addition_5)  # disabled
text_2 = Text(addition_6)  # disabled
number_20 = Number(text)  # disabled
number_21 = Number(text_2)  # disabled
modulus = Modulus(A=number_20, B=grid_size_5)  # disabled
modulus_2 = Modulus(A=number_21, B=grid_size_5)  # disabled
mass_addition = MassAddition(Input=[modulus_2, modulus])  # -> Result, PartialResults; disabled
larger_than = LargerThan(FirstNumber=mass_addition.Result, SecondNumber=0)  # -> LargerThan, OrEqualTo; disabled
stream_filter_5 = StreamFilter(
    Gate=larger_than.LargerThan,
    Stream0="Everything Okay",
    Stream1="WARNING: Ground Floor rectangle domain does not fit in grid size.")  # disabled

# ----
number_22 = Number(level_height_2)  # disabled
offset_curve_3 = OffsetCurve(Distance=1, Corners=1)
level_height_6 = GetNumber(number_22, AtLeast=1, AtMost=1, Maximum=1.797693135e+308, Minimum=-1.797693135e+308)  # disabled

# ---- group: Rectangles
deconstuct_rectangle_2 = DeconstuctRectangle(Rectangle=geometry_2)  # -> BasePlane, XInterval, YInterval; disabled
integer_3 = Integer(levels_2)  # disabled
number_23 = Number(balcony_depth_2)  # disabled
integer_4 = Integer(levels_per_level_2)  # disabled
balcony_depth_6 = GetNumber(number_23, AtLeast=1, AtMost=1, Maximum=1.797693135e+308, Minimum=-1.797693135e+308)  # disabled
levels_per_level_6 = GetNumber(integer_4, AtLeast=1, AtMost=1, Maximum=1.797693135e+308, Minimum=-1.797693135e+308)  # disabled
levels_6 = GetNumber(integer_3, AtLeast=1, AtMost=1, Maximum=1.797693135e+308, Minimum=-1.797693135e+308)  # disabled
deconstruct_domain_3 = DeconstructDomain(Domain=deconstuct_rectangle_2.XInterval)  # -> Start, End; disabled
deconstruct_domain_4 = DeconstructDomain(Domain=deconstuct_rectangle_2.YInterval)  # -> Start, End; disabled
series_3 = Series(Start=0, Step=balcony_depth_6, Count=levels_6)  # disabled
panel_3 = Panel("2")  # disabled
panel_4 = Panel("0")  # disabled
repeat_data_2 = RepeatData(Data=levels_per_level_6, Length=levels_6)  # disabled
absolute_3 = Absolute(Value=deconstruct_domain_3.Start)  # disabled
absolute_4 = Absolute(Value=deconstruct_domain_4.Start)  # disabled
replace_items_2 = ReplaceItems(List=repeat_data_2, Item=panel_3, Indices=panel_4, Wrap=False)  # disabled
addition_7 = Addition(A=absolute_3, B=deconstruct_domain_3.End)  # disabled
addition_8 = Addition(A=absolute_4, B=deconstruct_domain_4.End)  # disabled
stack_data_2 = StackData(Data=series_3, Stack=replace_items_2)  # disabled
xy_plane_6 = XYPlane(Origin=point_2)  # disabled
subtraction_3 = Subtraction(A=addition_7, B=stack_data_2)  # disabled
subtraction_4 = Subtraction(A=addition_8, B=stack_data_2)  # disabled
rectangle_6 = Rectangle(Plane=xy_plane_6, XSize=subtraction_3, YSize=subtraction_4, Radius=0)  # -> Rectangle, Length; disabled
list_length_2 = ListLength(List=rectangle_6.Rectangle)  # disabled
series_4 = Series(Start=level_height_6, Step=level_height_6, Count=list_length_2)  # disabled
unit_z_2 = UnitZ(Factor=series_4)  # disabled
move_11 = Move(Geometry=xy_plane_6, Motion=unit_z_2)  # -> Geometry, Transform; disabled
move_12 = Move(Geometry=rectangle_6.Rectangle, Motion=unit_z_2)  # -> Geometry, Transform; disabled
plane_2 = Plane(move_11.Geometry)  # disabled
curve_6 = Curve(move_12.Geometry)  # disabled

# ---- group: Floor Plan Check
number_24 = Number(grid_size_2)  # disabled
grid_size_6 = GetNumber(number_24, AtLeast=1, AtMost=1, Maximum=1.797693135e+308, Minimum=-1.797693135e+308)  # disabled
text_3 = Text(addition_7)  # disabled
text_4 = Text(addition_8)  # disabled
number_25 = Number(text_3)  # disabled
number_26 = Number(text_4)  # disabled
modulus_3 = Modulus(A=number_25, B=grid_size_6)  # disabled
modulus_4 = Modulus(A=number_26, B=grid_size_6)  # disabled
mass_addition_2 = MassAddition(Input=[modulus_4, modulus_3])  # -> Result, PartialResults; disabled
larger_than_2 = LargerThan(FirstNumber=mass_addition_2.Result, SecondNumber=0)  # -> LargerThan, OrEqualTo; disabled
stream_filter_6 = StreamFilter(
    Gate=larger_than_2.LargerThan,
    Stream0="Everything Okay",
    Stream1="WARNING: Ground Floor rectangle domain does not fit in grid size.")  # disabled

# ----
number_27 = Number(level_height_3)

# ---- group: RH_OUT:OUT
out = Panel(stream_filter_5)  # disabled

# ----
level_height_7 = GetNumber(number_27, AtLeast=1, AtMost=1, Maximum=1.797693135e+308, Minimum=-1.797693135e+308)

# ---- group: Rectangles
deconstuct_rectangle_3 = DeconstuctRectangle(Rectangle=geometry_3)  # -> BasePlane, XInterval, YInterval
number_28 = Number(balcony_depth_3)
integer_5 = Integer(levels_per_level_3)
integer_6 = Integer(levels_3)
balcony_depth_7 = GetNumber(number_28, AtLeast=1, AtMost=1, Maximum=1.797693135e+308, Minimum=-1.797693135e+308)
levels_per_level_7 = GetNumber(integer_5, AtLeast=1, AtMost=1, Maximum=1.797693135e+308, Minimum=-1.797693135e+308)
levels_7 = GetNumber(integer_6, AtLeast=1, AtMost=1, Maximum=1.797693135e+308, Minimum=-1.797693135e+308)
deconstruct_domain_5 = DeconstructDomain(Domain=deconstuct_rectangle_3.XInterval)  # -> Start, End
deconstruct_domain_6 = DeconstructDomain(Domain=deconstuct_rectangle_3.YInterval)  # -> Start, End
series_5 = Series(Start=0, Step=balcony_depth_7, Count=levels_7)
repeat_data_3 = RepeatData(Data=levels_per_level_7, Length=levels_7)
absolute_5 = Absolute(Value=deconstruct_domain_5.Start)
absolute_6 = Absolute(Value=deconstruct_domain_6.Start)
replace_items_3 = ReplaceItems(List=repeat_data_3, Item="2", Indices="0", Wrap=False)
addition_9 = Addition(A=absolute_5, B=deconstruct_domain_5.End)
addition_10 = Addition(A=absolute_6, B=deconstruct_domain_6.End)
stack_data_3 = StackData(Data=series_5, Stack=replace_items_3)
xy_plane_7 = XYPlane(Origin=point_3)
subtraction_5 = Subtraction(A=addition_9, B=stack_data_3)
subtraction_6 = Subtraction(A=addition_10, B=stack_data_3)
rectangle_7 = Rectangle(Plane=xy_plane_7, XSize=subtraction_5, YSize=subtraction_6, Radius=0)  # -> Rectangle, Length
list_length_3 = ListLength(List=rectangle_7.Rectangle)
series_6 = Series(Start=level_height_7, Step=level_height_7, Count=list_length_3)
unit_z_3 = UnitZ(Factor=series_6)
move_13 = Move(Geometry=xy_plane_7, Motion=unit_z_3)  # -> Geometry, Transform
move_14 = Move(Geometry=rectangle_7.Rectangle, Motion=unit_z_3)  # -> Geometry, Transform
plane_3 = Plane(move_13.Geometry)
curve_7 = Curve(move_14.Geometry)

# ---- group: Floor Plan Check
number_29 = Number(grid_size_3)
grid_size_7 = GetNumber(number_29, AtLeast=1, AtMost=1, Maximum=1.797693135e+308, Minimum=-1.797693135e+308)
text_5 = Text(addition_9)
text_6 = Text(addition_10)
number_30 = Number(text_5)
number_31 = Number(text_6)
modulus_5 = Modulus(A=number_30, B=grid_size_7)
modulus_6 = Modulus(A=number_31, B=grid_size_7)
mass_addition_3 = MassAddition(Input=[modulus_6, modulus_5])  # -> Result, PartialResults
larger_than_3 = LargerThan(FirstNumber=mass_addition_3.Result, SecondNumber=0)  # -> LargerThan, OrEqualTo
stream_filter_7 = StreamFilter(
    Gate=larger_than_3.LargerThan,
    Stream0="Everything Okay",
    Stream1="WARNING: Ground Floor rectangle domain does not fit in grid size.")

# ----
number_32 = Number(level_height_4)

# ---- group: RH_OUT:OUT
out_2 = Panel(stream_filter_6)  # disabled

# ----
level_height_8 = GetNumber(number_32, AtLeast=1, AtMost=1, Maximum=1.797693135e+308, Minimum=-1.797693135e+308)

# ---- group: Rectangles
deconstuct_rectangle_4 = DeconstuctRectangle(Rectangle=geometry_4)  # -> BasePlane, XInterval, YInterval
integer_7 = Integer(levels_4)
number_33 = Number(balcony_depth_4)
integer_8 = Integer(levels_per_level_4)
balcony_depth_8 = GetNumber(number_33, AtLeast=1, AtMost=1, Maximum=1.797693135e+308, Minimum=-1.797693135e+308)
levels_per_level_8 = GetNumber(integer_8, AtLeast=1, AtMost=1, Maximum=1.797693135e+308, Minimum=-1.797693135e+308)
levels_8 = GetNumber(integer_7, AtLeast=1, AtMost=1, Maximum=1.797693135e+308, Minimum=-1.797693135e+308)
deconstruct_domain_7 = DeconstructDomain(Domain=deconstuct_rectangle_4.XInterval)  # -> Start, End
deconstruct_domain_8 = DeconstructDomain(Domain=deconstuct_rectangle_4.YInterval)  # -> Start, End
series_7 = Series(Start=0, Step=balcony_depth_8, Count=levels_8)
repeat_data_4 = RepeatData(Data=levels_per_level_8, Length=levels_8)
absolute_7 = Absolute(Value=deconstruct_domain_7.Start)
absolute_8 = Absolute(Value=deconstruct_domain_8.Start)
replace_items_4 = ReplaceItems(List=repeat_data_4, Item="2", Indices="0", Wrap=False)
addition_11 = Addition(A=absolute_7, B=deconstruct_domain_7.End)
addition_12 = Addition(A=absolute_8, B=deconstruct_domain_8.End)
stack_data_4 = StackData(Data=series_7, Stack=replace_items_4)
xy_plane_8 = XYPlane(Origin=point_4)
subtraction_7 = Subtraction(A=addition_11, B=stack_data_4)
subtraction_8 = Subtraction(A=addition_12, B=stack_data_4)
rectangle_8 = Rectangle(Plane=xy_plane_8, XSize=subtraction_7, YSize=subtraction_8, Radius=0)  # -> Rectangle, Length
list_length_4 = ListLength(List=rectangle_8.Rectangle)
series_8 = Series(Start=level_height_8, Step=level_height_8, Count=list_length_4)
unit_z_4 = UnitZ(Factor=series_8)
move_15 = Move(Geometry=xy_plane_8, Motion=unit_z_4)  # -> Geometry, Transform
move_16 = Move(Geometry=rectangle_8.Rectangle, Motion=unit_z_4)  # -> Geometry, Transform
plane_4 = Plane(move_15.Geometry)
curve_8 = Curve(move_16.Geometry)

# ---- group: Floor Plan Check
number_34 = Number(grid_size_4)
grid_size_8 = GetNumber(number_34, AtLeast=1, AtMost=1, Maximum=1.797693135e+308, Minimum=-1.797693135e+308)
text_7 = Text(addition_11)
text_8 = Text(addition_12)
number_35 = Number(text_7)
number_36 = Number(text_8)
modulus_7 = Modulus(A=number_35, B=grid_size_8)
modulus_8 = Modulus(A=number_36, B=grid_size_8)
mass_addition_4 = MassAddition(Input=[modulus_8, modulus_7])  # -> Result, PartialResults
larger_than_4 = LargerThan(FirstNumber=mass_addition_4.Result, SecondNumber=0)  # -> LargerThan, OrEqualTo
stream_filter_8 = StreamFilter(
    Gate=larger_than_4.LargerThan,
    Stream0="Everything Okay",
    Stream1="WARNING: Ground Floor rectangle domain does not fit in grid size.")

# ---- group: RH_OUT:OUT
out_3 = Panel(stream_filter_7)

# ---- group: Point Grid
deconstuct_rectangle_5 = DeconstuctRectangle(Rectangle=curve_5)  # -> BasePlane, XInterval, YInterval; disabled
deconstruct_domain_9 = DeconstructDomain(Domain=deconstuct_rectangle_5.XInterval)  # -> Start, End; disabled
deconstruct_domain_10 = DeconstructDomain(Domain=deconstuct_rectangle_5.YInterval)  # -> Start, End; disabled
absolute_9 = Absolute(Value=deconstruct_domain_9.Start)  # disabled
absolute_10 = Absolute(Value=deconstruct_domain_10.Start)  # disabled
addition_13 = Addition(A=absolute_9, B=deconstruct_domain_9.End)  # disabled
addition_14 = Addition(A=absolute_10, B=deconstruct_domain_10.End)  # disabled
text_9 = Text(addition_13)  # disabled
text_10 = Text(addition_14)  # disabled
grid_size_9 = Number(grid_size_5)  # disabled
number_37 = Number(text_9)  # disabled
number_38 = Number(text_10)  # disabled
division = Division(A=number_37, B=grid_size_9)  # disabled
division_2 = Division(A=number_38, B=grid_size_9)  # disabled
round = Round(Number=division)  # -> Nearest, graft(Floor), Ceiling; disabled
round_2 = Round(Number=division_2)  # -> Nearest, graft(Floor), Ceiling; disabled
series_9 = Series(Start=0, Step=grid_size_9, Count=expr("x+1", round.Floor))  # disabled
series_10 = Series(Start=0, Step=grid_size_9, Count=expr("x+1", round_2.Floor))  # disabled
cross_reference = CrossReference(ListListA=series_9, ListListB=series_10, CrossMode=1)  # -> ListListA, ListListB; disabled
construct_point = ConstructPoint(XCoordinate=cross_reference.ListListA, YCoordinate=cross_reference.ListListB, ZCoordinate=0)  # -> simplify(Point); disabled
move_17 = Move(Geometry=construct_point, Motion=graft(unit_z))  # -> simplify(Geometry), Transform; disabled

# ---- group: RH_OUT:OUT
out_4 = Panel(stream_filter_8)

# ---- group: Point Grid
deconstuct_rectangle_6 = DeconstuctRectangle(Rectangle=curve_6)  # -> BasePlane, XInterval, YInterval; disabled
deconstruct_domain_11 = DeconstructDomain(Domain=deconstuct_rectangle_6.XInterval)  # -> Start, End; disabled
deconstruct_domain_12 = DeconstructDomain(Domain=deconstuct_rectangle_6.YInterval)  # -> Start, End; disabled
absolute_11 = Absolute(Value=deconstruct_domain_11.Start)  # disabled
absolute_12 = Absolute(Value=deconstruct_domain_12.Start)  # disabled
addition_15 = Addition(A=absolute_11, B=deconstruct_domain_11.End)  # disabled
addition_16 = Addition(A=absolute_12, B=deconstruct_domain_12.End)  # disabled
text_11 = Text(addition_16)  # disabled
text_12 = Text(addition_15)  # disabled
grid_size_10 = Number(grid_size_6)  # disabled
number_39 = Number(text_12)  # disabled
number_40 = Number(text_11)  # disabled
division_3 = Division(A=number_39, B=grid_size_10)  # disabled
division_4 = Division(A=number_40, B=grid_size_10)  # disabled
round_3 = Round(Number=division_3)  # -> Nearest, graft(Floor), Ceiling; disabled
round_4 = Round(Number=division_4)  # -> Nearest, graft(Floor), Ceiling; disabled
series_11 = Series(Start=0, Step=grid_size_10, Count=expr("x+1", round_3.Floor))  # disabled
series_12 = Series(Start=0, Step=grid_size_10, Count=expr("x+1", round_4.Floor))  # disabled
cross_reference_2 = CrossReference(ListListA=series_11, ListListB=series_12, CrossMode=1)  # -> ListListA, ListListB; disabled
construct_point_2 = ConstructPoint(XCoordinate=cross_reference_2.ListListA, YCoordinate=cross_reference_2.ListListB, ZCoordinate=0)  # -> simplify(Point); disabled
move_18 = Move(Geometry=construct_point_2, Motion=graft(unit_z_2))  # -> simplify(Geometry), Transform; disabled

deconstuct_rectangle_7 = DeconstuctRectangle(Rectangle=curve_7)  # -> BasePlane, XInterval, YInterval
deconstruct_domain_13 = DeconstructDomain(Domain=deconstuct_rectangle_7.XInterval)  # -> Start, End
deconstruct_domain_14 = DeconstructDomain(Domain=deconstuct_rectangle_7.YInterval)  # -> Start, End
absolute_13 = Absolute(Value=deconstruct_domain_13.Start)
absolute_14 = Absolute(Value=deconstruct_domain_14.Start)
addition_17 = Addition(A=absolute_13, B=deconstruct_domain_13.End)
addition_18 = Addition(A=absolute_14, B=deconstruct_domain_14.End)
text_13 = Text(addition_17)
text_14 = Text(addition_18)
grid_size_11 = Number(grid_size_7)
number_41 = Number(text_13)
number_42 = Number(text_14)
division_5 = Division(A=number_41, B=grid_size_11)
division_6 = Division(A=number_42, B=grid_size_11)
round_5 = Round(Number=division_5)  # -> Nearest, graft(Floor), Ceiling
round_6 = Round(Number=division_6)  # -> Nearest, graft(Floor), Ceiling
series_13 = Series(Start=0, Step=grid_size_11, Count=expr("x+1", round_5.Floor))
series_14 = Series(Start=0, Step=grid_size_11, Count=expr("x+1", round_6.Floor))
cross_reference_3 = CrossReference(ListListA=series_13, ListListB=series_14, CrossMode=1)  # -> ListListA, ListListB
construct_point_3 = ConstructPoint(XCoordinate=cross_reference_3.ListListA, YCoordinate=cross_reference_3.ListListB, ZCoordinate=0)  # -> simplify(Point)
move_19 = Move(Geometry=construct_point_3, Motion=graft(unit_z_3))  # -> simplify(Geometry), Transform

deconstuct_rectangle_8 = DeconstuctRectangle(Rectangle=curve_8)  # -> BasePlane, XInterval, YInterval
deconstruct_domain_15 = DeconstructDomain(Domain=deconstuct_rectangle_8.XInterval)  # -> Start, End
deconstruct_domain_16 = DeconstructDomain(Domain=deconstuct_rectangle_8.YInterval)  # -> Start, End
absolute_15 = Absolute(Value=deconstruct_domain_15.Start)
absolute_16 = Absolute(Value=deconstruct_domain_16.Start)
addition_19 = Addition(A=absolute_15, B=deconstruct_domain_15.End)
addition_20 = Addition(A=absolute_16, B=deconstruct_domain_16.End)
text_15 = Text(addition_20)
text_16 = Text(addition_19)
grid_size_12 = Number(grid_size_8)
number_43 = Number(text_16)
number_44 = Number(text_15)
division_7 = Division(A=number_43, B=grid_size_12)
division_8 = Division(A=number_44, B=grid_size_12)
round_7 = Round(Number=division_7)  # -> Nearest, graft(Floor), Ceiling
round_8 = Round(Number=division_8)  # -> Nearest, graft(Floor), Ceiling
series_15 = Series(Start=0, Step=grid_size_12, Count=expr("x+1", round_7.Floor))
series_16 = Series(Start=0, Step=grid_size_12, Count=expr("x+1", round_8.Floor))
cross_reference_4 = CrossReference(ListListA=series_15, ListListB=series_16, CrossMode=1)  # -> ListListA, ListListB
construct_point_4 = ConstructPoint(XCoordinate=cross_reference_4.ListListA, YCoordinate=cross_reference_4.ListListB, ZCoordinate=0)  # -> simplify(Point)
move_20 = Move(Geometry=construct_point_4, Motion=graft(unit_z_4))  # -> simplify(Geometry), Transform

# ---- group: General Information
area = Area(Geometry=curve_5)  # -> Area, Centroid; disabled
mass_addition_5 = MassAddition(Input=area.Area)  # -> Result, PartialResults; disabled

area_2 = Area(Geometry=curve_6)  # -> Area, Centroid; disabled
mass_addition_6 = MassAddition(Input=area_2.Area)  # -> Result, PartialResults; disabled

# ---- group: General Information / RH_OUT:Area
area_3 = Panel(mass_addition_5.Result)  # disabled

# ---- group: General Information
area_4 = Area(Geometry=curve_7)  # -> Area, Centroid
mass_addition_7 = MassAddition(Input=area_4.Area)  # -> Result, PartialResults

# ---- group: General Information / RH_OUT:Area
area_5 = Panel(mass_addition_6.Result)  # disabled

# ----
level_height_9 = Number(level_height_5)  # disabled

# ---- group: General Information
area_6 = Area(Geometry=curve_8)  # -> Area, Centroid
mass_addition_8 = MassAddition(Input=area_6.Area)  # -> Result, PartialResults

# ---- group: General Information / RH_OUT:Area
area_7 = Panel(mass_addition_7.Result)

# ----
level_height_10 = Number(level_height_6)  # disabled

# ---- group: General Information / RH_OUT:Area
area_8 = Panel(mass_addition_8.Result)

# ----
level_height_11 = Number(level_height_7)
level_height_12 = Number(level_height_8)
panel_5 = Panel("Warning: not parametric")  # disabled
panel_6 = Panel("{0;35}")  # disabled

# ----
# Extract epw data
epw_url = Panel("https://energyplus-weather.s3.amazonaws.com/europe_wmo_region_6/NLD/NLD_Amsterdam.062400_IWEC/NLD_Amsterdam.062400_IWEC.zip")  # disabled
go_to_epw_website = BooleanToggle(False)  # disabled
epwmap = LBEPWmap(epw_map=go_to_epw_website)  # -> Output; disabled; plug-in component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
downloadepw = LBDownloadWeather(weather_URL=epw_url)  # -> epw_file, stat_file, ddy_file; disabled; plug-in component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
importepw = LBImportEPW(epw_file=downloadepw.epw_file)  # -> location, dry_bulb_temperature, dew_point_temperature, relative_humidity, wind_speed, wind_direction, direct_normal_rad, diffuse_horizontal_rad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; disabled; plug-in component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

number_slider = Slider(7, range=0..100)  # disabled
recipesettings = HBRecipeSettings(workers=number_slider, reload_old=False)  # -> settings; disabled; plug-in component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

# ----
# Extract epw data
epw_url_2 = Panel("https://energyplus-weather.s3.amazonaws.com/europe_wmo_region_6/NLD/NLD_Amsterdam.062400_IWEC/NLD_Amsterdam.062400_IWEC.zip")
go_to_epw_website_2 = BooleanToggle(False)
epwmap_2 = LBEPWmap(epw_map=go_to_epw_website_2)  # -> Output; plug-in component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
downloadepw_2 = LBDownloadWeather(weather_URL=epw_url_2)  # -> epw_file, stat_file, ddy_file; plug-in component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
importepw_2 = LBImportEPW(epw_file=downloadepw_2.epw_file)  # -> location, dry_bulb_temperature, dew_point_temperature, relative_humidity, wind_speed, wind_direction, direct_normal_rad, diffuse_horizontal_rad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; plug-in component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

panel_7 = Panel("2")  # disabled

multiplication = Multiplication(A=list_length, B=level_height_5)  # disabled
curve_9 = Curve(stream_filter)  # disabled
unit_z_5 = UnitZ(Factor=multiplication)  # disabled
extrude = Extrude(Base=curve_9, Direction=unit_z_5)  # disabled
brep_plane = BrepPlane(Brep=extrude, Plane=plane)  # -> Curves, Points; disabled
cap_holes = CapHoles(Brep=extrude)  # disabled
surface = Surface(curve_5)  # disabled
surface_split = SurfaceSplit(Surface=graft(surface), Curves=brep_plane.Curves)  # -> simplify(Fragments); disabled
cluster = Cluster(geometry=extrude, transform=rotate_direction.Transform, transform_3=move.Transform)  # disabled
list_item_13 = ListItem(List=surface_split, Index=0, Wrap=True)  # disabled
cluster_2 = Cluster(geometry=list_item_13, transform=rotate_direction.Transform, transform_3=move.Transform)  # disabled
colour_swatch = ColourSwatch(SwatchColor=RGB(255, 255, 255))  # disabled
colour_swatch_2 = ColourSwatch(SwatchColor=RGB(255, 255, 255))  # disabled

# ---- group: RH_OUT:Core
geometry_5 = Geometry(cluster)  # disabled

# ---- group: RH_OUT:Floor Surfaces
surface_2 = Surface(cluster_2)  # disabled

# ----
custom_preview = CustomPreview(Geometry=geometry_5, Material=colour_swatch)  # disabled
custom_preview_2 = CustomPreview(Geometry=surface_2, Material=colour_swatch_2)  # disabled

# ---- group: General Information / RH_OUT:Height
height = Panel(multiplication)  # disabled

# ---- group: Point Grid Core Extraction
point_in_brep = PointInBrep(Brep=cap_holes, Point=move_17.Geometry, Strict=False)  # disabled
cull_pattern = CullPattern(List=move_17.Geometry, CullPattern=invert(point_in_brep))  # disabled
cluster_3 = Cluster(geometry=cull_pattern, transform=rotate_direction.Transform, transform_3=move.Transform)  # disabled

# ---- group: Columns
unit_z_6 = UnitZ(Factor=1)  # disabled
negative_5 = Negative(Value=unit_z_6)  # disabled
line_sdl = LineSDL(Start=cull_pattern, Direction=negative_5, Length=level_height_9)  # -> flatten(Line); disabled
join_curves = JoinCurves(Curves=line_sdl, Preserve=False)  # disabled
cluster_4 = Cluster(geometry=join_curves, transform=rotate_direction.Transform, transform_3=move.Transform)  # disabled

# ---- group: Point Grid Core Extraction / RH_OUT:Points
point_5 = Point(cluster_3)  # disabled

# ----
cluster_5 = Cluster(geometry=join_curves, transform=rotate_direction.Transform, transform_3=move.Transform)  # disabled

# ---- group: Columns / RH_OUT:Columns
curve_10 = Curve(cluster_4)  # disabled

# ----
multiplication_2 = Multiplication(A=list_length_2, B=level_height_6)  # disabled
curve_11 = Curve(stream_filter_2)  # disabled
unit_z_7 = UnitZ(Factor=multiplication_2)  # disabled
extrude_2 = Extrude(Base=curve_11, Direction=unit_z_7)  # disabled
brep_plane_2 = BrepPlane(Brep=extrude_2, Plane=plane_2)  # -> Curves, Points; disabled
cap_holes_2 = CapHoles(Brep=extrude_2)  # disabled
surface_3 = Surface(curve_6)  # disabled
surface_split_2 = SurfaceSplit(Surface=graft(surface_3), Curves=brep_plane_2.Curves)  # -> simplify(Fragments); disabled
cluster_6 = Cluster(geometry=extrude_2, transform=rotate_direction_2.Transform, transform_3=move_2.Transform)  # disabled
list_item_14 = ListItem(List=surface_split_2, Index=0, Wrap=True)  # disabled
cluster_7 = Cluster(geometry=list_item_14, transform=rotate_direction_2.Transform, transform_3=move_2.Transform)  # disabled
colour_swatch_3 = ColourSwatch(SwatchColor=RGB(255, 255, 255))  # disabled
colour_swatch_4 = ColourSwatch(SwatchColor=RGB(255, 255, 255))  # disabled

# ---- group: RH_OUT:Core
geometry_6 = Geometry(cluster_6)  # disabled

# ---- group: RH_OUT:Floor Surfaces
surface_4 = Surface(cluster_7)  # disabled

# ----
custom_preview_3 = CustomPreview(Geometry=geometry_6, Material=colour_swatch_3)  # disabled
custom_preview_4 = CustomPreview(Geometry=surface_4, Material=colour_swatch_4)  # disabled

# ---- group: General Information / RH_OUT:Height
height_2 = Panel(multiplication_2)  # disabled

# ---- group: Point Grid Core Extraction
point_in_brep_2 = PointInBrep(Brep=cap_holes_2, Point=move_18.Geometry, Strict=False)  # disabled
cull_pattern_2 = CullPattern(List=move_18.Geometry, CullPattern=invert(point_in_brep_2))  # disabled
cluster_8 = Cluster(geometry=cull_pattern_2, transform=rotate_direction_2.Transform, transform_3=move_2.Transform)  # disabled

# ---- group: Columns
unit_z_8 = UnitZ(Factor=1)  # disabled
negative_6 = Negative(Value=unit_z_8)  # disabled
line_sdl_2 = LineSDL(Start=cull_pattern_2, Direction=negative_6, Length=level_height_10)  # -> flatten(Line); disabled
join_curves_2 = JoinCurves(Curves=line_sdl_2, Preserve=False)  # disabled
cluster_9 = Cluster(geometry=join_curves_2, transform=rotate_direction_2.Transform, transform_3=move_2.Transform)  # disabled

# ---- group: Point Grid Core Extraction / RH_OUT:Points
point_6 = Point(cluster_8)  # disabled

# ----
cluster_10 = Cluster(geometry=join_curves_2, transform=rotate_direction_2.Transform, transform_3=move_2.Transform)  # disabled

# ---- group: Columns / RH_OUT:Columns
curve_12 = Curve(cluster_9)  # disabled

# ----
multiplication_3 = Multiplication(A=list_length_3, B=level_height_7)
curve_13 = Curve(stream_filter_3)
unit_z_9 = UnitZ(Factor=multiplication_3)
extrude_3 = Extrude(Base=curve_13, Direction=unit_z_9)
brep_plane_3 = BrepPlane(Brep=extrude_3, Plane=plane_3)  # -> Curves, Points
cap_holes_3 = CapHoles(Brep=extrude_3)
surface_5 = Surface(curve_7)
surface_split_3 = SurfaceSplit(Surface=graft(surface_5), Curves=brep_plane_3.Curves)  # -> simplify(Fragments)
cluster_11 = Cluster(geometry=extrude_3, transform=rotate_direction_3.Transform, transform_3=move_3.Transform)
list_item_15 = ListItem(List=surface_split_3, Index=0, Wrap=True)
cluster_12 = Cluster(geometry=list_item_15, transform=rotate_direction_3.Transform, transform_3=move_3.Transform)

# ---- group: RH_OUT:Core
geometry_7 = Geometry(cluster_11)

# ---- group: RH_OUT:Floor Surfaces
surface_6 = Surface(cluster_12)

# ----
custom_preview_5 = CustomPreview(Geometry=geometry_7, Material=ColourSwatch(SwatchColor=RGB(255, 255, 255)))
custom_preview_6 = CustomPreview(Geometry=surface_6, Material=ColourSwatch(SwatchColor=RGB(255, 255, 255)))

# ---- group: General Information / RH_OUT:Height
height_3 = Panel(multiplication_3)

# ---- group: Point Grid Core Extraction
point_in_brep_3 = PointInBrep(Brep=cap_holes_3, Point=move_19.Geometry, Strict=False)
cull_pattern_3 = CullPattern(List=move_19.Geometry, CullPattern=invert(point_in_brep_3))
cluster_13 = Cluster(geometry=cull_pattern_3, transform=rotate_direction_3.Transform, transform_3=move_3.Transform)

# ---- group: Columns
unit_z_10 = UnitZ(Factor=1)
negative_7 = Negative(Value=unit_z_10)
line_sdl_3 = LineSDL(Start=cull_pattern_3, Direction=negative_7, Length=level_height_11)  # -> flatten(Line)
join_curves_3 = JoinCurves(Curves=line_sdl_3, Preserve=False)
cluster_14 = Cluster(geometry=join_curves_3, transform=rotate_direction_3.Transform, transform_3=move_3.Transform)

# ---- group: Point Grid Core Extraction / RH_OUT:Points
point_7 = Point(cluster_13)

# ----
cluster_15 = Cluster(geometry=join_curves_3, transform=rotate_direction_3.Transform, transform_3=move_3.Transform)

# ---- group: Columns / RH_OUT:Columns
curve_14 = Curve(cluster_14)

# ---- group: Shell
partition_list = PartitionList(List=curve_5, Size=replace_items)  # disabled
number_45 = Number(shell_offset)  # disabled
shell_offset_5 = GetNumber(number_45, AtLeast=1, AtMost=1, Maximum=1.797693135e+308, Minimum=-1.797693135e+308)  # disabled
list_item_16 = ListItem(List=partition_list, Index=-1, Wrap=True)  # -> simplify(Item); disabled
offset_curve_4 = OffsetCurve(Curve=list_item_16, Distance=shell_offset_5, Corners=1)  # -> flatten(Curve); disabled
loft = Loft(Curves=offset_curve_4, Options={Adjust=False, Closed=False, LoftEnds=0, LoftSimp=0, LoftType=0, Rebuild=10, Refit=0.01})  # disabled
cluster_16 = Cluster(geometry=loft, transform=rotate_direction.Transform, transform_3=move.Transform)  # disabled
colour_swatch_5 = ColourSwatch(SwatchColor=RGBA(255, 255, 255, 153))  # disabled

# ---- group: Shell / RH_OUT:Outer Shell
geometry_8 = Geometry(cluster_16)  # disabled

# ----
cluster_17 = Cluster(geometry=curve_5, transform=rotate_direction.Transform, transform_3=move.Transform)  # disabled
mesh_brep = MeshBrep(
    Brep=geometry_8,
    Settings={GridMaxCount=0, GridMinCount=16, JaggedSeams=False, MaxEdgeLength=0, MinEdgeLength=0.0001, MinTolerance=0, Refine=True, RefineAngle=0, RelativeTolerance=0.65, SimplePlanes=True, Tolerance=0})  # disabled
number_46 = Number(balcony_depth)  # disabled
mesh_plane = MeshPlane(Mesh=mesh_brep, Plane=cluster_17)  # -> simplify(Curves); disabled
offset_curve_5 = OffsetCurve(Curve=cluster_17, Distance=flatten(number_46), Corners=1)  # disabled
discontinuity_13 = Discontinuity(Curve=cluster_17, Level=1)  # -> simplify(Points), Parameters; disabled
discontinuity_14 = Discontinuity(Curve=mesh_plane, Level=1)  # -> simplify(Points), Parameters; disabled
merge = Merge(Data1=graft(cluster_17), Data2=offset_curve_5)  # disabled
closest_point = ClosestPoint(Point=discontinuity_13.Points, Cloud=discontinuity_14.Points)  # -> ClosestPoint, CPIndex, Distance; disabled
loft_2 = Loft(Curves=merge, Options={Adjust=False, Closed=False, LoftEnds=0, LoftSimp=0, LoftType=0, Rebuild=10, Refit=0.01})  # disabled
clean_tree = CleanTree(RemoveNulls=True, RemoveInvalid=True, RemoveEmpty=False, Tree=closest_point.ClosestPoint)  # disabled
tree_statistics = TreeStatistics(Tree=clean_tree)  # -> Paths, Length, Count; disabled
larger_than_5 = LargerThan(FirstNumber=tree_statistics.Length, SecondNumber=0)  # -> LargerThan, OrEqualTo; disabled
cull_pattern_4 = CullPattern(List=tree_statistics.Paths, CullPattern=larger_than_5.LargerThan)  # disabled
tree_branch = TreeBranch(Tree=discontinuity_13.Points, Path=cull_pattern_4, MaintainPaths=True)  # disabled
tree_branch_2 = TreeBranch(Tree=closest_point.ClosestPoint, Path=cull_pattern_4, MaintainPaths=True)  # disabled
tree_branch_3 = TreeBranch(Tree=simplify(loft_2), Path=cull_pattern_4, MaintainPaths=True)  # -> flatten(Branch); disabled
polyline = PolyLine(Vertices=tree_branch_2, Closed=True)  # disabled
polyline_2 = PolyLine(Vertices=tree_branch, Closed=True)  # disabled
loft_3 = Loft(
    Curves=[polyline, polyline_2],
    Options={Adjust=False, Closed=False, LoftEnds=0, LoftSimp=0, LoftType=0, Rebuild=10, Refit=0.01})  # disabled
boolean = Boolean(balcony_type)  # disabled
balconies_bool = GetBoolean(boolean, AtLeast=1, AtMost=1, FalseValue="False", TrueValue="True")  # disabled
stream_filter_9 = StreamFilter(Gate=balconies_bool, Stream0=flatten(loft_3), Stream1=tree_branch_3)  # disabled

# ---- group: Shell (continued)
custom_preview_7 = CustomPreview(Geometry=geometry_8, Material=colour_swatch_5)  # disabled

# ---- group: RH_OUT:Balconies
geometry_9 = Geometry(stream_filter_9)  # disabled

# ----
multiplication_4 = Multiplication(A=list_length_4, B=level_height_8)
curve_15 = Curve(stream_filter_4)
unit_z_11 = UnitZ(Factor=multiplication_4)
extrude_4 = Extrude(Base=curve_15, Direction=unit_z_11)
brep_plane_4 = BrepPlane(Brep=extrude_4, Plane=plane_4)  # -> Curves, Points
cap_holes_4 = CapHoles(Brep=extrude_4)
surface_7 = Surface(curve_8)
surface_split_4 = SurfaceSplit(Surface=graft(surface_7), Curves=brep_plane_4.Curves)  # -> simplify(Fragments)
cluster_18 = Cluster(geometry=extrude_4, transform=rotate_direction_4.Transform, transform_3=move_4.Transform)
list_item_17 = ListItem(List=surface_split_4, Index=0, Wrap=True)
cluster_19 = Cluster(geometry=list_item_17, transform=rotate_direction_4.Transform, transform_3=move_4.Transform)

# ---- group: RH_OUT:Core
geometry_10 = Geometry(cluster_18)

# ---- group: RH_OUT:Floor Surfaces
surface_8 = Surface(cluster_19)

# ----
custom_preview_8 = CustomPreview(Geometry=geometry_10, Material=ColourSwatch(SwatchColor=RGB(255, 255, 255)))
custom_preview_9 = CustomPreview(Geometry=surface_8, Material=ColourSwatch(SwatchColor=RGB(255, 255, 255)))

# ---- group: General Information / RH_OUT:Height
height_4 = Panel(multiplication_4)

# ---- group: Point Grid Core Extraction
point_in_brep_4 = PointInBrep(Brep=cap_holes_4, Point=move_20.Geometry, Strict=False)
cull_pattern_5 = CullPattern(List=move_20.Geometry, CullPattern=invert(point_in_brep_4))
cluster_20 = Cluster(geometry=cull_pattern_5, transform=rotate_direction_4.Transform, transform_3=move_4.Transform)

# ---- group: Columns
unit_z_12 = UnitZ(Factor=1)
negative_8 = Negative(Value=unit_z_12)
line_sdl_4 = LineSDL(Start=cull_pattern_5, Direction=negative_8, Length=level_height_12)  # -> flatten(Line)
join_curves_4 = JoinCurves(Curves=line_sdl_4, Preserve=False)
cluster_21 = Cluster(geometry=join_curves_4, transform=rotate_direction_4.Transform, transform_3=move_4.Transform)

# ---- group: Point Grid Core Extraction / RH_OUT:Points
point_8 = Point(cluster_20)

# ----
cluster_22 = Cluster(geometry=join_curves_4, transform=rotate_direction_4.Transform, transform_3=move_4.Transform)

# ---- group: Columns / RH_OUT:Columns
curve_16 = Curve(cluster_21)

# ---- group: Shell
partition_list_2 = PartitionList(List=curve_6, Size=replace_items_2)  # disabled
number_47 = Number(shell_offset_2)  # disabled
shell_offset_6 = GetNumber(number_47, AtLeast=1, AtMost=1, Maximum=1.797693135e+308, Minimum=-1.797693135e+308)  # disabled
list_item_18 = ListItem(List=partition_list_2, Index=-1, Wrap=True)  # -> simplify(Item); disabled
offset_curve_6 = OffsetCurve(Curve=list_item_18, Distance=shell_offset_6, Corners=1)  # -> flatten(Curve); disabled
loft_4 = Loft(Curves=offset_curve_6, Options={Adjust=False, Closed=False, LoftEnds=0, LoftSimp=0, LoftType=0, Rebuild=10, Refit=0.01})  # disabled
cluster_23 = Cluster(geometry=loft_4, transform=rotate_direction_2.Transform, transform_3=move_2.Transform)  # disabled
colour_swatch_6 = ColourSwatch(SwatchColor=RGBA(255, 255, 255, 153))  # disabled

# ---- group: Shell / RH_OUT:Outer Shell
geometry_11 = Geometry(cluster_23)  # disabled

# ----
cluster_24 = Cluster(geometry=curve_6, transform=rotate_direction_2.Transform, transform_3=move_2.Transform)  # disabled
mesh_brep_2 = MeshBrep(
    Brep=geometry_11,
    Settings={GridMaxCount=0, GridMinCount=16, JaggedSeams=False, MaxEdgeLength=0, MinEdgeLength=0.0001, MinTolerance=0, Refine=True, RefineAngle=0, RelativeTolerance=0.65, SimplePlanes=True, Tolerance=0})  # disabled
number_48 = Number(balcony_depth_2)  # disabled
mesh_plane_2 = MeshPlane(Mesh=mesh_brep_2, Plane=cluster_24)  # -> simplify(Curves); disabled
offset_curve_7 = OffsetCurve(Curve=cluster_24, Distance=flatten(number_48), Corners=1)  # disabled
discontinuity_15 = Discontinuity(Curve=cluster_24, Level=1)  # -> simplify(Points), Parameters; disabled
discontinuity_16 = Discontinuity(Curve=mesh_plane_2, Level=1)  # -> simplify(Points), Parameters; disabled
merge_2 = Merge(Data1=graft(cluster_24), Data2=offset_curve_7)  # disabled
closest_point_2 = ClosestPoint(Point=discontinuity_15.Points, Cloud=discontinuity_16.Points)  # -> ClosestPoint, CPIndex, Distance; disabled
loft_5 = Loft(Curves=merge_2, Options={Adjust=False, Closed=False, LoftEnds=0, LoftSimp=0, LoftType=0, Rebuild=10, Refit=0.01})  # disabled
clean_tree_2 = CleanTree(RemoveNulls=True, RemoveInvalid=True, RemoveEmpty=False, Tree=closest_point_2.ClosestPoint)  # disabled
tree_statistics_2 = TreeStatistics(Tree=clean_tree_2)  # -> Paths, Length, Count; disabled
larger_than_6 = LargerThan(FirstNumber=tree_statistics_2.Length, SecondNumber=0)  # -> LargerThan, OrEqualTo; disabled
cull_pattern_6 = CullPattern(List=tree_statistics_2.Paths, CullPattern=larger_than_6.LargerThan)  # disabled
tree_branch_4 = TreeBranch(Tree=discontinuity_15.Points, Path=cull_pattern_6, MaintainPaths=True)  # disabled
tree_branch_5 = TreeBranch(Tree=closest_point_2.ClosestPoint, Path=cull_pattern_6, MaintainPaths=True)  # disabled
tree_branch_6 = TreeBranch(Tree=simplify(loft_5), Path=cull_pattern_6, MaintainPaths=True)  # -> flatten(Branch); disabled
polyline_3 = PolyLine(Vertices=tree_branch_5, Closed=True)  # disabled
polyline_4 = PolyLine(Vertices=tree_branch_4, Closed=True)  # disabled
loft_6 = Loft(
    Curves=[polyline_3, polyline_4],
    Options={Adjust=False, Closed=False, LoftEnds=0, LoftSimp=0, LoftType=0, Rebuild=10, Refit=0.01})  # disabled
boolean_2 = Boolean(balcony_type_2)  # disabled
balconies_bool_2 = GetBoolean(boolean_2, AtLeast=1, AtMost=1, FalseValue="False", TrueValue="True")  # disabled
stream_filter_10 = StreamFilter(Gate=balconies_bool_2, Stream0=flatten(loft_6), Stream1=tree_branch_6)  # disabled

# ---- group: Shell (continued)
custom_preview_10 = CustomPreview(Geometry=geometry_11, Material=colour_swatch_6)  # disabled

# ----
geometry_12 = Geometry(stream_filter_10)  # disabled

unit_z_13 = UnitZ(Factor=level_height)  # disabled
brep = Brep(geometry_11)  # disabled
unit_z_14 = UnitZ(Factor=level_height)  # disabled
unit_z_15 = UnitZ(Factor=level_height)  # disabled
move_21 = Move(Geometry=geometry_9, Motion=unit_z_14)  # -> Geometry, Transform; disabled
move_22 = Move(Geometry=polyline_2, Motion=unit_z_13)  # -> Geometry, Transform; disabled
move_23 = Move(Geometry=polyline, Motion=unit_z_15)  # -> Geometry, Transform; disabled
loft_7 = Loft(
    Curves=[polyline_2, move_22.Geometry],
    Options={Adjust=False, Closed=False, LoftEnds=0, LoftSimp=0, LoftType=0, Rebuild=10, Refit=0.01})  # -> flatten(Loft); disabled
loft_8 = Loft(
    Curves=[polyline, move_23.Geometry],
    Options={Adjust=False, Closed=False, LoftEnds=0, LoftSimp=0, LoftType=0, Rebuild=10, Refit=0.01})  # -> flatten(Loft); disabled
deconstruct_brep = DeconstructBrep(Brep=graft(loft_8))  # -> Faces, Edges, Vertices; disabled
deconstruct_brep_2 = DeconstructBrep(Brep=deconstruct_brep.Faces)  # -> Faces, Edges, Vertices; disabled
join_curves_5 = JoinCurves(Curves=deconstruct_brep_2.Edges, Preserve=False)  # disabled
number_slider_2 = Slider(0.1, range=0..1)  # disabled
list_length_5 = ListLength(List=geometry_9)  # disabled
trim_tree = TrimTree(Tree=join_curves_5, Depth=2)  # disabled
offset_on_srf = OffsetOnSrf(Curve=trim_tree, Distance=number_slider_2, Surface=deconstruct_brep.Faces)  # disabled
duplicate_data = DuplicateData(Data=brep, Number=list_length_5, Order=True)  # -> flatten(Data); disabled
trim_tree_2 = TrimTree(Tree=offset_on_srf, Depth=2)  # disabled
graft_tree = GraftTree(Tree=geometry_9, IncludeEmptyLists=True, IncludeNullItems=True)  # disabled
graft_tree_2 = GraftTree(Tree=loft_7, IncludeEmptyLists=True, IncludeNullItems=True)  # disabled
graft_tree_3 = GraftTree(Tree=move_21.Geometry, IncludeEmptyLists=True, IncludeNullItems=True)  # disabled
graft_tree_4 = GraftTree(Tree=duplicate_data, IncludeEmptyLists=True, IncludeNullItems=True)  # disabled
graft_tree_5 = GraftTree(Tree=loft_8, IncludeEmptyLists=True, IncludeNullItems=True)  # disabled
surface_9 = Surface(trim_tree_2)  # disabled

brep_2 = Brep(geometry_8)  # disabled
unit_z_16 = UnitZ(Factor=level_height_2)  # disabled
unit_z_17 = UnitZ(Factor=level_height_2)  # disabled
unit_z_18 = UnitZ(Factor=level_height_2)  # disabled
move_24 = Move(Geometry=polyline_4, Motion=unit_z_16)  # -> Geometry, Transform; disabled
move_25 = Move(Geometry=geometry_12, Motion=unit_z_17)  # -> Geometry, Transform; disabled
move_26 = Move(Geometry=polyline_3, Motion=unit_z_18)  # -> Geometry, Transform; disabled
loft_9 = Loft(
    Curves=[polyline_4, move_24.Geometry],
    Options={Adjust=False, Closed=False, LoftEnds=0, LoftSimp=0, LoftType=0, Rebuild=10, Refit=0.01})  # -> flatten(Loft); disabled
loft_10 = Loft(
    Curves=[polyline_3, move_26.Geometry],
    Options={Adjust=False, Closed=False, LoftEnds=0, LoftSimp=0, LoftType=0, Rebuild=10, Refit=0.01})  # -> flatten(Loft); disabled
deconstruct_brep_3 = DeconstructBrep(Brep=graft(loft_10))  # -> Faces, Edges, Vertices; disabled
deconstruct_brep_4 = DeconstructBrep(Brep=deconstruct_brep_3.Faces)  # -> Faces, Edges, Vertices; disabled
join_curves_6 = JoinCurves(Curves=deconstruct_brep_4.Edges, Preserve=False)  # disabled
number_slider_3 = Slider(0.1, range=0..1)  # disabled
list_length_6 = ListLength(List=geometry_12)  # disabled
trim_tree_3 = TrimTree(Tree=join_curves_6, Depth=2)  # disabled
offset_on_srf_2 = OffsetOnSrf(Curve=trim_tree_3, Distance=number_slider_3, Surface=deconstruct_brep_3.Faces)  # disabled
duplicate_data_2 = DuplicateData(Data=brep_2, Number=list_length_6, Order=True)  # -> flatten(Data); disabled
trim_tree_4 = TrimTree(Tree=offset_on_srf_2, Depth=2)  # disabled
graft_tree_6 = GraftTree(Tree=move_25.Geometry, IncludeEmptyLists=True, IncludeNullItems=True)  # disabled
graft_tree_7 = GraftTree(Tree=geometry_12, IncludeEmptyLists=True, IncludeNullItems=True)  # disabled
graft_tree_8 = GraftTree(Tree=loft_9, IncludeEmptyLists=True, IncludeNullItems=True)  # disabled
graft_tree_9 = GraftTree(Tree=duplicate_data_2, IncludeEmptyLists=True, IncludeNullItems=True)  # disabled
graft_tree_10 = GraftTree(Tree=loft_10, IncludeEmptyLists=True, IncludeNullItems=True)  # disabled
surface_10 = Surface(trim_tree_4)  # disabled

path_mapper = PathMapper(surface_10, source="{A;B}", target="{A;B+30}")  # disabled
brep_3 = Brep(graft_tree)  # disabled
brep_4 = Brep(graft_tree_7)  # disabled
brep_5 = Brep(graft_tree_3)  # disabled
brep_6 = Brep(graft_tree_6)  # disabled
brep_7 = Brep(graft_tree_8)  # disabled
brep_8 = Brep(graft_tree_2)  # disabled
brep_9 = Brep(graft_tree_10)  # disabled
brep_10 = Brep(graft_tree_4)  # disabled
brep_11 = Brep(graft_tree_9)  # disabled
brep_12 = Brep(graft_tree_5)  # disabled
brep_13 = Brep(surface_9)  # disabled
brep_14 = Brep(path_mapper)  # disabled
merge_3 = Merge(Data1=simplify(flatten(brep_3)), Data2=simplify(flatten(brep_4)))  # -> graft(Result); disabled
merge_4 = Merge(Data1=simplify(flatten(brep_8)), Data2=simplify(flatten(brep_7)))  # -> graft(Result); disabled
merge_5 = Merge(Data1=simplify(flatten(brep_5)), Data2=simplify(flatten(brep_6)))  # -> graft(Result); disabled
merge_6 = Merge(Data1=simplify(flatten(brep_12)), Data2=simplify(flatten(brep_9)))  # -> graft(Result); disabled
merge_7 = Merge(Data1=simplify(flatten(brep_10)), Data2=simplify(flatten(brep_11)))  # -> graft(Result); disabled
merge_8 = Merge(Data1=brep_13, Data2=brep_14)  # disabled
tree_branch_7 = TreeBranch(Tree=merge_3, Path=panel_6, MaintainPaths=True)  # disabled
tree_branch_8 = TreeBranch(Tree=merge_5, Path=panel_6, MaintainPaths=True)  # disabled
tree_branch_9 = TreeBranch(Tree=merge_4, Path=panel_6, MaintainPaths=True)  # disabled
tree_branch_10 = TreeBranch(Tree=merge_6, Path=panel_6, MaintainPaths=True)  # disabled
tree_branch_11 = TreeBranch(Tree=merge_8, Path=panel_6, MaintainPaths=True)  # disabled
tree_branch_12 = TreeBranch(Tree=merge_7, Path=panel_6, MaintainPaths=True)  # disabled

# ----
# Create honeybee elements
panel_8 = Panel("RoofCeiling")  # disabled
panel_9 = Panel("Outdoors")  # disabled
panel_10 = Panel("Outdoors")  # disabled
panel_11 = Panel("Outdoors")  # disabled
panel_12 = Panel("Ground")  # disabled
panel_13 = Panel("Wall")  # disabled
panel_14 = Panel("Floor")  # disabled
panel_15 = Panel("Wall")  # disabled
panel_16 = Panel("Adiabatic")  # disabled
panel_17 = Panel("True")  # disabled
panel_18 = Panel("Wall")  # disabled
face = HBFace(geo=merge_3, type=panel_14, bc=panel_12)  # -> out, simplify(faces); disabled; plug-in component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
face_2 = HBFace(geo=merge_5, type=panel_8, bc=panel_11)  # -> out, simplify(faces); disabled; plug-in component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
aperture = HBAperture(geo=merge_8, operable=panel_17)  # -> out, apertures; disabled; plug-in component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
face_3 = HBFace(geo=merge_7, type=panel_15, bc=panel_10)  # -> out, faces; disabled; plug-in component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
face_4 = HBFace(geo=merge_6, type=panel_13, bc=panel_9)  # -> out, simplify(faces); disabled; plug-in component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
face_5 = HBFace(geo=merge_4, type=panel_18, bc=panel_16)  # -> out, simplify(faces); disabled; plug-in component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

list_length_7 = ListLength(List=merge_3)  # disabled

# ----
# Create honeybee model
addshade = HBAddShade(hb_obj=aperture.apertures)  # -> hb_obj; disabled; plug-in component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
number_slider_4 = Slider(0.1, range=0..1)  # disabled
series_17 = Series(Start=0, Step=1, Count=list_length_7)  # disabled
panel_19 = Panel("Room")  # disabled
panel_20 = Panel("True")  # disabled
addsubface = HBAddSubface(hb_obj=simplify(face_4.faces), sub_faces=addshade)  # -> simplify(hb_obj); disabled; plug-in component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
concatenate = Concatenate(FragmentA=panel_19, FragmentB=series_17)  # disabled
bordershades = HBExtrudedBorderShades(hb_objs=aperture.apertures, depth=number_slider_4, indoor=panel_20)  # -> out, simplify(hb_objs); disabled; plug-in component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
room = HBRoom(faces=[face.faces, face_2.faces, addsubface, face_5.faces], name=simplify(graft(concatenate)), conditioned=True)  # -> out, room; disabled; plug-in component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
series_18 = Series(Start=0, Step=1, Count=list_length_7)  # disabled
panel_21 = Panel("model")  # disabled
concatenate_2 = Concatenate(FragmentA=panel_21, FragmentB=series_18)  # disabled
model = HBModel(rooms=room.room, faces=face_3.faces, apertures=bordershades.hb_objs, name=simplify(graft(concatenate_2)))  # -> out, model; disabled; plug-in component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

# ----
# Create grid size
height_to_analyse = Slider(0, range=0..1)  # disabled
gridsize = Slider(5, range=0..15)  # disabled
gridrooms = HBSensorGridFromRooms(rooms=model.model, grid_size=gridsize, dist_floor=height_to_analyse)  # -> grid, points, mesh; disabled; plug-in component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
deconstruct_mesh = DeconstructMesh(Mesh=gridrooms.mesh)  # -> Vertices, Faces, Colours, Normals; disabled
list_length_8 = ListLength(List=deconstruct_mesh.Faces)  # -> flatten(Length); disabled
mesh_join = MeshJoin(Meshes=flatten(gridrooms.mesh))  # disabled
assigngridsviews = HBAssignGridsAndViews(model=model.model, grids=gridrooms.grid)  # -> model; disabled; plug-in component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

# ---- group: Shell
partition_list_3 = PartitionList(List=curve_7, Size=replace_items_3)
number_49 = Number(shell_offset_3)
shell_offset_7 = GetNumber(number_49, AtLeast=1, AtMost=1, Maximum=1.797693135e+308, Minimum=-1.797693135e+308)
list_item_19 = ListItem(List=partition_list_3, Index=-1, Wrap=True)  # -> simplify(Item)
offset_curve_8 = OffsetCurve(Curve=list_item_19, Distance=shell_offset_7, Corners=1)  # -> flatten(Curve)
loft_11 = Loft(Curves=offset_curve_8, Options={Adjust=False, Closed=False, LoftEnds=0, LoftSimp=0, LoftType=0, Rebuild=10, Refit=0.01})
cluster_25 = Cluster(geometry=loft_11, transform=rotate_direction_3.Transform, transform_3=move_3.Transform)

# ---- group: Shell / RH_OUT:Outer Shell
geometry_13 = Geometry(cluster_25)

# ----
cluster_26 = Cluster(geometry=curve_7, transform=rotate_direction_3.Transform, transform_3=move_3.Transform)
mesh_brep_3 = MeshBrep(
    Brep=geometry_13,
    Settings={GridMaxCount=0, GridMinCount=16, JaggedSeams=False, MaxEdgeLength=0, MinEdgeLength=0.0001, MinTolerance=0, Refine=True, RefineAngle=0, RelativeTolerance=0.65, SimplePlanes=True, Tolerance=0})
number_50 = Number(balcony_depth_3)
mesh_plane_3 = MeshPlane(Mesh=mesh_brep_3, Plane=cluster_26)  # -> simplify(Curves)
offset_curve_9 = OffsetCurve(Curve=cluster_26, Distance=flatten(number_50), Corners=1)
discontinuity_17 = Discontinuity(Curve=cluster_26, Level=1)  # -> simplify(Points), Parameters
discontinuity_18 = Discontinuity(Curve=mesh_plane_3, Level=1)  # -> simplify(Points), Parameters
merge_9 = Merge(Data1=graft(cluster_26), Data2=offset_curve_9)
closest_point_3 = ClosestPoint(Point=discontinuity_17.Points, Cloud=discontinuity_18.Points)  # -> ClosestPoint, CPIndex, Distance
loft_12 = Loft(Curves=merge_9, Options={Adjust=False, Closed=False, LoftEnds=0, LoftSimp=0, LoftType=0, Rebuild=10, Refit=0.01})
clean_tree_3 = CleanTree(RemoveNulls=True, RemoveInvalid=True, RemoveEmpty=False, Tree=closest_point_3.ClosestPoint)
tree_statistics_3 = TreeStatistics(Tree=clean_tree_3)  # -> Paths, Length, Count
larger_than_7 = LargerThan(FirstNumber=tree_statistics_3.Length, SecondNumber=0)  # -> LargerThan, OrEqualTo
cull_pattern_7 = CullPattern(List=tree_statistics_3.Paths, CullPattern=larger_than_7.LargerThan)
tree_branch_13 = TreeBranch(Tree=discontinuity_17.Points, Path=cull_pattern_7, MaintainPaths=True)
tree_branch_14 = TreeBranch(Tree=closest_point_3.ClosestPoint, Path=cull_pattern_7, MaintainPaths=True)
tree_branch_15 = TreeBranch(Tree=simplify(loft_12), Path=cull_pattern_7, MaintainPaths=True)  # -> flatten(Branch)
polyline_5 = PolyLine(Vertices=tree_branch_14, Closed=True)
polyline_6 = PolyLine(Vertices=tree_branch_13, Closed=True)
loft_13 = Loft(
    Curves=[polyline_5, polyline_6],
    Options={Adjust=False, Closed=False, LoftEnds=0, LoftSimp=0, LoftType=0, Rebuild=10, Refit=0.01})
boolean_3 = Boolean(balcony_type_3)
balconies_bool_3 = GetBoolean(boolean_3, AtLeast=1, AtMost=1, FalseValue="False", TrueValue="True")
stream_filter_11 = StreamFilter(Gate=balconies_bool_3, Stream0=flatten(loft_13), Stream1=tree_branch_15)

# ---- group: Shell (continued)
custom_preview_11 = CustomPreview(Geometry=geometry_13, Material=ColourSwatch(SwatchColor=RGBA(255, 255, 255, 153)))

# ---- group: RH_OUT:Balconies
geometry_14 = Geometry(stream_filter_11)

# ----
# Roof generation within facade
unit_z_19 = UnitZ(Factor=level_height_3)
move_27 = Move(Geometry=geometry_14, Motion=unit_z_19)  # -> Geometry, Transform
deconstruct_brep_5 = DeconstructBrep(Brep=move_27.Geometry)  # -> Faces, Edges, Vertices
cap_holes_5 = CapHoles(Brep=geometry_13)
list_item_20 = ListItem(List=deconstruct_brep_5.Vertices, Index=3, Wrap=True)
point_in_brep_5 = PointInBrep(Brep=cap_holes_5, Point=list_item_20, Strict=False)  # -> simplify(graft(Inside))
shift_list = ShiftList(List=geometry_14, Shift=1, Wrap=True)  # -> graft(List)
cull_pattern_8 = CullPattern(List=graft(move_27.Geometry), CullPattern=point_in_brep_5)
combine_data = CombineData(Input0=cull_pattern_8, Input1=shift_list)  # -> simplify(flatten(Result)), Index
partition_list_4 = PartitionList(List=combine_data.Result, Size=levels_per_level_3)
list_item_21 = ListItem(List=partition_list_4, Index=-1, Wrap=True)

# ---- group: Shell
partition_list_5 = PartitionList(List=curve_8, Size=replace_items_4)
number_51 = Number(shell_offset_4)
shell_offset_8 = GetNumber(number_51, AtLeast=1, AtMost=1, Maximum=1.797693135e+308, Minimum=-1.797693135e+308)
list_item_22 = ListItem(List=partition_list_5, Index=-1, Wrap=True)  # -> simplify(Item)
offset_curve_10 = OffsetCurve(Curve=list_item_22, Distance=shell_offset_8, Corners=1)  # -> flatten(Curve)
loft_14 = Loft(Curves=offset_curve_10, Options={Adjust=False, Closed=False, LoftEnds=0, LoftSimp=0, LoftType=0, Rebuild=10, Refit=0.01})
cluster_27 = Cluster(geometry=loft_14, transform=rotate_direction_4.Transform, transform_3=move_4.Transform)

# ---- group: Shell / RH_OUT:Outer Shell
geometry_15 = Geometry(cluster_27)

# ----
cluster_28 = Cluster(geometry=curve_8, transform=rotate_direction_4.Transform, transform_3=move_4.Transform)
mesh_brep_4 = MeshBrep(
    Brep=geometry_15,
    Settings={GridMaxCount=0, GridMinCount=16, JaggedSeams=False, MaxEdgeLength=0, MinEdgeLength=0.0001, MinTolerance=0, Refine=True, RefineAngle=0, RelativeTolerance=0.65, SimplePlanes=True, Tolerance=0})
number_52 = Number(balcony_depth_4)
mesh_plane_4 = MeshPlane(Mesh=mesh_brep_4, Plane=cluster_28)  # -> simplify(Curves)
offset_curve_11 = OffsetCurve(Curve=cluster_28, Distance=flatten(number_52), Corners=1)
discontinuity_19 = Discontinuity(Curve=cluster_28, Level=1)  # -> simplify(Points), Parameters
discontinuity_20 = Discontinuity(Curve=mesh_plane_4, Level=1)  # -> simplify(Points), Parameters
merge_10 = Merge(Data1=graft(cluster_28), Data2=offset_curve_11)
closest_point_4 = ClosestPoint(Point=discontinuity_19.Points, Cloud=discontinuity_20.Points)  # -> ClosestPoint, CPIndex, Distance
loft_15 = Loft(Curves=merge_10, Options={Adjust=False, Closed=False, LoftEnds=0, LoftSimp=0, LoftType=0, Rebuild=10, Refit=0.01})
clean_tree_4 = CleanTree(RemoveNulls=True, RemoveInvalid=True, RemoveEmpty=False, Tree=closest_point_4.ClosestPoint)
tree_statistics_4 = TreeStatistics(Tree=clean_tree_4)  # -> Paths, Length, Count
larger_than_8 = LargerThan(FirstNumber=tree_statistics_4.Length, SecondNumber=0)  # -> LargerThan, OrEqualTo
cull_pattern_9 = CullPattern(List=tree_statistics_4.Paths, CullPattern=larger_than_8.LargerThan)
tree_branch_16 = TreeBranch(Tree=discontinuity_19.Points, Path=cull_pattern_9, MaintainPaths=True)
tree_branch_17 = TreeBranch(Tree=closest_point_4.ClosestPoint, Path=cull_pattern_9, MaintainPaths=True)
tree_branch_18 = TreeBranch(Tree=simplify(loft_15), Path=cull_pattern_9, MaintainPaths=True)  # -> flatten(Branch)
polyline_7 = PolyLine(Vertices=tree_branch_17, Closed=True)
polyline_8 = PolyLine(Vertices=tree_branch_16, Closed=True)
loft_16 = Loft(
    Curves=[polyline_7, polyline_8],
    Options={Adjust=False, Closed=False, LoftEnds=0, LoftSimp=0, LoftType=0, Rebuild=10, Refit=0.01})
boolean_4 = Boolean(balcony_type_4)
balconies_bool_4 = GetBoolean(boolean_4, AtLeast=1, AtMost=1, FalseValue="False", TrueValue="True")
stream_filter_12 = StreamFilter(Gate=balconies_bool_4, Stream0=flatten(loft_16), Stream1=tree_branch_18)

# ---- group: Shell (continued)
custom_preview_12 = CustomPreview(Geometry=geometry_15, Material=ColourSwatch(SwatchColor=RGBA(255, 255, 255, 153)))

# ----
# Roof generation within facade
unit_z_20 = UnitZ(Factor=level_height_3)
cap_holes_6 = CapHoles(Brep=geometry_15)

geometry_16 = Geometry(stream_filter_12)
brep_15 = Brep(geometry_13)
unit_z_21 = UnitZ(Factor=level_height_4)
move_28 = Move(Geometry=polyline_8, Motion=unit_z_21)  # -> Geometry, Transform
loft_17 = Loft(
    Curves=[polyline_8, move_28.Geometry],
    Options={Adjust=False, Closed=False, LoftEnds=0, LoftSimp=0, LoftType=0, Rebuild=10, Refit=0.01})  # -> flatten(Loft)
deconstruct_brep_6 = DeconstructBrep(Brep=loft_17)  # -> simplify(flatten(Faces)), Edges, Vertices
multiplication_5 = Multiplication(A=levels_per_level_4, B=4)
partition_list_6 = PartitionList(List=geometry_16, Size=levels_per_level_4)  # -> simplify(Chunks)
list_item_23 = ListItem(List=partition_list_6, Index=0, Wrap=True)
split_brep_multiple = SplitBrepMultiple(Brep=geometry_15, Cutters=geometry_16)  # -> simplify(graft(Result))
deconstruct_brep_7 = DeconstructBrep(Brep=split_brep_multiple)  # -> Faces, Edges, Vertices
deconstruct_brep_8 = DeconstructBrep(Brep=deconstruct_brep_7.Faces)  # -> Faces, Edges, Vertices
join_curves_7 = JoinCurves(Curves=deconstruct_brep_8.Edges, Preserve=False)
trim_tree_5 = TrimTree(Tree=join_curves_7, Depth=2)
offset_on_srf_3 = OffsetOnSrf(Curve=trim_tree_5, Distance=Slider(0.1, range=0..1), Surface=deconstruct_brep_7.Faces)
trim_tree_6 = TrimTree(Tree=offset_on_srf_3, Depth=2)
list_length_9 = ListLength(List=split_brep_multiple)
surface_11 = Surface(trim_tree_6)
duplicate_data_3 = DuplicateData(Data=brep_15, Number=list_length_9, Order=True)  # -> flatten(Data)
partition_list_7 = PartitionList(List=deconstruct_brep_6.Faces, Size=multiplication_5)  # -> simplify(Chunks)
graft_tree_11 = GraftTree(Tree=duplicate_data_3, IncludeEmptyLists=True, IncludeNullItems=True)  # -> simplify(Tree)

# ----
# Create floor partly
partition_list_8 = PartitionList(List=partition_list_7, Size=4)
brep_join = BrepJoin(Breps=partition_list_8)  # -> Breps, Closed
trim_tree_7 = TrimTree(Tree=brep_join.Breps, Depth=1)
list_item_24 = ListItem(List=trim_tree_7, Index=0, Wrap=True)  # -> Item, Item1
deconstruct_brep_9 = DeconstructBrep(Brep=list_item_24.Item1)  # -> Faces, Edges, Vertices
deconstruct_brep_10 = DeconstructBrep(Brep=list_item_24.Item)  # -> Faces, Edges, Vertices
deconstruct = Deconstruct(Point=deconstruct_brep_9.Vertices)  # -> XComponent, YComponent, ZComponent
deconstruct_2 = Deconstruct(Point=deconstruct_brep_10.Vertices)  # -> XComponent, YComponent, ZComponent
sort_list = SortList(Keys=deconstruct.ZComponent, ValuesValuesA=deconstruct_brep_9.Vertices)  # -> Keys, ValuesValuesA
sort_list_2 = SortList(Keys=deconstruct_2.ZComponent, ValuesValuesA=deconstruct_brep_10.Vertices)  # -> Keys, ValuesValuesA
split_list = SplitList(List=sort_list.ValuesValuesA, Index=4)  # -> ListA, ListB
split_list_2 = SplitList(List=sort_list_2.ValuesValuesA, Index=4)  # -> ListA, ListB
sort_along_curve = SortAlongCurve(Points=split_list.ListA, Curve=curve_4)  # -> Points, Indices
sort_along_curve_2 = SortAlongCurve(Points=split_list_2.ListB, Curve=curve_4)  # -> Points, Indices
cull_index = CullIndex(List=sort_along_curve_2.Points, Indices=4, Wrap=True)
cull_index_2 = CullIndex(List=sort_along_curve.Points, Indices=4, Wrap=True)
polyline_9 = PolyLine(Vertices=cull_index, Closed=False)
polyline_10 = PolyLine(Vertices=cull_index_2, Closed=False)
loft_18 = Loft(
    Curves=[polyline_9, polyline_10],
    Options={Adjust=False, Closed=False, LoftEnds=0, LoftSimp=0, LoftType=0, Rebuild=10, Refit=0.01})  # -> simplify(Loft)

move_29 = Move(Geometry=geometry_16, Motion=unit_z_20)  # -> Geometry, Transform
deconstruct_brep_11 = DeconstructBrep(Brep=move_29.Geometry)  # -> Faces, Edges, Vertices
list_item_25 = ListItem(List=deconstruct_brep_11.Vertices, Index=3, Wrap=True)
point_in_brep_6 = PointInBrep(Brep=cap_holes_6, Point=list_item_25, Strict=False)  # -> simplify(graft(Inside))
shift_list_2 = ShiftList(List=geometry_16, Shift=1, Wrap=True)  # -> graft(List)
cull_pattern_10 = CullPattern(List=graft(move_29.Geometry), CullPattern=point_in_brep_6)
combine_data_2 = CombineData(Input0=cull_pattern_10, Input1=shift_list_2)  # -> simplify(flatten(Result)), Index
partition_list_9 = PartitionList(List=combine_data_2.Result, Size=levels_per_level_4)
list_item_26 = ListItem(List=partition_list_9, Index=-1, Wrap=True)  # -> simplify(Item)

merge_11 = Merge(Data1=list_item_23, Data2=loft_18)  # -> simplify(Result)

brep_16 = Brep(geometry_15)
unit_z_22 = UnitZ(Factor=level_height_3)
move_30 = Move(Geometry=polyline_6, Motion=unit_z_22)  # -> Geometry, Transform
loft_19 = Loft(
    Curves=[polyline_6, move_30.Geometry],
    Options={Adjust=False, Closed=False, LoftEnds=0, LoftSimp=0, LoftType=0, Rebuild=10, Refit=0.01})  # -> flatten(Loft)
deconstruct_brep_12 = DeconstructBrep(Brep=loft_19)  # -> simplify(flatten(Faces)), Edges, Vertices
multiplication_6 = Multiplication(A=levels_per_level_3, B=4)
partition_list_10 = PartitionList(List=geometry_14, Size=levels_per_level_3)  # -> simplify(Chunks)
list_item_27 = ListItem(List=partition_list_10, Index=0, Wrap=True)
split_brep_multiple_2 = SplitBrepMultiple(Brep=geometry_13, Cutters=geometry_14)  # -> simplify(graft(Result))
deconstruct_brep_13 = DeconstructBrep(Brep=split_brep_multiple_2)  # -> Faces, Edges, Vertices
deconstruct_brep_14 = DeconstructBrep(Brep=deconstruct_brep_13.Faces)  # -> Faces, Edges, Vertices
join_curves_8 = JoinCurves(Curves=deconstruct_brep_14.Edges, Preserve=False)
trim_tree_8 = TrimTree(Tree=join_curves_8, Depth=2)
offset_on_srf_4 = OffsetOnSrf(Curve=trim_tree_8, Distance=Slider(0.1, range=0..1), Surface=deconstruct_brep_13.Faces)
trim_tree_9 = TrimTree(Tree=offset_on_srf_4, Depth=2)
list_length_10 = ListLength(List=split_brep_multiple_2)
duplicate_data_4 = DuplicateData(Data=brep_16, Number=list_length_10, Order=True)  # -> flatten(Data)
partition_list_11 = PartitionList(List=deconstruct_brep_12.Faces, Size=multiplication_6)  # -> simplify(Chunks)
graft_tree_12 = GraftTree(Tree=duplicate_data_4, IncludeEmptyLists=True, IncludeNullItems=True)
surface_12 = Surface(trim_tree_9)

# ----
# Create part of the floor
partition_list_12 = PartitionList(List=partition_list_11, Size=4)
brep_join_2 = BrepJoin(Breps=partition_list_12)  # -> Breps, Closed
trim_tree_10 = TrimTree(Tree=brep_join_2.Breps, Depth=1)
list_item_28 = ListItem(List=trim_tree_10, Index=0, Wrap=True)  # -> Item, Item1
deconstruct_brep_15 = DeconstructBrep(Brep=list_item_28.Item1)  # -> Faces, Edges, Vertices
deconstruct_brep_16 = DeconstructBrep(Brep=list_item_28.Item)  # -> Faces, Edges, Vertices
deconstruct_3 = Deconstruct(Point=deconstruct_brep_15.Vertices)  # -> XComponent, YComponent, ZComponent
deconstruct_4 = Deconstruct(Point=deconstruct_brep_16.Vertices)  # -> XComponent, YComponent, ZComponent
sort_list_3 = SortList(Keys=deconstruct_3.ZComponent, ValuesValuesA=deconstruct_brep_15.Vertices)  # -> Keys, ValuesValuesA
sort_list_4 = SortList(Keys=deconstruct_4.ZComponent, ValuesValuesA=deconstruct_brep_16.Vertices)  # -> Keys, ValuesValuesA
split_list_3 = SplitList(List=sort_list_3.ValuesValuesA, Index=4)  # -> ListA, ListB
split_list_4 = SplitList(List=sort_list_4.ValuesValuesA, Index=4)  # -> ListA, ListB
sort_along_curve_3 = SortAlongCurve(Points=split_list_3.ListA, Curve=curve_3)  # -> Points, Indices
sort_along_curve_4 = SortAlongCurve(Points=split_list_4.ListB, Curve=curve_3)  # -> Points, Indices
cull_index_3 = CullIndex(List=sort_along_curve_4.Points, Indices=4, Wrap=True)
cull_index_4 = CullIndex(List=sort_along_curve_3.Points, Indices=4, Wrap=True)
polyline_11 = PolyLine(Vertices=cull_index_3, Closed=False)
polyline_12 = PolyLine(Vertices=cull_index_4, Closed=False)
loft_20 = Loft(
    Curves=[polyline_11, polyline_12],
    Options={Adjust=False, Closed=False, LoftEnds=0, LoftSimp=0, LoftType=0, Rebuild=10, Refit=0.01})  # -> simplify(Loft)

merge_12 = Merge(Data1=list_item_27, Data2=loft_20)  # -> simplify(Result)

brep_17 = Brep(merge_12)
brep_18 = Brep(merge_11)
brep_19 = Brep(list_item_21)
brep_20 = Brep(list_item_26)
brep_21 = Brep(partition_list_11)
brep_22 = Brep(partition_list_7)
brep_23 = Brep(split_brep_multiple_2)
brep_24 = Brep(split_brep_multiple)
brep_25 = Brep(surface_12)
brep_26 = Brep(surface_11)
brep_27 = Brep(graft_tree_12)
brep_28 = Brep(graft_tree_11)
path_mapper_2 = PathMapper(brep_18, source="{A}", target="{A+10}")
path_mapper_3 = PathMapper(brep_22, source="{A}", target="{A+10}")
path_mapper_4 = PathMapper(brep_26, source="{A}", target="{A+10}")
merge_13 = Merge(Data1=simplify(flatten(brep_19)), Data2=simplify(flatten(brep_20)))  # -> simplify(graft(Result))
merge_14 = Merge(Data1=simplify(brep_21), Data2=simplify(path_mapper_3))
merge_15 = Merge(Data1=simplify(flatten(brep_23)), Data2=simplify(flatten(brep_24)))  # -> simplify(graft(Result))
merge_16 = Merge(Data1=simplify(brep_17), Data2=simplify(path_mapper_2))
merge_17 = Merge(Data1=brep_25, Data2=path_mapper_4)
merge_18 = Merge(Data1=simplify(flatten(brep_27)), Data2=simplify(flatten(brep_28)))  # -> simplify(graft(Result))

# ----
# Create honeybee elements
panel_22 = Panel("RoofCeiling")
face_6 = HBFace(geo=merge_16, type="Floor", bc="Ground")  # -> out, faces; plug-in component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
face_7 = HBFace(geo=merge_13, type=panel_22, bc="Outdoors")  # -> out, faces; plug-in component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
face_8 = HBFace(geo=merge_18, type="Wall", bc="Outdoors")  # -> out, faces; plug-in component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
aperture_2 = HBAperture(geo=merge_17, operable="False")  # -> out, apertures; plug-in component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
face_9 = HBFace(geo=merge_15, type="Wall", bc="Outdoors")  # -> out, faces; plug-in component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
face_10 = HBFace(geo=merge_14, type="Wall", bc="Adiabatic")  # -> out, faces; plug-in component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

# ----
# Create honeybee model
flatten_tree = FlattenTree(Tree=merge_15, Path="{0}")
list_length_11 = ListLength(List=flatten_tree)
series_19 = Series(Start=0, Step=1, Count=list_length_11)
addshade_2 = HBAddShade(hb_obj=aperture_2.apertures)  # -> hb_obj; plug-in component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
concatenate_3 = Concatenate(FragmentA="Room", FragmentB=series_19)
addsubface_2 = HBAddSubface(hb_obj=simplify(face_9.faces), sub_faces=addshade_2)  # -> hb_obj; plug-in component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
bordershades_2 = HBExtrudedBorderShades(hb_objs=aperture_2.apertures, depth=Slider(0.1, range=0..1), indoor="True")  # -> out, simplify(hb_objs); plug-in component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
room_2 = HBRoom(faces=[face_6.faces, face_7.faces, face_10.faces, addsubface_2], name=simplify(graft(concatenate_3)), conditioned=True)  # -> out, room; plug-in component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
series_20 = Series(Start=0, Step=1, Count=list_length_11)
concatenate_4 = Concatenate(FragmentA="model", FragmentB=series_20)
model_2 = HBModel(rooms=room_2.room, faces=face_8.faces, apertures=bordershades_2.hb_objs, name=simplify(graft(concatenate_4)))  # -> out, model; plug-in component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

# ----
# Create grid size
height_to_analyse_2 = Slider(0, range=0..1)
gridsize_2 = Slider(5, range=0..15)
gridrooms_2 = HBSensorGridFromRooms(rooms=model_2.model, grid_size=gridsize_2, dist_floor=height_to_analyse_2)  # -> grid, points, mesh; plug-in component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
deconstruct_mesh_2 = DeconstructMesh(Mesh=gridrooms_2.mesh)  # -> Vertices, Faces, Colours, Normals
list_length_12 = ListLength(List=deconstruct_mesh_2.Faces)  # -> flatten(Length)
mesh_join_2 = MeshJoin(Meshes=flatten(gridrooms_2.mesh))
assigngridsviews_2 = HBAssignGridsAndViews(model=model_2.model, grids=gridrooms_2.grid)  # -> model; plug-in component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

# ----
# Annual sunlight analysis
# Run analysis!
number_slider_5 = Slider(8, range=0..100)
wea = HBWeaFromEPW(epw_file=downloadepw_2.epw_file)  # -> wea; plug-in component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
recipesettings_2 = HBRecipeSettings(workers=number_slider_5, reload_old=False)  # -> settings; plug-in component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
unit_y_9 = UnitY(Factor=1)
directsunhours = HBDirectSunHours(model=simplify(assigngridsviews_2), wea=wea, north=unit_y_9, run_settings=recipesettings_2, run=Toggle(False))  # -> out, results, hours; plug-in component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
partition_list_13 = PartitionList(List=directsunhours.hours, Size=list_length_12)
data_recorder = DataRecorder(directsunhours.hours, DataLimit=2000, RecordData=True)
heatmap = LBSpatialHeatmap(values=simplify(flatten(partition_list_13)), mesh=simplify(mesh_join_2))  # -> mesh, simplify(legend), title, colors, legend_par; plug-in component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
mesh = Mesh(heatmap.mesh)

# ----
# Point in time analysis
# Run analysis!
hour = Slider(15, range=0..24)
month = Slider(4, range=0..12)
day = Slider(4, range=0..31)
unit_y_10 = UnitY(Factor=1)
ciesky = HBCIEStandardSky(north=unit_y_10, location=importepw_2.location, month=month, day=day, hour=hour, type=Slider(0, range=0..100))  # -> sky; plug-in component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
radpar = HBRadianceParameter(recipe_type=Slider(0, range=0..2), detail_level=Slider(0, range=0..10))  # -> rad_par; plug-in component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
hoy = LBCalculateHOY(month=month, day=day, hour=hour)  # -> flatten(hoy), flatten(doy), flatten(date); plug-in component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
panel_23 = Panel("2")
sunpath = LBSunPath(north=unit_y_10, location=importepw_2.location, hoys=hoy.hoy, scale=2)  # -> out, vectors, altitudes, azimuths, hoys, sun_pts, analemma, daily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; plug-in component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
pitgrid = HBPointInTimeGridBased(model=assigngridsviews_2, sky=ciesky, metric=Slider(1, range=0..2), radiance_par=radpar, run=Toggle(False))  # -> out, results; plug-in component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
partition_list_14 = PartitionList(List=pitgrid.results, Size=list_length_12)
data_recorder_2 = DataRecorder(partition_list_14, DataLimit=-10, RecordData=True)
heatmap_2 = LBSpatialHeatmap(values=simplify(flatten(partition_list_14)), mesh=simplify(mesh_join_2))  # -> mesh, simplify(legend), title, colors, legend_par; plug-in component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
mesh_2 = Mesh(heatmap_2.mesh)

# ----
# Annual sunlight analysis
# Run analysis!
wea_2 = HBWeaFromEPW(epw_file=downloadepw.epw_file)  # -> wea; disabled; plug-in component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
boolean_toggle = BooleanToggle(False)  # disabled
unit_y_11 = UnitY(Factor=1)  # disabled
directsunhours_2 = HBDirectSunHours(model=simplify(assigngridsviews), wea=wea_2, north=unit_y_11, run_settings=recipesettings, run=boolean_toggle)  # -> out, results, hours; disabled; plug-in component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

panel_24 = Panel(directsunhours_2.hours)  # disabled
data_recorder_3 = DataRecorder(directsunhours_2.hours, DataLimit=2000, RecordData=True)  # disabled
partition_list_15 = PartitionList(List=directsunhours_2.hours, Size=list_length_8)  # disabled

heatmap_3 = LBSpatialHeatmap(values=simplify(flatten(partition_list_15)), mesh=simplify(mesh_join))  # -> mesh, simplify(legend), title, colors, legend_par; disabled; plug-in component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

mesh_3 = Mesh(heatmap_3.mesh)  # disabled

# ----
# Point in time analysis
# Run analysis!
month_2 = Slider(4, range=0..12)  # disabled
hour_2 = Slider(15, range=0..24)  # disabled
day_2 = Slider(4, range=0..31)  # disabled
number_slider_6 = Slider(0, range=0..100)  # disabled
number_slider_7 = Slider(0, range=0..2)  # disabled
number_slider_8 = Slider(0, range=0..10)  # disabled
unit_y_12 = UnitY(Factor=1)  # disabled
ciesky_2 = HBCIEStandardSky(north=unit_y_12, location=importepw.location, month=month_2, day=day_2, hour=hour_2, type=number_slider_6)  # -> sky; disabled; plug-in component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
radpar_2 = HBRadianceParameter(recipe_type=number_slider_7, detail_level=number_slider_8)  # -> rad_par; disabled; plug-in component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
boolean_toggle_2 = BooleanToggle(False)  # disabled
number_slider_9 = Slider(1, range=0..2)  # disabled
pitgrid_2 = HBPointInTimeGridBased(model=assigngridsviews, sky=ciesky_2, metric=number_slider_9, radiance_par=radpar_2, run=boolean_toggle_2)  # -> out, results; disabled; plug-in component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

hoy_2 = LBCalculateHOY(month=month_2, day=day_2, hour=hour_2)  # -> flatten(hoy), flatten(doy), flatten(date); disabled; plug-in component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
sunpath_2 = LBSunPath(north=unit_y_12, location=importepw.location, hoys=hoy_2.hoy, scale=2)  # -> out, vectors, altitudes, azimuths, hoys, sun_pts, analemma, daily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; disabled; plug-in component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
partition_list_16 = PartitionList(List=pitgrid_2.results, Size=list_length_8)  # disabled
data_recorder_4 = DataRecorder(partition_list_16, DataLimit=-10, RecordData=True)  # disabled

heatmap_4 = LBSpatialHeatmap(values=simplify(flatten(partition_list_16)), mesh=simplify(mesh_join))  # -> mesh, simplify(legend), title, colors, legend_par; disabled; plug-in component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

mesh_4 = Mesh(heatmap_4.mesh)  # disabled

# ==== cluster Cluster
transform = ClusterInput()
inverse_transform = InverseTransform(Transform=transform)
geometry = ClusterInput()
transform_2 = Transform(Geometry=geometry, Transform=inverse_transform)
transform_3 = ClusterInput()
inverse_transform_2 = InverseTransform(Transform=transform_3)
transform_4 = Transform(Geometry=transform_2, Transform=inverse_transform_2)
geometry_2 = ClusterOutput(transform_4)
