# Grasshopper definition Towers.gh (Grasshopper 1.0.7)
# Copyright: Job de Vogel

# ---- group: BIG TOWER
balcony_depth = Slider(1.8, range=0..10)
# DESIGN PARAMETERS
shell_offset = Slider(1.8, range=0..10)

levels_per_level = Slider(3, range=0..10)
level_height = Slider(3.8, range=0..10)
grid_size = Slider(7.2, range=0..10)
core_y_size = Slider(15, range=0..100)
levels = Slider(13, range=0..30)
core_x_distance = Slider(10, range=0..100)
# OUTER CORE POSITION ->
core_y_distance = Slider(10, range=0..100)
core_x_size = Slider(15, range=0..100)

# ----
# STRUCTURAL PARAMETERS
balcony_type = BooleanToggle(False)

# ---- group: SMALL TOWER
balcony_depth_2 = Slider(1.8, range=0..10)
shell_offset_2 = Slider(1.8, range=0..10)

levels_2 = Slider(10, range=0..30)
levels_per_level_2 = Slider(3, range=0..10)
level_height_2 = Slider(3.8, range=0..10)
grid_size_2 = Slider(7.2, range=0..10)
core_x_distance_2 = Slider(10, range=0..100)
core_y_distance_2 = Slider(10, range=0..100)
core_x_size_2 = Slider(15, range=0..100)
core_y_size_2 = Slider(15, range=0..100)

# ----
core_corner = Slider(0, range=0..3)
x_size_small_core = Slider(9, range=0..15)
y_size_small_core = Slider(10, range=0..15)
core_split_level = Slider(14, range=0..30)
truss_x_grid_distance = Slider(7.2, range=0..10)
truss_1_height = Slider(22, range=0..30)
truss_2_height = Slider(16, range=0..30)
truss_height = Slider(4.2, range=0..8.4)
truss_count_center = Slider(3, range=0..10)
# README: For the facade truss extensions, paramaters can be found in script, depending on control level choose grafted list or just in X and Y direction.
truss_count_endings = Slider(2, range=0..10)
balcony_type_2 = BooleanToggle(False)
curve = Curve(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)
ground_floor_rectangle = GetGeometry(curve, AtLeast=1, AtMost=1, DeleteInput=False, Filter=1073741828)

# ---- group: Move tower to origin
discontinuity = Discontinuity(Curve=ground_floor_rectangle, Level=1)  # -> Points, Parameters
list_item = ListItem(List=discontinuity.Points, Index=0, Wrap=True)  # -> Item, Item1
xy_plane = XYPlane(Origin=Point(0, 0, 0))
vector_2pt = Vector2Pt(PointA=xy_plane, PointB=list_item.Item, Unitize=False)  # -> Vector, Length
negative = Negative(Value=vector_2pt.Vector)
move = Move(Geometry=ground_floor_rectangle, Motion=negative)  # -> Geometry, Transform
discontinuity_2 = Discontinuity(Curve=move.Geometry, Level=1)  # -> Points, Parameters
list_item_2 = ListItem(List=discontinuity_2.Points, Index=0, Wrap=True)  # -> Item, Item1
vector_2pt_2 = Vector2Pt(PointA=list_item_2.Item, PointB=list_item_2.Item1, Unitize=False)  # -> Vector, Length
unit_x = UnitX(Factor=1)
unit_y = UnitY(Factor=1)
rotate_direction = RotateDirection(Geometry=move.Geometry, Center=Point(0, 0, 0), From=vector_2pt_2.Vector, To=unit_x)  # -> Geometry, Transform
discontinuity_3 = Discontinuity(Curve=rotate_direction.Geometry, Level=1)  # -> Points, Parameters
list_item_3 = ListItem(List=discontinuity_3.Points, Index=0, Wrap=True)
point = Point(list_item_3)
geometry = Geometry(rotate_direction.Geometry)

# ---- group: Core Rectangle
number = Number(core_y_distance_2)
number_2 = Number(core_x_distance_2)
core_x_distance_3 = GetNumber(number_2, AtLeast=1, AtMost=1, Maximum=1.797693135e+308, Minimum=-1.797693135e+308)
core_y_distance_3 = GetNumber(number, AtLeast=1, AtMost=1, Maximum=1.797693135e+308, Minimum=-1.797693135e+308)
number_3 = Number(core_x_size_2)
number_4 = Number(core_y_size_2)
core_x_size_3 = GetNumber(number_3, AtLeast=1, AtMost=1, Maximum=1.797693135e+308, Minimum=-1.797693135e+308)
core_y_size_3 = GetNumber(number_4, AtLeast=1, AtMost=1, Maximum=1.797693135e+308, Minimum=-1.797693135e+308)
unit_y_2 = UnitY(Factor=core_y_distance_3)
unit_x_2 = UnitX(Factor=core_x_distance_3)
rectangle = Rectangle(Plane=PlaneXY(0, 0, 0), XSize=core_x_size_3, YSize=core_y_size_3, Radius=0)  # -> Rectangle, Length
addition = Addition(A=unit_x_2, B=unit_y_2)
use_core_boolean_toggle = BooleanToggle(True)
move_2 = Move(Geometry=rectangle.Rectangle, Motion=addition)  # -> Geometry, Transform
use_core_boolean_toggle_2 = GetBoolean(use_core_boolean_toggle, AtLeast=1, AtMost=1, FalseValue="False", TrueValue="True")
stream_filter = StreamFilter(Gate=use_core_boolean_toggle_2, Stream1=move_2.Geometry)

# ----
number_5 = Number(level_height_2)
level_height_3 = GetNumber(number_5, AtLeast=1, AtMost=1, Maximum=1.797693135e+308, Minimum=-1.797693135e+308)

# ---- group: Rectangles
deconstuct_rectangle = DeconstuctRectangle(Rectangle=geometry)  # -> BasePlane, XInterval, YInterval
integer = Integer(levels_2)
number_6 = Number(balcony_depth_2)
integer_2 = Integer(levels_per_level_2)
balcony_depth_3 = GetNumber(number_6, AtLeast=1, AtMost=1, Maximum=1.797693135e+308, Minimum=-1.797693135e+308)
levels_per_level_3 = GetNumber(integer_2, AtLeast=1, AtMost=1, Maximum=1.797693135e+308, Minimum=-1.797693135e+308)
levels_3 = GetNumber(integer, AtLeast=1, AtMost=1, Maximum=1.797693135e+308, Minimum=-1.797693135e+308)
deconstruct_domain = DeconstructDomain(Domain=deconstuct_rectangle.XInterval)  # -> Start, End
deconstruct_domain_2 = DeconstructDomain(Domain=deconstuct_rectangle.YInterval)  # -> Start, End
series = Series(Start=0, Step=balcony_depth_3, Count=levels_3)
panel = Panel("3")
repeat_data = RepeatData(Data=levels_per_level_3, Length=levels_3)
absolute = Absolute(Value=deconstruct_domain.Start)
absolute_2 = Absolute(Value=deconstruct_domain_2.Start)
replace_items = ReplaceItems(List=repeat_data, Item=panel, Indices="0", Wrap=False)
addition_2 = Addition(A=absolute, B=deconstruct_domain.End)
addition_3 = Addition(A=absolute_2, B=deconstruct_domain_2.End)
stack_data = StackData(Data=series, Stack=replace_items)
xy_plane_2 = XYPlane(Origin=point)
subtraction = Subtraction(A=addition_2, B=stack_data)
subtraction_2 = Subtraction(A=addition_3, B=stack_data)
rectangle_2 = Rectangle(Plane=xy_plane_2, XSize=subtraction, YSize=subtraction_2, Radius=0)  # -> Rectangle, Length
list_length = ListLength(List=rectangle_2.Rectangle)
series_2 = Series(Start=level_height_3, Step=level_height_3, Count=list_length)
unit_z = UnitZ(Factor=series_2)
move_3 = Move(Geometry=xy_plane_2, Motion=unit_z)  # -> Geometry, Transform
move_4 = Move(Geometry=rectangle_2.Rectangle, Motion=unit_z)  # -> Geometry, Transform
plane = Plane(move_3.Geometry)
curve_2 = Curve(move_4.Geometry)

# ---- group: Floor Plan Check
number_7 = Number(grid_size_2)
grid_size_3 = GetNumber(number_7, AtLeast=1, AtMost=1, Maximum=1.797693135e+308, Minimum=-1.797693135e+308)
text = Text(addition_2)
text_2 = Text(addition_3)
number_8 = Number(text)
number_9 = Number(text_2)
modulus = Modulus(A=number_8, B=grid_size_3)
modulus_2 = Modulus(A=number_9, B=grid_size_3)
mass_addition = MassAddition(Input=[modulus_2, modulus])  # -> Result, PartialResults
larger_than = LargerThan(FirstNumber=mass_addition.Result, SecondNumber=0)  # -> LargerThan, OrEqualTo
stream_filter_2 = StreamFilter(
    Gate=larger_than.LargerThan,
    Stream0="Everything Okay",
    Stream1="WARNING: Ground Floor rectangle domain does not fit in grid size.")

# ---- group: RH_OUT:OUT
out = Panel(stream_filter_2)

# ---- group: General Information
area = Area(Geometry=curve_2)  # -> Area, Centroid
mass_addition_2 = MassAddition(Input=area.Area)  # -> Result, PartialResults

# ----
merge = Merge(Data1=simplify(flatten(geometry)), Data2=flatten(move_4.Geometry))  # -> simplify(graft(Result))

# ---- group: General Information / RH_OUT:Area
area_2 = Panel(mass_addition_2.Result)

# ---- group: Point Grid
deconstuct_rectangle_2 = DeconstuctRectangle(Rectangle=curve_2)  # -> BasePlane, XInterval, YInterval
deconstruct_domain_3 = DeconstructDomain(Domain=deconstuct_rectangle_2.XInterval)  # -> Start, End
deconstruct_domain_4 = DeconstructDomain(Domain=deconstuct_rectangle_2.YInterval)  # -> Start, End
absolute_3 = Absolute(Value=deconstruct_domain_3.Start)
absolute_4 = Absolute(Value=deconstruct_domain_4.Start)
addition_4 = Addition(A=absolute_3, B=deconstruct_domain_3.End)
addition_5 = Addition(A=absolute_4, B=deconstruct_domain_4.End)
text_3 = Text(addition_4)
text_4 = Text(addition_5)
grid_size_4 = Number(grid_size_3)
number_10 = Number(text_3)
number_11 = Number(text_4)
division = Division(A=number_10, B=grid_size_4)
division_2 = Division(A=number_11, B=grid_size_4)
round = Round(Number=division)  # -> Nearest, graft(Floor), Ceiling
round_2 = Round(Number=division_2)  # -> Nearest, graft(Floor), Ceiling
series_3 = Series(Start=0, Step=grid_size_4, Count=expr("x+1", round.Floor))
series_4 = Series(Start=0, Step=grid_size_4, Count=expr("x+1", round_2.Floor))
cross_reference = CrossReference(ListListA=series_3, ListListB=series_4, CrossMode=1)  # -> ListListA, ListListB
construct_point = ConstructPoint(XCoordinate=cross_reference.ListListA, YCoordinate=cross_reference.ListListB, ZCoordinate=0)  # -> simplify(Point)
move_5 = Move(Geometry=construct_point, Motion=graft(unit_z))  # -> simplify(Geometry), Transform

# ----
level_height_4 = Number(level_height_3)

# ---- group: Cores / Core Corner
integer_3 = Integer(core_corner)

# ---- group: Cores / X Size Small Core
number_12 = Number(x_size_small_core)

# ---- group: Cores / Y Size Small Core
number_13 = Number(y_size_small_core)

# ---- group: Core Split Level
integer_4 = Integer(core_split_level)

# ----
panel_2 = Panel("""53.4x53.4
58.8x58.8""")
panel_3 = Panel("1 item: mesh core")

# ---- group: Truss Height
number_14 = Number(truss_height)

# ----
truss_1_height_2 = Number(truss_1_height)

# ---- group: Truss X Grid Distance
number_15 = Number(truss_x_grid_distance)

# ---- group: Truss 2 Height
number_16 = Number(truss_2_height)

# ----
facade_truss_y_width = Slider(8.1, range=0..10)
# TRUSS EXTENSION PARAMETERS
# README: If you need more control over the length of the facade trusses, just add some number sliders to the Data input. e.g. adding two sliders will give control over all sides individually.
facade_truss_x_width = Slider(6.9, range=0..10)

width_1 = Slider(6.9, range=0..10)
width_2 = Slider(6.9, range=0..10)
width_3 = Slider(6.9, range=0..10)
width_4 = Slider(6.9, range=0..10)
width_5 = Slider(6.9, range=0..10)
width_6 = Slider(6.9, range=0..10)
width_7 = Slider(6.9, range=0..10)
width_8 = Slider(6.9, range=0..10)

merge_2 = Merge(Data1=width_1, Data2=width_2, Data3=width_3, Data4=width_4)
merge_3 = Merge(Data1=width_5, Data2=width_6, Data3=width_7, Data4=width_8)

# ---- group: Truss Count Center
integer_5 = Integer(truss_count_center)

# ----
entwine = Entwine(Branch00=merge_2, Branch01=merge_3, FlattenInputs=True)  # -> simplify(Result)
number_17 = Number(entwine)

# ---- group: Truss Count Endings
integer_6 = Integer(truss_count_endings)

# ----
multiplication = Multiplication(A=list_length, B=level_height_3)
curve_3 = Curve(stream_filter)
unit_z_2 = UnitZ(Factor=multiplication)
extrude = Extrude(Base=curve_3, Direction=unit_z_2)
brep_plane = BrepPlane(Brep=extrude, Plane=plane, UseTasks=False)  # -> Curves, Points
cap_holes = CapHoles(Brep=extrude)
surface = Surface(curve_2)
cluster = Cluster(geometry=extrude, transform=rotate_direction.Transform, transform_3=move.Transform)

merge_4 = Merge(Data1=move_2.Geometry, Data2=flatten(brep_plane.Curves))  # -> graft(Result)

# ---- group: General Information / RH_OUT:Height
height = Panel(multiplication)

# ---- group: Point Grid Core Extraction
point_in_brep = PointInBrep(Brep=cap_holes, Point=move_5.Geometry, Strict=False)
cull_pattern = CullPattern(List=move_5.Geometry, CullPattern=invert(point_in_brep))
cluster_2 = Cluster(geometry=cull_pattern, transform=rotate_direction.Transform, transform_3=move.Transform)

# ---- group: Columns
unit_z_3 = UnitZ(Factor=1)
negative_2 = Negative(Value=unit_z_3)
line_sdl = LineSDL(Start=cull_pattern, Direction=negative_2, Length=level_height_4)  # -> flatten(Line)
join_curves = JoinCurves(Curves=line_sdl, Preserve=False)
cluster_3 = Cluster(geometry=join_curves, transform=rotate_direction.Transform, transform_3=move.Transform)

# ---- group: Point Grid Core Extraction / RH_OUT:Points
point_2 = Point(cluster_2)

# ----
cluster_4 = Cluster(geometry=join_curves, transform=rotate_direction.Transform, transform_3=move.Transform)

# ---- group: Columns / RH_OUT:Columns
curve_4 = Curve(cluster_3)

# ----
curve_5 = Curve(merge_4)
discontinuity_4 = Discontinuity(Curve=curve_5, Level=1)  # -> Points, Parameters
list_item_4 = ListItem(List=flatten(curve_5), Index=0, Wrap=True)

# ---- group: RH_OUT:Core
geometry_2 = Geometry(cluster)

# ----
sort_along_curve = SortAlongCurve(Points=discontinuity_4.Points, Curve=list_item_4)  # -> Points, Indices
polyline = PolyLine(Vertices=sort_along_curve.Points, Closed=True)

# ---- group: Shell
partition_list = PartitionList(List=curve_2, Size=replace_items)
number_18 = Number(shell_offset_2)
shell_offset_3 = GetNumber(number_18, AtLeast=1, AtMost=1, Maximum=1.797693135e+308, Minimum=-1.797693135e+308)
list_item_5 = ListItem(List=partition_list, Index=-1, Wrap=True)  # -> simplify(Item)
offset_curve = OffsetCurve(Curve=list_item_5, Distance=shell_offset_3, Corners=1)  # -> flatten(Curve)
loft = Loft(Curves=offset_curve, Options={Adjust=False, Closed=False, LoftEnds=0, LoftSimp=0, LoftType=0, Rebuild=10, Refit=0.01})
cluster_5 = Cluster(geometry=loft, transform=rotate_direction.Transform, transform_3=move.Transform)

# ---- group: Shell / RH_OUT:Outer Shell
geometry_3 = Geometry(cluster_5)

# ---- group: Balconies
cluster_6 = Cluster(geometry=curve_2, transform=rotate_direction.Transform, transform_3=move.Transform)
mesh_brep = MeshBrep(
    Brep=geometry_3,
    Settings={GridMaxCount=0, GridMinCount=16, JaggedSeams=False, MaxEdgeLength=0, MinEdgeLength=0.0001, MinTolerance=0, Refine=True, RefineAngle=0, RelativeTolerance=0.65, SimplePlanes=True, Tolerance=0})
number_19 = Number(balcony_depth_2)
mesh_plane = MeshPlane(Mesh=mesh_brep, Plane=cluster_6, UseTasks=False)  # -> simplify(Curves)
offset_curve_2 = OffsetCurve(Curve=cluster_6, Distance=flatten(number_19), Corners=1)
discontinuity_5 = Discontinuity(Curve=cluster_6, Level=1)  # -> simplify(Points), Parameters
discontinuity_6 = Discontinuity(Curve=mesh_plane, Level=1)  # -> simplify(Points), Parameters
merge_5 = Merge(Data1=graft(cluster_6), Data2=offset_curve_2)
closest_point = ClosestPoint(Point=discontinuity_5.Points, Cloud=discontinuity_6.Points)  # -> ClosestPoint, CPIndex, Distance
loft_2 = Loft(Curves=merge_5, Options={Adjust=False, Closed=False, LoftEnds=0, LoftSimp=0, LoftType=0, Rebuild=10, Refit=0.01})
clean_tree = CleanTree(RemoveNulls=True, RemoveInvalid=True, RemoveEmpty=False, Tree=closest_point.ClosestPoint)
tree_statistics = TreeStatistics(Tree=clean_tree)  # -> Paths, Length, Count
larger_than_2 = LargerThan(FirstNumber=tree_statistics.Length, SecondNumber=0)  # -> LargerThan, OrEqualTo
cull_pattern_2 = CullPattern(List=tree_statistics.Paths, CullPattern=larger_than_2.LargerThan)
tree_branch = TreeBranch(Tree=discontinuity_5.Points, Path=cull_pattern_2, MaintainPaths=True)
tree_branch_2 = TreeBranch(Tree=closest_point.ClosestPoint, Path=cull_pattern_2, MaintainPaths=True)
tree_branch_3 = TreeBranch(Tree=simplify(loft_2), Path=cull_pattern_2, MaintainPaths=True)  # -> flatten(Branch)
polyline_2 = PolyLine(Vertices=tree_branch_2, Closed=True)
polyline_3 = PolyLine(Vertices=tree_branch, Closed=True)
loft_3 = Loft(
    Curves=[polyline_2, polyline_3],
    Options={Adjust=False, Closed=False, LoftEnds=0, LoftSimp=0, LoftType=0, Rebuild=10, Refit=0.01})
boolean = Boolean(balcony_type_2)
balconies_bool = GetBoolean(boolean, AtLeast=1, AtMost=1, FalseValue="False", TrueValue="True")
stream_filter_3 = StreamFilter(Gate=balconies_bool, Stream0=flatten(loft_3), Stream1=tree_branch_3)

# ---- group: Shell (continued)
custom_preview = CustomPreview(Geometry=geometry_3, Material=ColourSwatch(SwatchColor=RGBA(255, 255, 255, 153)))

# ---- group: Anyoing part of the script that should have been avoided...
curve_6 = Curve(merge)
integer_7 = Integer(panel)
xy_plane_3 = XYPlane(Origin=Point(0, 0, 0))
merge_6 = Merge(Data1=xy_plane_3, Data2=plane)  # -> flatten(Result)
split_list = SplitList(List=flatten(curve_6), Index=integer_7)  # -> flatten(ListA), ListB
split_list_2 = SplitList(List=merge_6, Index=integer_7)  # -> ListA, ListB
brep_plane_2 = BrepPlane(Brep=loft, Plane=split_list_2.ListB, UseTasks=False)  # -> simplify(Curves), Points
merge_7 = Merge(Data1=split_list.ListA, Data2=flatten(brep_plane_2.Curves))  # -> graft(Result)

# ---- group: RH_OUT:Balconies
geometry_4 = Geometry(stream_filter_3)

# ----
custom_preview_2 = CustomPreview(Geometry=geometry_2, Material=ColourSwatch(SwatchColor=RGB(255, 255, 255)))

# ---- group: Cores
list_item_6 = ListItem(List=sort_along_curve.Points, Index=integer_3, Wrap=True)  # -> Item1, Item, Item1_2, Item2
vector_2pt_3 = Vector2Pt(PointA=list_item_6.Item, PointB=list_item_6.Item1, Unitize=False)  # -> Vector, Length
vector_2pt_4 = Vector2Pt(PointA=list_item_6.Item, PointB=list_item_6.Item1_2, Unitize=False)  # -> Vector, Length
xy_plane_4 = XYPlane(Origin=list_item_6.Item)
amplitude = Amplitude(Vector=vector_2pt_3.Vector, Amplitude=number_12)  # -> simplify(Vector)
amplitude_2 = Amplitude(Vector=vector_2pt_4.Vector, Amplitude=number_13)  # -> simplify(Vector)
move_6 = Move(Geometry=list_item_6.Item, Motion=amplitude_2)  # -> Geometry, Transform
move_7 = Move(Geometry=list_item_6.Item, Motion=amplitude)  # -> Geometry, Transform
rectangle_2pt = Rectangle2Pt(Plane=xy_plane_4, PointA=move_7.Geometry, PointB=move_6.Geometry, Radius=0)  # -> flatten(Rectangle), Length
merge_8 = Merge(
    Data1=move_7.Geometry,
    Data2=list_item_6.Item1,
    Data3=list_item_6.Item2,
    Data4=list_item_6.Item1_2,
    Data5=move_6.Geometry)
polyline_4 = PolyLine(Vertices=merge_8, Closed=False)  # -> flatten(Polyline)
split_list_3 = SplitList(List=rectangle_2pt.Rectangle, Index=integer_4)  # -> ListA, ListB
split_list_4 = SplitList(List=polyline_4, Index=integer_4)  # -> ListA, ListB
curve_7 = Curve(rectangle_2pt.Rectangle)
curve_8 = Curve(split_list_4.ListA)
loft_4 = Loft(Curves=curve_7, Options={Adjust=False, Closed=False, LoftEnds=0, LoftSimp=0, LoftType=0, Rebuild=10, Refit=0.01})
loft_5 = Loft(Curves=curve_8, Options={Adjust=False, Closed=False, LoftEnds=0, LoftSimp=0, LoftType=0, Rebuild=10, Refit=0.01})

# ---- group: Core Corners
split_list_5 = SplitList(List=flatten(polyline), Index=integer_4)  # -> ListA, ListB
merge_9 = Merge(Data1=split_list_5.ListA, Data2=split_list_3.ListB)
deconstruct_brep = DeconstructBrep(Brep=merge_9)  # -> Faces, Edges, Vertices
shift_list = ShiftList(List=deconstruct_brep.Edges, Shift=1, Wrap=True)
end_points = EndPoints(Curve=deconstruct_brep.Edges)  # -> Start, End
plane_normal = PlaneNormal(Origin=end_points.Start, ZAxis=shift_list)  # -> simplify(Plane)
curve_plane = CurvePlane(Curve=merge_7, Plane=plane_normal)  # -> Points, ParamsC, ParamsP
discontinuity_7 = Discontinuity(Curve=merge_9, Level=1)  # -> simplify(Points), Parameters
trim_tree = TrimTree(Tree=curve_plane.Points, Depth=1)
closest_point_2 = ClosestPoint(Point=trim_tree, Cloud=discontinuity_7.Points)  # -> ClosestPoint, CPIndex, Distance

# ---- group: Cores / Small Core
geometry_5 = Geometry(loft_4)

# ---- group: Cores / Large Core
geometry_6 = Geometry(loft_5)

# ---- group: Cores (continued)
mesh_brep_2 = MeshBrep(
    Brep=geometry_5,
    Settings={GridMaxCount=0, GridMinCount=16, JaggedSeams=False, MaxEdgeLength=0, MinEdgeLength=0.0001, MinTolerance=0, Refine=True, RefineAngle=0, RelativeTolerance=0.65, SimplePlanes=True, Tolerance=0})
mesh_brep_3 = MeshBrep(
    Brep=geometry_6,
    Settings={GridMaxCount=0, GridMinCount=16, JaggedSeams=False, MaxEdgeLength=0, MinEdgeLength=0.0001, MinTolerance=0, Refine=True, RefineAngle=0, RelativeTolerance=0.65, SimplePlanes=True, Tolerance=0})
mesh_join = MeshJoin(Meshes=flatten([mesh_brep_2, mesh_brep_3]))

# ---- group: Combined Core
mesh = Mesh(mesh_join)

# ---- group: Core Rectangles
# 1 list: all rectangle sections of core
curve_9 = Curve(merge_9)

# ---- group: Outriggers
line = Line(StartPoint=closest_point_2.ClosestPoint, EndPoint=trim_tree)  # -> simplify(Line)
unit_z_4 = UnitZ(Factor=number_14)
tree_branch_4 = TreeBranch(Tree=line, Path=[truss_1_height_2, number_16], MaintainPaths=False)
negative_3 = Negative(Value=unit_z_4)
move_8 = Move(Geometry=tree_branch_4, Motion=negative_3)  # -> Geometry, Transform
end_points_2 = EndPoints(Curve=graft(tree_branch_4))  # -> Start, End
end_points_3 = EndPoints(Curve=graft(move_8.Geometry))  # -> Start, End
divide_distance = DivideDistance(Curve=tree_branch_4, Distance=number_15)  # -> Points, Tangents, Parameters
divide_distance_2 = DivideDistance(Curve=move_8.Geometry, Distance=number_15)  # -> Points, Tangents, Parameters
vector_2pt_5 = Vector2Pt(PointA=end_points_3.Start, PointB=end_points_3.End, Unitize=False)  # -> Vector, Length
mesh_brep_4 = MeshBrep(
    Brep=loft,
    Settings={GridMaxCount=0, GridMinCount=16, JaggedSeams=False, MaxEdgeLength=0, MinEdgeLength=0.0001, MinTolerance=0, Refine=True, RefineAngle=0, RelativeTolerance=0.65, SimplePlanes=True, Tolerance=0})
merge_10 = Merge(Data1=divide_distance.Points, Data2=end_points_2.End)
mesh_ray = MeshRay(Mesh=mesh_brep_4, Point=end_points_3.Start, Direction=vector_2pt_5.Vector)  # -> Point, Hit
merge_11 = Merge(Data1=divide_distance_2.Points, Data2=mesh_ray.Point)
shift_list_2 = ShiftList(List=merge_10, Shift=1, Wrap=False)  # -> simplify(List)
shift_list_3 = ShiftList(List=merge_11, Shift=1, Wrap=False)  # -> simplify(List)
line_2 = Line(StartPoint=end_points_3.Start, EndPoint=mesh_ray.Point)
shortest_list = ShortestList(ListListA=merge_10, ListListB=shift_list_3, TrimMode=2)  # -> ListListA, ListListB
shortest_list_2 = ShortestList(ListListA=shift_list_2, ListListB=merge_11, TrimMode=2)  # -> ListListA, ListListB
line_3 = Line(StartPoint=shortest_list_2.ListListA, EndPoint=shortest_list_2.ListListB)
line_4 = Line(StartPoint=shortest_list.ListListA, EndPoint=shortest_list.ListListB)
line_5 = Line(StartPoint=merge_10, EndPoint=merge_11)

# ---- group: Horizontal Top
curve_10 = Curve(graft(tree_branch_4))

# ---- group: Diagonal 2
curve_11 = Curve(line_4)

# ---- group: Horizontal Bottom
curve_12 = Curve(line_2)

# ---- group: Diagonal 1
# {1;*} indicating outrigger level
# 
# Subbranch indicating truss
# 
# Item indicating element
curve_13 = Curve(line_3)

# ---- group: Vertical
curve_14 = Curve(line_5)

# ----
surface_split = SurfaceSplit(Surface=graft(surface), Curves=graft(merge_9))  # -> simplify(Fragments)
list_item_7 = ListItem(List=surface_split, Index=0, Wrap=True)
cluster_7 = Cluster(geometry=list_item_7, transform=rotate_direction.Transform, transform_3=move.Transform)

# ---- group: RH_OUT:Floor Surfaces
surface_2 = Surface(cluster_7)

# ----
custom_preview_3 = CustomPreview(Geometry=surface_2, Material=ColourSwatch(SwatchColor=RGB(255, 255, 255)))

tree_branch_5 = TreeBranch(Tree=simplify(merge_7), Path=[truss_1_height_2, number_16], MaintainPaths=False)
trim_tree_2 = TrimTree(Tree=end_points_2.End, Depth=1)
curve_closest_point = CurveClosestPoint(Point=trim_tree_2, Curve=tree_branch_5)  # -> Point, Parameter, Distance
sort_list = SortList(Keys=curve_closest_point.Parameter, ValuesValuesA=curve_closest_point.Point)  # -> Keys, ValuesValuesA
dispatch = Dispatch(List=sort_list.ValuesValuesA, DispatchPattern=[True, False])  # -> ListA, ListB
line_6 = Line(StartPoint=dispatch.ListA, EndPoint=dispatch.ListB)
vector_2pt_6 = Vector2Pt(PointA=dispatch.ListA, PointB=dispatch.ListB, Unitize=False)  # -> Vector, Length
repeat_data_2 = RepeatData(Data=[facade_truss_x_width, facade_truss_y_width], Length=8)
negative_4 = Negative(Value=vector_2pt_6.Vector)
partition_list_2 = PartitionList(List=repeat_data_2, Size=4)
divide_curve = DivideCurve(Curve=line_6, Count=integer_5, Kinks=False)  # -> Points, Tangents, Parameters
shift_list_4 = ShiftList(List=divide_curve.Points, Shift=1, Wrap=False)  # -> simplify(List)

number_20 = Number(partition_list_2)

# ---- group: Facade Horizontal Bottom
curve_closest_point_2 = CurveClosestPoint(Point=trim_tree_2, Curve=tree_branch_5)  # -> Point, Parameter, Distance
trim_tree_3 = TrimTree(Tree=mesh_ray.Point, Depth=1)
sort_list_2 = SortList(Keys=curve_closest_point_2.Parameter, ValuesValuesA=trim_tree_3)  # -> Keys, ValuesValuesA
partition_list_3 = PartitionList(List=sort_list_2.ValuesValuesA, Size=2)
polyline_5 = PolyLine(Vertices=partition_list_3, Closed=False)
end_points_4 = EndPoints(Curve=polyline_5)  # -> Start, End
vector_2pt_7 = Vector2Pt(PointA=end_points_4.Start, PointB=end_points_4.End, Unitize=False)  # -> Vector, Length
negative_5 = Negative(Value=vector_2pt_7.Vector)
amplitude_3 = Amplitude(Vector=negative_5, Amplitude=graft(number_20))  # -> simplify(Vector)
amplitude_4 = Amplitude(Vector=vector_2pt_7.Vector, Amplitude=graft(number_20))  # -> simplify(Vector)
move_9 = Move(Geometry=end_points_4.Start, Motion=amplitude_3)  # -> Geometry, Transform
move_10 = Move(Geometry=end_points_4.End, Motion=amplitude_4)  # -> Geometry, Transform
line_7 = Line(StartPoint=end_points_4.Start, EndPoint=move_9.Geometry)
line_8 = Line(StartPoint=end_points_4.End, EndPoint=move_10.Geometry)
join_curves_2 = JoinCurves(Curves=[polyline_5, line_7, line_8], Preserve=False)
merge_12 = Merge(Data1=graft(line_7), Data2=graft(line_8))

# ----
amplitude_5 = Amplitude(Vector=vector_2pt_6.Vector, Amplitude=number_20)
amplitude_6 = Amplitude(Vector=negative_4, Amplitude=number_20)
move_11 = Move(Geometry=dispatch.ListA, Motion=amplitude_6)  # -> Geometry, Transform
move_12 = Move(Geometry=dispatch.ListB, Motion=amplitude_5)  # -> Geometry, Transform
divide_curve_2 = DivideCurve(Curve=polyline_5, Count=integer_5, Kinks=False)  # -> Points, Tangents, Parameters
line_9 = Line(StartPoint=dispatch.ListA, EndPoint=move_11.Geometry)
line_10 = Line(StartPoint=dispatch.ListB, EndPoint=move_12.Geometry)
line_11 = Line(StartPoint=divide_curve.Points, EndPoint=divide_curve_2.Points)
shift_list_5 = ShiftList(List=divide_curve_2.Points, Shift=1, Wrap=False)  # -> simplify(List)
trim_tree_4 = TrimTree(Tree=line_11, Depth=1)
shortest_list_3 = ShortestList(ListListA=divide_curve.Points, ListListB=shift_list_5, TrimMode=2)  # -> ListListA, ListListB
shortest_list_4 = ShortestList(ListListA=shift_list_4, ListListB=divide_curve_2.Points, TrimMode=2)  # -> ListListA, ListListB
merge_13 = Merge(Data1=graft(line_9), Data2=graft(line_10))
merge_14 = Merge(Data1=graft(line_6), Data2=simplify(merge_13))
move_13 = Move(Geometry=merge_13, Motion=negative_3)  # -> Geometry, Transform
join_curves_3 = JoinCurves(Curves=merge_14, Preserve=False)
divide_curve_3 = DivideCurve(Curve=merge_13, Count=integer_6, Kinks=False)  # -> Points, Tangents, Parameters
divide_curve_4 = DivideCurve(Curve=merge_12, Count=integer_6, Kinks=False)  # -> Points, Tangents, Parameters
shift_list_6 = ShiftList(List=divide_curve_3.Points, Shift=1, Wrap=False)  # -> simplify(List)
shift_list_7 = ShiftList(List=divide_curve_4.Points, Shift=1, Wrap=False)  # -> simplify(List)
line_12 = Line(StartPoint=shortest_list_4.ListListA, EndPoint=shortest_list_4.ListListB)  # -> simplify(Line)
shortest_list_5 = ShortestList(ListListA=divide_curve_3.Points, ListListB=shift_list_7, TrimMode=2)  # -> ListListA, ListListB
line_13 = Line(StartPoint=shortest_list_3.ListListA, EndPoint=shortest_list_3.ListListB)
shortest_list_6 = ShortestList(ListListA=shift_list_6, ListListB=divide_curve_4.Points, TrimMode=2)  # -> ListListA, ListListB
line_14 = Line(StartPoint=shortest_list_6.ListListA, EndPoint=shortest_list_6.ListListB)
line_15 = Line(StartPoint=shortest_list_5.ListListA, EndPoint=shortest_list_5.ListListB)
line_16 = Line(StartPoint=divide_curve_3.Points, EndPoint=divide_curve_4.Points)  # -> simplify(Line)
trim_tree_5 = TrimTree(Tree=line_14, Depth=1)  # -> simplify(Tree)
trim_tree_6 = TrimTree(Tree=line_15, Depth=1)  # -> simplify(Tree)
trim_tree_7 = TrimTree(Tree=line_16, Depth=1)

# ---- group: Facade Horizontal Bottom
curve_15 = Curve(join_curves_2)

# ---- group: Facade Horizontal Top
# {1;*} indicating outrigger level
# 
# Subbranch indicating truss
# 
# Item indicating element
curve_16 = Curve(join_curves_3)

# ---- group: Facade Vertical
curve_17 = Curve([trim_tree_7, trim_tree_4])

# ---- group: Facade Diagonals
curve_18 = Curve([trim_tree_5, trim_tree_6, line_12, line_13])

# ---- group: Facade Columns
split_tree = SplitTree(Data=simplify(curve_16), Masks=flatten("{0;*}"))  # -> Positive, Negative
split_tree_2 = SplitTree(Data=curve_17, Masks=flatten("{0;*}"))  # -> Positive, Negative
end_points_5 = EndPoints(Curve=split_tree_2.Positive)  # -> Start, End
end_points_6 = EndPoints(Curve=split_tree_2.Negative)  # -> Start, End
curve_closest_point_3 = CurveClosestPoint(Point=end_points_5.End, Curve=split_tree.Negative)  # -> Point, Parameter, Distance
vector_2pt_8 = Vector2Pt(PointA=end_points_6.Start, PointB=end_points_6.End, Unitize=False)  # -> Vector, Length
xy_plane_5 = XYPlane(Origin=Point(0, 0, 0))
line_17 = Line(StartPoint=end_points_5.End, EndPoint=curve_closest_point_3.Point)
project_point = ProjectPoint(Point=end_points_6.End, Direction=vector_2pt_8.Vector, Geometry=xy_plane_5)  # -> Point, Index
line_18 = Line(StartPoint=end_points_6.End, EndPoint=project_point.Point)

# ----
# Top columns organized by truss
curve_19 = Curve(line_17)
# Bottom columns organized by truss
curve_20 = Curve(line_18)
cluster_8 = Cluster(
    geometry=[curve_19, curve_20, curve_16, curve_17, curve_18, curve_15, curve_13, curve_11, curve_14, curve_10, curve_12, mesh],
    transform=rotate_direction.Transform,
    transform_3=move.Transform)

# ==== cluster Cluster
transform = ClusterInput()
inverse_transform = InverseTransform(Transform=transform)
geometry = ClusterInput()
transform_2 = Transform(Geometry=geometry, Transform=inverse_transform)
transform_3 = ClusterInput()
inverse_transform_2 = InverseTransform(Transform=transform_3)
transform_4 = Transform(Geometry=transform_2, Transform=inverse_transform_2)
geometry_2 = ClusterOutput(transform_4)
