# Grasshopper definition Towers_Hops.gh (Grasshopper 1.0.7)
# Copyright: Job de Vogel
# plug-ins: Hops

shell_offset = Slider(1.8, range=0..10)
levels_per_level = Slider(3, range=0..10)
levels = Slider(11, range=0..30)
level_height = Slider(4.2, range=0..10)
grid_size = Slider(3.6, range=0..10)
core_x_distance = Slider(15, range=0..100)
curve = Curve(<curve referenced from the Rhino model>)
balcony_depth = Slider(1.8, range=0..10)
core_y_distance = Slider(15, range=0..100)
core_x_size = Slider(15, range=0..100)
core_y_size = Slider(15, range=0..100)
curve_2 = Curve(<curve referenced from the Rhino model>)
hops = Hops(
    GroundFloorRectangle=curve,
    BalconyDepth=balcony_depth,
    ShellOffset=shell_offset,
    LevelsPerLevel=levels_per_level,
    Levels=levels,
    LevelHeight=level_height,
    GridSize=grid_size,
    CoreXDistance=core_x_distance,
    CoreYDistance=core_y_distance,
    CoreXSize=core_x_size,
    CoreYSize=core_y_size,
    UseCoreBooleanToggle=Toggle(True),
    CacheResultsInMemory=True,
    CacheSolveResults=True,
    RemoteDefinitionLocation="C:\Users\Job de Vogel\OneDrive\Documenten\TU Delft\Building Technology\MEGA\Grasshopper Files\Towers.gh",
    RemoteSolveVersion=(0, 1, 0),
    ShowInput_Enabled=False,
    ShowInput_Path=False,
    SynchronousSolve=False)  # -> OUT, OuterShell, Columns, Points, FloorSurfaces, Core, Height, Area
