# Grasshopper definition main_base.gh (Grasshopper 1.0.7)
# Copyright: Job de Vogel

curve_center_grid = Slider(0.516, range=0..1)
water_offset = Slider(99, range=0..150)
north_border = Slider(0.919, range=0..1)
south_border = Slider(0.034, range=0..1)
dike_offset = Slider(50, range=0..100)
dike_cut_size = Slider(50, range=-50..75)
grid_size_x = Slider(12, range=0..12)
grid_size_y = Slider(24, range=0..24)
x_size_grid = Slider(175, range=0..175)
y_size_grid = Slider(300, range=0..300)
distribution_height = Slider(12, range=0..100)
z_grid_size = Slider(6, range=0..10)

column_radius = Slider(0.4, range=0..1)
curve = Curve()
distribution_height_2 = GetNumber(distribution_height, AtLeast=1, AtMost=1, Maximum=1.797693135e+308, Minimum=-1.797693135e+308)
curve_center_grid_2 = GetNumber(curve_center_grid, AtLeast=1, AtMost=1, Maximum=1.797693135e+308, Minimum=-1.797693135e+308)
water_outline = GetGeometry(curve, AtLeast=1, AtMost=1, DeleteInput=False, Filter=1074004029)
column_radius_2 = GetNumber(column_radius, AtLeast=1, AtMost=1, Maximum=1.797693135e+308, Minimum=-1.797693135e+308)
north_border_2 = GetNumber(north_border, AtLeast=1, AtMost=1, Maximum=1.797693135e+308, Minimum=-1.797693135e+308)
south_border_2 = GetNumber(south_border, AtLeast=1, AtMost=1, Maximum=1.797693135e+308, Minimum=-1.797693135e+308)
dike_cut_size_2 = GetNumber(dike_cut_size, AtLeast=1, AtMost=1, Maximum=1.797693135e+308, Minimum=-1.797693135e+308)
water_offset_2 = GetNumber(water_offset, AtLeast=1, AtMost=1, Maximum=1.797693135e+308, Minimum=-1.797693135e+308)
dike_offset_2 = GetNumber(dike_offset, AtLeast=1, AtMost=1, Maximum=1.797693135e+308, Minimum=-1.797693135e+308)
grid_size_x_2 = GetNumber(grid_size_x, AtLeast=1, AtMost=1, Maximum=1.797693135e+308, Minimum=-1.797693135e+308)
grid_size_y_2 = GetNumber(grid_size_y, AtLeast=1, AtMost=1, Maximum=1.797693135e+308, Minimum=-1.797693135e+308)
x_size_grid_2 = GetNumber(x_size_grid, AtLeast=1, AtMost=1, Maximum=1.797693135e+308, Minimum=-1.797693135e+308)
y_size_grid_2 = GetNumber(y_size_grid, AtLeast=1, AtMost=1, Maximum=1.797693135e+308, Minimum=-1.797693135e+308)
z_grid_size_2 = GetNumber(z_grid_size, AtLeast=1, AtMost=1, Maximum=1.797693135e+308, Minimum=-1.797693135e+308)

# ---- group: Water Outline Curves
number = Number(north_border_2)
number_2 = Number(south_border_2)
merge = Merge(Data1=number, Data2=number_2)
shatter = Shatter(Curve=reparameterize(water_outline), Parameters=merge)
xy_plane = XYPlane(Origin=Point(0, 0, 0))
number_3 = Number(water_offset_2)
list_item = ListItem(List=shatter, Index=1, Wrap=True)
negative = Negative(Value=number_3)
number_4 = Number(dike_offset_2)
offset_curve = OffsetCurve(Curve=list_item, Distance=number_4, Plane=xy_plane, Corners=1)
offset_curve_2 = OffsetCurve(Curve=list_item, Distance=negative, Plane=xy_plane, Corners=1)
end_points = EndPoints(Curve=offset_curve)  # -> Start, End
end_points_2 = EndPoints(Curve=offset_curve_2)  # -> Start, End
line = Line(StartPoint=end_points_2.Start, EndPoint=end_points.Start)
line_2 = Line(StartPoint=end_points_2.End, EndPoint=end_points.End)
join_curves = JoinCurves(Curves=[line, line_2, offset_curve_2, offset_curve], Preserve=False)
water_outline_2 = Data(list_item)
closed_curve = Data(join_curves)
outer_curve = Data(offset_curve)
inner_curve = Data(offset_curve_2)

# ----
number_5 = Number(curve_center_grid_2)
number_6 = Number(dike_cut_size_2)
number_7 = Number(grid_size_x_2)
number_8 = Number(grid_size_y_2)
number_9 = Number(x_size_grid_2)
number_10 = Number(y_size_grid_2)

# ---- group: Generate Point Grid
water_outline_3 = Data(water_outline_2)
evaluate_curve = EvaluateCurve(Curve=reparameterize(water_outline_3), Parameter=number_5)  # -> Point, Tangent, Angle
plane_normal = PlaneNormal(Origin=evaluate_curve.Point, ZAxis=evaluate_curve.Tangent)
deconstruct_plane = DeconstructPlane(Plane=plane_normal)  # -> Origin, XAxis, YAxis, ZAxis
construct_plane = ConstructPlane(Origin=deconstruct_plane.Origin, XAxis=deconstruct_plane.XAxis, YAxis=deconstruct_plane.ZAxis)
flip_plane = FlipPlane(Plane=construct_plane, ReverseX=True, ReverseY=True, SwapAxes=False)
deconstruct_plane_2 = DeconstructPlane(Plane=flip_plane)  # -> Origin, XAxis, YAxis, ZAxis
negative_2 = Negative(Value=deconstruct_plane_2.XAxis)
negative_3 = Negative(Value=deconstruct_plane_2.YAxis)
plane = Plane(flip_plane)
amplitude = Amplitude(Vector=negative_3, Amplitude=expr("x/2", number_10))
amplitude_2 = Amplitude(Vector=negative_2, Amplitude=number_6)
addition = Addition(A=amplitude_2, B=amplitude)
division = Division(A=number_9, B=number_7)
division_2 = Division(A=number_10, B=number_8)
move = Move(Geometry=plane, Motion=addition)  # -> Geometry, Transform
rectangular = Rectangular(Plane=move.Geometry, SizeX=number_7, SizeY=number_8, ExtentX=division, ExtentY=division_2)  # -> Cells, Points
base_grid_ground_floor = Data(rectangular.Points)
grid_normal = Data(deconstruct_plane.ZAxis)

# ---- group: Exclude points outside boundary
pointgrid = Data(base_grid_ground_floor)
closed_curve_2 = Data(closed_curve)
normal = Data(grid_normal)
point = Point(pointgrid)
point_in_curve = PointInCurve(Point=point, Curve=closed_curve_2)  # -> Relationship, Point
dispatch = Dispatch(List=point, DispatchPattern=point_in_curve.Relationship)  # -> ListA, ListB
plane_normal_2 = PlaneNormal(Origin=dispatch.ListB, ZAxis=normal)
excluded_point_grid = Data(dispatch.ListA)
excluded_points_planes = Data(plane_normal_2)

# ---- group: Walls
outer_curve_2 = Data(outer_curve)
exclude_point_planes = Data(excluded_points_planes)
inner_curve_2 = Data(inner_curve)
curve_2 = Curve(inner_curve_2)
curve_3 = Curve(outer_curve_2)
curve_plane = CurvePlane(Curve=curve_2, Plane=exclude_point_planes)  # -> Points, flatten(ParamsC), ParamsP
curve_plane_2 = CurvePlane(Curve=curve_3, Plane=exclude_point_planes)  # -> Points, flatten(ParamsC), ParamsP
sort_list = SortList(Keys=curve_plane.ParamsC)  # -> Keys, ValuesA
sort_list_2 = SortList(Keys=curve_plane_2.ParamsC)  # -> Keys, ValuesValuesA
delete_consecutive = DeleteConsecutive(Set=sort_list.Keys, Wrap=False)  # -> Set, Count
delete_consecutive_2 = DeleteConsecutive(Set=sort_list_2.Keys, Wrap=False)  # -> Set, Count
list_item_2 = ListItem(List=delete_consecutive.Set, Index=0, Wrap=True)  # -> Item1, Item
list_item_3 = ListItem(List=delete_consecutive_2.Set, Index=0, Wrap=True)  # -> Item1, Item
shatter_2 = Shatter(Curve=curve_2, Parameters=[list_item_2.Item, list_item_2.Item1])
shatter_3 = Shatter(Curve=curve_3, Parameters=[list_item_3.Item, list_item_3.Item1])
distribution_height_3 = Data(distribution_height_2)
list_item_4 = ListItem(List=shatter_2, Index=1, Wrap=True)
unit_z = UnitZ(Factor=distribution_height_3)
list_item_5 = ListItem(List=shatter_3, Index=1, Wrap=True)
extrude = Extrude(Base=list_item_4, Direction=unit_z)
extrude_2 = Extrude(Base=list_item_5, Direction=unit_z)
extrusion = Data(extrude)
extrusion_2 = Data(extrude_2)

# ---- group: RH_OUT:Pointgrid
point_2 = Point(simplify(excluded_point_grid))

# ---- group: RH_OUT:Inner Wall
geometry = Geometry(simplify(extrusion))

# ---- group: RH_OUT:Outer Wall
geometry_2 = Geometry(simplify(extrusion_2))

# ---- group: Columns
excluded_point_grid_2 = Data(excluded_point_grid)
z_grid_size_3 = Data(z_grid_size_2)
distribution_height_4 = Data(distribution_height_2)
division_3 = Division(A=distribution_height_4, B=z_grid_size_3)
graft_tree = GraftTree(Tree=simplify(excluded_point_grid_2), IncludeEmptyLists=True, IncludeNullItems=True)
series = Series(Start=z_grid_size_3, Step=z_grid_size_3, Count=division_3)
clean_tree = CleanTree(RemoveNulls=False, RemoveInvalid=True, RemoveEmpty=True, Tree=graft_tree)
unit_z_2 = UnitZ(Factor=series)
move_2 = Move(Geometry=clean_tree, Motion=unit_z_2)  # -> Geometry, Transform
merge_2 = Merge(Data1=clean_tree, Data2=move_2.Geometry)
polyline = PolyLine(Vertices=merge_2, Closed=False)
column_polylines = Data(polyline)

# ----
pipe = Pipe(Curve=column_polylines, Radius=column_radius_2, Caps=1)

# ---- group: RH_OUT:Columns
geometry_3 = Geometry(simplify(pipe))

# ---- group: RH_OUT:Column Curves
curve_4 = Curve(column_polylines)

# ----
water_offset_3 = Slider(194, range=0..220)
xy_plane_2 = XYPlane(Origin=Point(0, 0, 0))
waterlevel = Slider(29, range=0..100)
existing_dike_height = Slider(22, range=0..100)
road_width = Slider(7, range=0..10)
curve_5 = Curve(offset_curve_2)
curve_6 = Curve(list_item)
negative_4 = Negative(Value=water_offset_3)
unit_z_3 = UnitZ(Factor=waterlevel)
unit_z_4 = UnitZ(Factor=existing_dike_height)
offset_curve_3 = OffsetCurve(Curve=curve_6, Distance=negative_4, Plane=xy_plane_2, Corners=1)
offset_curve_4 = OffsetCurve(Curve=curve_6, Distance=Slider(66, range=0..100), Plane=xy_plane_2, Corners=1)
negative_5 = Negative(Value=unit_z_3)
move_3 = Move(Geometry=offset_curve_3, Motion=negative_5)  # -> Geometry, Transform
move_4 = Move(Geometry=offset_curve_4, Motion=unit_z_4)  # -> Geometry, Transform
offset_curve_5 = OffsetCurve(Curve=move_4.Geometry, Distance=road_width, Plane=xy_plane_2, Corners=1)
end_points_3 = EndPoints(Curve=move_4.Geometry)  # -> Start, End
end_points_4 = EndPoints(Curve=offset_curve_5)  # -> Start, End
ruled_surface = RuledSurface(CurveA=curve_5, CurveB=curve_6)
ruled_surface_2 = RuledSurface(CurveA=curve_5, CurveB=move_3.Geometry)
ruled_surface_3 = RuledSurface(CurveA=curve_6, CurveB=move_4.Geometry)
line_3 = Line(StartPoint=end_points_3.End, EndPoint=end_points_4.End)
line_4 = Line(StartPoint=end_points_3.Start, EndPoint=end_points_4.Start)
join_curves_2 = JoinCurves(Curves=flatten([line_4, line_3, offset_curve_5, move_4.Geometry]), Preserve=False)
surface = Surface(join_curves_2)

# ---- group: Dimensions
curve_middle = CurveMiddle(Curve=curve_6)
curve_closest_point = CurveClosestPoint(Point=curve_middle, Curve=curve_5)  # -> Point, Parameter, Distance
curve_closest_point_2 = CurveClosestPoint(Point=curve_closest_point.Point, Curve=offset_curve_3)  # -> Point, Parameter, Distance
curve_closest_point_3 = CurveClosestPoint(Point=curve_middle, Curve=offset_curve_4)  # -> Point, Parameter, Distance
line_5 = Line(StartPoint=curve_closest_point.Point, EndPoint=curve_closest_point_2.Point)
line_6 = Line(StartPoint=curve_middle, EndPoint=curve_closest_point.Point)
line_7 = Line(StartPoint=curve_middle, EndPoint=curve_closest_point_3.Point)
linear_dimension = LinearDimension(Line=line_5, PointA=curve_closest_point.Point, PointB=curve_closest_point_2.Point, Text="{0:0.00}", Size=5)
linear_dimension_2 = LinearDimension(Line=line_6, PointA=curve_middle, PointB=curve_closest_point.Point, Text="{0:0.00}", Size=5)
linear_dimension_3 = LinearDimension(Line=line_7, PointA=curve_closest_point_3.Point, PointB=curve_middle, Text="{0:0.00}", Size=5)

# ---- group: RH_OUT:Dike
geometry_4 = Geometry([ruled_surface, ruled_surface_2, ruled_surface_3, surface])

# ----
custom_preview = CustomPreview(Geometry=geometry_4, Material=ColourSwatch(SwatchColor=RGBA(255, 255, 255, 60)))
