# Grasshopper definition main_structure.gh (Grasshopper 1.0.7)
# Copyright: Job de Vogel

facade_truss_y_width = Slider(8.1, range=0..10)
facade_truss_x_width = Slider(6.9, range=0..10)
truss_count_center = Slider(3, range=0..10)
truss_x_grid_distance = Slider(7.2, range=0..10)
truss_1_height = Slider(22, range=0..30)
truss_2_height = Slider(16, range=0..30)
truss_height = Slider(4.2, range=0..8.4)
truss_count_endings = Slider(2, range=0..10)
ground_floor_level_exception = GetInteger(AtLeast=0, AtMost=1, Maximum=2147483647, Minimum=-2147483648)
floor_outer_rectangles = GetGeometry(AtLeast=0, AtMost=2147483647, DeleteInput=False, Filter=1074004029)
core_outer_rectangles = GetGeometry(AtLeast=0, AtMost=2147483647, DeleteInput=False, Filter=1074004029)
core_inner_rectangles = GetGeometry(AtLeast=0, AtMost=2147483647, DeleteInput=False, Filter=1074004029)
facade_truss_x_width_2 = GetNumber(facade_truss_x_width, AtLeast=0, AtMost=1, Maximum=1.797693135e+308, Minimum=-1.797693135e+308)
facade_truss_y_width_2 = GetNumber(facade_truss_y_width, AtLeast=0, AtMost=1, Maximum=1.797693135e+308, Minimum=-1.797693135e+308)
truss_count_endings_2 = GetInteger(truss_count_endings, AtLeast=0, AtMost=1, Maximum=2147483647, Minimum=-2147483648)
truss_count_center_2 = GetInteger(truss_count_center, AtLeast=0, AtMost=1, Maximum=2147483647, Minimum=-2147483648)
core_split_level = GetNumber(AtLeast=0, AtMost=2147483647, Maximum=1.797693135e+308, Minimum=-1.797693135e+308)
truss_1_height_2 = GetInteger(truss_1_height, AtLeast=0, AtMost=1, Maximum=2147483647, Minimum=-2147483648)
truss_2_height_2 = GetInteger(truss_2_height, AtLeast=0, AtMost=1, Maximum=2147483647, Minimum=-2147483648)
truss_x_grid_distance_2 = GetNumber(truss_x_grid_distance, AtLeast=0, AtMost=1, Maximum=1.797693135e+308, Minimum=-1.797693135e+308)
floor_planes = GetGeometry(AtLeast=0, AtMost=2147483647, DeleteInput=False, Filter=1074004029)
truss_height_2 = GetNumber(truss_height, AtLeast=0, AtMost=1, Maximum=1.797693135e+308, Minimum=-1.797693135e+308)
outer_shell = GetGeometry(AtLeast=1, AtMost=1, DeleteInput=False, Filter=1074004029)
integer = Integer(ground_floor_level_exception)

# ---- group: Anyoing part of the script that should have been avoided...
curve = Curve(floor_outer_rectangles)
xy_plane = XYPlane(Origin=Point(0, 0, 0))
merge = Merge(Data1=xy_plane, Data2=floor_planes)  # -> flatten(Result)
split_list = SplitList(List=flatten(curve), Index=integer)  # -> flatten(ListA), ListB
split_list_2 = SplitList(List=merge, Index=integer)  # -> ListA, ListB
brep_plane = BrepPlane(Brep=outer_shell, Plane=split_list_2.ListB, UseTasks=False)  # -> simplify(Curves), Points
merge_2 = Merge(Data1=split_list.ListA, Data2=flatten(brep_plane.Curves))  # -> simplify(graft(Result))

# ---- group: Core Corners
split_list_3 = SplitList(List=flatten(core_outer_rectangles), Index=core_split_level)  # -> ListA, ListB
merge_3 = Merge(Data1=flatten(split_list_3.ListA), Data2=flatten(core_inner_rectangles))
deconstruct_brep = DeconstructBrep(Brep=merge_3)  # -> Faces, Edges, Vertices
shift_list = ShiftList(List=deconstruct_brep.Edges, Shift=1, Wrap=True)
end_points = EndPoints(Curve=deconstruct_brep.Edges)  # -> Start, End
plane_normal = PlaneNormal(Origin=end_points.Start, ZAxis=shift_list)  # -> simplify(Plane)
# README: If you need more control over the length of the facade trusses, just add some number sliders to the Data input. e.g. adding two sliders will give control over all sides individually.
curve_plane = CurvePlane(Curve=merge_2, Plane=plane_normal, UseTasks=False)  # -> simplify(Points), ParamsC, ParamsP
discontinuity = Discontinuity(Curve=merge_3, Level=1)  # -> simplify(Points), Parameters
trim_tree = TrimTree(Tree=curve_plane.Points, Depth=1)
closest_point = ClosestPoint(Point=trim_tree, Cloud=discontinuity.Points)  # -> ClosestPoint, CPIndex, Distance

# ---- group: Truss Height
number = Number(truss_height_2)

# ----
integer_2 = Integer(truss_1_height_2)
integer_3 = Integer(truss_2_height_2)

# ----
# TRUSS EXTENSION PARAMETERS
width_1 = Slider(6.9, range=0..10)
width_2 = Slider(6.9, range=0..10)
width_3 = Slider(6.9, range=0..10)
width_4 = Slider(6.9, range=0..10)
width_5 = Slider(6.9, range=0..10)
width_6 = Slider(6.9, range=0..10)
width_7 = Slider(6.9, range=0..10)
width_8 = Slider(6.9, range=0..10)

# ---- group: Truss X Grid Distance
number_2 = Number(truss_x_grid_distance_2)

# ---- group: Outriggers
line = Line(StartPoint=closest_point.ClosestPoint, EndPoint=trim_tree)  # -> simplify(Line)
unit_z = UnitZ(Factor=number)
tree_branch = TreeBranch(Tree=simplify(line), Path=[integer_2, integer_3], MaintainPaths=False)
negative = Negative(Value=unit_z)
move = Move(Geometry=tree_branch, Motion=negative)  # -> Geometry, Transform
end_points_2 = EndPoints(Curve=graft(tree_branch))  # -> Start, End
end_points_3 = EndPoints(Curve=graft(move.Geometry))  # -> Start, End
divide_distance = DivideDistance(Curve=tree_branch, Distance=number_2)  # -> Points, Tangents, Parameters
divide_distance_2 = DivideDistance(Curve=move.Geometry, Distance=number_2)  # -> Points, Tangents, Parameters
vector_2pt = Vector2Pt(PointA=end_points_3.Start, PointB=end_points_3.End, Unitize=False)  # -> Vector, Length
mesh_brep = MeshBrep(
    Brep=outer_shell,
    Settings={GridMaxCount=0, GridMinCount=16, JaggedSeams=False, MaxEdgeLength=0, MinEdgeLength=0.0001, MinTolerance=0, Refine=True, RefineAngle=0, RelativeTolerance=0.65, SimplePlanes=True, Tolerance=0})
merge_4 = Merge(Data1=divide_distance.Points, Data2=end_points_2.End)
mesh_ray = MeshRay(Mesh=mesh_brep, Point=end_points_3.Start, Direction=vector_2pt.Vector)  # -> Point, Hit
merge_5 = Merge(Data1=divide_distance_2.Points, Data2=mesh_ray.Point)
shift_list_2 = ShiftList(List=merge_4, Shift=1, Wrap=False)  # -> simplify(List)
shift_list_3 = ShiftList(List=merge_5, Shift=1, Wrap=False)  # -> simplify(List)
line_2 = Line(StartPoint=end_points_3.Start, EndPoint=mesh_ray.Point)
shortest_list = ShortestList(ListListA=merge_4, ListListB=shift_list_3, TrimMode=2)  # -> ListListA, ListListB
shortest_list_2 = ShortestList(ListListA=shift_list_2, ListListB=merge_5, TrimMode=2)  # -> ListListA, ListListB
line_3 = Line(StartPoint=shortest_list_2.ListListA, EndPoint=shortest_list_2.ListListB)
line_4 = Line(StartPoint=shortest_list.ListListA, EndPoint=shortest_list.ListListB)
line_5 = Line(StartPoint=merge_4, EndPoint=merge_5)

# ----
merge_6 = Merge(Data1=width_1, Data2=width_2, Data3=width_3, Data4=width_4)
merge_7 = Merge(Data1=width_5, Data2=width_6, Data3=width_7, Data4=width_8)
entwine = Entwine(Branch00=merge_6, Branch01=merge_7, FlattenInputs=True)  # -> simplify(Result)
number_3 = Number(entwine)

# ---- group: RH_OUT:Horizontal Top
curve_2 = Curve(graft(tree_branch))

# ---- group: RH_OUT:Diagonal 2
curve_3 = Curve(line_4)

# ---- group: RH_OUT:Diagonal 1
# {1;*} indicating outrigger level
# 
# Subbranch indicating truss
# 
# Item indicating element
curve_4 = Curve(line_3)

# ---- group: RH_OUT:Vertical
curve_5 = Curve(line_5)

# ---- group: RH_OUT:Horizontal Bottom
curve_6 = Curve(line_2)

# ---- group: Truss Count Center
integer_4 = Integer(truss_count_center_2)

# ---- group: Truss Count Endings
integer_5 = Integer(truss_count_endings_2)

# ----
tree_branch_2 = TreeBranch(Tree=simplify(merge_2), Path=[integer_2, integer_3], MaintainPaths=False)
trim_tree_2 = TrimTree(Tree=end_points_2.End, Depth=1)
curve_closest_point = CurveClosestPoint(Point=trim_tree_2, Curve=tree_branch_2)  # -> Point, Parameter, Distance
sort_list = SortList(Keys=curve_closest_point.Parameter, ValuesValuesA=curve_closest_point.Point)  # -> Keys, ValuesValuesA
dispatch = Dispatch(List=sort_list.ValuesValuesA, DispatchPattern=[True, False])  # -> ListA, ListB
line_6 = Line(StartPoint=dispatch.ListA, EndPoint=dispatch.ListB)
vector_2pt_2 = Vector2Pt(PointA=dispatch.ListA, PointB=dispatch.ListB, Unitize=False)  # -> Vector, Length
repeat_data = RepeatData(Data=[facade_truss_x_width_2, facade_truss_y_width_2], Length=8)
negative_2 = Negative(Value=vector_2pt_2.Vector)
partition_list = PartitionList(List=repeat_data, Size=4)
divide_curve = DivideCurve(Curve=line_6, Count=integer_4, Kinks=False)  # -> Points, Tangents, Parameters
shift_list_4 = ShiftList(List=divide_curve.Points, Shift=1, Wrap=False)  # -> simplify(List)

number_4 = Number(partition_list)

# ---- group: Facade Horizontal Bottom
curve_closest_point_2 = CurveClosestPoint(Point=trim_tree_2, Curve=tree_branch_2)  # -> Point, Parameter, Distance
trim_tree_3 = TrimTree(Tree=mesh_ray.Point, Depth=1)
sort_list_2 = SortList(Keys=curve_closest_point_2.Parameter, ValuesValuesA=trim_tree_3)  # -> Keys, ValuesValuesA
partition_list_2 = PartitionList(List=sort_list_2.ValuesValuesA, Size=2)
polyline = PolyLine(Vertices=partition_list_2, Closed=False)
end_points_4 = EndPoints(Curve=polyline)  # -> Start, End
vector_2pt_3 = Vector2Pt(PointA=end_points_4.Start, PointB=end_points_4.End, Unitize=False)  # -> Vector, Length
negative_3 = Negative(Value=vector_2pt_3.Vector)
amplitude = Amplitude(Vector=negative_3, Amplitude=graft(number_4))  # -> simplify(Vector)
amplitude_2 = Amplitude(Vector=vector_2pt_3.Vector, Amplitude=graft(number_4))  # -> simplify(Vector)
move_2 = Move(Geometry=end_points_4.Start, Motion=amplitude)  # -> Geometry, Transform
move_3 = Move(Geometry=end_points_4.End, Motion=amplitude_2)  # -> Geometry, Transform
line_7 = Line(StartPoint=end_points_4.Start, EndPoint=move_2.Geometry)
line_8 = Line(StartPoint=end_points_4.End, EndPoint=move_3.Geometry)
join_curves = JoinCurves(Curves=[polyline, line_7, line_8], Preserve=False)
merge_8 = Merge(Data1=graft(line_7), Data2=graft(line_8))

# ----
amplitude_3 = Amplitude(Vector=vector_2pt_2.Vector, Amplitude=number_4)
amplitude_4 = Amplitude(Vector=negative_2, Amplitude=number_4)
move_4 = Move(Geometry=dispatch.ListA, Motion=amplitude_4)  # -> Geometry, Transform
move_5 = Move(Geometry=dispatch.ListB, Motion=amplitude_3)  # -> Geometry, Transform
divide_curve_2 = DivideCurve(Curve=polyline, Count=integer_4, Kinks=False)  # -> Points, Tangents, Parameters
line_9 = Line(StartPoint=dispatch.ListA, EndPoint=move_4.Geometry)
line_10 = Line(StartPoint=dispatch.ListB, EndPoint=move_5.Geometry)
line_11 = Line(StartPoint=divide_curve.Points, EndPoint=divide_curve_2.Points)
shift_list_5 = ShiftList(List=divide_curve_2.Points, Shift=1, Wrap=False)  # -> simplify(List)
trim_tree_4 = TrimTree(Tree=line_11, Depth=1)
shortest_list_3 = ShortestList(ListListA=divide_curve.Points, ListListB=shift_list_5, TrimMode=2)  # -> ListListA, ListListB
shortest_list_4 = ShortestList(ListListA=shift_list_4, ListListB=divide_curve_2.Points, TrimMode=2)  # -> ListListA, ListListB
merge_9 = Merge(Data1=graft(line_9), Data2=graft(line_10))
merge_10 = Merge(Data1=graft(line_6), Data2=simplify(merge_9))
move_6 = Move(Geometry=merge_9, Motion=negative)  # -> Geometry, Transform
join_curves_2 = JoinCurves(Curves=merge_10, Preserve=False)
divide_curve_3 = DivideCurve(Curve=merge_9, Count=integer_5, Kinks=False)  # -> Points, Tangents, Parameters
divide_curve_4 = DivideCurve(Curve=merge_8, Count=integer_5, Kinks=False)  # -> Points, Tangents, Parameters
shift_list_6 = ShiftList(List=divide_curve_3.Points, Shift=1, Wrap=False)  # -> simplify(List)
shift_list_7 = ShiftList(List=divide_curve_4.Points, Shift=1, Wrap=False)  # -> simplify(List)
line_12 = Line(StartPoint=shortest_list_4.ListListA, EndPoint=shortest_list_4.ListListB)  # -> simplify(Line)
shortest_list_5 = ShortestList(ListListA=divide_curve_3.Points, ListListB=shift_list_7, TrimMode=2)  # -> ListListA, ListListB
line_13 = Line(StartPoint=shortest_list_3.ListListA, EndPoint=shortest_list_3.ListListB)
shortest_list_6 = ShortestList(ListListA=shift_list_6, ListListB=divide_curve_4.Points, TrimMode=2)  # -> ListListA, ListListB
line_14 = Line(StartPoint=shortest_list_6.ListListA, EndPoint=shortest_list_6.ListListB)
line_15 = Line(StartPoint=shortest_list_5.ListListA, EndPoint=shortest_list_5.ListListB)
line_16 = Line(StartPoint=divide_curve_3.Points, EndPoint=divide_curve_4.Points)  # -> simplify(Line)
trim_tree_5 = TrimTree(Tree=line_14, Depth=1)  # -> simplify(Tree)
trim_tree_6 = TrimTree(Tree=line_15, Depth=1)  # -> simplify(Tree)
trim_tree_7 = TrimTree(Tree=line_16, Depth=1)

# ---- group: RH_OUT:Facade Horizontal Bottom
curve_7 = Curve(join_curves)

# ---- group: RH_OUT:Facade Horizontal Top
# {1;*} indicating outrigger level
# 
# Subbranch indicating truss
# 
# Item indicating element
curve_8 = Curve(join_curves_2)

# ---- group: RH_OUT:Facade Vertical
curve_9 = Curve([trim_tree_7, trim_tree_4])

# ---- group: RH_OUT:Facade Diagonals
curve_10 = Curve([trim_tree_5, trim_tree_6, line_12, line_13])

# ---- group: Facade Columns
split_tree = SplitTree(Data=simplify(curve_8), Masks=flatten("{0;*}"))  # -> Positive, Negative
split_tree_2 = SplitTree(Data=curve_9, Masks=flatten("{0;*}"))  # -> Positive, Negative
end_points_5 = EndPoints(Curve=split_tree_2.Positive)  # -> Start, End
end_points_6 = EndPoints(Curve=split_tree_2.Negative)  # -> Start, End
curve_closest_point_3 = CurveClosestPoint(Point=end_points_5.End, Curve=split_tree.Negative)  # -> Point, Parameter, Distance
vector_2pt_4 = Vector2Pt(PointA=end_points_6.Start, PointB=end_points_6.End, Unitize=False)  # -> Vector, Length
xy_plane_2 = XYPlane(Origin=Point(0, 0, 0))
line_17 = Line(StartPoint=end_points_5.End, EndPoint=curve_closest_point_3.Point)
# Top columns organized by truss
project_point = ProjectPoint(Point=end_points_6.End, Direction=vector_2pt_4.Vector, Geometry=xy_plane_2)  # -> Point, Index
# Bottom columns organized by truss
line_18 = Line(StartPoint=end_points_6.End, EndPoint=project_point.Point)

# ---- group: RH_OUT:Top Facade Columns
curve_11 = Curve(line_17)

# ---- group: RH_OUT:Bottom Facade Columns
curve_12 = Curve(line_18)
