# Grasshopper definition main_towers.gh (Grasshopper 1.0.7)
# Copyright: Job de Vogel

shell_offset = Slider(1.8, range=0..10)
balcony_depth = Slider(0.6, range=0..10)

levels = Slider(37, range=0..40)
levels_per_level = Slider(1, range=0..10)
level_height = Slider(3.8, range=0..10)
grid_size = Slider(7.2, range=0..10)
core_x_distance = Slider(10, range=0..100)
core_y_distance = Slider(10, range=0..100)
core_x_size = Slider(15, range=0..100)
core_y_size = Slider(15, range=0..100)
balcony_type = BooleanToggle(False)

amount_of_base_floors = Slider(3, range=0..10)
start_grid_offset = Slider(0, range=0..1)
# STRUCTURAL PARAMETERS
core_corner = Slider(0, range=0..3)
x_size_small_core = Slider(9, range=0..15)
y_size_small_core = Slider(10, range=0..15)
core_split_level = Slider(20, range=0..30)
# DESIGN PARAMETERS
ground_floor_rectangle = GetGeometry(AtLeast=1, AtMost=1, DeleteInput=False, Filter=1073741828)
core_corner_2 = GetInteger(core_corner, AtLeast=1, AtMost=1, Maximum=3, Minimum=0)
x_size_small_core_2 = GetNumber(x_size_small_core, AtLeast=1, AtMost=1, Maximum=1.797693135e+308, Minimum=-1.797693135e+308)
y_size_small_core_2 = GetNumber(y_size_small_core, AtLeast=1, AtMost=1, Maximum=1.797693135e+308, Minimum=-1.797693135e+308)
core_split_level_2 = GetInteger(core_split_level, AtLeast=1, AtMost=1, Maximum=2147483647, Minimum=-2147483648)
shell_offset_2 = GetNumber(shell_offset, AtLeast=1, AtMost=1, Maximum=1.797693135e+308, Minimum=-1.797693135e+308)
balcony_depth_2 = GetNumber(balcony_depth, AtLeast=1, AtMost=1, Maximum=1.797693135e+308, Minimum=-1.797693135e+308)
levels_2 = GetNumber(levels, AtLeast=1, AtMost=1, Maximum=1.797693135e+308, Minimum=-1.797693135e+308)
levels_per_level_2 = GetNumber(levels_per_level, AtLeast=1, AtMost=1, Maximum=1.797693135e+308, Minimum=-1.797693135e+308)
amount_of_base_floors_2 = GetInteger(amount_of_base_floors, AtLeast=1, AtMost=1, Maximum=2147483647, Minimum=-2147483648)
level_height_2 = GetNumber(level_height, AtLeast=1, AtMost=1, Maximum=1.797693135e+308, Minimum=-1.797693135e+308)
grid_size_2 = GetNumber(grid_size, AtLeast=1, AtMost=1, Maximum=1.797693135e+308, Minimum=-1.797693135e+308)
start_grid_offset_2 = GetNumber(start_grid_offset, AtLeast=1, AtMost=1, Maximum=1.797693135e+308, Minimum=-1.797693135e+308)
core_x_distance_2 = GetNumber(core_x_distance, AtLeast=1, AtMost=1, Maximum=1.797693135e+308, Minimum=-1.797693135e+308)
core_y_distance_2 = GetNumber(core_y_distance, AtLeast=1, AtMost=1, Maximum=1.797693135e+308, Minimum=-1.797693135e+308)
core_x_size_2 = GetNumber(core_x_size, AtLeast=1, AtMost=1, Maximum=1.797693135e+308, Minimum=-1.797693135e+308)
core_y_size_2 = GetNumber(core_y_size, AtLeast=1, AtMost=1, Maximum=1.797693135e+308, Minimum=-1.797693135e+308)
balconies_bool = GetBoolean(balcony_type, AtLeast=1, AtMost=1, FalseValue="False", TrueValue="True")
# LARGE TOWER
curve = Curve(<curve referenced from the Rhino model>)

# ---- group: Move tower to origin
discontinuity = Discontinuity(Curve=curve, Level=1)  # -> Points, Parameters
list_item = ListItem(List=discontinuity.Points, Index=0, Wrap=True)  # -> Item, Item1
xy_plane = XYPlane(Origin=Point(0, 0, 0))
vector_2pt = Vector2Pt(PointA=xy_plane, PointB=list_item.Item, Unitize=False)  # -> Vector, Length
negative = Negative(Value=vector_2pt.Vector)
move = Move(Geometry=curve, Motion=negative)  # -> Geometry, Transform
discontinuity_2 = Discontinuity(Curve=move.Geometry, Level=1)  # -> Points, Parameters
list_item_2 = ListItem(List=discontinuity_2.Points, Index=0, Wrap=True)  # -> Item, Item1
vector_2pt_2 = Vector2Pt(PointA=list_item_2.Item, PointB=list_item_2.Item1, Unitize=False)  # -> Vector, Length
unit_x = UnitX(Factor=1)
unit_y = UnitY(Factor=1)
rotate_direction = RotateDirection(Geometry=move.Geometry, Center=Point(0, 0, 0), From=vector_2pt_2.Vector, To=unit_x)  # -> Geometry, Transform
discontinuity_3 = Discontinuity(Curve=rotate_direction.Geometry, Level=1)  # -> Points, Parameters
list_item_3 = ListItem(List=discontinuity_3.Points, Index=0, Wrap=True)
point = Point(list_item_3)
geometry = Geometry(rotate_direction.Geometry)

# ---- group: Core Rectangle
number = Number(core_y_distance_2)
number_2 = Number(core_x_distance_2)
number_3 = Number(core_x_size_2)
number_4 = Number(core_y_size_2)
unit_y_2 = UnitY(Factor=number)
unit_x_2 = UnitX(Factor=number_2)
rectangle = Rectangle(Plane=PlaneXY(0, 0, 0), XSize=number_3, YSize=number_4, Radius=0)  # -> Rectangle, Length
addition = Addition(A=unit_x_2, B=unit_y_2)
use_core_boolean_toggle = BooleanToggle(True)
move_2 = Move(Geometry=rectangle.Rectangle, Motion=addition)  # -> Geometry, Transform
use_core_boolean_toggle_2 = GetBoolean(use_core_boolean_toggle, AtLeast=1, AtMost=1, FalseValue="False", TrueValue="True")
stream_filter = StreamFilter(Gate=use_core_boolean_toggle_2, Stream1=move_2.Geometry)

# ----
number_5 = Number(level_height_2)

# ---- group: Rectangles
deconstuct_rectangle = DeconstuctRectangle(Rectangle=geometry)  # -> BasePlane, XInterval, YInterval
integer = Integer(levels_2)
number_6 = Number(balcony_depth_2)
integer_2 = Integer(levels_per_level_2)
deconstruct_domain = DeconstructDomain(Domain=deconstuct_rectangle.XInterval)  # -> Start, End
deconstruct_domain_2 = DeconstructDomain(Domain=deconstuct_rectangle.YInterval)  # -> Start, End
series = Series(Start=0, Step=number_6, Count=integer)
repeat_data = RepeatData(Data=integer_2, Length=integer)
absolute = Absolute(Value=deconstruct_domain.Start)
absolute_2 = Absolute(Value=deconstruct_domain_2.Start)
replace_items = ReplaceItems(List=repeat_data, Item=amount_of_base_floors_2, Indices="0", Wrap=False)
addition_2 = Addition(A=absolute, B=deconstruct_domain.End)
addition_3 = Addition(A=absolute_2, B=deconstruct_domain_2.End)
stack_data = StackData(Data=series, Stack=replace_items)
xy_plane_2 = XYPlane(Origin=point)
subtraction = Subtraction(A=addition_2, B=stack_data)
subtraction_2 = Subtraction(A=addition_3, B=stack_data)
rectangle_2 = Rectangle(Plane=xy_plane_2, XSize=subtraction, YSize=subtraction_2, Radius=0)  # -> Rectangle, Length
list_length = ListLength(List=rectangle_2.Rectangle)
series_2 = Series(Start=number_5, Step=number_5, Count=list_length)
unit_z = UnitZ(Factor=series_2)
move_3 = Move(Geometry=xy_plane_2, Motion=unit_z)  # -> Geometry, Transform
move_4 = Move(Geometry=rectangle_2.Rectangle, Motion=unit_z)  # -> Geometry, Transform
plane = Plane(move_3.Geometry)
curve_2 = Curve(move_4.Geometry)

# ---- group: Floor Plan Check
number_7 = Number(grid_size_2)
text = Text(addition_2)
text_2 = Text(addition_3)
number_8 = Number(text)
number_9 = Number(text_2)
modulus = Modulus(A=number_8, B=number_7)
modulus_2 = Modulus(A=number_9, B=number_7)
mass_addition = MassAddition(Input=[modulus_2, modulus])  # -> Result, PartialResults
larger_than = LargerThan(FirstNumber=mass_addition.Result, SecondNumber=0)  # -> LargerThan, OrEqualTo
stream_filter_2 = StreamFilter(
    Gate=larger_than.LargerThan,
    Stream0="Everything Okay",
    Stream1="WARNING: Ground Floor rectangle domain does not fit in grid size.")

# ---- group: OUT
out = Panel(stream_filter_2)

# ---- group: Walls
unit_z_2 = UnitZ(Factor=number_5)
negative_2 = Negative(Value=unit_z_2)
extrude = Extrude(Base=move_4.Geometry, Direction=negative_2)

# ---- group: Walls / RH_OUT:Inner Facade
geometry_2 = Geometry(extrude)

# ---- group: Cores / Core Corner
integer_3 = Integer(core_corner_2)

# ---- group: Point Grid
deconstuct_rectangle_2 = DeconstuctRectangle(Rectangle=curve_2)  # -> BasePlane, XInterval, YInterval
deconstruct_domain_3 = DeconstructDomain(Domain=deconstuct_rectangle_2.XInterval)  # -> Start, End
deconstruct_domain_4 = DeconstructDomain(Domain=deconstuct_rectangle_2.YInterval)  # -> Start, End
absolute_3 = Absolute(Value=deconstruct_domain_3.Start)
absolute_4 = Absolute(Value=deconstruct_domain_4.Start)
addition_4 = Addition(A=absolute_3, B=deconstruct_domain_3.End)
addition_5 = Addition(A=absolute_4, B=deconstruct_domain_4.End)
text_3 = Text(addition_4)
text_4 = Text(addition_5)
grid_size_3 = Number(number_7)
number_10 = Number(text_3)
number_11 = Number(text_4)
division = Division(A=number_10, B=grid_size_3)
division_2 = Division(A=number_11, B=grid_size_3)
round = Round(Number=division)  # -> Nearest, graft(Floor), Ceiling
round_2 = Round(Number=division_2)  # -> Nearest, graft(Floor), Ceiling
series_3 = Series(Start=start_grid_offset_2, Step=grid_size_3, Count=expr("x+1", round.Floor))
series_4 = Series(Start=start_grid_offset_2, Step=grid_size_3, Count=expr("x+1", round_2.Floor))
cross_reference = CrossReference(ListListA=series_3, ListListB=series_4, CrossMode=1)  # -> ListListA, ListListB
construct_point = ConstructPoint(XCoordinate=cross_reference.ListListA, YCoordinate=cross_reference.ListListB, ZCoordinate=0)  # -> simplify(Point)
move_5 = Move(Geometry=construct_point, Motion=graft(unit_z))  # -> simplify(Geometry), Transform

# ---- group: Shell
partition_list = PartitionList(List=curve_2, Size=replace_items)
number_12 = Number(shell_offset_2)
list_item_4 = ListItem(List=partition_list, Index=-1, Wrap=True)  # -> simplify(Item)
offset_curve = OffsetCurve(Curve=list_item_4, Distance=number_12, Corners=1)  # -> flatten(Curve)
loft = Loft(Curves=offset_curve, Options={Adjust=False, Closed=False, LoftEnds=0, LoftSimp=0, LoftType=0, Rebuild=10, Refit=0.01})

# ---- group: Cores / X Size Small Core
number_13 = Number(x_size_small_core_2)

# ---- group: Cores / Y Size Small Core
number_14 = Number(y_size_small_core_2)

# ---- group: Shell / RH_OUT:Outer Shell
geometry_3 = Geometry(simplify(loft))

# ----
integer_4 = Integer(core_split_level_2)

# ---- group: Balconies
mesh_brep = MeshBrep(
    Brep=loft,
    Settings={GridMaxCount=0, GridMinCount=16, JaggedSeams=False, MaxEdgeLength=0, MinEdgeLength=0.0001, MinTolerance=0, Refine=True, RefineAngle=0, RelativeTolerance=0.65, SimplePlanes=True, Tolerance=0})
number_15 = Number(balcony_depth_2)
mesh_plane = MeshPlane(Mesh=mesh_brep, Plane=curve_2, UseTasks=False)  # -> simplify(Curves)
offset_curve_2 = OffsetCurve(Curve=curve_2, Distance=flatten(number_15), Corners=1)
discontinuity_4 = Discontinuity(Curve=curve_2, Level=1)  # -> simplify(Points), Parameters
discontinuity_5 = Discontinuity(Curve=mesh_plane, Level=1)  # -> simplify(Points), Parameters
merge = Merge(Data1=graft(curve_2), Data2=offset_curve_2)
closest_point = ClosestPoint(Point=discontinuity_4.Points, Cloud=discontinuity_5.Points)  # -> ClosestPoint, CPIndex, Distance
loft_2 = Loft(Curves=merge, Options={Adjust=False, Closed=False, LoftEnds=0, LoftSimp=0, LoftType=0, Rebuild=10, Refit=0.01})
clean_tree = CleanTree(RemoveNulls=True, RemoveInvalid=True, RemoveEmpty=False, Tree=closest_point.ClosestPoint)
tree_statistics = TreeStatistics(Tree=clean_tree)  # -> Paths, Length, Count
larger_than_2 = LargerThan(FirstNumber=tree_statistics.Length, SecondNumber=0)  # -> LargerThan, OrEqualTo
cull_pattern = CullPattern(List=tree_statistics.Paths, CullPattern=larger_than_2.LargerThan)
tree_branch = TreeBranch(Tree=discontinuity_4.Points, Path=cull_pattern, MaintainPaths=True)
tree_branch_2 = TreeBranch(Tree=closest_point.ClosestPoint, Path=cull_pattern, MaintainPaths=True)
tree_branch_3 = TreeBranch(Tree=simplify(loft_2), Path=cull_pattern, MaintainPaths=True)  # -> flatten(Branch)
polyline = PolyLine(Vertices=tree_branch_2, Closed=True)
polyline_2 = PolyLine(Vertices=tree_branch, Closed=True)
loft_3 = Loft(
    Curves=[polyline, polyline_2],
    Options={Adjust=False, Closed=False, LoftEnds=0, LoftSimp=0, LoftType=0, Rebuild=10, Refit=0.01})
boolean = Boolean(balconies_bool)
stream_filter_3 = StreamFilter(Gate=boolean, Stream0=flatten(loft_3), Stream1=tree_branch_3)

# ---- group: RH_OUT:Ground Floor Level Exception
integer_5 = Integer(flatten(amount_of_base_floors_2))

# ---- group: RH_OUT:Floor Planes
plane_2 = Plane(flatten(plane))

# ---- group: RH_OUT:--- STRUCTURAL OUTPUTS ---
geometry_4 = Geometry()

# ----
level_height_3 = Number(number_5)

# ---- group: Balconies / RH_OUT:Balconies
geometry_5 = Geometry(simplify(stream_filter_3))

# ----
transform = Transform(flatten(move.Transform))
transform_2 = Transform(flatten(rotate_direction.Transform))

inverse_transform = InverseTransform(Transform=transform_2)
inverse_transform_2 = InverseTransform(Transform=transform)

compound = Compound(Transforms=[inverse_transform, inverse_transform_2])
transform_matrix = TransformMatrix(compound, Digits=3)
deconstruct_matrix = DeconstructMatrix(Matrix=transform_matrix)  # -> Rows, Columns, Values

# ---- group: RH_OUT:[4x4] Inversed Transform
number_16 = Number(deconstruct_matrix.Values)

# ----
multiplication = Multiplication(A=list_length, B=number_5)
curve_3 = Curve(stream_filter)
unit_z_3 = UnitZ(Factor=multiplication)
extrude_2 = Extrude(Base=curve_3, Direction=unit_z_3)
brep_plane = BrepPlane(Brep=extrude_2, Plane=plane, UseTasks=False)  # -> Curves, Points
cap_holes = CapHoles(Brep=extrude_2)
surface = Surface(curve_2)

# ---- group: Large Core rectangle outlines
merge_2 = Merge(Data1=move_2.Geometry, Data2=flatten(brep_plane.Curves))  # -> graft(Result)
curve_4 = Curve(merge_2)

# ---- group: Core base rectangle
curve_5 = Curve(curve_4)
discontinuity_6 = Discontinuity(Curve=curve_5, Level=1)  # -> Points, Parameters
list_item_5 = ListItem(List=flatten(curve_5), Index=0, Wrap=True)
sort_along_curve = SortAlongCurve(Points=discontinuity_6.Points, Curve=list_item_5)  # -> Points, Indices
polyline_3 = PolyLine(Vertices=sort_along_curve.Points, Closed=True)

# ---- group: RH_OUT:Core Outer Rectangles
geometry_6 = Geometry(flatten(polyline_3))

# ---- group: Point Grid Core Extraction
point_in_brep = PointInBrep(Brep=cap_holes, Point=move_5.Geometry, Strict=False)
cull_pattern_2 = CullPattern(List=move_5.Geometry, CullPattern=invert(point_in_brep))

# ---- group: Columns
unit_z_4 = UnitZ(Factor=1)
negative_3 = Negative(Value=unit_z_4)
line_sdl = LineSDL(Start=cull_pattern_2, Direction=negative_3, Length=level_height_3)  # -> flatten(Line)
join_curves = JoinCurves(Curves=line_sdl, Preserve=False)

# ---- group: Point Grid Core Extraction / RH_OUT:Points
point_2 = Point(simplify(cull_pattern_2))

# ---- group: Columns / RH_OUT:Columns
curve_6 = Curve(simplify(join_curves))

# ---- group: Cores
list_item_6 = ListItem(List=sort_along_curve.Points, Index=integer_3, Wrap=True)  # -> Item1, Item, Item1_2, Item2
vector_2pt_3 = Vector2Pt(PointA=list_item_6.Item, PointB=list_item_6.Item1, Unitize=False)  # -> Vector, Length
vector_2pt_4 = Vector2Pt(PointA=list_item_6.Item, PointB=list_item_6.Item1_2, Unitize=False)  # -> Vector, Length
xy_plane_3 = XYPlane(Origin=list_item_6.Item)
amplitude = Amplitude(Vector=vector_2pt_3.Vector, Amplitude=number_13)  # -> simplify(Vector)
amplitude_2 = Amplitude(Vector=vector_2pt_4.Vector, Amplitude=number_14)  # -> simplify(Vector)
move_6 = Move(Geometry=list_item_6.Item, Motion=amplitude_2)  # -> Geometry, Transform
move_7 = Move(Geometry=list_item_6.Item, Motion=amplitude)  # -> Geometry, Transform
rectangle_2pt = Rectangle2Pt(Plane=xy_plane_3, PointA=move_7.Geometry, PointB=move_6.Geometry, Radius=0)  # -> flatten(Rectangle), Length
merge_3 = Merge(
    Data1=move_7.Geometry,
    Data2=list_item_6.Item1,
    Data3=list_item_6.Item2,
    Data4=list_item_6.Item1_2,
    Data5=move_6.Geometry)
polyline_4 = PolyLine(Vertices=merge_3, Closed=False)  # -> flatten(Polyline)
split_list = SplitList(List=rectangle_2pt.Rectangle, Index=integer_4)  # -> ListA, ListB
split_list_2 = SplitList(List=polyline_4, Index=integer_4)  # -> ListA, ListB
curve_7 = Curve(rectangle_2pt.Rectangle)
curve_8 = Curve(split_list_2.ListA)
loft_4 = Loft(Curves=curve_7, Options={Adjust=False, Closed=False, LoftEnds=0, LoftSimp=0, LoftType=0, Rebuild=10, Refit=0.01})
loft_5 = Loft(Curves=curve_8, Options={Adjust=False, Closed=False, LoftEnds=0, LoftSimp=0, LoftType=0, Rebuild=10, Refit=0.01})

# ---- group: Cores / Small Core
geometry_7 = Geometry(loft_4)

# ---- group: Cores / Large Core
geometry_8 = Geometry(loft_5)

# ----
merge_4 = Merge(Data1=simplify(flatten(geometry)), Data2=flatten(move_4.Geometry))  # -> simplify(graft(Result))
curve_9 = Curve(split_list.ListB)
curve_10 = Curve(merge_4)

# ---- group: Cores (continued)
mesh_brep_2 = MeshBrep(
    Brep=geometry_7,
    Settings={GridMaxCount=0, GridMinCount=16, JaggedSeams=False, MaxEdgeLength=0, MinEdgeLength=0.0001, MinTolerance=0, Refine=True, RefineAngle=0, RelativeTolerance=0.65, SimplePlanes=True, Tolerance=0})
mesh_brep_3 = MeshBrep(
    Brep=geometry_8,
    Settings={GridMaxCount=0, GridMinCount=16, JaggedSeams=False, MaxEdgeLength=0, MinEdgeLength=0.0001, MinTolerance=0, Refine=True, RefineAngle=0, RelativeTolerance=0.65, SimplePlanes=True, Tolerance=0})
mesh_join = MeshJoin(Meshes=flatten([mesh_brep_2, mesh_brep_3]))

# ---- group: RH_OUT:Core Inner Rectangles
geometry_9 = Geometry(flatten(curve_9))

# ---- group: RH_OUT:Floor Outer Rectangles
geometry_10 = Geometry(flatten(curve_10))

# ---- group: RH_OUT:Core Mesh
mesh = Mesh(simplify(mesh_join))

# ---- group: Core Floorplan Outline
split_list_3 = SplitList(List=flatten(polyline_3), Index=integer_4)  # -> ListA, ListB

# ----
cull_index = CullIndex(List=split_list_3.ListA, Indices=0, Wrap=True)

# ---- group: Core Floorplan Outline (continued)
merge_5 = Merge(Data1=flatten(cull_index), Data2=flatten(split_list.ListB))

# ----
surface_split = SurfaceSplit(Surface=simplify(graft(surface)), Curves=simplify(graft(merge_5)))  # -> simplify(Fragments)

list_item_7 = ListItem(List=surface_split, Index=0, Wrap=True)

# ---- group: RH_OUT:Floor Surfaces
surface_2 = Surface(simplify(list_item_7))
