# Grasshopper definition rulesheet.gh (Grasshopper 1.0.7)
# Copyright: Job de Vogel
# plug-ins: Hops

# All Grasshopper scripts assume meters
# as unit input. Please change Rhino files
# to meters in RMB on Grid > meters.
# Good!
point = Point()

# ----
# If a script requires plugins, please inform
# in the description on Github.
# The profiler (Display > Canvas Widgets
# > Profiler) can be used to check the speed
# of your script. If you are using time
# costly functions, please disable when
# saved on OneDrive.
# Please turn on all autosave settings in the
# Grasshopper menu. If your script is too
# slow, make sure you always keep on
# "on object added event"
point_2 = Point()
point_3 = Point()
# Even worse!
point_4 = Point()

# ----
# Wires
# Hidden wires are only used in extreme
# scenarios. Please always indicate with
# corresponding group colors.
# Rhino settings
point_5 = Point()

# ---- group: Group Name
# GRASSHOPPER RULE SHEET
# Groups
# Grasshopper settings
# Good!
# Grasshopper scripts should always be
# reduced to the absolute minimum of
# components used. Smaller functions is
# better.
point_6 = Point()
point_7 = Point()
point_8 = Point()

# ----
point_9 = Point(point)
point_10 = Point()

# ----
# Bad!
point_11 = Point()
point_12 = Point()
point_13 = Point()

# ----
# Bad!
point_14 = Point(point_10)
point_15 = Point(point_5)
# Use contextual parameters and group
# naming for inputs and outputs for Hops
my_object = GetGeometry(AtLeast=1, AtMost=1, DeleteInput=False, Filter=1074004029)
# Clusters
cluster_input = ClusterInput()
# Clusters are ONLY used if nodes are
# absolutely bug free and no future use
# is required.
cluster_output = ClusterOutput()
# Hops
# The Hops component is used to read
# local or online Grasshopper files.
hops = Hops(
    CacheResultsInMemory=True,
    CacheSolveResults=True,
    RemoteDefinitionLocation="https://github.com/JobdeVogel/MEGA/raw/main/test.gh",
    RemoteSolveVersion=(0, 1, 0),
    ShowInput_Enabled=False,
    ShowInput_Path=False,
    SynchronousSolve=True)

# ---- group: RH_OUT: My script output
geometry = Geometry(my_object)

# ----
# Very bad!
number_slider = Slider(0, range=0..10)
# Comments
# My comment: USE COMMENTS TO GIVE INFORMATION ABOUT SCRIPT
# Use the following panel layout for
# comments. Always give a name to
# comments.
# Sliders
# Good!
cool_name = Slider(0, range=0..10)
