# Grasshopper definition test.gh (Grasshopper 1.0.7)
# Copyright: Job de Vogel

geometry = Geometry()
get_geometry = GetGeometry(geometry, AtLeast=1, AtMost=1, DeleteInput=False, Filter=1074004029)
get_number = GetNumber(Slider(0.3, range=0.1..1), AtLeast=1, AtMost=1, Maximum=1.797693135e+308, Minimum=-1.797693135e+308)
evaluate_curve = EvaluateCurve(Curve=reparameterize(get_geometry), Parameter=get_number)  # -> Point, Tangent, Angle

# ---- group: RH_OUT:YOOOOOO
point = Point(evaluate_curve.Point)
point_2 = Point(evaluate_curve.Point)
