# Grasshopper definition test3.gh (Grasshopper 1.0.7)
# Copyright: Job de Vogel

get_number = GetNumber(AtLeast=1, AtMost=1, Maximum=1.797693135e+308, Minimum=-1.797693135e+308)
get_geometry = GetGeometry(AtLeast=1, AtMost=1, DeleteInput=False, Filter=1074004029)
divide_curve = DivideCurve(Curve=get_geometry, Count=get_number, Kinks=False)  # -> Points, Tangents, Parameters
context_bake = ContextBake(Geometry=divide_curve.Points)
